# Grasshopper definition 01-ConduitLayout.gh (Grasshopper 0.9.76)
# plug-ins: ProvingGround.Conduit

genes = GenePool(Decimals=2, Maximum=100, Minimum=0, Value=[49.96, 49.89, 50.12, 50.23, 50])
genes_2 = GenePool(Decimals=2, Maximum=100, Minimum=0, Value=[28.42, 43.09, 54.31, 71.53, 84.14])
# 01 - Conduit Layout
# Version:  2017.4.7
# Company Info: Authored by Proving Ground
# 
# http://ProvingGround.io
# Copyright (c) 2017 Proving Ground LLC
# Layout Grid
bounds = GetViewportBoundaryDimensions(Refresh=True, Origin=Point(0, 0, 0), Scale=0.25, xDim=1983, yDim=1120)
# Elements
irreg_tiles = IrregularGridTiles(
    Boundary=bounds,
    RelativeColumnSizes=genes,
    RelativeRowSizes=genes_2,
    InteriorPadding=Slider(0.004, range=0..0.05),
    ExteriorPadding=Slider(0.003, range=0..0.05),
    PaddingAxis=0)

lng = ListLength(List=irreg_tiles)
range = Range(Domain=Domain(0, 1), Steps=expr("X-1", lng))
gradient = Gradient(
    LowerLimit=0,
    UpperLimit=1,
    Parameter=range,
    stops=[0: RGB(234, 38, 0), 0.25: RGB(234, 126, 0), 0.5: RGB(254, 244, 84), 0.75: RGB(173, 203, 249), 1: RGB(75, 107, 169)])
gradient_2 = Gradient(
    LowerLimit=0,
    UpperLimit=1,
    Parameter=range,
    stops=[0: RGB(243, 57, 0), 0.1: RGB(236, 27, 60), 0.2: RGB(210, 0, 118), 0.3: RGB(103, 0, 120), 0.4: RGB(39, 72, 161), 0.5: RGB(1, 192, 229), 0.6: RGB(18, 178, 90), 0.7: RGB(79, 186, 8), 0.8: RGB(220, 237, 32), 0.9: RGB(247, 159, 20), 1: RGB(243, 57, 0)])
series = Series(Start=0, Step=1, Count=lng)
explode = Explode(Curve=irreg_tiles, Recursive=True)  # -> Segments, Vertices
int = Integer(series)
hud_line = DrawLines(Lines=explode.Segments, ThicknessOverride=Slider(3, range=0..5), ColorOverride=graft(gradient), PixelDepth=1)
hud_text = DrawText(
    Boundary=graft(irreg_tiles),
    Text=graft(int),
    TextOrdering=1,
    TextDistribution=0,
    ColorOverride=graft(gradient_2),
    OrientVertically=False)

# ----
# Create HUD!
toggle = BooleanToggle(True)
hud = HeadsUpDisplayHUD(
    ShowHUD=toggle,
    DrawingObjects=flatten([hud_text, hud_line]),
    DrawingBoundary=bounds,
    ConduitStyleSheet="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")
