# Grasshopper definition 02-BasicPieChart.gh (Grasshopper 0.9.76)
# plug-ins: ProvingGround.Conduit

genes = GenePool(Decimals=2, Maximum=100, Minimum=0, Value=[30.02, 100])
genes_2 = GenePool(Decimals=2, Maximum=100, Minimum=0, Value=[52.45, 52.81, 51.98])
# 02 - Basic Pie Charts
# Version:  2017.4.7
# Company Info: Authored by Proving Ground
# 
# http://ProvingGround.io
# Copyright (c) 2017 Proving Ground LLC
# Layout Grid
bounds = GetViewportBoundaryDimensions(Refresh=True, Origin=Point(0, 0, 0), Scale=0.25, xDim=1448, yDim=880)
irreg_tiles = IrregularGridTiles(
    Boundary=bounds,
    RelativeColumnSizes=genes,
    RelativeRowSizes=genes_2,
    InteriorPadding=Slider(0.004, range=0..0.05),
    ExteriorPadding=Slider(0.003, range=0..0.05),
    PaddingAxis=0)
item = ListItem(List=irreg_tiles, Index="2", Wrap=True)
item_2 = ListItem(List=irreg_tiles, Index="4", Wrap=True)
item_3 = ListItem(List=irreg_tiles, Index="0", Wrap=True)

# ---- group: Reference Grid
# Draw Reference
explode = Explode(Curve=[item_3, item, item_2], Recursive=True)  # -> Segments, Vertices
swatch = ColourSwatch(SwatchColor=RGB(191, 191, 191))
# Pie Charts
int = Integer(["0", "2", "4"])
rec = Rectangle([item_3, item, item_2])
hud_line = DrawLines(Lines=explode.Segments, ThicknessOverride=Slider(1, range=0..5), ColorOverride=graft(swatch), PixelDepth=1)
hud_text = DrawText(
    Boundary=graft(rec),
    Text=graft(int),
    TextOrdering=1,
    TextDistribution=1,
    ColorOverride=graft(swatch),
    OrientVertically=False)

# ---- group: Pie Chart 02
random = Random(Range="1 to 20", Number=10, Seed=2)
pie_style = ConduitPieStyle(
    InnerRadius=Slider(0.721, range=0..1),
    OuterRadius=Slider(0.966, range=0..1),
    LabelRadius=Slider(0.788, range=0..1),
    LabelFontFace="Arial",
    RelativeLabelHeight=Slider(0.038, range=0..1),
    LabelColor=ColourSwatch(SwatchColor=RGB(0, 0, 0)))
int_2 = Integer(random)
hud_pie = DrawPieChart(BoundaryRectangle=item, Labels=int_2, DataValues=int_2, PieStyle=pie_style)

# ---- group: Pie Chart 03
series = Series(Start=1, Step=1, Count=20)
pie_style_2 = ConduitPieStyle(
    InnerRadius=Slider(0.485, range=0..1),
    OuterRadius=Slider(0.776, range=0..1),
    LabelRadius=Slider(0.879, range=0..1),
    LabelFontFace="Arial",
    RelativeLabelHeight=Slider(0.032, range=0..1),
    LabelColor=ColourSwatch(SwatchColor=RGB(255, 255, 255)))
palette = ConduitColorPalette(
    Seed=3,
    HueRange=Domain(-0.05, 0.05),
    SaturationRange=Domain(-0.15, 0.15),
    LuminanceRange=Domain(-0.1, 0.1),
    BaseColors=[ColourSwatch(SwatchColor=RGB(49, 111, 255)), ColourSwatch(SwatchColor=RGB(113, 245, 255)), ColourSwatch(SwatchColor=RGB(234, 245, 0))])
int_3 = Integer(series)
hud_pie_2 = DrawPieChart(BoundaryRectangle=item_2, Labels=int_3, DataValues=int_3, PieStyle=pie_style_2, ColorPalette=palette)

# ---- group: Pie Chart 01
series_2 = Series(Start=0, Step=1, Count=10)
pie_style_3 = ConduitPieStyle(
    InnerRadius=0,
    OuterRadius=Slider(0.67, range=0..1),
    LabelRadius=Slider(0.804, range=0..1),
    LabelFontFace="Arial",
    RelativeLabelHeight=Slider(0.057, range=0..1),
    LabelColor=ColourSwatch(SwatchColor=RGB(255, 255, 255)))
int_4 = Integer(series_2)
hud_pie_3 = DrawPieChart(BoundaryRectangle=item_3, Labels=int_4, DataValues=int_4, PieStyle=pie_style_3)

# ----
# Create HUD!
toggle = BooleanToggle(True)
hud = HeadsUpDisplayHUD(
    ShowHUD=toggle,
    DrawingObjects=flatten([hud_text, hud_line, hud_pie_3, hud_pie, hud_pie_2]),
    DrawingBoundary=bounds,
    ConduitStyleSheet="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")
