# Grasshopper definition 03-BasicBarChart.gh (Grasshopper 0.9.76)
# plug-ins: ProvingGround.Conduit

genes = GenePool(Decimals=2, Maximum=100, Minimum=0, Value=[61.22, 100])
genes_2 = GenePool(Decimals=2, Maximum=100, Minimum=0, Value=[52.45, 52.81, 87.98])
# 03 - Basic Bar Charts
# Version:  2017.4.7
# Company Info: Authored by Proving Ground
# 
# http://ProvingGround.io
# Copyright (c) 2017 Proving Ground LLC
# Layout Grid
bounds = GetViewportBoundaryDimensions(Refresh=True, Origin=Point(0, 0, 0), Scale=0.25, xDim=668, yDim=440)
irreg_tiles = IrregularGridTiles(
    Boundary=bounds,
    RelativeColumnSizes=genes,
    RelativeRowSizes=genes_2,
    InteriorPadding=Slider(0.018, range=0..0.05),
    ExteriorPadding=Slider(0.028, range=0..0.05),
    PaddingAxis=0)
item = ListItem(List=irreg_tiles, Index="2", Wrap=True)
item_2 = ListItem(List=irreg_tiles, Index="4", Wrap=True)
item_3 = ListItem(List=irreg_tiles, Index="0", Wrap=True)

# ---- group: Reference Grid
# Draw Reference
explode = Explode(Curve=[item_3, item, item_2], Recursive=True)  # -> Segments, Vertices
swatch = ColourSwatch(SwatchColor=RGB(191, 191, 191))
int = Integer(["0", "2", "4"])
rec = Rectangle([item_3, item, item_2])
hud_line = DrawLines(Lines=explode.Segments, ThicknessOverride=Slider(1, range=0..5), ColorOverride=graft(swatch), PixelDepth=1)
hud_text = DrawText(
    Boundary=graft(rec),
    Text=graft(int),
    TextOrdering=1,
    TextDistribution=1,
    ColorOverride=graft(swatch),
    OrientVertically=False)

# ----
# BarCharts
panel = Panel("1 to 20")
random = Random(Range=panel, Number=10, Seed=2)
lng = ListLength(List=random)
font = ConduitFont(
    Font="Arial",
    TextHeight=12,
    AdaptiveHeight=True,
    TextSpacing=1.15,
    Alignment=1,
    Bold=False,
    Italic=False,
    Color=ColourSwatch(SwatchColor=RGB(255, 255, 255)))
int_2 = Integer(random)
series = Series(Start=0, Step=1, Count=lng)
int_3 = Integer(series)
chart = ConduitChart(
    Bounds=item_3,
    Values=int_2,
    Categories=int_3,
    Title="Column Chart",
    CategoryTitle="Elements",
    ValueTitle="Totals",
    Range="0 to 25",
    Font=font)  # -> HUDDrawingObjects, ChartSettings

random_2 = Random(Range="1 to 20", Number=10, Seed=5)
random_3 = Random(Range="1 to 20", Number=10, Seed=6)
lng_2 = ListLength(List=random_2)
lng_3 = ListLength(List=random_3)
font_2 = ConduitFont(
    Font="Arial",
    TextHeight=12,
    AdaptiveHeight=True,
    TextSpacing=1.15,
    Alignment=1,
    Bold=False,
    Italic=False,
    Color=ColourSwatch(SwatchColor=RGB(255, 255, 255)))
int_4 = Integer(random_2)
int_5 = Integer(random_3)
series_2 = Series(Start=0, Step=1, Count=lng_2)
series_3 = Series(Start=0, Step=1, Count=lng_3)
int_6 = Integer(series_2)
int_7 = Integer(series_3)
panel_2 = Panel("""Group A
Group B""")
entwine = Entwine(Branch00=int_4, Branch01=int_5, FlattenInputs=True)
entwine_2 = Entwine(Branch00=int_6, Branch01=int_7, FlattenInputs=True)
chart_2 = ConduitChart(
    Bounds=item,
    Values=entwine,
    Categories=int_6,
    Periods=panel_2,
    Title="Clustered Column Chart",
    CategoryTitle="Elements",
    ValueTitle="Totals",
    Range="0 to 25",
    Font=font_2)  # -> HUDDrawingObjects, ChartSettings

random_4 = Random(Range="1 to 20", Number=10, Seed=3)
random_5 = Random(Range="1 to 20", Number=10, Seed=6)
lng_4 = ListLength(List=random_4)
font_3 = ConduitFont(
    Font="Arial",
    TextHeight=12,
    AdaptiveHeight=True,
    TextSpacing=1.15,
    Alignment=1,
    Bold=False,
    Italic=False,
    Color=ColourSwatch(SwatchColor=RGB(255, 255, 255)))
int_8 = Integer(random_4)
int_9 = Integer(random_5)
series_4 = Series(Start=0, Step=1, Count=lng_4)
entwine_3 = Entwine(Branch00=int_8, Branch01=int_9, FlattenInputs=True)
int_10 = Integer(series_4)
format = Format(Format="Group {0}", Culture=127, Data0=int_10)

flip = FlipMatrix(Data=entwine_3)

chart_3 = ConduitChart(
    Bounds=item_2,
    Values=flip,
    Periods=format,
    Title="Clustered Bar Chart",
    CategoryTitle="Elements",
    ValueTitle="Totals",
    Range="0 to 25",
    Font=font_3)  # -> HUDDrawingObjects, ChartSettings

# ----
# Create HUD!
toggle = BooleanToggle(True)
hud = HeadsUpDisplayHUD(
    ShowHUD=toggle,
    DrawingObjects=flatten([hud_text, hud_line, chart.HUDDrawingObjects, chart_2.HUDDrawingObjects, chart_3.HUDDrawingObjects]),
    DrawingBoundary=bounds,
    ConduitStyleSheet="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")
