# Grasshopper definition 04-ProjectGeometry.gh (Grasshopper 0.9.76)
# plug-ins: ProvingGround.Conduit, Human, LunchBox

# ----
# Parametric Panel Layout
# Version: 2017.4.7
# Company Info: Authored by Proving Ground
# 
# http://ProvingGround.io
# Copyright (c) 2017 Proving Ground LLC
# Create Geometry
A = Slider(2.642, range=0..10)
B = Slider(2.352, range=0..10)
number_slider = Slider(11, range=0..20)
number_slider_2 = Slider(10, range=0..20)
paraboloid = HyperbolicParaboloid(U=100, V=100, a=A, b=B, S=5, D1=Domain(-4, 4), D2=Domain(-4, 4))
tria = TriangularPanelsA(Surface=paraboloid, UDivisions=number_slider, VDivisions=number_slider_2)

multiplication = Multiplication(A=number_slider, B=2)
# Selection
multiplication_2 = Multiplication(A=number_slider_2, B=2)
subtraction = Subtraction(A=multiplication, B=1)
subtraction_2 = Subtraction(A=multiplication_2, B=1)
sqgrid = Square(Plane=PlaneXY(0, 0, 0), Size=Slider(7.647, range=0..40), ExtentX=subtraction, ExtentY=subtraction_2)  # -> Cells, flatten(Points)
# 2D Panel Layout
number_slider_3 = Slider(0.555, range=0..1)
bounds = GetViewportBoundaryDimensions(Refresh=True, Origin=Point(0, 0, 0), Scale=0.25, xDim=1482, yDim=880)
short = ShortestList(ListA=tria, ListB=sqgrid.Points, TrimMode=2)  # -> ListA, ListB
pln = Plane(tria)
orient = Orient(Geometry=tria, Source=pln, Target=short.ListB)  # -> Geometry, Transform
vert_tiles = VerticalTiles(
    Boundary=bounds,
    RelativeSizes=[number_slider_3, Slider(0.09, range=0..1)],
    Width=Slider(0.396, range=0..1),
    WidthPadding=Slider(0.038, range=0..1),
    HeightPadding=Slider(0.064, range=0..1))
item = ListItem(List=vert_tiles, Index=0, Wrap=True)  # -> Item, Item1
bbox = BoundingBox(Content=orient.Geometry, Plane=PlaneXY(0, 0, 0), UnionBox=True)  # -> Box, Box_2
drec = DeconstuctRectangle(Rectangle=item.Item)  # -> BasePlane, XInterval, YInterval
explode = Explode(Curve=item.Item, Recursive=True)  # -> Segments, Vertices
debox = DeconstructBox(Box=bbox.Box)  # -> Plane, X, Y, Z
dedomain = DeconstructDomain(Domain=drec.YInterval)  # -> Start, End
dedomain_2 = DeconstructDomain(Domain=debox.Y)  # -> Start, End
subtraction_3 = Subtraction(A=dedomain.End, B=dedomain.Start)
subtraction_4 = Subtraction(A=dedomain_2.End, B=dedomain_2.Start)
item_2 = ListItem(List=explode.Vertices, Index=0, Wrap=True)
division = Division(A=subtraction_3, B=subtraction_4)
pt = Point(Point(0, 0, 0))
scale = Scale(Geometry=orient.Geometry, Center=Point(0, 0, 0), Factor=division)  # -> Geometry, Transform
vec2pt = Vector2Pt(PointA=pt, PointB=item_2, Unitize=False)  # -> Vector, Length
move = Move(Geometry=scale.Geometry, Motion=vec2pt.Vector)  # -> Geometry, Transform

area = Area(Geometry=orient.Geometry)  # -> Area, Centroid
ma = MassAddition(Input=area.Area)  # -> Result, PartialResults
expression = Expression(x=ma.Result, Expression="Round(x, 3)")
lng = ListLength(List=orient.Geometry)
format = Format(Format="Number of Panels: {0}", Culture=127, Data0=lng)
format_2 = Format(Format="Panel Area: {0} sf", Culture=127, Data0=expression)
merge = Merge(Data1=format, Data2=format_2)
font = ConduitFont(
    Font="Arial",
    TextHeight=Slider(23, range=0..32),
    AdaptiveHeight=False,
    TextSpacing=1.15,
    Alignment=0,
    Bold=False,
    Italic=False,
    Color=ColourSwatch(SwatchColor=RGB(255, 255, 255)))
hud_text = DrawText(Boundary=item.Item1, Text=merge, TextOrdering=1, TextDistribution=0, OrientVertically=False, CustomFont=font)

wires = BrepWireframe(Brep=move.Geometry, Density=-1)
hud_line = DrawLines(
    Lines=wires,
    ThicknessOverride=Slider(2, range=0..5),
    ColorOverride=ColourSwatch(SwatchColor=RGB(181, 181, 181)),
    PixelDepth="2")

panel = Slider(0, range=0..200)
lng_2 = ListLength(List=tria)
wires_2 = BrepWireframe(Brep=tria, Density=-1)
item_3 = ListItem(List=tria, Index=panel, Wrap=True)
debrep = DeconstructBrep(Brep=tria)  # -> Faces, Edges, Vertices
series = Series(Start="1", Step=1, Count=lng_2)
format_3 = Format(Format="Panel-{0}", Culture=127, Data0=series)
item_4 = ListItem(List=format_3, Index=panel, Wrap=True)
swatch = ColourSwatch(SwatchColor=RGB(255, 0, 115))
swatch_2 = ColourSwatch(SwatchColor=RGB(255, 255, 255))
preview = CustomPreview(Geometry=wires_2, Shader=ColourSwatch(SwatchColor=RGB(255, 255, 255)))
preview_2 = CustomPreview(Geometry=debrep.Vertices, Shader=swatch)
preview_3 = CustomPreview(Geometry=item_3, Shader=swatch)
tag = TextTag3D(Location=item_3, Text=item_4, Size=Slider(0.48, range=0..1), Colour=swatch_2, Justification=7)

debrep_2 = DeconstructBrep(Brep=item_3)  # -> Faces, Edges, Vertices

previewlw = CustomPreviewLineweights(Geometry=debrep_2.Edges, Shader=swatch_2, Thickness=Slider(4, range=0..5), Absolute=False)

item_5 = ListItem(List=move.Geometry, Index=panel, Wrap=True)
wires_3 = BrepWireframe(Brep=item_5, Density=-1)
hud_line_2 = DrawLines(
    Lines=wires_3,
    ThicknessOverride=Slider(4, range=0..5),
    ColorOverride=ColourSwatch(SwatchColor=RGB(255, 0, 115)),
    PixelDepth=1)

# ----
# Geometry and Text
merge_2 = Merge(Data1=hud_line, Data2=hud_line_2, Data3=hud_text)

# ----
# Create HUD!
toggle = BooleanToggle(True)
hud = HeadsUpDisplayHUD(
    ShowHUD=toggle,
    DrawingObjects=flatten(merge_2),
    DrawingBoundary=bounds,
    ConduitStyleSheet="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")
