# Grasshopper definition TT_Toolbox_Platypus_GhToGh_pull.gh (Grasshopper 0.9.76)
# plug-ins: Platypus

# ----
# copyright: Thornton Tomasetti, Inc.
# Date: 11/30/2015
# Revision: 0
# GH: 0.9.0076
# Description: For release 1.7
# Pull Geometries from another Platypus user
# 1) Click on the button to open a Platypus website
button = Button()
launch_browser = LaunchBrowser(LaunchBrowser=button)

# ---- group: Session number
panel = Panel("347-553-679")

# ----
# 2) Copy and paste the session number you find on the upper right corner of the website
# Set the Boolean Toggle to true to connect to the Platypus server
toggle = BooleanToggle(True)
platypus = PlatypusConnection(Connect=toggle, Session=panel)

# ---- group: RH_Input
pt = Point(Point(0, 0, 0))

pt_2 = Point(Point(0, 0, 0))

# ---- group: Input
pt_3 = Point(Point(0, 0, 0))

pt_4 = Point(Point(0, 0, 0))

# ---- group: Operation
pt_5 = Point(Point(0, 0, 0))

pt_6 = Point(Point(0, 0, 0))

# ---- group: Output
pt_7 = Point(Point(0, 0, 0))

pt_8 = Point(Point(0, 0, 0))

# ---- group: Visualization
pt_9 = Point(Point(0, 0, 0))

pt_10 = Point(Point(0, 0, 0))

# ----
# 3) Pull geometries from another Grasshopper user who is in this same Platypus session
pullgh = PullGHGHGeometry(PlatypusKey=platypus)  # -> AuthorsNames, Points, Curves, Breps, Meshes

crv = Curve(pullgh.Curves)
brep = Brep(pullgh.Breps)
mesh = Mesh(pullgh.Meshes)
pt_11 = Point(pullgh.Points)
txt = Text(pullgh.AuthorsNames)

panel_2 = Panel(txt)
