# Grasshopper definition TT_Toolbox_Platypus_GhToGh_push.gh (Grasshopper 0.9.76)
# plug-ins: Platypus

# ----
# copyright: Thornton Tomasetti, Inc.
# Date: 11/30/2015
# Revision: 0
# GH: 0.9.0076
# Description: For release 1.7
# Push Geometries to another Platypus user
# 1) Click on the button to open a Platypus website
button = Button()
launch_browser = LaunchBrowser(LaunchBrowser=button)

# ---- group: Session number
panel = Panel("347-553-679")

# ----
# 2) Copy and paste the session number you find on the upper right corner of the website
# Set the Boolean Toggle to true to connect to the Platypus server
toggle = BooleanToggle(True)
platypus = PlatypusConnection(Connect=toggle, Session=panel)

pt = ConstructPoint(XCoordinate=0, YCoordinate=0, ZCoordinate=0)
pt_2 = ConstructPoint(XCoordinate=0, YCoordinate=0, ZCoordinate=Slider(25, range=0..100))
pt_3 = ConstructPoint(XCoordinate=0, YCoordinate=0, ZCoordinate=Slider(54, range=0..100))
circle = CircleCNR(Center=pt_2, Normal=Vector(0, 0, 1), Radius=Slider(6.8, range=0..10))
circle_2 = CircleCNR(Center=pt, Normal=Vector(0, 0, 1), Radius=Slider(3.6, range=0..10))
circle_3 = CircleCNR(Center=pt_3, Normal=Vector(0, 0, 1), Radius=Slider(4.3, range=0..10))

# ---- group: RH_Input
pt_4 = Point(Point(0, 0, 0))

pt_5 = Point(Point(0, 0, 0))

# ---- group: Input
pt_6 = Point(Point(0, 0, 0))

pt_7 = Point(Point(0, 0, 0))

# ---- group: Operation
pt_8 = Point(Point(0, 0, 0))

pt_9 = Point(Point(0, 0, 0))

# ----
crv = Curve(circle)
crv_2 = Curve(circle_3)
crv_3 = Curve(circle_2)

# ---- group: Output
pt_10 = Point(Point(0, 0, 0))

pt_11 = Point(Point(0, 0, 0))

# ---- group: Visualization
pt_12 = Point(Point(0, 0, 0))

pt_13 = Point(Point(0, 0, 0))

# ---- group: Meshed surface
merge = Merge(Data1=crv_3, Data2=crv, Data3=crv_2)
loft = Loft(Curves=merge, Options={Adjust=False, Closed=False, LoftEnds=0, LoftSimp=0, LoftType=0, Rebuild=10, Refit=0.01})
mesh_uv = MeshSurface(Surface=loft, UCount=Slider(25, range=0..100), VCount=Slider(29, range=0..100), Overhang=True, Equalize=False)

# ---- group: GH Output Mesh
mesh = Mesh(mesh_uv)

# ----
# 3) Push geometries to another Grasshopper user who is in the same Platypus session
pushgh = PushGHGHGeometry(PlatypusKey=platypus, Geometry=mesh)
