# Grasshopper definition TT_Toolbox_Platypus_StreamGeometrySliders.gh (Grasshopper 0.9.76)
# plug-ins: Platypus

# ----
# copyright: Thornton Tomasetti, Inc.
# Date: 11/30/2015
# Revision: 0
# GH: 0.9.0076
# Description: For release 1.7
# Stream Geometry and Sliders to the Platypus server
# 1) Click on the button to open a Platypus website
button = Button()
launch_browser = LaunchBrowser(LaunchBrowser=button)

# ---- group: Session number
# 3) Stream geometries and sliders
panel = Panel("364-890-756")

# ----
# 2) Copy and paste the session number you find on the upper right corner of the website
# Set the Boolean Toggle to true to connect to the Platypus server
toggle = BooleanToggle(False)
platypus = PlatypusConnection(Connect=toggle, Session=panel)

pt = ConstructPoint(XCoordinate=0, YCoordinate=0, ZCoordinate=0)
pt_2 = ConstructPoint(XCoordinate=0, YCoordinate=0, ZCoordinate=Slider(25, range=0..100))
pt_3 = ConstructPoint(XCoordinate=0, YCoordinate=0, ZCoordinate=Slider(54, range=0..100))
circle = CircleCNR(Center=pt_2, Normal=Vector(0, 0, 1), Radius=Slider(6.8, range=0..10))
circle_2 = CircleCNR(Center=pt, Normal=Vector(0, 0, 1), Radius=Slider(5, range=0..10))
circle_3 = CircleCNR(Center=pt_3, Normal=Vector(0, 0, 1), Radius=Slider(4.3, range=0..10))

# ---- group: RH_Input
pt_4 = Point(Point(0, 0, 0))

pt_5 = Point(Point(0, 0, 0))

# ---- group: Input
pt_6 = Point(Point(0, 0, 0))

pt_7 = Point(Point(0, 0, 0))

# ---- group: Operation
pt_8 = Point(Point(0, 0, 0))

pt_9 = Point(Point(0, 0, 0))

# ----
number_slider = Slider(76, range=0..100)
number_slider_2 = Slider(64, range=0..100)
crv = Curve(circle)
crv_2 = Curve(circle_3)
crv_3 = Curve(circle_2)

# ---- group: Output
pt_10 = Point(Point(0, 0, 0))

pt_11 = Point(Point(0, 0, 0))

# ---- group: Visualization
pt_12 = Point(Point(0, 0, 0))

pt_13 = Point(Point(0, 0, 0))

# ---- group: Meshed surface
merge = Merge(Data1=crv_3, Data2=crv, Data3=crv_2)
loft = Loft(Curves=merge, Options={Adjust=False, Closed=False, LoftEnds=0, LoftSimp=0, LoftType=0, Rebuild=10, Refit=0.01})
mesh_uv = MeshSurface(Surface=loft, UCount=number_slider_2, VCount=number_slider, Overhang=True, Equalize=False)

# ---- group: GH Output Mesh
mesh = Mesh(mesh_uv)

# ---- group: Mullion lines
medges = MeshEdges(Mesh=mesh)  # -> NakedEdges, InteriorEdges, NonManifoldEdges
line = Line([medges.NakedEdges, medges.InteriorEdges])

# ----
swatch = ColourSwatch(SwatchColor=RGB(0, 98, 255))

# ---- group: Stream lines
streamlines = StreamLines(PlatypusKey=platypus, Lines=line, Colors=ColourSwatch(SwatchColor=RGB(255, 0, 0)))

# ---- group: Stream sliders
streamsliders = StreamSliders(PlatypusKey=platypus, NumberSliders=[number_slider_2, number_slider])

# ---- group: Stream meshes
streammeshes = StreamMeshes(PlatypusKey=platypus, Meshes=mesh, Colors=swatch, EdgeColors=swatch, Transparency=Slider(0.5, range=0..1), Shiny=False)
