# Grasshopper definition TT_Toolbox_Sample_release1.7.gh (Grasshopper 0.9.76)
# plug-ins: CORE.GH
# TT Toolbox Sample File

# ----
# RemoveDuplicatePoints
list_of_pts = Panel("""1,0,0
1,5,0
1,10,0
1,10,0
1,15,0
1,0,0
1,5,0""")  # disabled
cullduppoints = RemoveDuplicatePoints(InputPoints=list_of_pts, Tolerance=0.001)  # -> OutputPoints, FirstPointIndexes; disabled

list_of_pts_a = Panel("""1,0,0
1,5,0
1,10,0
1,10,0
1,15,0
1,20,0
1,25,0""")  # disabled
list_of_pts_b = Panel("""10,0,0
10,5,0
10,10,0
10,10,0
10,15,0
10,20,0
10,25,0""")  # disabled

plane = PlaneSrf(Plane=PlaneXY(0, 0, 0), XSize=Domain(-10, 10), YSize=Domain(-10, 10))  # disabled
divide = DivideDomain²(Domain=plane, UCount=3, VCount=3)  # disabled
subsrf = Isotrim(Surface=plane, Domain=divide)  # disabled
pan = Panel("1")  # disabled
sdivide = DivideSurface(Surface=subsrf, UCount=pan, VCount=pan)  # -> Points, Normals, Parameters; disabled
lng = ListLength(List=flatten(sdivide.Points))  # disabled
panel = Panel(sdivide.Points)  # disabled
viewer = ParamViewer(sdivide.Points)  # disabled
random = Random(Range=Domain(0, 1), Number=lng, Seed=2)  # disabled

number_slider = Slider(5, range=1..10)  # disabled
number_slider_2 = Slider(3, range=1..10)  # disabled
number_slider_3 = Slider(4, range=0..10)  # disabled
number_slider_4 = Slider(5, range=1..10)  # disabled
number_slider_5 = Slider(6, range=1..10)  # disabled
number_slider_6 = Slider(0, range=0..10)  # disabled
number_slider_7 = Slider(3, range=1..10)  # disabled
number_slider_8 = Slider(4, range=1..10)  # disabled
number_slider_9 = Slider(0, range=0..10)  # disabled
panel_2 = Panel("-1")  # disabled
panel_3 = Panel("-1")  # disabled
panel_4 = Panel("-1")  # disabled
number_slider_10 = Slider(5.19, range=0..10)  # disabled
rec = Rectangle({Plane=PlaneXZ(4, 0, 0), Size=Domain2(u=0..2, v=0..1)})  # disabled
multiplication = Multiplication(A=number_slider_2, B=panel_4)  # disabled
multiplication_2 = Multiplication(A=number_slider_5, B=panel_3)  # disabled
multiplication_3 = Multiplication(A=number_slider_8, B=panel_2)  # disabled
boxrec = BoxRectangle(Rectangle=rec, Height=number_slider_10)  # disabled
pt = ConstructPoint(XCoordinate=number_slider, YCoordinate=multiplication, ZCoordinate=number_slider_3)  # disabled
pt_2 = ConstructPoint(XCoordinate=number_slider_4, YCoordinate=multiplication_2, ZCoordinate=number_slider_6)  # disabled
pt_3 = ConstructPoint(XCoordinate=number_slider_7, YCoordinate=multiplication_3, ZCoordinate=number_slider_9)  # disabled

crv = Curve([<curve referenced from the Rhino model> x6])  # disabled
crv_2 = Curve(<curve referenced from the Rhino model>)  # disabled
slider = Slider(0.188, range=0..1)  # disabled
flip = FlipCurve(Curve=crv_2)  # -> Curve, Flag; disabled

# ----
# TreeBranch
cell_size = Slider(3, range=0..10)  # disabled
cells = Slider(3, range=0..10)  # disabled
height = Slider(50, range=0..100)  # disabled
levels = Slider(8, range=0..10)  # disabled
pt_4 = ConstructPoint(XCoordinate=0, YCoordinate=0, ZCoordinate=0)  # disabled
Z = UnitZ(Factor=1)  # disabled
sqgrid = Square(Plane=PlaneXY(0, 0, 0), Size=cell_size, ExtentX=cells, ExtentY=cells)  # -> Cells, flatten(Points); disabled
line = LineSDL(Start=pt_4, Direction=Z, Length=height)  # disabled
divide_2 = DivideCurve(Curve=line, Number=levels, Kinks=False)  # -> Points, Tangents, Parameters; disabled
xy = XYPlane(Origin=divide_2.Points)  # disabled
project = Project(Geometry=sqgrid.Points, Plane=graft(xy))  # -> Geometry, Transform; disabled

# ----
# GetGeometryAttributes
crv_3 = Curve([<curve referenced from the Rhino model> x4])  # disabled
geoattrib = GetGeometryAttributes(Geometry=crv_3)  # -> GeometryNames, GUID, Layer; disabled

# ----
# TreeItem
cell_size_2 = Slider(3, range=0..10)  # disabled
cells_2 = Slider(3, range=0..10)  # disabled
height_2 = Slider(50, range=0..100)  # disabled
levels_2 = Slider(8, range=0..10)  # disabled
pt_5 = ConstructPoint(XCoordinate=0, YCoordinate=0, ZCoordinate=0)  # disabled
Z_2 = UnitZ(Factor=1)  # disabled
sqgrid_2 = Square(Plane=PlaneXY(0, 0, 0), Size=cell_size_2, ExtentX=cells_2, ExtentY=cells_2)  # -> Cells, flatten(Points); disabled
line_2 = LineSDL(Start=pt_5, Direction=Z_2, Length=height_2)  # disabled
divide_3 = DivideCurve(Curve=line_2, Number=levels_2, Kinks=False)  # -> Points, Tangents, Parameters; disabled
xy_2 = XYPlane(Origin=divide_3.Points)  # disabled
project_2 = Project(Geometry=sqgrid_2.Points, Plane=graft(xy_2))  # -> Geometry, Transform; disabled

# ----
# copyright: Thornton Tomasetti, Inc.
# Date: 11/20/2015
# Revision: 0
# GH: 0.9.0076
# Description: For release 1.7
# TTSweep
# A) Right Click Component to set Inputs
# To get a mesh as the output, set this Boolean to True
is_mesh = BooleanToggle(True)  # disabled
degrees = Slider(90, range=0..180)  # disabled
crv_4 = Curve(<curve referenced from the Rhino model>)  # disabled
ttsweep = TTSweep(
    OutputMesh=is_mesh,
    BeamRail=crv_4,
    Justification=-1,
    Rotation=degrees,
    JustificationIndex=4,
    SectionNameIndex=191,
    ShapeTypeIndex=0,
    UnitTypeIndex=0)  # -> BrepsOrMeshes, SectionProfiles; disabled

# ---- group: Rhino Surface
srf = Surface(reparameterize(<surface referenced from the Rhino model>))  # disabled

# ---- group: X&Y inputs : GENOMES
slider_2 = Slider(0.792, range=0..1)  # disabled
slider_3 = Slider(0.705, range=0..1)  # disabled

# ----
# Read Iterations from Excel and Visualize
toggle = BooleanToggle(True)  # disabled
readxl = ReadExcelSheet(Run=toggle, Worksheet="1")  # -> UserMessages, Columns, Rows; disabled

# ----
# MatchTreeStructure
slider_4 = Slider(1, range=0..6)  # disabled
slider_5 = Slider(1, range=0..1)  # disabled
panel_5 = Panel("m")  # disabled
panel_6 = Panel("ft")  # disabled

# ----
# SharedNodes
panel_7 = Panel("20")  # disabled
pop3d = Populate3D(Region={Plane=PlaneXY(0, 0, 0), X=Domain(0, 10), Y=Domain(0, 10), Z=Domain(0, 2)}, Count=panel_7, Seed=1)  # disabled
con = DelaunayEdges(Points=pop3d, Plane=PlaneXY(0, 0, 0))  # -> Connectivity, Edges; disabled
crv_5 = Curve(con.Edges)  # disabled

panel_8 = Panel("20")  # disabled
pop3d_2 = Populate3D(Region={Plane=PlaneXY(0, 0, 0), X=Domain(0, 10), Y=Domain(0, 10), Z=Domain(0, 2)}, Count=panel_8, Seed=1)  # disabled
panel_9 = Panel("""1
1
0""")  # disabled
cull = CullPattern(List=pop3d_2, CullPattern=panel_9)  # disabled
item = ListItem(List=pop3d_2, Index=0, Wrap=True)  # disabled
con_2 = DelaunayEdges(Points=cull, Plane=PlaneXY(0, 0, 0))  # -> Connectivity, Edges; disabled
crv_6 = Curve(con_2.Edges)  # disabled
pt_6 = Point(item)  # disabled

# ----
# RemoveDuplicateLines
ln = Line(StartPoint=list_of_pts_a, EndPoint=list_of_pts_b)  # disabled
cullduplines = RemoveDuplicateLines(InputLines=ln, Tolerance=0.001)  # -> OutputLines, FirstLineIndexes; disabled

panel_10 = Panel(cullduppoints.OutputPoints)  # disabled
panel_11 = Panel(cullduppoints.FirstPointIndexes)  # disabled

# ----
# SortCurvesAlongCurves
# Original
# Sorted
sortc = SortCurvesAlongCrv(Curves=crv, GuideCrv=reparameterize(crv_2), CrvParam=slider)  # -> SortedCurves, CurveIndex; disabled
eval = EvaluateCurve(Curve=reparameterize(crv), Parameter=0.5)  # -> Point, Tangent, Angle; disabled
slider_6 = Slider(2.32, range=0..10)  # disabled
eval_2 = EvaluateCurve(Curve=sortc.SortedCurves, Parameter=0.5)  # -> Point, Tangent, Angle; disabled
panel_12 = Panel(sortc.CurveIndex)  # disabled
points = PointList(Points=eval.Point, Tags=True, Lines=True, Size=expr("x/2", slider_6))  # disabled
points_2 = PointList(Points=eval_2.Point, Tags=True, Lines=True, Size=slider_6)  # disabled

pt_7 = ConstructPoint(XCoordinate=slider_2, YCoordinate=slider_3, ZCoordinate=0)  # disabled
eval_3 = EvaluateSurface(Surface=srf, Point=pt_7)  # -> Point, Normal, Frame; disabled
pt_8 = Point(eval_3.Point)  # disabled
pdecon = Deconstruct(Point=pt_8)  # -> XComponent, YComponent, ZComponent; disabled

# ----
# UnitConverter
uc = UnitConverter(TargetUnit=panel_5, SourceUnit=panel_6, Factor=slider_5, Exponent=slider_4)  # -> RHUnit, Value; disabled

panel_13 = Panel("2")  # disabled
panel_14 = Panel("1")  # disabled
panel_15 = Panel("0")  # disabled
item_2 = ListItem(List=readxl.Rows, Index=panel_15, Wrap=True)  # disabled
item_3 = ListItem(List=readxl.Rows, Index=panel_13, Wrap=True)  # disabled
item_4 = ListItem(List=readxl.Rows, Index=panel_14, Wrap=True)  # disabled

panel_16 = Panel(geoattrib.GUID)  # disabled
panel_17 = Panel(geoattrib.GeometryNames)  # disabled
panel_18 = Panel(geoattrib.Layer)  # disabled

# ---- group: RH_Input
pt_9 = Point(Point(0, 0, 0))

pt_10 = Point(Point(0, 0, 0))

# ----
# Specify an integer, not an actual branch
# path to select a branch and item.
branch = Slider(5, range=0..10)  # disabled
item_5 = Slider(0, range=0..25)  # disabled

# ----
# Specify an integer, not an actual branch
# path to select a branch.
slider_7 = Slider(0, range=0..10)  # disabled

# ----
# A) No Points Specified
nodeconn = SharedNodes(Curves=flatten(crv_5))  # -> GroupedCurves, CommonPoints; disabled

panel_19 = Panel(cullduplines.OutputLines)  # disabled
panel_20 = Panel(cullduplines.FirstLineIndexes)  # disabled

# ----
# Run Galapagos, Collect iterations, Write to Excel
reset = BooleanToggle(False)  # disabled
merge = Merge(Data1=slider_2, Data2=slider_3)  # disabled
galaplist = GalapagosListener(Genomes=merge, Fitness=pdecon.ZComponent, Reset=reset)  # -> Fitness, Iterations; disabled
galapagos = Galapagos(fitness=pdecon, gene=[slider_2, slider_3])

crv_7 = Curve(ttsweep.SectionProfiles)  # disabled
mesh = Mesh(ttsweep.BrepsOrMeshes)  # disabled
panel_21 = Panel(mesh)  # disabled
panel_22 = Panel(crv_7)  # disabled

panel_23 = Panel(uc.RHUnit)  # disabled
panel_24 = Panel(uc.Value)  # disabled

# ---- group: Input
pt_11 = Point(Point(0, 0, 0))

pt_12 = Point(Point(0, 0, 0))

# ----
# B) Points Specified
nodeconn_2 = SharedNodes(Curves=flatten(crv_6), Points=flatten(pt_6))  # -> GroupedCurves, CommonPoints; disabled

bnd = Bounds(Numbers=flatten(item_2))  # disabled
pt_13 = ConstructPoint(XCoordinate=item_4, YCoordinate=item_3, ZCoordinate=0)  # disabled
gradient = Gradient(LowerLimit=0, UpperLimit=bnd, Parameter=item_2, stops=[0: RGB(0, 128, 0), 0.5: RGB(255, 255, 0), 1: RGB(255, 0, 0)])  # disabled
eval_4 = EvaluateSurface(Surface=srf, Point=pt_13)  # -> Point, Normal, Frame; disabled
preview = CustomPreview(Geometry=eval_4.Point, Shader=gradient)  # disabled

branch_2 = Slider(0, range=0..15)  # disabled
branch_3 = TreeBranch(Tree=nodeconn.CommonPoints, Path=branch_2, MaintainPaths=True)  # disabled
branch_4 = TreeBranch(Tree=nodeconn.GroupedCurves, Path=branch_2, MaintainPaths=True)  # disabled
swatch = ColourSwatch(SwatchColor=RGB(8, 253, 255))  # disabled
sph = Sphere(Base=branch_3, Radius=0.2)  # disabled
preview_2 = CustomPreview(Geometry=[sph, branch_4], Shader=swatch)  # disabled

# ---- group: Operation
pt_14 = Point(Point(0, 0, 0))

pt_15 = Point(Point(0, 0, 0))

# ----
viewer_2 = ParamViewer(random)  # disabled
panel_25 = Panel(random)  # disabled
match = MatchTreeStructure(DataList=flatten(random), TreeMask=sdivide.Points)  # disabled
match_2 = MatchTree(Tree=random, Guide=sdivide.Points)  # disabled

xz = XZPlane(Origin=Point(0, 0, 0))  # disabled
crv_8 = Curve([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])  # disabled
brep = Brep(boxrec)  # disabled
brep_cp = BrepClosestPoint(Point=[pt, pt_2, pt_3], Brep=brep)  # -> Point, Distance; disabled

branch_5 = Slider(0, range=0..15)  # disabled
tbi = TreeBranchIndex(DataTree=nodeconn_2.GroupedCurves, BranchIndex=branch_5)  # disabled
tbi_2 = TreeBranchIndex(DataTree=nodeconn_2.CommonPoints, BranchIndex=branch_5)  # disabled
swatch_2 = ColourSwatch(SwatchColor=RGB(8, 253, 255))  # disabled
preview_3 = CustomPreview(Geometry=[tbi, tbi_2], Shader=swatch_2)  # disabled

# ---- group: Output
pt_16 = Point(Point(0, 0, 0))

pt_17 = Point(Point(0, 0, 0))

# ----
panel_26 = Panel(project.Geometry)  # disabled
viewer_3 = ParamViewer(project.Geometry)  # disabled
tbi_3 = TreeBranchIndex(DataTree=project.Geometry, BranchIndex=slider_7)  # disabled

panel_27 = Panel(project_2.Geometry)  # disabled
viewer_4 = ParamViewer(project_2.Geometry)  # disabled
tii = TreeItemIndex(DataTree=reverse(project_2.Geometry), BranchIndex=branch, ItemIndex=item_5)  # disabled

# ---- group: FITNESS
num = Number(pdecon.ZComponent)  # disabled
panel_28 = Panel(num)  # disabled

# ----
merge_2 = Merge(Data1=galaplist.Fitness, Data2=galaplist.Iterations)  # disabled
datatree_of_iterations = Panel(merge_2)  # disabled

# ---- group: Visualization
pt_18 = Point(Point(0, 0, 0))

pt_19 = Point(Point(0, 0, 0))

# ----
# Unfold
unfold = Unfold(Brep=brep, Points=brep_cp.Point, Curves=flatten(crv_8), Plane=xz)  # -> UnFold, Pts, Curves; disabled

swatch_3 = ColourSwatch(SwatchColor=RGB(255, 255, 255))  # disabled
preview_4 = CustomPreview(Geometry=tbi_3, Shader=swatch_3)  # disabled

viewer_5 = ParamViewer(match)  # disabled
panel_29 = Panel(match)  # disabled

panel_30 = Panel(tbi_3)  # disabled
viewer_6 = ParamViewer(tbi_3)  # disabled

swatch_4 = ColourSwatch(SwatchColor=RGB(255, 255, 255))  # disabled
preview_5 = CustomPreview(Geometry=tii, Shader=swatch_4)  # disabled

panel_31 = Panel(tii)  # disabled
viewer_7 = ParamViewer(tii)  # disabled

srf_2 = Surface(unfold.UnFold)  # disabled
pt_20 = Point(unfold.Pts)  # disabled
crv_9 = Curve(unfold.Curves)  # disabled
unfold_surfaces = Panel(srf_2)  # disabled
points_unfolded_w_brep = Panel(pt_20)  # disabled
curves_unfolded_w_brep = Panel(crv_9)  # disabled

panel_32 = Panel("C:\tem\galapagos.xlsx")  # disabled
toggle_2 = BooleanToggle(False)  # disabled
wo = WriteOptions(
    FilePath=panel_32,
    ClearDataOverwrite=False,
    SaveAfterWrite=False,
    CloseAfterWrite=False,
    ColumnStartPosition=1,
    RowStartPosition=1)  # -> UserMessages, WriteOptions; disabled
writexl = WriteToExcel(
    Run=toggle_2,
    ExcelWorksheet="1",
    WriteOptions=wo.WriteOptions,
    ColumnnsOrRows=True,
    DataToWriteIntoColumns=datatree_of_iterations)  # disabled

# ----
# TTExcel Tools
columns = Slider(8, range=1..40)  # disabled
rows = Slider(6, range=1..40)  # disabled
repeat = RepeatData(Data=columns, Length=rows)  # disabled
lng_2 = ListLength(List=repeat)  # disabled
panel_33 = Panel(" 0")  # disabled
random_2 = Random(Range=Domain(0, 1), Number=lng_2, Seed=2)  # disabled
dom = Domain(DomainStart=panel_33, DomainEnd=lng_2)  # disabled
random_3 = Random(Range=Domain(0, 1), Number=repeat, Seed=random_2)  # disabled
random_4 = Random(Range=dom, Number=1, Seed=graft(random_2))  # disabled
replace = ListReplace(List=random_3, Indices=random_4, Wrap=False)  # disabled

rows_2 = Slider(22, range=1..40)  # disabled
columns_2 = Slider(3, range=1..40)  # disabled
repeat_2 = RepeatData(Data=rows_2, Length=columns_2)  # disabled
series = Series(Start=1, Step=1, Count=columns_2)  # disabled
series_2 = Series(Start=1, Step=1, Count=rows_2)  # disabled
panel_34 = Panel("COL_")  # disabled
panel_35 = Panel("ROW_")  # disabled
lng_3 = ListLength(List=repeat_2)  # disabled
int = Integer(series)  # disabled
int_2 = Integer(series_2)  # disabled
concat = Concatenate(A=panel_34, B=int)  # disabled
concat_2 = Concatenate(A=panel_35, B=int_2)  # disabled
random_5 = Random(Range=Domain(0, 1), Number=lng_3, Seed=2)  # disabled
random_6 = Random(Range=Domain(0, 1), Number=repeat_2, Seed=random_5)  # disabled

worksheet_number = Slider(1, range=1..3)  # disabled
toggle_3 = BooleanToggle(False)  # disabled

# ----
# Find the Excel listener in your sample files folder
# Update the file path accordingly
panel_36 = Panel("C:\Users\AGarciaPuyol\Documents\GitHub\CORE.Grasshopper\samples\TT_Toolbox_ExcelListener.xlsx")  # disabled

# ----
# 3) Read from Excel
readxl_2 = ReadExcelSheet(Run=toggle_3, Worksheet=worksheet_number, Listen=False)  # -> UserMessages, Columns, Rows; disabled

viewer_8 = ParamViewer(readxl_2.Columns)  # disabled
data_as_columns = Panel(readxl_2.Columns)  # disabled
data_as_rows = Panel(readxl_2.Rows)  # disabled
viewer_9 = ParamViewer(readxl_2.Rows)  # disabled

# ----
# 2) Write to Excel - complete
toggle_4 = BooleanToggle(False)  # disabled
str = String(simplify(random_6))  # disabled

toggle_5 = BooleanToggle(False)  # disabled
toggle_6 = BooleanToggle(True)  # disabled
str_2 = String(simplify(replace))  # disabled

column_start = Slider(1, range=1..40)  # disabled
row_start = Slider(1, range=1..40)  # disabled
wo_2 = WriteOptions(
    ClearDataOverwrite=True,
    SaveAfterWrite=False,
    CloseAfterWrite=False,
    ColumnStartPosition=column_start,
    RowStartPosition=row_start)  # -> UserMessages, WriteOptions; disabled
writexl_2 = WriteToExcel(
    Run=toggle_4,
    ExcelWorksheet="1",
    ColumnNames=concat,
    RowNames=concat_2,
    WriteOptions=wo_2.WriteOptions,
    ColumnnsOrRows=False,
    DataToWriteIntoColumns=str)  # disabled

# ----
# 1) Write to Excel - simple
writexl_3 = WriteToExcel(Run=toggle_5, ExcelWorksheet="1", WriteOptions="None", ColumnnsOrRows=toggle_6, DataToWriteIntoColumns=str_2)  # disabled

panel_37 = Panel(str_2)  # disabled

# ----
# CAD Exporter
cell_size_3 = Slider(3, range=0..10)  # disabled
cells_3 = Slider(3, range=0..10)  # disabled
height_3 = Slider(50, range=0..100)  # disabled
# GALAPAGOS LISTENER
levels_3 = Slider(8, range=0..10)  # disabled
pt_21 = ConstructPoint(XCoordinate=0, YCoordinate=0, ZCoordinate=0)  # disabled
Z_3 = UnitZ(Factor=1)  # disabled
sqgrid_3 = Square(Plane=PlaneXY(0, 0, 0), Size=cell_size_3, ExtentX=cells_3, ExtentY=cells_3)  # -> Cells, flatten(Points); disabled
line_3 = LineSDL(Start=pt_21, Direction=Z_3, Length=height_3)  # disabled
divide_4 = DivideCurve(Curve=line_3, Number=levels_3, Kinks=False)  # -> Points, Tangents, Parameters; disabled
xy_3 = XYPlane(Origin=divide_4.Points)  # disabled
project_3 = Project(Geometry=sqgrid_3.Points, Plane=graft(xy_3))  # -> Geometry, Transform; disabled
pdecon_2 = Deconstruct(Point=project_3.Geometry)  # -> XComponent, YComponent, ZComponent; disabled
bnd_2 = Bounds(Numbers=flatten(pdecon_2.ZComponent))  # disabled
dom_2 = Domain(DomainStart=1, DomainEnd=0.4)  # disabled
remap = RemapNumbers(Value=pdecon_2.ZComponent, Source=bnd_2, Target=dom_2)  # -> Mapped, Clipped; disabled
circle = CircleCNR(Center=project_3.Geometry, Normal=Vector(0, 0, 1), Radius=remap.Mapped)  # disabled
panel_38 = Panel("""floor1
floor2
floor3
floor4
floor5""")  # disabled

# ----
# Choose a location to save files
panel_39 = Panel("C:\tem")  # disabled
panel_40 = Panel("dxf")  # disabled
toggle_7 = BooleanToggle(True)  # disabled
panel_41 = Panel(".02")  # disabled
str_3 = String(simplify(graft(panel_38)))  # disabled
panel_42 = Panel("""layer1
layer2
layer3
layer4
layer5""")  # disabled
area = Area(Geometry=circle)  # -> Area, Centroid; disabled

cadexporter = CADExporter(
    Export=toggle_7,
    ExportType=panel_40,
    FilePaths=panel_39,
    FileNames=str_3,
    LayerNames=panel_42,
    Points=area.Centroid,
    Curves=circle,
    TextLocations=area.Centroid,
    Texts=area.Area,
    TextSizes=panel_41)  # disabled

# ----
# B) Set Shape(s) by list of strings and rotation by Planes
crv_10 = Curve([<curve referenced from the Rhino model> x3])  # disabled

plane_rotation = Slider(0, range=0..360)  # disabled
panel_43 = Panel("-1")  # disabled
panel_44 = Panel("1")  # disabled
curvepoint = PointOnCurve(crv_10, parameter=0)  # disabled
X = UnitX(Factor=panel_43)  # disabled
Z_4 = UnitZ(Factor=panel_44)  # disabled
pl = Plane(Origin=curvepoint, XAxis=X, YAxis=Z_4)  # disabled
rad = Radians(Degrees=plane_rotation)  # disabled
ttsweepnames = TTSweepNames(outputListLength=0, String=["W14X90", "2L8X8X5/8", "HSS20X8X5/8"])  # disabled
justification = Slider(5, range=0..8)  # disabled
section_rotation = Slider(0, range=0..360)  # disabled
panel_45 = Panel(ttsweepnames)  # disabled
prot = RotatePlane(Plane=pl, Angle=rad)  # disabled

ttsweep_2 = TTSweep(
    OutputMesh=False,
    BeamRail=crv_10,
    SectionNameOrCurve=panel_45,
    Justification=justification,
    Rotation=section_rotation,
    SweepPlane=prot,
    JustificationIndex=4,
    SectionNameIndex=191,
    ShapeTypeIndex=0,
    UnitTypeIndex=0)  # -> BrepsOrMeshes, SectionProfiles; disabled

crv_11 = Curve(ttsweep_2.SectionProfiles)  # disabled
brep_2 = Brep(ttsweep_2.BrepsOrMeshes)  # disabled
panel_46 = Panel(brep_2)  # disabled
panel_47 = Panel(crv_11)  # disabled

# ----
# 4) Listen from Excel
# Read points from an excel doc, and stitch together a mesh mesh using the points.  Color by Z value.
listen_for_changes = BooleanToggle(True)  # disabled
read_data = BooleanToggle(True)  # disabled
readxl_3 = ReadExcelSheet(Run=read_data, FilePath=panel_36, Worksheet="1", Listen=listen_for_changes)  # -> UserMessages, Columns, Rows; disabled
data = Data(readxl_3.Columns)  # disabled

shift = ShiftList(List=data, Shift=1, Wrap=False)  # disabled
bang = ExplodeTree(Data=shift)  # -> Branch0, Branch1, Branch2; disabled
pt_22 = ConstructPoint(XCoordinate=bang.Branch0, YCoordinate=bang.Branch1, ZCoordinate=bang.Branch2)  # disabled
del = DelaunayMesh(Points=pt_22, Plane=PlaneXY(0, 0, 0))  # disabled

mesh_2 = Mesh(del)  # disabled

mcomp = Decompose(Mesh=mesh_2)  # -> Vertices, Faces, Colours, Normals; disabled
pdecon_3 = Deconstruct(Point=mcomp.Vertices)  # -> XComponent, YComponent, ZComponent; disabled
bnd_3 = Bounds(Numbers=pdecon_3.ZComponent)  # disabled
domcomp = DomainComponents(Domain=bnd_3)  # -> Start, End; disabled
gradient_2 = Gradient(
    LowerLimit=domcomp.Start,
    UpperLimit=domcomp.End,
    Parameter=pdecon_3.ZComponent,
    stops=[0: RGB(0, 255, 255), 1: RGB(255, 0, 255)])  # disabled
mcol = MeshColours(Mesh=mesh_2, Colours=gradient_2)  # disabled
