# Grasshopper definition 6D Kmeans.gh (Grasshopper 0.9.76)
# plug-ins: Owl.GH

box = DomainBox(Base=PlaneXY(0, 0, 0), X="1 to 3", Y="1 to 3", Z="1 to 3")
box_2 = DomainBox(Base=PlaneXY(0, 0, 0), X="0 to 30", Y="0 to 30", Z="0 to 30")
pop3d = Populate3D(Region=box, Count=100, Seed=Slider(123, range=0..1000))
pop3d_2 = Populate3D(Region=box_2, Count=100, Seed=Slider(234, range=0..1000))
T = Tensor(pop3d)
T_2 = Tensor(pop3d_2)
pdecon = Deconstruct(Point=pop3d)  # -> XComponent, YComponent, ZComponent
tensorset = ConstructTensorSet(Tensors=T)
tensorset_2 = ConstructTensorSet(Tensors=T_2)
box_3 = CenterBox(Base=pop3d_2, X=pdecon.XComponent, Y=pdecon.YComponent, Z=pdecon.ZComponent)
remap = RemapTSet(TensorSet=tensorset_2, Source="0 to 30", Target=Domain(0, 1))
remap_2 = RemapTSet(TensorSet=tensorset, Source="1 to 3", Target=Domain(0, 1))
detset = DeconstructTensorSet(TensorSet=remap)
detset_2 = DeconstructTensorSet(TensorSet=remap_2)
detensor = DeconstructTensor(Tensor=detset)
detensor_2 = DeconstructTensor(Tensor=detset_2)
merge = Merge(Data1=detensor, Data2=detensor_2)
datatree_to_tensorset = DataTreeToTensorSet(DataTree=merge)  # "DT->TS"
kmeans = KMeansClustering(
    Data=datatree_to_tensorset,
    Clusters=Slider(5, range=0..10),
    Iterations=Slider(100, range=0..100),
    Seed=Slider(2399, range=0..10000))  # -> Clusters, Indices
item = ListItem(List=box_3, Index=kmeans.Indices, Wrap=True)
tstat = TreeStatistics(Tree=item)  # -> Paths, Length, Count
random = Random(Range=Domain(0, 1), Number=tstat.Count, Seed=Slider(517, range=0..1000))
hsl = ColourHSL(Alpha=1, Hue=random, Saturation=1, Luminance=0.5)
preview = CustomPreview(Geometry=item, Shader=graft(hsl))
