# Grasshopper definition Simple backprop.gh (Grasshopper 0.9.76)
# plug-ins: Owl.Accord.GH, Owl.GH

pop3d = Populate3D(
    Region={Plane=Plane(origin=(0, 0, 0), x=(0, 1, 0), y=(1, 0, 0)), X=Domain(0, 10), Y=Domain(0, 10), Z=Domain(-10, 0)},
    Count=Slider(10, range=0..100),
    Seed=1)
sph = Sphere(Base=pop3d, Radius=Slider(0.435, range=0..1))
pdecon = Deconstruct(Point=pop3d)  # -> XComponent, YComponent, ZComponent
preview = CustomPreview(Geometry=sph, Shader=ColourSwatch(SwatchColor=RGB(255, 0, 0)))
featurets = FeatureTensorSet(Feature0=pdecon.ZComponent)
featurets_2 = FeatureTensorSet(Feature0=pdecon.XComponent, Feature1=pdecon.YComponent)
number_slider = Slider(0.02, range=0..0.1)
remap = RemapTSet(TensorSet=featurets, Source="0 to 10", Target=Domain(0, 1))
remap_2 = RemapTSet(TensorSet=featurets_2, Source="0 to 10", Target=Domain(0, 1))
panel = Panel("""2
15
1""")
series = Series(Start=Slider(200, range=0..1000), Step=1, Count=Slider(100, range=0..1000))
series_2 = Series(Start=Slider(100, range=0..1000), Step=1, Count=Slider(100, range=0..1000))
network = ConstructNetwork(Layers=panel, Activation=0, Alpha=2, Seed=123)
noise = AddNoise(TensorSet=remap_2, Amplitude=number_slider, Seed=series_2, Constrain=Domain(0, 1))
noise_2 = AddNoise(TensorSet=remap, Amplitude=number_slider, Seed=123, Constrain=series)
mergets = MergeTSet(TensorSets=noise)
mergets_2 = MergeTSet(TensorSets=noise_2)
backprop = Backpropagation(
    ActivationNetwork=network,
    Input=mergets,
    Output=mergets_2,
    LearningRate=0.01,
    Momentum=0.001,
    Epoch=10,
    Iterations=Slider(2000, range=0..10000))  # -> ActivationNetwork, Error
range = Range(Domain=Domain(0, 1), Steps=Slider(31, range=0..100))
crossref = CrossReference(ListA=range, ListB=range, CrossMode=1)  # -> ListA, ListB
featurets_3 = FeatureTensorSet(Feature0=crossref.ListA, Feature1=crossref.ListB)
compute = Compute(ActivationNetwork=backprop.ActivationNetwork, Input=featurets_3)
remap_3 = RemapTSet(TensorSet=featurets_3, Source=Domain(0, 1), Target="0 to 10")
remap_4 = RemapTSet(TensorSet=compute, Source=Domain(0, 1), Target="0 to 10")
detset = DeconstructTensorSet(TensorSet=remap_3)
detset_2 = DeconstructTensorSet(TensorSet=remap_4)
detensor = DeconstructTensor(Tensor=detset)
detensor_2 = DeconstructTensor(Tensor=detset_2)  # -> flatten(Values)
item = ListItem(List=detensor, Index=0, Wrap=True)  # -> flatten(Item), flatten(Item1)
pt = ConstructPoint(XCoordinate=item.Item, YCoordinate=item.Item1, ZCoordinate=detensor_2)
