# Grasshopper definition backfit the city data.gh (Grasshopper 0.9.76)
# plug-ins: Human, Bifocals, Owl.Accord.GH, Telepathy, Owl.GH

dpipeline = DynamicGeometryPipeline(
    LayerFilter="*",
    TypeFilter="Mesh",
    NameFilter="*",
    enableFullPath=False,
    GroupByLayer=False,
    GroupByType=False,
    IncludeHidden=True,
    IncludeLocked=True,
    listenToAttriubtes=True)
geo = Geometry(dpipeline)
# Geometry / Data Ingest
objatts = ObjectAttributes(ObjectOrAttributes=geo)  # -> Name, LayerName, LayerFullPath, Color, MaterialName, LinetypeName, GroupIndices, PlotWeight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
layertable = LayerTable(Update=True, AutoUpdate=False)  # -> Layers, FullLayerPaths, LayerColors, Linetypes, MaterialNames, Visible, PrintWidth, PrintColor
list = ItemSelector(
    layertable.Layers,
    {"Geometry", "Ziggarat", "moderne", "low", "classic", "monumental"}, selected=["Ziggarat", "moderne", "low", "classic", "monumental"])
tmatch = MatchText(Text=list, Pattern=graft(objatts.LayerName), Case=True)
color_groups_clusters = Button(ExpressionNormal="True")
ma = MassAddition(Input=tmatch)  # -> Result, PartialResults
cull = CullPattern(List=geo, CullPattern=invert(flatten(ma.Result)))
cull_2 = CullPattern(List=geo, CullPattern=flatten(ma.Result))
cull_3 = CullPattern(List=objatts.LayerName, CullPattern=flatten(ma.Result))
col = Colour([RGBA(4, 0, 255, 135), RGBA(0, 128, 255, 133), RGBA(210, 255, 148, 141), RGBA(255, 0, 0, 122), RGBA(224, 224, 224, 211)])
fsim = FindSimilarMember(Data=cull_3, Set=layertable.Layers)  # -> Hit, Index
lng = ListLength(List=layertable.Layers)
analysis_geo = RemoteSender(cull)
panel = Panel(cull_3)
panel_2 = Panel(fsim.Index)
geo_2 = Geometry(cull_2)
geo_3 = Geometry(cull)

# ---- group: Classification
data = Data(simplify(graft(fsim.Index)))

# ---- group: input geometry
geo_4 = Geometry(graft(geo_2))

# ----
geo_5 = Geometry(graft(geo_3))
# Analysis Stuffs
field_titles = Panel("""Area
Volume
centroid x
centroid y 
centroid z
BB_Height
BB_With
BB_Depth
low_slice_length
mid_slice_length
upper_slice_length
Eccentricity x
e y
e z
second moment x
sm y
sm x
faces
edges
vertexes
voume/bb""")
cluster = Cluster_4(G_3=geo_4, G_2=geo_4, C=geo_4, M=geo_4, G=geo_4, mesh=geo_4)
cluster_2 = Cluster_4(G_3=geo_5, G_2=geo_5, C=geo_5, M=geo_5, G=geo_5, mesh=geo_5)
list_2 = ItemSelector(
    field_titles,
    {"Area", "Volume", "centroid x", "centroid y": "centroid y ", "centroid z", "BB_Height", "BB_With", "BB_Depth", "low_slice_length", "mid_slice_length", "upper_slice_length", "Eccentricity x", "e y", "e z", "second moment x", "sm y", "sm x", "faces", "edges", "vertexes", "voume/bb"}, selected=["Volume", "centroid z", "mid_slice_length", "faces", "vertexes", "voume/bb"])
fsim_2 = FindSimilarMember(Data=list_2, Set=field_titles)  # -> Hit, Index
item = ListItem(List=cluster_2, Index=fsim_2.Index, Wrap=True)
item_2 = ListItem(List=cluster, Index=fsim_2.Index, Wrap=True)
panel_3 = Panel(fsim_2.Index)
flip = FlipMatrix(Data=item)
shape_type = Data(data)
flip_2 = FlipMatrix(Data=item_2)
merge = Merge(Data1=flip_2, Data2=flip)
subtraction = Subtraction(A=lng, B=1)
bnd = Bounds(Numbers=merge)
remap = RemapNumbers(Value=flip, Source=bnd, Target=Domain(0, 1))  # -> Mapped, Clipped
remap_2 = RemapNumbers(Value=flip_2, Source=bnd, Target=Domain(0, 1))  # -> Mapped, Clipped
remap_3 = RemapNumbers(Value=shape_type, Source=subtraction, Target=Domain(0, 1))  # -> Mapped, Clipped
flip_3 = FlipMatrix(Data=remap_2.Mapped)
flip_4 = FlipMatrix(Data=remap.Mapped)
panel_4 = Panel("""30
1""")
# ML Action
lng_2 = ListLength(List=fsim_2.Index)
merge_2 = Merge(Data1=lng_2, Data2=panel_4)
datatree_to_tensorset = DataTreeToTensorSet(DataTree=flip_4)  # "DT->TS"
datatree_to_tensorset_2 = DataTreeToTensorSet(DataTree=flip_3)  # "DT->TS"
featurets = FeatureTensorSet(Feature0=flatten(remap_3.Mapped))
panel_5 = Panel(merge_2)
panel_6 = Panel(flip_4)
network = ConstructNetwork(Layers=panel_5, Activation=1, Alpha=1, Seed=Slider(100, range=0..100))
backprop = Backpropagation(
    ActivationNetwork=network,
    Input=datatree_to_tensorset_2,
    Output=featurets,
    LearningRate=0.01,
    Momentum=0.001,
    Epoch=10,
    Iterations=Slider(10000, range=0..10000))  # -> ActivationNetwork, Error
# Visualization of Results
_2dpreview = NetworkPreview(Network=backprop.ActivationNetwork, Lines=Domain(1, 5), Radius=5)
compute = Compute(ActivationNetwork=backprop.ActivationNetwork, Input=datatree_to_tensorset)
detset = DeconstructTensorSet(TensorSet=compute)
detensor = DeconstructTensor(Tensor=detset)
tsview = TensorSetDisplay(TensorSet=detset, Range=Domain(0, 1))
remap_4 = RemapNumbers(Value=detensor, Source=Domain(0, 1), Target=subtraction)  # -> Mapped, Clipped
analysis_geo_2 = RemoteReceiver(flatten(analysis_geo))
col_2 = Colour(layertable.LayerColors)
round = Round(Number=remap_4.Mapped)  # -> Nearest, Floor, Ceiling
item_3 = ListItem(List=flatten(col_2), Index=round.Nearest, Wrap=True)  # -> flatten(Item)
panel_7 = Panel(round.Nearest)
preview = CustomPreview(Geometry=analysis_geo_2, Shader=item_3)

# ----
# ToolDescription: Enter a description of this definition's functionality and use
update_file_info = Button()
group_prefixes = Panel("""out_
in_
action_
warning_
cluster""")
c_script = CSharpScript(update=color_groups_clusters, name=group_prefixes, col=col)  # -> out, A; inputs update: Boolean, name: list of String, col: list of Color
# ---------- c_script: C# ----------
    Color clusterColor = Color.Transparent;
    for(int i = 0;i < name.Count;i++){
      if(name[i].Contains("cluster")){
        clusterColor = col[i];
        break;
      }
    }



    if(update){
      List<Guid> guids = new List<Guid>();
      List<Grasshopper.Kernel.Special.GH_Group> grps = new List<Grasshopper.Kernel.Special.GH_Group>();
      List<Grasshopper.Kernel.Special.GH_Group> alreadygrps = new List<Grasshopper.Kernel.Special.GH_Group>();


      foreach(IGH_DocumentObject o in GrasshopperDocument.Objects){
        Grasshopper.Kernel.Special.GH_Group g = o as Grasshopper.Kernel.Special.GH_Group;
        if(g != null){
          for(int j = 0;j < name.Count;j++){
            if(g.NickName.ToUpper().Contains(name[j].ToUpper())){
              g.Colour = col[j % col.Count];
            }

          }
        }


        if(o is Grasshopper.Kernel.Special.GH_Cluster){
          Grasshopper.Kernel.Special.GH_Cluster cluster = o as  Grasshopper.Kernel.Special.GH_Cluster;
          string filepath = cluster.FilePath;
          if(!String.IsNullOrEmpty(filepath)){
            cluster.Name = System.IO.Path.GetFileNameWithoutExtension(filepath);
            cluster.NickName = System.IO.Path.GetFileNameWithoutExtension(filepath);
            cluster.Attributes.ExpireLayout();
          }
          guids.Add(cluster.InstanceGuid);
          Grasshopper.Kernel.Special.GH_Group grp = new Grasshopper.Kernel.Special.GH_Group();
          grps.Add(grp);

        } else if (o is Grasshopper.Kernel.Special.GH_Group){
          Grasshopper.Kernel.Special.GH_Group alreadygrp = o as Grasshopper.Kernel.Special.GH_Group;
          alreadygrps.Add(alreadygrp);
        }





      }

      List<bool> isAlreadyInGroup = IsAlreadyInGroup(guids, alreadygrps);

      for(int i = 0;i < grps.Count;i++){
        Grasshopper.Kernel.Special.GH_Group grp = grps[i];
        grp.Colour = clusterColor;
        grp.NickName = "";
        grp.AddObject(guids[i]);
        if(!isAlreadyInGroup[i]){
          grp.ExpireCaches();
          GrasshopperDocument.AddObject(grp, false, 1000);
        }
      }



    }
# ---------- c_script: C# additional code ----------
  List<bool> IsAlreadyInGroup(List<Guid> guids, List<Grasshopper.Kernel.Special.GH_Group> grps){
    List<bool> results = new List<bool>();
    foreach(Guid g in guids){
      results.Add(false);
    }
    foreach(Grasshopper.Kernel.Special.GH_Group grp in grps){ //for every group in the pre-existing groups
      if(grp.Objects().Count == 1){ //if that group only has one object in it
        for (int j = 0;j < guids.Count;j++){
          Guid g = guids[j];
          if(grp.ObjectIDs.Contains(g)){
            results[j] = true;
            break;
          }
        }
      }
    }
    return results;
  }
# ---------- end c_script ----------

data_2 = Data(update_file_info)

c_script_2 = CSharpScript(x=data_2)  # -> out, A, B, C, D, E
# ---------- c_script_2: C# ----------
    List < IGH_DocumentObject> objectsRecursive = new List<IGH_DocumentObject>();
    objectsRecursive.AddRange(clusterObjectsRecursive(GrasshopperDocument));


    B = GrasshopperDocument.Author.Name + " " + GrasshopperDocument.Author.Email;
    D = GrasshopperDocument.Properties.DateTag;
    if(GrasshopperDocument.IsFilePathDefined){
      C = GrasshopperDocument.FilePath;
      System.IO.FileInfo info = new System.IO.FileInfo(GrasshopperDocument.FilePath);
      if(info.LastWriteTime != null){
        E = info.LastWriteTime;
      } else {
        E = "";
      }
    } else {
      C = "Unsaved Document";
      E = "";
    }
    A = objectsRecursive;
# ---------- c_script_2: C# additional code ----------
  List<IGH_DocumentObject> clusterObjectsRecursive(GH_Document doc){
    List<IGH_DocumentObject> objList = new List<IGH_DocumentObject>();
    objList.AddRange(doc.Objects);
    foreach(IGH_DocumentObject obj in doc.Objects){
      Grasshopper.Kernel.Special.GH_Cluster cluster = obj as Grasshopper.Kernel.Special.GH_Cluster;
      try{
        objList.AddRange(clusterObjectsRecursive(cluster.Document("")));
      } catch {

      }
    }
    return objList;
  }
# ---------- end c_script_2 ----------
cluster_3 = Cluster_2(T=c_script_2.A, N=c_script_2.B, fn=c_script_2.C, dc=c_script_2.D, dm=c_script_2.E)
file_info = Panel(cluster_3)

# ==== cluster Cluster_2
T = ClusterInput()
N = ClusterInput()
fn = ClusterInput()
dc = ClusterInput()
dm = ClusterInput()
cluster = Cluster(T=T, N=N, fn=fn, dc=dc, dm=dm)  # -> T_2, author_2, objcount_2, fn_3, dc_4, dm_4
merge = Merge(
    Data1=cluster.author_2,
    Data2=cluster.T_2,
    Data3=cluster.objcount_2,
    Data4=cluster.fn_3,
    Data5=cluster.dc_4,
    Data6=cluster.dm_4)
R = ClusterOutput(merge)

# ==== cluster Cluster_4
mesh = ClusterInput()
mesh_2 = Mesh(mesh)

vmoments = VolumeMoments(Geometry=mesh_2)  # -> simplify(Volume), simplify(Centroid), simplify(Inertia), simplify(InertiaError), simplify(Secondary), simplify(SecondaryError), simplify(Gyration)
data = Data(vmoments.Secondary)
data_2 = Data(data)
cluster = Cluster_3(data=data_2)
data_3 = Data(simplify(cluster))

bbox = BoundingBox(Content=mesh_2, Plane=PlaneXY(0, 0, 0))  # -> Box, Box_2
volume = Volume(Geometry=mesh_2)  # -> Volume, Centroid
volume_2 = Volume(Geometry=bbox.Box_2)  # -> Volume, Centroid
data_4 = Data(volume.Volume)
data_5 = Data(volume_2.Volume)
division = Division(A=data_5, B=data_4)
data_6 = Data(division)
data_7 = Data(simplify(data_6))

G = ClusterInput()

area = Area(Geometry=G)  # -> Area, Centroid
pdecon = Deconstruct(Point=area.Centroid)  # -> XComponent, YComponent, ZComponent
volume_3 = Volume(Geometry=mesh_2)  # -> Volume, Centroid
data_8 = Data(pdecon.ZComponent)
sort = SortList(Keys=data_8, ValuesA=data_8, ValuesB=mesh_2, ValuesC=area.Centroid)  # -> Keys, ValuesA, ValuesB, ValuesC
pt = Point(volume_3.Centroid)
item = ListItem(List=sort.ValuesC, Index=0, Wrap=True)
pt_2 = Point(item)
vec2pt = Vector2Pt(PointA=pt_2, PointB=pt, Unitize=False)  # -> Vector, Length
data_9 = Data(vec2pt.Vector)
data_10 = Data(data_9)
cluster_2 = Cluster_3(data=data_10)
data_11 = Data(simplify(cluster_2))

medges = MeshEdges(Mesh=mesh_2)  # -> NakedEdges, InteriorEdges, NonManifoldEdges
explode = MeshExplode(Mesh=mesh_2, Interpolate=False)
mesh_topo_vertex = MeshTopologyVertex(Mesh=mesh_2)  # -> ListOfMeshVertices, VertexVertexStructure, VertexFaceStructure
lng = ListLength(List=mesh_topo_vertex.ListOfMeshVertices)
lng_2 = ListLength(List=explode)
lng_3 = ListLength(List=medges.NakedEdges)
data_12 = Data(lng)
data_13 = Data(lng_2)
data_14 = Data(lng_3)
data_15 = Data(simplify(data_13))
data_16 = Data(simplify(data_14))
data_17 = Data(simplify(data_12))
merge = Merge(Data1=data_11, Data2=data_3, Data3=data_15, Data4=data_16, Data5=data_17, Data6=data_7)
data_18 = Data(merge)

C = ClusterInput()
bbox_2 = BoundingBox(Content=C, Plane=PlaneXY(0, 0, 0))  # -> Box, Box_2
G_2 = ClusterInput()
G_3 = ClusterInput()
M = ClusterInput()
debox = DeconstructBox(Box=bbox_2.Box)  # -> Plane, simplify(X), simplify(Y), simplify(Z)
volume_4 = Volume(Geometry=G_2)  # -> simplify(Volume), Centroid
area_2 = Area(Geometry=G_3)  # -> simplify(Area), Centroid
dlength = DLength(I=debox.Y)
dlength_2 = DLength(I=debox.Z)
pdecon_2 = Deconstruct(Point=volume_4.Centroid)  # -> simplify(XComponent), simplify(YComponent), simplify(ZComponent)
dlength_3 = DLength(I=debox.X)
panel = Panel(area_2.Area)
panel_2 = Panel(pdecon_2.XComponent)
panel_3 = Panel(pdecon_2.YComponent)
panel_4 = Panel(pdecon_2.ZComponent)
panel_5 = Panel(dlength_3)
panel_6 = Panel(dlength)
panel_7 = Panel(dlength_2)
panel_8 = Panel(volume_4.Volume)
data_19 = Data(data_18)
panel_9 = Panel(data_17)
# [eccentricity]
# x
# y
# z
panel_10 = Panel(data_11)
# [second moment of inertia]
# Ixx
# Iyy
# Izy
panel_11 = Panel(data_3)
panel_12 = Panel(data_15)
# [brep topology]
# number of faces
# number of edges
# number of vertexs
panel_13 = Panel(data_16)
# volume/ bb volume ratio
panel_14 = Panel(data_7)

# ---- group: length of slice at low mid and high
panel_15 = Panel("""0.1
0.5
0.9""")
box = EvaluateBox(Box=bbox_2.Box, UParameter="0", VParameter="0", WParameter=panel_15)  # -> Plane, Point, Include

# ----
sec = MeshPlane(Mesh=M, Plane=box.Plane)

# ---- group: length of slice at low mid and high (continued)
trim = TrimTree(Tree=sec, Depth=1)
len = Length(Curve=trim)
item_2 = ListItem(List=simplify(len), Index=0, Wrap=True)  # -> Item, Item1, Item2

# ----
division_2 = Division(A=item_2.Item, B=item_2.Item2)
merge_2 = Merge(
    Data1=panel,
    Data2=panel_8,
    Data3=panel_2,
    Data4=panel_3,
    Data5=panel_4,
    Data6=panel_5,
    Data7=panel_6,
    Data8=panel_7,
    Data9=item_2.Item,
    Data10=division_2,
    Data11=item_2.Item2,
    Data12=data_19)
R = ClusterOutput(merge_2)

# ==== cluster Cluster
N = ClusterInput()
T = ClusterInput()
N_2 = Text(N)
split = TextSplit(Text=T, Separators=".")
fn = ClusterInput()
dm = ClusterInput()
item = ListItem(List=split, Index=0, Wrap=True)
dc = ClusterInput()
pan = Panel("""HDT_Reference
HDTReference""")
pan_2 = Panel("""Human
Human""")
lng = ListLength(List=T)
len = TextLength(Text=N_2)
contains = ContainsAB(B=N_2)
dm_2 = Text(dm)
dc_2 = Text(dc)
fn_2 = Text(fn)
replace = ReplaceMembers(Set=item, Find=pan, Replace=pan_2)
cset = CreateSet(List=flatten(replace))  # -> Set, Map
txt = Text(["ScriptComponents", "Grasshopper", "MathComponents", "GalapagosComponents", "FieldComponents", "VectorComponents", "AnalysisComponents", "CurveComponents", "LegacyScriptComponents", "SurfaceComponents", "TriangulationComponents", "MassXForms", "LinearXForms"])
format = Format(Format="Definition by {0}", Culture=127, Data0=N_2)
difference = SetDifference(SetA=cset.Set, SetB=txt)
lng_2 = ListLength(List=flatten(difference))
dispatch = Dispatch(List=format, DispatchPattern=contains)  # -> ListA, ListB
format_2 = Format(Format="Object Count: {0:0}", Culture=127, Data0=lng)
format_3 = Format(Format="Date Modified: {0}", Culture=127, Data0=dm_2)
format_4 = Format(Format="Date Created: {0}", Culture=127, Data0=dc_2)
dependencies = Text(flatten(difference))
author = Text(flatten(dispatch.ListB))
larger = LargerThan(FirstNumber=lng_2, SecondNumber="1")  # -> LargerThan, OrEqualTo
objcount = Text(flatten(format_2))
author_2 = ClusterOutput(author)
dm_3 = Text(flatten(format_3))
fn_3 = ClusterOutput(fn_2)
dc_3 = Text(flatten(format_4))
objcount_2 = ClusterOutput(objcount)
dc_4 = ClusterOutput(dc_3)
filter = StreamFilter(
    Gate=larger.LargerThan,
    Stream0="This definition requires the following plug-in:",
    Stream1="This definition requires the following plug-ins:")
dm_4 = ClusterOutput(dm_3)
pan_3 = Panel("""{0}
{1}""")
join = TextJoin(Text=dependencies)
format_5 = Format(Format=pan_3, Culture=127, Data0=filter, Data1=join)
clean = CleanTree(Tree=format_5, CleanInvalid=True, CleanEmpty=False)
T_2 = ClusterOutput(clean)

# ==== cluster DLength: computes length of a domain
I = ClusterInput()
dedomain = DeconstructDomain(Domain=I)  # -> Start, End
subtraction = Subtraction(A=dedomain.Start, B=dedomain.End)
abs = Absolute(Value=subtraction)
y = ClusterOutput(abs)

# ==== cluster Cluster_3
data = ClusterInput()
data_2 = Data(data)
pdecon = Deconstruct(Point=data_2)  # -> XComponent, YComponent, ZComponent
merge = Merge(Data1=pdecon.XComponent, Data2=pdecon.YComponent, Data3=pdecon.ZComponent)
data_3 = Data(merge)
data_4 = ClusterOutput(data_3)

# ==== cluster ContainsAB: Tests if a string contains another string.
B = ClusterInput()
A = ClusterInput()
A_2 = String(A)
B_2 = String(B)
eval = Evaluate(F="Contains(x,y)", x=A_2, y=B_2)
c = Boolean(eval)
c_2 = ClusterOutput(c)
