# Grasshopper definition Mesh analysis 02 diagram.ghx (Grasshopper 0.9.76)
# plug-ins: Python Interpreter, Human, TT Toolbox, Telepathy, Owl.GH

# ----
# NUMBER OF INDIVIDUAL PRIMITIVES
number_slider = Slider(15, range=0..100)

color_groups_clusters = Button(ExpressionNormal="True")

panel = Panel("BASE PLANE")
pln = Plane(PlaneXY(0.08767023439, 0.0884122404, 0))

num = Number(50)
range = Range(Domain=num, Steps=number_slider)
num_2 = Number(0)
cull_i = CullIndex(List=range, Indices=num_2, Wrap=True)
col = Colour([RGBA(4, 0, 255, 135), RGBA(0, 128, 255, 133), RGBA(210, 255, 148, 141), RGBA(255, 0, 0, 122), RGBA(224, 224, 224, 211)])
panel_2 = Panel(cull_i)

python = PythonScript()  # -> out, random_int
# ---------- python: Python ----------
import Rhino.Geometry as rg
import rhinoscriptsyntax as rs
import math

from random import randint
random_int = (randint(0, 100))
# ---------- end python ----------
python_2 = PythonScript()  # -> out, random_int; same code as python
python_3 = PythonScript()  # -> out, random_int; same code as python
python_4 = PythonScript()  # -> out, random_int; same code as python
python_5 = PythonScript()  # -> out, random_int; same code as python
python_6 = PythonScript()  # -> out, random_int; same code as python
python_7 = PythonScript()  # -> out, random_int; same code as python
python_8 = PythonScript()  # -> out, random_int; same code as python
# Generate Test Geo
panel_3 = Panel("RANDOMIZE SHIT")
jitter = Jitter(List=panel_2, Jitter=1, Seed=python.random_int)  # -> Values, Indices
jitter_2 = Jitter(List=panel_2, Jitter=1, Seed=python_3.random_int)  # -> Values, Indices
jitter_3 = Jitter(List=panel_2, Jitter=1, Seed=python_4.random_int)  # -> Values, Indices
jitter_4 = Jitter(List=panel_2, Jitter=1, Seed=python_5.random_int)  # -> Values, Indices
jitter_5 = Jitter(List=panel_2, Jitter=1, Seed=python_2.random_int)  # -> Values, Indices
jitter_6 = Jitter(List=panel_2, Jitter=1, Seed=python_6.random_int)  # -> Values, Indices
jitter_7 = Jitter(List=panel_2, Jitter=1, Seed=python_7.random_int)  # -> Values, Indices
jitter_8 = Jitter(List=panel_2, Jitter=1, Seed=python_8.random_int)  # -> Values, Indices

panel_4 = Panel("PRIMITIVE CREATION")
box = CenterBox(Base=pln, X=jitter_2.Values, Y=jitter_3.Values, Z=jitter_4.Values)
cone = Cone(Base=pln, Radius=jitter_7.Values, Length=jitter_8.Values)  # -> Cone, Tip
sph = Sphere(Base=pln, Radius=jitter_6.Values)
cyl = Cylinder(Base=pln, Radius=jitter.Values, Length=jitter_5.Values)

capex = CapHolesEx(Brep=sph)  # -> Brep, Caps, Solid
capex_2 = CapHolesEx(Brep=box)  # -> Brep, Caps, Solid
capex_3 = CapHolesEx(Brep=cyl)  # -> Brep, Caps, Solid
capex_4 = CapHolesEx(Brep=cone.Cone)  # -> Brep, Caps, Solid
panel_5 = Panel(capex.Brep)
panel_6 = Panel(capex_3.Brep)
panel_7 = Panel(capex_4.Brep)
panel_8 = Panel(capex_2.Brep)
entwine = Entwine(Branch00=capex_4.Brep, Branch01=capex_3.Brep, Branch02=capex_2.Brep, FlattenInputs=True)  # -> flatten(Result)
data = Data(capex_2.Brep)
data_2 = Data(capex_3.Brep)
data_3 = Data(capex_4.Brep)
lng = ListLength(List=data)
lng_2 = ListLength(List=data_2)
lng_3 = ListLength(List=data_3)
dup = DuplicateData(Data="Box", Number=lng, Order=True)  # -> flatten(Data)
dup_2 = DuplicateData(Data="Cylinder", Number=lng_2, Order=True)  # -> flatten(Data)
dup_3 = DuplicateData(Data="Cone", Number=lng_3, Order=True)  # -> flatten(Data)
merge = Merge(Data1=dup_3, Data2=dup_2, Data3=dup)
graft = GraftTree(Tree=entwine, IncludeEmptyLists=True, IncludeNullItems=True)
data_4 = Data(simplify(graft(merge)))
mesh = Mesh([<mesh referenced from the Rhino model> x2])
mesh_2 = Mesh([<mesh referenced from the Rhino model> x50])
geometry_shapenames = RemoteSender(data_4)
geometry_primitives = RemoteSender(graft)
geometry_primitives_2 = RemoteReceiver(geometry_primitives)
geo = Geometry(simplify(graft(mesh_2)))
geo_2 = Geometry(geo)
data_5 = Data("5")
G = Geometry(geo)
geo_3 = Geometry(geo)
# MARK'S FEATURES
geo_4 = Geometry(geo)

geo_5 = Geometry(geo_2)
data_6 = Data(data_5)
contour = Contour(Shape=geo_5, Point=Point(0, 0, 0), Direction=Vector(0, 0, 1), Distance=data_6)  # -> simplify(Contours)
crv = Curve(contour)

area = Area(Geometry=geo_3)  # -> Area, Centroid

data_7 = Data(Slider(45, range=0..100))
range_2 = Range(Domain="0 to 90", Steps=data_7)
cull_i_2 = CullIndex(List=range_2, Indices=data_7, Wrap=True)
data_8 = Data(cull_i_2)
rad = Radians(Degrees=data_8)
data_9 = Data(rad)

crv_2 = Curve(crv)
lng_4 = ListLength(List=crv_2)
data_10 = Data(lng_4)

pt = Point(area.Centroid)
pt_2 = Point(pt)
pt_3 = Point(pt_2)
pt_4 = Point(pt_2)
pdecon = Deconstruct(Point=pt_4)  # -> XComponent, YComponent, ZComponent
preview = CustomPreview(Geometry=geo_2, Shader=ColourSwatch(SwatchColor=RGB(219, 113, 0)))

crv_3 = Curve(simplify(crv))
cluster = Cluster_4(C=crv_3)
trim = TrimTree(Tree=cluster, Depth=1)
G_2 = Geometry(trim)

preview_2 = CustomPreview(Geometry=G_2, Shader=ColourSwatch(SwatchColor=RGB(0, 66, 99)))
geometry_primitives_3 = RemoteReceiver(geometry_primitives)

geo_6 = Geometry(geo_4)
volume = Volume(Geometry=geo_6)  # -> Volume, Centroid
pt_5 = Point(volume.Centroid)
xy = XYPlane(Origin=pt_5)
prot = RotatePlane(Plane=xy, Angle=data_9)

# ---- group: input geometry
geo_7 = Geometry(geometry_primitives_3)

# ----
G_3 = Geometry(G_2)
area_2 = Area(Geometry=G_3)  # -> Area, Centroid
data_11 = Data(area_2.Area)

data_12 = Data(data_11)

L = List(data_12)
lng_5 = ListLength(List=L)
multiplication = Multiplication(A=lng_5, B=Slider(0.95, range=0..1))
B = DomainEnd(multiplication)
dom = ConstructDomain(DomainStart=0, DomainEnd=B)
subset = SubList(List=L, Domain=dom, Wrap=True)  # -> List, Index
data_13 = Data(simplify(subset.List))

pt_6 = Point(pt_3)
crv_4 = Curve(G_2)

data_14 = Data(data_11)
data_15 = Data(data_5)
multiplication_2 = Multiplication(A=data_14, B=data_15)  # -> simplify(Result)
data_16 = Data(multiplication_2)

data_17 = Data(data_16)
avr = Average(Input=data_17)
data_18 = Data(avr)

geo_8 = Geometry(geo_4)
P = Plane(prot)
bbox = BoundingBox(Content=geo_8, Plane=P)  # -> Box, Box_2
trim_2 = TrimTree(Tree=bbox.Box, Depth=1)
geo_9 = Geometry(simplify(trim_2))

# ----
# NATE'S FEATURES
geometry_shapenames_2 = RemoteReceiver(geometry_shapenames)
subset_2 = SubList(List=crv_4, Domain=dom, Wrap=True)  # -> List, Index
area_3 = Area(Geometry=geo_7)  # -> simplify(Area), Centroid
data_19 = Data(simplify(subset_2.List))

K = Keys(data_13)
sort = SortList(Keys=K, ValuesA=data_19)  # -> Keys, ValuesA
item = ListItem(List=sort.Keys, Index=0, Wrap=True)  # -> Item1, Item
item_2 = ListItem(List=sort.Keys, Index=0, Wrap=True)
data_20 = Data(item.Item1)
data_21 = Data(item_2)
division = Division(A=data_21, B=data_20)
data_22 = Data(division)

data_23 = Data(sort.ValuesA)
lng_6 = ListLength(List=data_23)
series = Series(Start=0, Step=1, Count=lng_6)
data_24 = Data(sort.ValuesA)
data_25 = Data(sort.Keys)
panel_9 = Panel(item_2)
item_3 = ListItem(List=data_24, Index=0, Wrap=True)  # -> Item1, Item
panel_10 = Panel(data_20)
data_26 = Data(data_21)

data_27 = Data(data_26)
data_28 = Data(Slider(0.2, range=0..1))
multiplication_3 = Multiplication(A=data_27, B=data_28)
data_29 = Data(multiplication_3)

data_30 = Data(simplify(data_25))
data_31 = Data(data_29)
pt_7 = ConstructPoint(XCoordinate=data_30, YCoordinate=0, ZCoordinate=0)
cullduppoints = RemoveDuplicatePoints(InputPoints=pt_7, Tolerance=data_31)  # -> OutputPoints, FirstPointIndexes
null = NullItem(Item=cullduppoints.OutputPoints)  # -> NullFlags, InvalidFlags, Description
dispatch = Dispatch(List=cullduppoints.OutputPoints, DispatchPattern=null.InvalidFlags)  # -> ListA, ListB
data_32 = Data(simplify(dispatch.ListB))

null_2 = NullItem(Item=cullduppoints.OutputPoints)  # -> NullFlags, InvalidFlags, Description
dispatch_2 = Dispatch(List=series, DispatchPattern=null_2.InvalidFlags)  # -> ListA, ListB
item_4 = ListItem(List=data_23, Index=dispatch_2.ListB, Wrap=True)
item_5 = ListItem(List=data_30, Index=dispatch_2.ListB, Wrap=True)
data_33 = Data(item_5)
bnd = Bounds(Numbers=data_33)
data_34 = Data(bnd)
dedomain = DeconstructDomain(Domain=data_34)  # -> Start, End
geo_10 = Geometry(item_4)
gradient = Gradient(
    LowerLimit=dedomain.Start,
    UpperLimit=dedomain.End,
    Parameter=data_33,
    stops=[0: RGB(234, 38, 0), 0.25: RGB(234, 126, 0), 0.5: RGB(254, 244, 84), 0.75: RGB(173, 203, 249), 1: RGB(75, 107, 169)])
previewlw = CustomPreviewLineweights(Geometry=geo_10, Shader=gradient, Thickness=Slider(2, range=0..10), Absolute=False)

lng_7 = ListLength(List=data_32)
larger = LargerThan(FirstNumber=lng_7, SecondNumber="3")  # -> LargerThan, OrEqualTo
data_35 = Data(larger.LargerThan)

dispatch_3 = Dispatch(List=geo_2, DispatchPattern=data_35)  # -> ListA, ListB

data_36 = Data(data_16)
ma = MassAddition(Input=data_36)  # -> Result, PartialResults
data_37 = Data(ma.Result)

bbox_2 = BoundingBox(Content=geo_7, Plane=PlaneXY(0, 0, 0))  # -> Box, Box_2
debox = DeconstructBox(Box=bbox_2.Box)  # -> Plane, simplify(X), simplify(Y), simplify(Z)
dlength = DLength(I=debox.Y)  # -> data_6, data_5, y
dlength_2 = DLength(I=debox.X)  # -> data_6, data_5, y
dlength_3 = DLength(I=debox.Z)  # -> data_6, data_5, y
panel_11 = Panel(dlength_2.y)
panel_12 = Panel(dlength.y)
panel_13 = Panel(dlength_3.y)

# ---- group: length of slice at low mid and high
panel_14 = Panel("""0.1
0.5
0.9""")
box_2 = EvaluateBox(Box=bbox_2.Box, UParameter="0", VParameter="0", WParameter=panel_14)  # -> Plane, Point, Include
sec = BrepPlane(Brep=geo_7, Plane=box_2.Plane)  # -> Curves, Points
trim_3 = TrimTree(Tree=sec.Curves, Depth=1)
len = Length(Curve=trim_3)
item_6 = ListItem(List=simplify(len), Index=0, Wrap=True)  # -> Item, Item1, Item2

# ----
previewlw_2 = CustomPreviewLineweights(
    Geometry=item_3.Item1,
    Shader=ColourSwatch(SwatchColor=RGB(255, 20, 208)),
    Thickness=Slider(5, range=0..10),
    Absolute=False)
previewlw_3 = CustomPreviewLineweights(
    Geometry=item_3.Item,
    Shader=ColourSwatch(SwatchColor=RGB(54, 154, 255)),
    Thickness=Slider(5, range=0..10),
    Absolute=False)

mesh_3 = Mesh(dispatch_3.ListA)
mesh_4 = Mesh(dispatch_3.ListB)
swatch = ColourSwatch(SwatchColor=RGB(132, 0, 255))
preview_3 = CustomPreview(Geometry=mesh_3, Shader=ColourSwatch(SwatchColor=RGB(255, 69, 69)))

panel_15 = Panel(area_3.Area)
volume_2 = Volume(Geometry=geo_7)  # -> simplify(Volume), Centroid
pdecon_2 = Deconstruct(Point=volume_2.Centroid)  # -> simplify(XComponent), simplify(YComponent), simplify(ZComponent)
panel_16 = Panel(pdecon_2.XComponent)
panel_17 = Panel(pdecon_2.YComponent)
panel_18 = Panel(pdecon_2.ZComponent)

geo_11 = Geometry(simplify(geo_9))
volume_3 = Volume(Geometry=geo_11)  # -> Volume, Centroid
sort_2 = SortList(Keys=volume_3.Volume, ValuesA=geo_11, ValuesC=data_8)  # -> Keys, ValuesA, ValuesB, ValuesC, ValuesD
item_7 = ListItem(List=sort_2.ValuesC, Index=0, Wrap=True)
item_8 = ListItem(List=sort_2.ValuesA, Index=0, Wrap=True)
data_38 = Data(item_7)
data_39 = Data(item_8)

data_40 = Data(flatten(lng_7))
shape_type = Data(geometry_shapenames_2)
bnd_2 = Bounds(Numbers=data_40)
panel_19 = Panel(volume_2.Volume)
G_4 = Geometry(G_2)
item_9 = ListItem(List=G_4, Index=0, Wrap=True)
G_5 = Geometry(item_9)
G_6 = Geometry(G_5)
G_7 = Geometry(G_6)
area_4 = Area(Geometry=G_7)  # -> Area, Centroid
pt_8 = Point(area_4.Centroid)
vec2pt = Vector2Pt(PointA=pt_8, PointB=pt_6, Unitize=False)  # -> Vector, Length
data_41 = Data(vec2pt.Vector)
data_42 = Data(data_41)
cluster_2 = Cluster_3(data=data_42)
data_43 = Data(simplify(cluster_2))
panel_20 = Panel(data_27)
bnd_3 = Bounds()
panel_21 = Panel(data_40)
dedomain_2 = DeconstructDomain(Domain=bnd_2)  # -> Start, End
panel_22 = Panel(dedomain_2.End)
gradient_2 = Gradient(
    LowerLimit=dedomain_2.End,
    UpperLimit=dedomain_2.Start,
    Parameter=lng_7,
    stops=[0: RGB(99, 5, 117), 0.19: RGB(184, 0, 129), 0.364: RGB(234, 38, 0), 0.559: RGB(234, 126, 0), 0.746: RGB(254, 244, 84), 0.888: RGB(173, 203, 249), 1: RGB(140, 149, 168)])
data_44 = Data(data_38)
data_45 = Data(simplify(data_39))
data_46 = Data(simplify(data_45))
debox_2 = DeconstructBox(Box=data_46)  # -> Plane, simplify(X), simplify(Y), simplify(Z)
pdecon_3 = Deconstruct(Point=debox_2.Plane)  # -> XComponent, YComponent, ZComponent
dlength_4 = DLength(data=pdecon_3.ZComponent, I=debox_2.Z)  # -> data_6, data_5, y
dlength_5 = DLength(data=pdecon_3.YComponent, I=debox_2.Y)  # -> data_6, data_5, y
dlength_6 = DLength(data=pdecon_3.XComponent, I=debox_2.X)  # -> data_6, data_5, y
data_47 = Data(dlength_4.data_6)
data_48 = Data(data_47)
addition = Addition(A=data_48, B="0.001")
pt_9 = ConstructPoint(XCoordinate=pdecon.XComponent, YCoordinate=pdecon.YComponent, ZCoordinate=addition)
O = Origin(pt_9)
O_2 = Origin(O)
xy_2 = XYPlane(Origin=O_2)
pln_2 = Plane(xy_2)
data_49 = Data(dlength_4.y)
data_50 = Data(data_49)
data_51 = Data(dlength_5.y)
data_52 = Data(dlength_6.y)

data_53 = Data(simplify(data_45))
volume_4 = Volume(Geometry=data_53)  # -> Volume, Centroid
data_54 = Data(volume_4.Volume)

d1 = Data1(data_52)
d2 = Data2(data_51)
d1_2 = Data1(data_52)
d2_2 = Data2(data_51)
d1_3 = Data1(data_49)
d2_3 = Data2(data_51)
d1_4 = Data1(data_49)
d2_4 = Data2(data_52)
integer_division = IntegerDivision(A=d1_3, B=d2_3)
integer_division_2 = IntegerDivision(A=d1_4, B=d2_4)
integer_division_3 = IntegerDivision(A=d2_2, B=d1_2)
integer_division_4 = IntegerDivision(A=d1, B=d2)
max = Maximum(A=integer_division_4, B=integer_division_3)
data_55 = Data(integer_division)
data_56 = Data(integer_division_2)
field_titles = Panel("""Shape
Area
Volume
centroid x
centroid y 
centroid z
BB_Height
BB_Width
BB_Depth
low_slice_length
mid_slice_length
upper_slice_length""")
data_57 = Data(max)
merge_2 = Merge(
    Data2=panel_15,
    Data3=panel_19,
    Data4=panel_16,
    Data5=panel_17,
    Data6=panel_18,
    Data7=panel_11,
    Data8=panel_12,
    Data9=panel_13,
    Data10=item_6.Item,
    Data11=item_6.Item1,
    Data12=item_6.Item2)
preview_4 = CustomPreview(Geometry=geo_2, Shader=gradient_2)
data_58 = Data(data_44)
# Bounding box volume
# Orientation
data_59 = Data(data_54)
data_60 = Data(data_59)
data_61 = Data(data_60)
# Average Slice Area
data_62 = Data(data_18)
data_63 = Data(data_22)
# Volume
data_64 = Data(data_37)
data_65 = Data(data_64)
data_66 = Data(data_64)

G_8 = Geometry(G)
data_67 = Data(data_65)
area_5 = Area(Geometry=G_8)  # -> Area, Centroid
data_68 = Data(area_5.Area)
data_69 = Data(data_68)
division_2 = Division(A=data_67, B=data_69)
data_70 = Data(division_2)

data_71 = Data(data_66)
division_3 = Division(A=data_71, B=data_61)
data_72 = Data(division_3)
# Height Aspect Ratio 2
data_73 = Data(data_55)
# Height Aspect Ratio 1
data_74 = Data(data_56)
# Aspect Ratio XY
data_75 = Data(data_57)
# Eccentricity
# X, Y, Z
data_76 = Data(data_43)
# Volume / Bounding Box Volume
data_77 = Data(data_72)
# Surface Area to Volume Ratio
data_78 = Data(data_70)
# Number of Terraces
data_79 = Data(lng_7)
features_values_nate = RemoteSender(merge_2)
# Min / Max  Slice Area
panel_24 = Panel(data_63)
features_names_nate = RemoteSender(field_titles)
merge_3 = Merge(
    Data1=simplify(data_59),
    Data2=simplify(data_58),
    Data3=simplify(data_74),
    Data4=simplify(data_73),
    Data5=simplify(data_75),
    Data6=simplify(data_64),
    Data7=simplify(data_62),
    Data8=simplify(data_63),
    Data9=simplify(data_76),
    Data10=simplify(data_77),
    Data11=simplify(data_78))
data_80 = Data(merge_3)
features_values_mark = RemoteSender(data_80)
features_names_mark = RemoteReceiver()
features_values_mark_2 = RemoteReceiver(features_values_mark)
# MERGE DATA
features_names_nate_2 = RemoteReceiver(features_names_nate)
features_values_nate_2 = RemoteReceiver(features_values_nate)
merge_4 = Merge(Data1=features_names_nate_2, Data2=features_names_mark)
merge_5 = Merge(Data1=features_values_nate_2, Data2=features_values_mark_2)
features_names = RemoteSender(merge_4)
features_values = RemoteSender(merge_5)
features_values_2 = RemoteReceiver(features_values)
flip = FlipMatrix(Data=features_values_2)
bnd_4 = Bounds(Numbers=flip)  # -> flatten(Domain)
# ML Stuffs
remap = RemapNumbers(Value=features_values_2, Source=bnd_4, Target=Domain(0, 1))  # -> Mapped, Clipped
panel_25 = Panel(features_values_2)
datatree_to_tensorset = DataTreeToTensorSet(DataTree=remap.Mapped)  # "DT->TS"
item_10 = ListItem(List=features_values_2, Index=0, Wrap=True)  # -> Item, Item1, Item2, Item3
kmeans = KMeansClustering(Data=datatree_to_tensorset, Clusters=Slider(3, range=0..10), Iterations=Slider(4, range=0..100), Seed=123)  # -> Clusters, Indices
mll_stuff = RemoteSender(kmeans.Indices)
mll_stuff_2 = RemoteReceiver(mll_stuff)
geometry_shapenames_3 = RemoteReceiver(geometry_shapenames)
geometry_primitives_4 = RemoteReceiver(geometry_primitives)
features_names_2 = RemoteReceiver(features_names)
item_11 = ListItem(List=flatten(item_10.Item), Index=mll_stuff_2, Wrap=True)
item_12 = ListItem(List=flatten(item_10.Item2), Index=mll_stuff_2, Wrap=True)
item_13 = ListItem(List=flatten(item_10.Item1), Index=mll_stuff_2, Wrap=True)
item_14 = ListItem(List=flatten(geometry_shapenames_3), Index=mll_stuff_2, Wrap=True)
item_15 = ListItem(List=flatten(geometry_primitives_4), Index=mll_stuff_2, Wrap=True)
panel_26 = Panel(item_15)
geometry_primitives_5 = RemoteReceiver(geometry_primitives)
geometry = RemoteReceiver([geometry_primitives, geometry_shapenames])
# Visualization Stuffs
panel_27 = Panel(item_14)
pt_10 = Point(Point(0, 0, 0))
pt_11 = ConstructPoint(XCoordinate=item_11, YCoordinate=item_13, ZCoordinate=item_12)
panel_28 = Panel(geometry)
scale = Scale(Geometry=pt_11, Center=pt_10, Factor=Slider(0.01, range=0..0.01))  # -> Geometry, Transform
move = Move(Geometry=item_15, Motion=scale.Geometry)  # -> Geometry, Transform
merge_6 = Merge(
    Data1=ColourSwatch(SwatchColor=RGB(0, 255, 166)),
    Data2=ColourSwatch(SwatchColor=RGB(255, 215, 54)),
    Data3=ColourSwatch(SwatchColor=RGB(255, 0, 0)))  # -> graft(Result)
preview_5 = CustomPreview(Geometry=move.Geometry, Shader=merge_6)

# ----
# ToolDescription: Enter a description of this definition's functionality and use
update_file_info = Button()
group_prefixes = Panel("""out_
in_
action_
warning_
cluster""")
c_script = CSharpScript(update=color_groups_clusters, name=group_prefixes, col=col)  # -> out, A; inputs update: Boolean, name: list of String, col: list of Color
# ---------- c_script: C# ----------
    Color clusterColor = Color.Transparent;
    for(int i = 0;i < name.Count;i++){
      if(name[i].Contains("cluster")){
        clusterColor = col[i];
        break;
      }
    }



    if(update){
      List<Guid> guids = new List<Guid>();
      List<Grasshopper.Kernel.Special.GH_Group> grps = new List<Grasshopper.Kernel.Special.GH_Group>();
      List<Grasshopper.Kernel.Special.GH_Group> alreadygrps = new List<Grasshopper.Kernel.Special.GH_Group>();


      foreach(IGH_DocumentObject o in GrasshopperDocument.Objects){
        Grasshopper.Kernel.Special.GH_Group g = o as Grasshopper.Kernel.Special.GH_Group;
        if(g != null){
          for(int j = 0;j < name.Count;j++){
            if(g.NickName.ToUpper().Contains(name[j].ToUpper())){
              g.Colour = col[j % col.Count];
            }

          }
        }


        if(o is Grasshopper.Kernel.Special.GH_Cluster){
          Grasshopper.Kernel.Special.GH_Cluster cluster = o as  Grasshopper.Kernel.Special.GH_Cluster;
          string filepath = cluster.FilePath;
          if(!String.IsNullOrEmpty(filepath)){
            cluster.Name = System.IO.Path.GetFileNameWithoutExtension(filepath);
            cluster.NickName = System.IO.Path.GetFileNameWithoutExtension(filepath);
            cluster.Attributes.ExpireLayout();
          }
          guids.Add(cluster.InstanceGuid);
          Grasshopper.Kernel.Special.GH_Group grp = new Grasshopper.Kernel.Special.GH_Group();
          grps.Add(grp);

        } else if (o is Grasshopper.Kernel.Special.GH_Group){
          Grasshopper.Kernel.Special.GH_Group alreadygrp = o as Grasshopper.Kernel.Special.GH_Group;
          alreadygrps.Add(alreadygrp);
        }





      }

      List<bool> isAlreadyInGroup = IsAlreadyInGroup(guids, alreadygrps);

      for(int i = 0;i < grps.Count;i++){
        Grasshopper.Kernel.Special.GH_Group grp = grps[i];
        grp.Colour = clusterColor;
        grp.NickName = "";
        grp.AddObject(guids[i]);
        if(!isAlreadyInGroup[i]){
          grp.ExpireCaches();
          GrasshopperDocument.AddObject(grp, false, 1000);
        }
      }



    }
# ---------- c_script: C# additional code ----------
  List<bool> IsAlreadyInGroup(List<Guid> guids, List<Grasshopper.Kernel.Special.GH_Group> grps){
    List<bool> results = new List<bool>();
    foreach(Guid g in guids){
      results.Add(false);
    }
    foreach(Grasshopper.Kernel.Special.GH_Group grp in grps){ //for every group in the pre-existing groups
      if(grp.Objects().Count == 1){ //if that group only has one object in it
        for (int j = 0;j < guids.Count;j++){
          Guid g = guids[j];
          if(grp.ObjectIDs.Contains(g)){
            results[j] = true;
            break;
          }
        }
      }
    }
    return results;
  }
# ---------- end c_script ----------

data_81 = Data(update_file_info)

c_script_2 = CSharpScript(x=data_81)  # -> out, A, B, C, D, E
# ---------- c_script_2: C# ----------
    List < IGH_DocumentObject> objectsRecursive = new List<IGH_DocumentObject>();
    objectsRecursive.AddRange(clusterObjectsRecursive(GrasshopperDocument));


    B = GrasshopperDocument.Author.Name + " " + GrasshopperDocument.Author.Email;
    D = GrasshopperDocument.Properties.DateTag;
    if(GrasshopperDocument.IsFilePathDefined){
      C = GrasshopperDocument.FilePath;
      System.IO.FileInfo info = new System.IO.FileInfo(GrasshopperDocument.FilePath);
      if(info.LastWriteTime != null){
        E = info.LastWriteTime;
      } else {
        E = "";
      }
    } else {
      C = "Unsaved Document";
      E = "";
    }
    A = objectsRecursive;
# ---------- c_script_2: C# additional code ----------
  List<IGH_DocumentObject> clusterObjectsRecursive(GH_Document doc){
    List<IGH_DocumentObject> objList = new List<IGH_DocumentObject>();
    objList.AddRange(doc.Objects);
    foreach(IGH_DocumentObject obj in doc.Objects){
      Grasshopper.Kernel.Special.GH_Cluster cluster = obj as Grasshopper.Kernel.Special.GH_Cluster;
      try{
        objList.AddRange(clusterObjectsRecursive(cluster.Document("")));
      } catch {

      }
    }
    return objList;
  }
# ---------- end c_script_2 ----------
cluster_3 = Cluster_2(T=c_script_2.A, N=c_script_2.B, fn=c_script_2.C, dc=c_script_2.D, dm=c_script_2.E)
file_info = Panel(cluster_3)

# ==== cluster Cluster_2
T = ClusterInput()
N = ClusterInput()
fn = ClusterInput()
dc = ClusterInput()
dm = ClusterInput()
cluster = Cluster(T=T, N=N, fn=fn, dc=dc, dm=dm)  # -> T_2, author_2, objcount_2, fn_3, dc_4, dm_4
merge = Merge(
    Data1=cluster.author_2,
    Data2=cluster.T_2,
    Data3=cluster.objcount_2,
    Data4=cluster.fn_3,
    Data5=cluster.dc_4,
    Data6=cluster.dm_4)
R = ClusterOutput(merge)

# ==== cluster DLength: computes length of a domain
data = ClusterInput()
I = ClusterInput()
data_2 = Data(data)
dedomain = DeconstructDomain(Domain=I)  # -> Start, End
addition = Addition(A=data_2, B=dedomain.Start)
addition_2 = Addition(A=data_2, B=dedomain.End)
subtraction = Subtraction(A=dedomain.Start, B=dedomain.End)
data_3 = Data(addition)
abs = Absolute(Value=subtraction)
data_4 = Data(addition_2)
data_5 = ClusterOutput(data_4)
data_6 = ClusterOutput(data_3)
y = ClusterOutput(abs)

# ==== cluster Cluster_3
data = ClusterInput()
data_2 = Data(data)
pdecon = Deconstruct(Point=data_2)  # -> XComponent, YComponent, ZComponent
merge = Merge(Data1=pdecon.XComponent, Data2=pdecon.YComponent, Data3=pdecon.ZComponent)
data_3 = Data(merge)
data_4 = ClusterOutput(data_3)

# ==== cluster Cluster_4
C = ClusterInput()
explode = Explode(Curve=C, Recursive=True)  # -> Segments, Vertices
trim = TrimTree(Tree=explode.Vertices, Depth=1)
hull = ConvexHull(Points=trim, Plane=PlaneXY(0, 0, 0))  # -> Hull, HullZ, Indices
hz = ClusterOutput(hull.HullZ)

# ==== cluster Cluster
N = ClusterInput()
T = ClusterInput()
N_2 = Text(N)
split = TextSplit(Text=T, Separators=".")
fn = ClusterInput()
dm = ClusterInput()
item = ListItem(List=split, Index=0, Wrap=True)
dc = ClusterInput()
pan = Panel("""HDT_Reference
HDTReference""")
pan_2 = Panel("""Human
Human""")
lng = ListLength(List=T)
len = TextLength(Text=N_2)
contains = ContainsAB(B=N_2)
dm_2 = Text(dm)
dc_2 = Text(dc)
fn_2 = Text(fn)
replace = ReplaceMembers(Set=item, Find=pan, Replace=pan_2)
cset = CreateSet(List=flatten(replace))  # -> Set, Map
txt = Text(["ScriptComponents", "Grasshopper", "MathComponents", "GalapagosComponents", "FieldComponents", "VectorComponents", "AnalysisComponents", "CurveComponents", "LegacyScriptComponents", "SurfaceComponents", "TriangulationComponents", "MassXForms", "LinearXForms"])
format = Format(Format="Definition by {0}", Culture=127, Data0=N_2)
difference = SetDifference(SetA=cset.Set, SetB=txt)
lng_2 = ListLength(List=flatten(difference))
dispatch = Dispatch(List=format, DispatchPattern=contains)  # -> ListA, ListB
format_2 = Format(Format="Object Count: {0:0}", Culture=127, Data0=lng)
format_3 = Format(Format="Date Modified: {0}", Culture=127, Data0=dm_2)
format_4 = Format(Format="Date Created: {0}", Culture=127, Data0=dc_2)
dependencies = Text(flatten(difference))
author = Text(flatten(dispatch.ListB))
larger = LargerThan(FirstNumber=lng_2, SecondNumber="1")  # -> LargerThan, OrEqualTo
objcount = Text(flatten(format_2))
author_2 = ClusterOutput(author)
dm_3 = Text(flatten(format_3))
fn_3 = ClusterOutput(fn_2)
dc_3 = Text(flatten(format_4))
objcount_2 = ClusterOutput(objcount)
dc_4 = ClusterOutput(dc_3)
filter = StreamFilter(
    Gate=larger.LargerThan,
    Stream0="This definition requires the following plug-in:",
    Stream1="This definition requires the following plug-ins:")
dm_4 = ClusterOutput(dm_3)
pan_3 = Panel("""{0}
{1}""")
join = TextJoin(Text=dependencies)
format_5 = Format(Format=pan_3, Culture=127, Data0=filter, Data1=join)
clean = CleanTree(Tree=format_5, CleanInvalid=True, CleanEmpty=False)
T_2 = ClusterOutput(clean)

# ==== cluster ContainsAB: Tests if a string contains another string.
B = ClusterInput()
A = ClusterInput()
A_2 = String(A)
B_2 = String(B)
eval = Evaluate(F="Contains(x,y)", x=A_2, y=B_2)
c = Boolean(eval)
c_2 = ClusterOutput(c)
