# Grasshopper definition Mesh analysis 02.ghx (Grasshopper 0.9.76)
# plug-ins: Python Interpreter, TT Toolbox, Telepathy, Owl.GH

# ----
# NUMBER OF INDIVIDUAL PRIMITIVES
number_slider = Slider(15, range=0..100)

color_groups_clusters = Button(ExpressionNormal="True")

panel = Panel("BASE PLANE")
pln = Plane(PlaneXY(0.08767023439, 0.0884122404, 0))

num = Number(50)
range = Range(Domain=num, Steps=number_slider)
num_2 = Number(0)
cull_i = CullIndex(List=range, Indices=num_2, Wrap=True)
col = Colour([RGBA(4, 0, 255, 135), RGBA(0, 128, 255, 133), RGBA(210, 255, 148, 141), RGBA(255, 0, 0, 122), RGBA(224, 224, 224, 211)])
panel_2 = Panel(cull_i)

python = PythonScript()  # -> out, random_int
# ---------- python: Python ----------
import Rhino.Geometry as rg
import rhinoscriptsyntax as rs
import math

from random import randint
random_int = (randint(0, 100))
# ---------- end python ----------
python_2 = PythonScript()  # -> out, random_int; same code as python
python_3 = PythonScript()  # -> out, random_int; same code as python
python_4 = PythonScript()  # -> out, random_int; same code as python
python_5 = PythonScript()  # -> out, random_int; same code as python
python_6 = PythonScript()  # -> out, random_int; same code as python
python_7 = PythonScript()  # -> out, random_int; same code as python
python_8 = PythonScript()  # -> out, random_int; same code as python
# Generate Test Geo
panel_3 = Panel("RANDOMIZE SHIT")
jitter = Jitter(List=panel_2, Jitter=1, Seed=python.random_int)  # -> Values, Indices
jitter_2 = Jitter(List=panel_2, Jitter=1, Seed=python_3.random_int)  # -> Values, Indices
jitter_3 = Jitter(List=panel_2, Jitter=1, Seed=python_4.random_int)  # -> Values, Indices
jitter_4 = Jitter(List=panel_2, Jitter=1, Seed=python_5.random_int)  # -> Values, Indices
jitter_5 = Jitter(List=panel_2, Jitter=1, Seed=python_2.random_int)  # -> Values, Indices
jitter_6 = Jitter(List=panel_2, Jitter=1, Seed=python_6.random_int)  # -> Values, Indices
jitter_7 = Jitter(List=panel_2, Jitter=1, Seed=python_7.random_int)  # -> Values, Indices
jitter_8 = Jitter(List=panel_2, Jitter=1, Seed=python_8.random_int)  # -> Values, Indices

panel_4 = Panel("PRIMITIVE CREATION")
box = CenterBox(Base=pln, X=jitter_2.Values, Y=jitter_3.Values, Z=jitter_4.Values)
cone = Cone(Base=pln, Radius=jitter_7.Values, Length=jitter_8.Values)  # -> Cone, Tip
sph = Sphere(Base=pln, Radius=jitter_6.Values)
cyl = Cylinder(Base=pln, Radius=jitter.Values, Length=jitter_5.Values)

capex = CapHolesEx(Brep=sph)  # -> Brep, Caps, Solid
capex_2 = CapHolesEx(Brep=box)  # -> Brep, Caps, Solid
capex_3 = CapHolesEx(Brep=cyl)  # -> Brep, Caps, Solid
capex_4 = CapHolesEx(Brep=cone.Cone)  # -> Brep, Caps, Solid
panel_5 = Panel(capex.Brep)
panel_6 = Panel(capex_3.Brep)
panel_7 = Panel(capex_4.Brep)
panel_8 = Panel(capex_2.Brep)
entwine = Entwine(Branch00=capex_4.Brep, Branch01=capex_3.Brep, Branch02=capex_2.Brep, FlattenInputs=True)  # -> flatten(Result)
data = Data(capex_2.Brep)
data_2 = Data(capex_3.Brep)
data_3 = Data(capex_4.Brep)
lng = ListLength(List=data)
lng_2 = ListLength(List=data_2)
lng_3 = ListLength(List=data_3)
dup = DuplicateData(Data="Box", Number=lng, Order=True)  # -> flatten(Data)
dup_2 = DuplicateData(Data="Cylinder", Number=lng_2, Order=True)  # -> flatten(Data)
dup_3 = DuplicateData(Data="Cone", Number=lng_3, Order=True)  # -> flatten(Data)
merge = Merge(Data1=dup_3, Data2=dup_2, Data3=dup)
graft = GraftTree(Tree=entwine, IncludeEmptyLists=True, IncludeNullItems=True)
data_4 = Data(simplify(graft(merge)))
mesh = Mesh([<mesh referenced from the Rhino model> x46])
geometry_shapenames = RemoteSender(data_4)
geometry_primitives = RemoteSender(graft)
geometry_primitives_2 = RemoteReceiver(geometry_primitives)
geo = Geometry(simplify(graft(mesh)))
geo_2 = Geometry(geo)
data_5 = Data("5")
G = Geometry(geo)
geo_3 = Geometry(geo)
# MARK'S FEATURES
geo_4 = Geometry(geo)

geo_5 = Geometry(geo_2)
data_6 = Data(data_5)
contour = Contour(Shape=geo_5, Point=Point(0, 0, 0), Direction=Vector(0, 0, 1), Distance=data_6)  # -> simplify(Contours)
crv = Curve(contour)

area = Area(Geometry=geo_3)  # -> Area, Centroid

data_7 = Data(Slider(45, range=0..100))
range_2 = Range(Domain="0 to 90", Steps=data_7)
cull_i_2 = CullIndex(List=range_2, Indices=data_7, Wrap=True)
data_8 = Data(cull_i_2)
rad = Radians(Degrees=data_8)
data_9 = Data(rad)

crv_2 = Curve(crv)
lng_4 = ListLength(List=crv_2)
data_10 = Data(lng_4)

pt = Point(area.Centroid)
pt_2 = Point(pt)
pt_3 = Point(pt_2)
pt_4 = Point(pt_2)
pdecon = Deconstruct(Point=pt_4)  # -> XComponent, YComponent, ZComponent
geometry_primitives_3 = RemoteReceiver(geometry_primitives)

crv_3 = Curve(simplify(crv))
cluster = Cluster_4(C=crv_3)
trim = TrimTree(Tree=cluster, Depth=1)
G_2 = Geometry(trim)

geo_6 = Geometry(geo_4)
volume = Volume(Geometry=geo_6)  # -> Volume, Centroid
pt_5 = Point(volume.Centroid)
xy = XYPlane(Origin=pt_5)
prot = RotatePlane(Plane=xy, Angle=data_9)

# ---- group: input geometry
geo_7 = Geometry(geometry_primitives_3)

# ----
G_3 = Geometry(G_2)
area_2 = Area(Geometry=G_3)  # -> Area, Centroid
data_11 = Data(area_2.Area)

data_12 = Data(data_11)

L = List(data_12)
lng_5 = ListLength(List=L)
multiplication = Multiplication(A=lng_5, B=Slider(0.95, range=0..1))
B = DomainEnd(multiplication)
dom = ConstructDomain(DomainStart=0, DomainEnd=B)
subset = SubList(List=L, Domain=dom, Wrap=True)  # -> List, Index
data_13 = Data(simplify(subset.List))

pt_6 = Point(pt_3)

K = Keys(data_13)
sort = SortList(Keys=K)  # -> Keys, ValuesA
item = ListItem(List=sort.Keys, Index=0, Wrap=True)  # -> Item1, Item
item_2 = ListItem(List=sort.Keys, Index=0, Wrap=True)
data_14 = Data(item_2)
data_15 = Data(item.Item1)
division = Division(A=data_14, B=data_15)
data_16 = Data(division)

data_17 = Data(data_16)
data_18 = Data(Slider(0.2, range=0..1))
multiplication_2 = Multiplication(A=data_17, B=data_18)
data_19 = Data(multiplication_2)

data_20 = Data(simplify(data_13))
data_21 = Data(data_19)
pt_7 = ConstructPoint(XCoordinate=data_20, YCoordinate=0, ZCoordinate=0)
cullduppoints = RemoveDuplicatePoints(InputPoints=pt_7, Tolerance=data_21)  # -> OutputPoints, FirstPointIndexes
null = NullItem(Item=cullduppoints.OutputPoints)  # -> NullFlags, InvalidFlags, Description
dispatch = Dispatch(List=cullduppoints.OutputPoints, DispatchPattern=null.InvalidFlags)  # -> ListA, ListB
data_22 = Data(simplify(dispatch.ListB))

data_23 = Data(data_11)
data_24 = Data(data_5)
multiplication_3 = Multiplication(A=data_23, B=data_24)  # -> simplify(Result)
data_25 = Data(multiplication_3)

data_26 = Data(data_25)
avr = Average(Input=data_26)
data_27 = Data(avr)

geo_8 = Geometry(geo_4)
P = Plane(prot)
bbox = BoundingBox(Content=geo_8, Plane=P)  # -> Box, Box_2
trim_2 = TrimTree(Tree=bbox.Box, Depth=1)
geo_9 = Geometry(simplify(trim_2))

# ----
# NATE'S FEATURES
geometry_shapenames_2 = RemoteReceiver(geometry_shapenames)
area_3 = Area(Geometry=geo_7)  # -> simplify(Area), Centroid

lng_6 = ListLength(List=data_22)  # disabled
panel_9 = Panel("3")  # disabled
larger = LargerThan(FirstNumber=lng_6, SecondNumber=panel_9)  # -> LargerThan, OrEqualTo; disabled
data_28 = Data(larger.LargerThan)  # disabled

dispatch_2 = Dispatch(List=geo_2, DispatchPattern=data_28)  # -> ListA, ListB; disabled
mesh_2 = Mesh(dispatch_2.ListA)  # disabled
mesh_3 = Mesh(dispatch_2.ListB)  # disabled
swatch = ColourSwatch(SwatchColor=RGB(255, 69, 69))  # disabled
swatch_2 = ColourSwatch(SwatchColor=RGB(132, 0, 255))  # disabled
preview = CustomPreview(Geometry=mesh_2, Shader=swatch)  # disabled
preview_2 = CustomPreview(Geometry=mesh_3, Shader=swatch_2)  # disabled

data_29 = Data(data_14)

data_30 = Data(data_25)
ma = MassAddition(Input=data_30)  # -> Result, PartialResults
data_31 = Data(ma.Result)

bbox_2 = BoundingBox(Content=geo_7, Plane=PlaneXY(0, 0, 0))  # -> Box, Box_2
debox = DeconstructBox(Box=bbox_2.Box)  # -> Plane, simplify(X), simplify(Y), simplify(Z)
dlength = DLength(I=debox.Y)  # -> data_6, data_5, y
dlength_2 = DLength(I=debox.X)  # -> data_6, data_5, y
dlength_3 = DLength(I=debox.Z)  # -> data_6, data_5, y
panel_10 = Panel(dlength_2.y)
panel_11 = Panel(dlength.y)
panel_12 = Panel(dlength_3.y)

# ---- group: length of slice at low mid and high
panel_13 = Panel("""0.1
0.5
0.9""")
box_2 = EvaluateBox(Box=bbox_2.Box, UParameter="0", VParameter="0", WParameter=panel_13)  # -> Plane, Point, Include
sec = BrepPlane(Brep=geo_7, Plane=box_2.Plane)  # -> Curves, Points
trim_3 = TrimTree(Tree=sec.Curves, Depth=1)
len = Length(Curve=trim_3)
item_3 = ListItem(List=simplify(len), Index=0, Wrap=True)  # -> Item, Item1, Item2

# ----
panel_14 = Panel(area_3.Area)
volume_2 = Volume(Geometry=geo_7)  # -> simplify(Volume), Centroid
pdecon_2 = Deconstruct(Point=volume_2.Centroid)  # -> simplify(XComponent), simplify(YComponent), simplify(ZComponent)
panel_15 = Panel(pdecon_2.XComponent)
panel_16 = Panel(pdecon_2.YComponent)
panel_17 = Panel(pdecon_2.ZComponent)

geo_10 = Geometry(simplify(geo_9))
volume_3 = Volume(Geometry=geo_10)  # -> Volume, Centroid
sort_2 = SortList(Keys=volume_3.Volume, ValuesA=geo_10, ValuesC=data_8)  # -> Keys, ValuesA, ValuesB, ValuesC, ValuesD
item_4 = ListItem(List=sort_2.ValuesC, Index=0, Wrap=True)
item_5 = ListItem(List=sort_2.ValuesA, Index=0, Wrap=True)
data_32 = Data(item_4)
data_33 = Data(item_5)

shape_type = Data(geometry_shapenames_2)
panel_18 = Panel(volume_2.Volume)
G_4 = Geometry(G_2)
item_6 = ListItem(List=G_4, Index=0, Wrap=True)
G_5 = Geometry(item_6)
G_6 = Geometry(G_5)
G_7 = Geometry(G_6)
area_4 = Area(Geometry=G_7)  # -> Area, Centroid
pt_8 = Point(area_4.Centroid)
vec2pt = Vector2Pt(PointA=pt_8, PointB=pt_6, Unitize=False)  # -> Vector, Length
data_34 = Data(vec2pt.Vector)
data_35 = Data(data_34)
cluster_2 = Cluster_3(data=data_35)
data_36 = Data(simplify(cluster_2))
data_37 = Data(data_32)
data_38 = Data(simplify(data_33))
data_39 = Data(simplify(data_38))
debox_2 = DeconstructBox(Box=data_39)  # -> Plane, simplify(X), simplify(Y), simplify(Z)
pdecon_3 = Deconstruct(Point=debox_2.Plane)  # -> XComponent, YComponent, ZComponent
dlength_4 = DLength(data=pdecon_3.ZComponent, I=debox_2.Z)  # -> data_6, data_5, y
dlength_5 = DLength(data=pdecon_3.YComponent, I=debox_2.Y)  # -> data_6, data_5, y
dlength_6 = DLength(data=pdecon_3.XComponent, I=debox_2.X)  # -> data_6, data_5, y
data_40 = Data(dlength_4.data_6)
data_41 = Data(data_40)
addition = Addition(A=data_41, B="0.001")
pt_9 = ConstructPoint(XCoordinate=pdecon.XComponent, YCoordinate=pdecon.YComponent, ZCoordinate=addition)
O = Origin(pt_9)
O_2 = Origin(O)
xy_2 = XYPlane(Origin=O_2)
pln_2 = Plane(xy_2)
data_42 = Data(dlength_4.y)
data_43 = Data(data_42)
data_44 = Data(dlength_5.y)
data_45 = Data(dlength_6.y)

data_46 = Data(simplify(data_38))
volume_4 = Volume(Geometry=data_46)  # -> Volume, Centroid
data_47 = Data(volume_4.Volume)

d1 = Data1(data_45)
d2 = Data2(data_44)
d1_2 = Data1(data_45)
d2_2 = Data2(data_44)
d1_3 = Data1(data_42)
d2_3 = Data2(data_44)
d1_4 = Data1(data_42)
d2_4 = Data2(data_45)
integer_division = IntegerDivision(A=d1_3, B=d2_3)
integer_division_2 = IntegerDivision(A=d1_4, B=d2_4)
integer_division_3 = IntegerDivision(A=d2_2, B=d1_2)
integer_division_4 = IntegerDivision(A=d1, B=d2)
max = Maximum(A=integer_division_4, B=integer_division_3)
data_48 = Data(integer_division)
data_49 = Data(integer_division_2)
field_titles = Panel("""Shape
Area
Volume
centroid x
centroid y 
centroid z
BB_Height
BB_Width
BB_Depth
low_slice_length
mid_slice_length
upper_slice_length""")
data_50 = Data(max)
merge_2 = Merge(
    Data2=panel_14,
    Data3=panel_18,
    Data4=panel_15,
    Data5=panel_16,
    Data6=panel_17,
    Data7=panel_10,
    Data8=panel_11,
    Data9=panel_12,
    Data10=item_3.Item,
    Data11=item_3.Item1,
    Data12=item_3.Item2)
# Bounding box volume
data_51 = Data(data_47)
data_52 = Data(data_51)
data_53 = Data(data_52)
# Orientation
data_54 = Data(data_37)
# Volume
data_55 = Data(data_31)
data_56 = Data(data_55)
data_57 = Data(data_55)

data_58 = Data(data_56)
G_8 = Geometry(G)
area_5 = Area(Geometry=G_8)  # -> Area, Centroid
data_59 = Data(area_5.Area)
data_60 = Data(data_59)
division_2 = Division(A=data_58, B=data_60)
data_61 = Data(division_2)

data_62 = Data(data_57)
division_3 = Division(A=data_62, B=data_53)
data_63 = Data(division_3)
# Average Slice Area
data_64 = Data(data_27)
# Min / Max  Slice Area
data_65 = Data(data_16)
# Height Aspect Ratio 2
data_66 = Data(data_48)
# Height Aspect Ratio 1
data_67 = Data(data_49)
# Aspect Ratio XY
data_68 = Data(data_50)
# Number of Terraces
data_69 = Data(data_22)
# Eccentricity
# X, Y, Z
data_70 = Data(data_36)
# Volume / Bounding Box Volume
data_71 = Data(data_63)
# Surface Area to Volume Ratio
data_72 = Data(data_61)
features_values_nate = RemoteSender(merge_2)
panel_19 = Panel(data_65)
features_names_nate = RemoteSender(field_titles)
merge_3 = Merge(
    Data1=simplify(data_51),
    Data2=simplify(data_54),
    Data3=simplify(data_67),
    Data4=simplify(data_66),
    Data5=simplify(data_68),
    Data6=simplify(data_55),
    Data7=simplify(data_64),
    Data8=simplify(data_65),
    Data9=simplify(data_70),
    Data10=simplify(data_71),
    Data11=simplify(data_72))
data_73 = Data(merge_3)
features_values_mark = RemoteSender(data_73)
features_names_mark = RemoteReceiver()
features_values_mark_2 = RemoteReceiver(features_values_mark)
# MERGE DATA
features_names_nate_2 = RemoteReceiver(features_names_nate)
features_values_nate_2 = RemoteReceiver(features_values_nate)
merge_4 = Merge(Data1=features_names_nate_2, Data2=features_names_mark)
merge_5 = Merge(Data1=features_values_nate_2, Data2=features_values_mark_2)
features_names = RemoteSender(merge_4)
features_values = RemoteSender(merge_5)
features_values_2 = RemoteReceiver(features_values)
flip = FlipMatrix(Data=features_values_2)
bnd = Bounds(Numbers=flip)  # -> flatten(Domain)
# ML Stuffs
remap = RemapNumbers(Value=features_values_2, Source=bnd, Target=Domain(0, 1))  # -> Mapped, Clipped
panel_20 = Panel(features_values_2)
datatree_to_tensorset = DataTreeToTensorSet(DataTree=remap.Mapped)  # "DT->TS"
item_7 = ListItem(List=features_values_2, Index=0, Wrap=True)  # -> Item, Item1, Item2, Item3
kmeans = KMeansClustering(Data=datatree_to_tensorset, Clusters=Slider(3, range=0..10), Iterations=Slider(4, range=0..100), Seed=123)  # -> Clusters, Indices
mll_stuff = RemoteSender(kmeans.Indices)
mll_stuff_2 = RemoteReceiver(mll_stuff)
geometry_shapenames_3 = RemoteReceiver(geometry_shapenames)
geometry_primitives_4 = RemoteReceiver(geometry_primitives)
features_names_2 = RemoteReceiver(features_names)
item_8 = ListItem(List=flatten(item_7.Item), Index=mll_stuff_2, Wrap=True)
item_9 = ListItem(List=flatten(item_7.Item2), Index=mll_stuff_2, Wrap=True)
item_10 = ListItem(List=flatten(item_7.Item1), Index=mll_stuff_2, Wrap=True)
item_11 = ListItem(List=flatten(geometry_shapenames_3), Index=mll_stuff_2, Wrap=True)
item_12 = ListItem(List=flatten(geometry_primitives_4), Index=mll_stuff_2, Wrap=True)
panel_21 = Panel(item_12)
geometry_primitives_5 = RemoteReceiver(geometry_primitives)
geometry = RemoteReceiver([geometry_primitives, geometry_shapenames])
# Visualization Stuffs
panel_22 = Panel(item_11)
pt_10 = Point(Point(0, 0, 0))
pt_11 = ConstructPoint(XCoordinate=item_8, YCoordinate=item_10, ZCoordinate=item_9)
panel_23 = Panel(geometry)
scale = Scale(Geometry=pt_11, Center=pt_10, Factor=Slider(0.01, range=0..0.01))  # -> Geometry, Transform
move = Move(Geometry=item_12, Motion=scale.Geometry)  # -> Geometry, Transform
merge_6 = Merge(
    Data1=ColourSwatch(SwatchColor=RGB(0, 255, 166)),
    Data2=ColourSwatch(SwatchColor=RGB(255, 215, 54)),
    Data3=ColourSwatch(SwatchColor=RGB(255, 0, 0)))  # -> graft(Result)
preview_3 = CustomPreview(Geometry=move.Geometry, Shader=merge_6)

# ----
# ToolDescription: Enter a description of this definition's functionality and use
update_file_info = Button()
group_prefixes = Panel("""out_
in_
action_
warning_
cluster""")
c_script = CSharpScript(update=color_groups_clusters, name=group_prefixes, col=col)  # -> out, A; inputs update: Boolean, name: list of String, col: list of Color
# ---------- c_script: C# ----------
    Color clusterColor = Color.Transparent;
    for(int i = 0;i < name.Count;i++){
      if(name[i].Contains("cluster")){
        clusterColor = col[i];
        break;
      }
    }



    if(update){
      List<Guid> guids = new List<Guid>();
      List<Grasshopper.Kernel.Special.GH_Group> grps = new List<Grasshopper.Kernel.Special.GH_Group>();
      List<Grasshopper.Kernel.Special.GH_Group> alreadygrps = new List<Grasshopper.Kernel.Special.GH_Group>();


      foreach(IGH_DocumentObject o in GrasshopperDocument.Objects){
        Grasshopper.Kernel.Special.GH_Group g = o as Grasshopper.Kernel.Special.GH_Group;
        if(g != null){
          for(int j = 0;j < name.Count;j++){
            if(g.NickName.ToUpper().Contains(name[j].ToUpper())){
              g.Colour = col[j % col.Count];
            }

          }
        }


        if(o is Grasshopper.Kernel.Special.GH_Cluster){
          Grasshopper.Kernel.Special.GH_Cluster cluster = o as  Grasshopper.Kernel.Special.GH_Cluster;
          string filepath = cluster.FilePath;
          if(!String.IsNullOrEmpty(filepath)){
            cluster.Name = System.IO.Path.GetFileNameWithoutExtension(filepath);
            cluster.NickName = System.IO.Path.GetFileNameWithoutExtension(filepath);
            cluster.Attributes.ExpireLayout();
          }
          guids.Add(cluster.InstanceGuid);
          Grasshopper.Kernel.Special.GH_Group grp = new Grasshopper.Kernel.Special.GH_Group();
          grps.Add(grp);

        } else if (o is Grasshopper.Kernel.Special.GH_Group){
          Grasshopper.Kernel.Special.GH_Group alreadygrp = o as Grasshopper.Kernel.Special.GH_Group;
          alreadygrps.Add(alreadygrp);
        }





      }

      List<bool> isAlreadyInGroup = IsAlreadyInGroup(guids, alreadygrps);

      for(int i = 0;i < grps.Count;i++){
        Grasshopper.Kernel.Special.GH_Group grp = grps[i];
        grp.Colour = clusterColor;
        grp.NickName = "";
        grp.AddObject(guids[i]);
        if(!isAlreadyInGroup[i]){
          grp.ExpireCaches();
          GrasshopperDocument.AddObject(grp, false, 1000);
        }
      }



    }
# ---------- c_script: C# additional code ----------
  List<bool> IsAlreadyInGroup(List<Guid> guids, List<Grasshopper.Kernel.Special.GH_Group> grps){
    List<bool> results = new List<bool>();
    foreach(Guid g in guids){
      results.Add(false);
    }
    foreach(Grasshopper.Kernel.Special.GH_Group grp in grps){ //for every group in the pre-existing groups
      if(grp.Objects().Count == 1){ //if that group only has one object in it
        for (int j = 0;j < guids.Count;j++){
          Guid g = guids[j];
          if(grp.ObjectIDs.Contains(g)){
            results[j] = true;
            break;
          }
        }
      }
    }
    return results;
  }
# ---------- end c_script ----------

data_74 = Data(update_file_info)

c_script_2 = CSharpScript(x=data_74)  # -> out, A, B, C, D, E
# ---------- c_script_2: C# ----------
    List < IGH_DocumentObject> objectsRecursive = new List<IGH_DocumentObject>();
    objectsRecursive.AddRange(clusterObjectsRecursive(GrasshopperDocument));


    B = GrasshopperDocument.Author.Name + " " + GrasshopperDocument.Author.Email;
    D = GrasshopperDocument.Properties.DateTag;
    if(GrasshopperDocument.IsFilePathDefined){
      C = GrasshopperDocument.FilePath;
      System.IO.FileInfo info = new System.IO.FileInfo(GrasshopperDocument.FilePath);
      if(info.LastWriteTime != null){
        E = info.LastWriteTime;
      } else {
        E = "";
      }
    } else {
      C = "Unsaved Document";
      E = "";
    }
    A = objectsRecursive;
# ---------- c_script_2: C# additional code ----------
  List<IGH_DocumentObject> clusterObjectsRecursive(GH_Document doc){
    List<IGH_DocumentObject> objList = new List<IGH_DocumentObject>();
    objList.AddRange(doc.Objects);
    foreach(IGH_DocumentObject obj in doc.Objects){
      Grasshopper.Kernel.Special.GH_Cluster cluster = obj as Grasshopper.Kernel.Special.GH_Cluster;
      try{
        objList.AddRange(clusterObjectsRecursive(cluster.Document("")));
      } catch {

      }
    }
    return objList;
  }
# ---------- end c_script_2 ----------
cluster_3 = Cluster_2(T=c_script_2.A, N=c_script_2.B, fn=c_script_2.C, dc=c_script_2.D, dm=c_script_2.E)
file_info = Panel(cluster_3)

# ==== cluster Cluster_2
T = ClusterInput()
N = ClusterInput()
fn = ClusterInput()
dc = ClusterInput()
dm = ClusterInput()
cluster = Cluster(T=T, N=N, fn=fn, dc=dc, dm=dm)  # -> T_2, author_2, objcount_2, fn_3, dc_4, dm_4
merge = Merge(
    Data1=cluster.author_2,
    Data2=cluster.T_2,
    Data3=cluster.objcount_2,
    Data4=cluster.fn_3,
    Data5=cluster.dc_4,
    Data6=cluster.dm_4)
R = ClusterOutput(merge)

# ==== cluster DLength: computes length of a domain
data = ClusterInput()
I = ClusterInput()
data_2 = Data(data)
dedomain = DeconstructDomain(Domain=I)  # -> Start, End
addition = Addition(A=data_2, B=dedomain.Start)
addition_2 = Addition(A=data_2, B=dedomain.End)
subtraction = Subtraction(A=dedomain.Start, B=dedomain.End)
data_3 = Data(addition)
abs = Absolute(Value=subtraction)
data_4 = Data(addition_2)
data_5 = ClusterOutput(data_4)
data_6 = ClusterOutput(data_3)
y = ClusterOutput(abs)

# ==== cluster Cluster_3
data = ClusterInput()
data_2 = Data(data)
pdecon = Deconstruct(Point=data_2)  # -> XComponent, YComponent, ZComponent
merge = Merge(Data1=pdecon.XComponent, Data2=pdecon.YComponent, Data3=pdecon.ZComponent)
data_3 = Data(merge)
data_4 = ClusterOutput(data_3)

# ==== cluster Cluster_4
C = ClusterInput()
explode = Explode(Curve=C, Recursive=True)  # -> Segments, Vertices
trim = TrimTree(Tree=explode.Vertices, Depth=1)
hull = ConvexHull(Points=trim, Plane=PlaneXY(0, 0, 0))  # -> Hull, HullZ, Indices
hz = ClusterOutput(hull.HullZ)

# ==== cluster Cluster
N = ClusterInput()
T = ClusterInput()
N_2 = Text(N)
split = TextSplit(Text=T, Separators=".")
fn = ClusterInput()
dm = ClusterInput()
item = ListItem(List=split, Index=0, Wrap=True)
dc = ClusterInput()
pan = Panel("""HDT_Reference
HDTReference""")
pan_2 = Panel("""Human
Human""")
lng = ListLength(List=T)
len = TextLength(Text=N_2)
contains = ContainsAB(B=N_2)
dm_2 = Text(dm)
dc_2 = Text(dc)
fn_2 = Text(fn)
replace = ReplaceMembers(Set=item, Find=pan, Replace=pan_2)
cset = CreateSet(List=flatten(replace))  # -> Set, Map
txt = Text(["ScriptComponents", "Grasshopper", "MathComponents", "GalapagosComponents", "FieldComponents", "VectorComponents", "AnalysisComponents", "CurveComponents", "LegacyScriptComponents", "SurfaceComponents", "TriangulationComponents", "MassXForms", "LinearXForms"])
format = Format(Format="Definition by {0}", Culture=127, Data0=N_2)
difference = SetDifference(SetA=cset.Set, SetB=txt)
lng_2 = ListLength(List=flatten(difference))
dispatch = Dispatch(List=format, DispatchPattern=contains)  # -> ListA, ListB
format_2 = Format(Format="Object Count: {0:0}", Culture=127, Data0=lng)
format_3 = Format(Format="Date Modified: {0}", Culture=127, Data0=dm_2)
format_4 = Format(Format="Date Created: {0}", Culture=127, Data0=dc_2)
dependencies = Text(flatten(difference))
author = Text(flatten(dispatch.ListB))
larger = LargerThan(FirstNumber=lng_2, SecondNumber="1")  # -> LargerThan, OrEqualTo
objcount = Text(flatten(format_2))
author_2 = ClusterOutput(author)
dm_3 = Text(flatten(format_3))
fn_3 = ClusterOutput(fn_2)
dc_3 = Text(flatten(format_4))
objcount_2 = ClusterOutput(objcount)
dc_4 = ClusterOutput(dc_3)
filter = StreamFilter(
    Gate=larger.LargerThan,
    Stream0="This definition requires the following plug-in:",
    Stream1="This definition requires the following plug-ins:")
dm_4 = ClusterOutput(dm_3)
pan_3 = Panel("""{0}
{1}""")
join = TextJoin(Text=dependencies)
format_5 = Format(Format=pan_3, Culture=127, Data0=filter, Data1=join)
clean = CleanTree(Tree=format_5, CleanInvalid=True, CleanEmpty=False)
T_2 = ClusterOutput(clean)

# ==== cluster ContainsAB: Tests if a string contains another string.
B = ClusterInput()
A = ClusterInput()
A_2 = String(A)
B_2 = String(B)
eval = Evaluate(F="Contains(x,y)", x=A_2, y=B_2)
c = Boolean(eval)
c_2 = ClusterOutput(c)
