# Grasshopper definition basic geo analysis + owl-MSyp 005.ghx (Grasshopper 0.9.76)
# plug-ins: Python Interpreter, Human, LunchBox, Telepathy, Owl.GH

# ----
# NUMBER OF INDIVIDUAL PRIMITIVES
number_slider = Slider(15, range=0..100)

panel = Panel("BASE PLANE")
pln = Plane(PlaneXY(0.08767023439, 0.0884122404, 0))

num = Number(50)
range = Range(Domain=num, Steps=number_slider)
num_2 = Number(0)
cull_i = CullIndex(List=range, Indices=num_2, Wrap=True)
panel_2 = Panel(cull_i)

python = PythonScript()  # -> out, random_int
# ---------- python: Python ----------
import Rhino.Geometry as rg
import rhinoscriptsyntax as rs
import math

from random import randint
random_int = (randint(0, 100))
# ---------- end python ----------
python_2 = PythonScript()  # -> out, random_int; same code as python
python_3 = PythonScript()  # -> out, random_int; same code as python
python_4 = PythonScript()  # -> out, random_int; same code as python
python_5 = PythonScript()  # -> out, random_int; same code as python
python_6 = PythonScript()  # -> out, random_int; same code as python
python_7 = PythonScript()  # -> out, random_int; same code as python
python_8 = PythonScript()  # -> out, random_int; same code as python
# Generate Test Geo
panel_3 = Panel("RANDOMIZE SHIT")
jitter = Jitter(List=panel_2, Jitter=1, Seed=python.random_int)  # -> Values, Indices
jitter_2 = Jitter(List=panel_2, Jitter=1, Seed=python_3.random_int)  # -> Values, Indices
jitter_3 = Jitter(List=panel_2, Jitter=1, Seed=python_4.random_int)  # -> Values, Indices
jitter_4 = Jitter(List=panel_2, Jitter=1, Seed=python_5.random_int)  # -> Values, Indices
jitter_5 = Jitter(List=panel_2, Jitter=1, Seed=python_2.random_int)  # -> Values, Indices
jitter_6 = Jitter(List=panel_2, Jitter=1, Seed=python_6.random_int)  # -> Values, Indices
jitter_7 = Jitter(List=panel_2, Jitter=1, Seed=python_7.random_int)  # -> Values, Indices
jitter_8 = Jitter(List=panel_2, Jitter=1, Seed=python_8.random_int)  # -> Values, Indices

color_groups_clusters = Button(ExpressionNormal="True")

panel_4 = Panel("PRIMITIVE CREATION")
box = CenterBox(Base=pln, X=jitter_2.Values, Y=jitter_3.Values, Z=jitter_4.Values)
cone = Cone(Base=pln, Radius=jitter_7.Values, Length=jitter_8.Values)  # -> Cone, Tip
sph = Sphere(Base=pln, Radius=jitter_6.Values)
cyl = Cylinder(Base=pln, Radius=jitter.Values, Length=jitter_5.Values)

col = Colour([RGBA(4, 0, 255, 135), RGBA(0, 128, 255, 133), RGBA(210, 255, 148, 141), RGBA(255, 0, 0, 122), RGBA(224, 224, 224, 211)])
capex = CapHolesEx(Brep=sph)  # -> Brep, Caps, Solid
capex_2 = CapHolesEx(Brep=box)  # -> Brep, Caps, Solid
capex_3 = CapHolesEx(Brep=cyl)  # -> Brep, Caps, Solid
capex_4 = CapHolesEx(Brep=cone.Cone)  # -> Brep, Caps, Solid
panel_5 = Panel(capex.Brep)
panel_6 = Panel(capex_4.Brep)
panel_7 = Panel(capex_3.Brep)
panel_8 = Panel(capex_2.Brep)
entwine = Entwine(Branch00=capex_4.Brep, Branch01=capex_3.Brep, Branch02=capex_2.Brep, FlattenInputs=True)  # -> flatten(Result)
data = Data(capex_2.Brep)
data_2 = Data(capex_3.Brep)
data_3 = Data(capex_4.Brep)
lng = ListLength(List=data)
lng_2 = ListLength(List=data_2)
lng_3 = ListLength(List=data_3)
dup = DuplicateData(Data="Box", Number=lng, Order=True)  # -> flatten(Data)
dup_2 = DuplicateData(Data="Cylinder", Number=lng_2, Order=True)  # -> flatten(Data)
dup_3 = DuplicateData(Data="Cone", Number=lng_3, Order=True)  # -> flatten(Data)
number_slider_2 = Slider(0.5, range=0..1)
merge = Merge(Data1=dup_3, Data2=dup_2, Data3=dup)
jitter_9 = Jitter(List=merge, Jitter=number_slider_2, Seed=2)  # -> Values, Indices
jitter_10 = Jitter(List=entwine, Jitter=number_slider_2, Seed=2)  # -> Values, Indices
data_4 = Data(simplify(graft(jitter_9.Values)))
graft = GraftTree(Tree=jitter_10.Values, IncludeEmptyLists=True, IncludeNullItems=True)
long = LongestList(ListA=Slider(111, range=70..130), ListB=graft, PaddingMode=2)  # -> ListA, ListB
ma = MassAddition(Input=flatten(long.ListA))  # -> Result, PartialResults
volume = Volume(Geometry=long.ListB)  # -> Volume, Centroid
pt = ConstructPoint(XCoordinate=0, YCoordinate=ma.PartialResults, ZCoordinate=0)  # -> graft(Point)
geometry_shapenames = RemoteSender(data_4)
orient = Orient(Geometry=long.ListB, Source=volume.Centroid, Target=pt)  # -> Geometry, Transform
geometry_primitives = RemoteSender(orient.Geometry)
geometry_primitives_2 = RemoteReceiver(geometry_primitives)
brep = Brep(simplify(geometry_primitives_2))
geometry_primitives_3 = RemoteReceiver(geometry_primitives)
brep_2 = Brep(brep)
brep_3 = Brep(brep)
brep_4 = Brep(brep)
brep_5 = Brep(brep)

# ---- group: input geometry
geo = Geometry(geometry_primitives_3)

# ----
vmoments = VolumeMoments(Geometry=brep_4)  # -> simplify(Volume), simplify(Centroid), simplify(Inertia), simplify(InertiaError), simplify(Secondary), simplify(SecondaryError), simplify(Gyration)
debrep = DeconstructBrep(Brep=brep_3)  # -> simplify(Faces), simplify(Edges), simplify(Vertices)
bbox = BoundingBox(Content=brep_5, Plane=PlaneXY(0, 0, 0))  # -> Box, Box_2
debrep_2 = DeconstructBrep(Brep=brep_2)  # -> Faces, Edges, Vertices
brep_6 = Brep(bbox.Box_2)
brep_7 = Brep(debrep_2.Faces)
data_5 = Data(vmoments.Secondary)
lng_4 = ListLength(List=debrep.Vertices)
lng_5 = ListLength(List=debrep.Faces)
lng_6 = ListLength(List=debrep.Edges)
volume_2 = Volume(Geometry=geo)  # -> simplify(Volume), Centroid
area = Area(Geometry=brep_7)  # -> Area, Centroid
volume_3 = Volume(Geometry=brep_5)  # -> Volume, Centroid
volume_4 = Volume(Geometry=brep_6)  # -> Volume, Centroid
data_6 = Data(lng_4)
data_7 = Data(lng_5)
data_8 = Data(lng_6)
pdecon = Deconstruct(Point=area.Centroid)  # -> XComponent, YComponent, ZComponent
data_9 = Data(volume_3.Volume)
data_10 = Data(volume_4.Volume)
data_11 = Data(pdecon.ZComponent)
bbox_2 = BoundingBox(Content=volume_2.Centroid, Plane=PlaneXY(0, 0, 0))  # -> Box, Box_2
# MARK'S FEATURES
volume_5 = Volume(Geometry=brep_2)  # -> Volume, Centroid
division = Division(A=data_10, B=data_9)
sort = SortList(Keys=data_11, ValuesA=data_11, ValuesB=brep_7, ValuesC=area.Centroid)  # -> Keys, ValuesA, ValuesB, ValuesC
bbox_3 = BoundingBox(Content=geo, Plane=PlaneXY(0, 0, 0))  # -> Box, Box_2

# ---- group: length of slice at low mid and high
panel_9 = Panel("""0.1
0.5
0.9""")
box_2 = EvaluateBox(Box=bbox_3.Box, UParameter="0", VParameter="0", WParameter=panel_9)  # -> Plane, Point, Include
sec = BrepPlane(Brep=geo, Plane=box_2.Plane)  # -> Curves, Points
trim = TrimTree(Tree=sec.Curves, Depth=1)
len = Length(Curve=trim)
item = ListItem(List=simplify(len), Index=0, Wrap=True)  # -> Item, Item1, Item2

# ----
box_3 = EvaluateBox(Box=bbox_2.Box, UParameter=0.5, VParameter=0.5, WParameter=0.5)  # -> Plane, Point, Include
# NATE'S FEATURES
area_2 = Area(Geometry=geo)  # -> simplify(Area), Centroid
data_12 = Data(division)
item_2 = ListItem(List=sort.ValuesC, Index=0, Wrap=True)
debox = DeconstructBox(Box=bbox_3.Box)  # -> Plane, simplify(X), simplify(Y), simplify(Z)
relative = RelativeCoordinates(Plane=box_3.Plane, Point=box_3.Point)  # -> RelativePoint, RelativeX, RelativeY, RelativeZ
pt_2 = Point(volume_5.Centroid)
pt_3 = Point(item_2)
dlength = DLength(I=debox.Y)
dlength_2 = DLength(I=debox.Z)
pdecon_2 = Deconstruct(Point=relative.RelativePoint)  # -> simplify(XComponent), simplify(YComponent), simplify(ZComponent)
dlength_3 = DLength(I=debox.X)
vec2pt = Vector2Pt(PointA=pt_3, PointB=pt_2, Unitize=False)  # -> Vector, Length
panel_10 = Panel(dlength_3)
panel_11 = Panel(dlength)
panel_12 = Panel(dlength_2)
panel_13 = Panel(volume_2.Volume)
panel_14 = Panel(area_2.Area)
panel_15 = Panel(pdecon_2.XComponent)
panel_16 = Panel(pdecon_2.YComponent)
panel_17 = Panel(pdecon_2.ZComponent)
data_13 = Data(vec2pt.Vector)
data_14 = Data(data_5)
data_15 = Data(data_13)
cluster = Cluster_3(data=data_14)
cluster_2 = Cluster_3(data=data_15)
data_16 = Data(simplify(cluster))
data_17 = Data(simplify(data_7))
data_18 = Data(simplify(data_8))
data_19 = Data(simplify(data_6))
data_20 = Data(simplify(data_12))
data_21 = Data(simplify(cluster_2))
field_titles = Panel("""Area
Volume
centroid x
centroid y 
centroid z
BB_Height
BB_Width
BB_Depth
low_slice_length
mid_slice_length
upper_slice_length
slice_ratio""")
string_name = Panel("Shape")
eval = Evaluate(F="z/y + z/x + y/z + y/x + x/z + x/y", x=item.Item, y=item.Item1, z=item.Item2)
merge_2 = Merge(Data1=data_21, Data2=data_16, Data3=data_17, Data4=data_18, Data5=data_19, Data6=data_20)
merge_3 = Merge(
    Data2=panel_14,
    Data3=panel_13,
    Data4=panel_15,
    Data5=panel_16,
    Data6=panel_17,
    Data7=panel_10,
    Data8=panel_11,
    Data9=panel_12,
    Data10=item.Item,
    Data11=item.Item1,
    Data12=item.Item2,
    Data13=eval)
data_22 = Data(merge_2)
features_values_nate = RemoteSender(merge_3)
features_values_mark = RemoteSender(data_22)
# [second moment of inertia]
# Ixx
# Iyy
# Izy
panel_18 = Panel(data_16)
panel_19 = Panel(data_21)
features_names_nate = RemoteSender(field_titles)
panel_20 = Panel("""x
y
z
lxx
lyy
lzy
num_faces
num_edges
num_vertices
vol-bb_ratio""")
# [brep topology]
# number of faces
# number of edges
# number of vertexs
panel_21 = Panel(data_18)
panel_22 = Panel(data_19)
# volume/ bb volume ratio
panel_23 = Panel(data_20)
panel_24 = Panel(data_17)
# [eccentricity]
# x
# y
# z
features_names_mark = RemoteSender(panel_20)
features_names_mark_2 = RemoteReceiver(features_names_mark)
features_values_mark_2 = RemoteReceiver(features_values_mark)
# MERGE DATA
features_names_nate_2 = RemoteReceiver(features_names_nate)
features_values_nate_2 = RemoteReceiver(features_values_nate)
merge_4 = Merge(Data1=features_names_nate_2, Data2=features_names_mark_2)
merge_5 = Merge(Data1=features_values_nate_2, Data2=features_values_mark_2)
geometry_primitives_4 = RemoteReceiver(geometry_primitives)
features_names = RemoteSender(merge_4)
features_values = RemoteSender(merge_5)
geometry_shapenames_2 = RemoteReceiver(geometry_shapenames)
# ADD METADATA
panel_25 = Panel("Shape")
bakeud = BakeWithUserData(geometry=geometry_primitives_4, field_names=features_names, field_values=features_values, clear=True)
bakeud_2 = BakeWithUserData(geometry=bakeud, field_names=panel_25, field_values=geometry_shapenames_2, clear=False)
geometry_withdata = RemoteSender(bakeud_2)
# ML Stuffs
features_values_2 = RemoteReceiver(features_values)
flip = FlipMatrix(Data=features_values_2)
bnd = Bounds(Numbers=flip)  # -> flatten(Domain)
remap = RemapNumbers(Value=features_values_2, Source=bnd, Target=Domain(0, 1))  # -> Mapped, Clipped
datatree_to_tensorset = DataTreeToTensorSet(DataTree=remap.Mapped)  # "DT->TS"
kmeans = KMeansClustering(Data=datatree_to_tensorset, Clusters=Slider(3, range=0..10), Iterations=Slider(100, range=0..7300), Seed=123)  # -> Clusters, Indices
mll_stuff = RemoteSender(kmeans.Indices)
mll_stuff_2 = RemoteReceiver(mll_stuff)
geometry_withdata_2 = RemoteReceiver(geometry_withdata)
merge_6 = Merge(
    Data1=ColourSwatch(SwatchColor=RGB(0, 255, 166)),
    Data2=ColourSwatch(SwatchColor=RGB(255, 215, 54)),
    Data3=ColourSwatch(SwatchColor=RGB(213, 61, 255)))  # -> graft(Result)
item_3 = ListItem(List=flatten(geometry_withdata_2), Index=mll_stuff_2, Wrap=True)
readud = ReadUserData(geometry=item_3)  # -> field_names_2, field_values_2
# Visualization Stuffs
geometry = RemoteReceiver([geometry_primitives, geometry_shapenames, geometry_withdata])
keysearch = KeyValueSearch(Keys=readud.field_names_2, Values=readud.field_values_2, Search="Shape")
panel_26 = Panel(geometry)
long_2 = LongestList(ListA=item_3, ListB=merge_6, PaddingMode=2)  # -> flatten(ListA), flatten(ListB)
mll_stuff_3 = RemoteReceiver(mll_stuff)
pshift = ShiftPaths(Data=keysearch, Offset=-1)
geometry_shapenames_3 = RemoteReceiver(geometry_shapenames)
features_names_2 = RemoteReceiver(features_names)
preview = CustomPreview(Geometry=flatten(long_2.ListA), Shader=long_2.ListB)
cset = CreateSet(List=pshift)  # -> Set, Map
item_4 = ListItem(List=flatten(geometry_shapenames_3), Index=mll_stuff_2, Wrap=True)
mindex = MemberIndex(Set=pshift, Member=cset.Set)  # -> Index, Count
sort_2 = SortList(Keys=mindex.Count, ValuesA=cset.Set)  # -> Keys, reverse(ValuesA)
item_5 = ListItem(List=sort_2.ValuesA, Index=0, Wrap=True)
panel_27 = Panel(item_4)
tmatch = MatchText(Text=pshift, Pattern=item_5, Case=True)  # -> graft(Match)
wires = BrepWireframe(Density=-1)
cull = CullPattern(List=wires, CullPattern=invert(tmatch))
previewlw = CustomPreviewLineweights(Geometry=cull, Shader=ColourSwatch(SwatchColor=RGB(255, 0, 0)), Thickness=Slider(8, range=0..10), Absolute=False)

# ----
# ToolDescription: Enter a description of this definition's functionality and use
update_file_info = Button()
group_prefixes = Panel("""out_
in_
action_
warning_
cluster""")
c_script = CSharpScript(update=color_groups_clusters, name=group_prefixes, col=col)  # -> out, A; inputs update: Boolean, name: list of String, col: list of Color
# ---------- c_script: C# ----------
    Color clusterColor = Color.Transparent;
    for(int i = 0;i < name.Count;i++){
      if(name[i].Contains("cluster")){
        clusterColor = col[i];
        break;
      }
    }



    if(update){
      List<Guid> guids = new List<Guid>();
      List<Grasshopper.Kernel.Special.GH_Group> grps = new List<Grasshopper.Kernel.Special.GH_Group>();
      List<Grasshopper.Kernel.Special.GH_Group> alreadygrps = new List<Grasshopper.Kernel.Special.GH_Group>();


      foreach(IGH_DocumentObject o in GrasshopperDocument.Objects){
        Grasshopper.Kernel.Special.GH_Group g = o as Grasshopper.Kernel.Special.GH_Group;
        if(g != null){
          for(int j = 0;j < name.Count;j++){
            if(g.NickName.ToUpper().Contains(name[j].ToUpper())){
              g.Colour = col[j % col.Count];
            }

          }
        }


        if(o is Grasshopper.Kernel.Special.GH_Cluster){
          Grasshopper.Kernel.Special.GH_Cluster cluster = o as  Grasshopper.Kernel.Special.GH_Cluster;
          string filepath = cluster.FilePath;
          if(!String.IsNullOrEmpty(filepath)){
            cluster.Name = System.IO.Path.GetFileNameWithoutExtension(filepath);
            cluster.NickName = System.IO.Path.GetFileNameWithoutExtension(filepath);
            cluster.Attributes.ExpireLayout();
          }
          guids.Add(cluster.InstanceGuid);
          Grasshopper.Kernel.Special.GH_Group grp = new Grasshopper.Kernel.Special.GH_Group();
          grps.Add(grp);

        } else if (o is Grasshopper.Kernel.Special.GH_Group){
          Grasshopper.Kernel.Special.GH_Group alreadygrp = o as Grasshopper.Kernel.Special.GH_Group;
          alreadygrps.Add(alreadygrp);
        }





      }

      List<bool> isAlreadyInGroup = IsAlreadyInGroup(guids, alreadygrps);

      for(int i = 0;i < grps.Count;i++){
        Grasshopper.Kernel.Special.GH_Group grp = grps[i];
        grp.Colour = clusterColor;
        grp.NickName = "";
        grp.AddObject(guids[i]);
        if(!isAlreadyInGroup[i]){
          grp.ExpireCaches();
          GrasshopperDocument.AddObject(grp, false, 1000);
        }
      }



    }
# ---------- c_script: C# additional code ----------
  List<bool> IsAlreadyInGroup(List<Guid> guids, List<Grasshopper.Kernel.Special.GH_Group> grps){
    List<bool> results = new List<bool>();
    foreach(Guid g in guids){
      results.Add(false);
    }
    foreach(Grasshopper.Kernel.Special.GH_Group grp in grps){ //for every group in the pre-existing groups
      if(grp.Objects().Count == 1){ //if that group only has one object in it
        for (int j = 0;j < guids.Count;j++){
          Guid g = guids[j];
          if(grp.ObjectIDs.Contains(g)){
            results[j] = true;
            break;
          }
        }
      }
    }
    return results;
  }
# ---------- end c_script ----------

data_23 = Data(update_file_info)

c_script_2 = CSharpScript(x=data_23)  # -> out, A, B, C, D, E
# ---------- c_script_2: C# ----------
    List < IGH_DocumentObject> objectsRecursive = new List<IGH_DocumentObject>();
    objectsRecursive.AddRange(clusterObjectsRecursive(GrasshopperDocument));


    B = GrasshopperDocument.Author.Name + " " + GrasshopperDocument.Author.Email;
    D = GrasshopperDocument.Properties.DateTag;
    if(GrasshopperDocument.IsFilePathDefined){
      C = GrasshopperDocument.FilePath;
      System.IO.FileInfo info = new System.IO.FileInfo(GrasshopperDocument.FilePath);
      if(info.LastWriteTime != null){
        E = info.LastWriteTime;
      } else {
        E = "";
      }
    } else {
      C = "Unsaved Document";
      E = "";
    }
    A = objectsRecursive;
# ---------- c_script_2: C# additional code ----------
  List<IGH_DocumentObject> clusterObjectsRecursive(GH_Document doc){
    List<IGH_DocumentObject> objList = new List<IGH_DocumentObject>();
    objList.AddRange(doc.Objects);
    foreach(IGH_DocumentObject obj in doc.Objects){
      Grasshopper.Kernel.Special.GH_Cluster cluster = obj as Grasshopper.Kernel.Special.GH_Cluster;
      try{
        objList.AddRange(clusterObjectsRecursive(cluster.Document("")));
      } catch {

      }
    }
    return objList;
  }
# ---------- end c_script_2 ----------
cluster_3 = Cluster_2(T=c_script_2.A, N=c_script_2.B, fn=c_script_2.C, dc=c_script_2.D, dm=c_script_2.E)
file_info = Panel(cluster_3)

# ==== cluster Cluster_2
T = ClusterInput()
N = ClusterInput()
fn = ClusterInput()
dc = ClusterInput()
dm = ClusterInput()
cluster = Cluster(T=T, N=N, fn=fn, dc=dc, dm=dm)  # -> T_2, author_2, objcount_2, fn_3, dc_4, dm_4
merge = Merge(
    Data1=cluster.author_2,
    Data2=cluster.T_2,
    Data3=cluster.objcount_2,
    Data4=cluster.fn_3,
    Data5=cluster.dc_4,
    Data6=cluster.dm_4)
R = ClusterOutput(merge)

# ==== cluster DLength: computes length of a domain
I = ClusterInput()
dedomain = DeconstructDomain(Domain=I)  # -> Start, End
subtraction = Subtraction(A=dedomain.Start, B=dedomain.End)
abs = Absolute(Value=subtraction)
y = ClusterOutput(abs)

# ==== cluster Cluster_3
data = ClusterInput()
data_2 = Data(data)
pdecon = Deconstruct(Point=data_2)  # -> XComponent, YComponent, ZComponent
smaller = SmallerThan(FirstNumber=pdecon.YComponent, SecondNumber=0.1)  # -> SmallerThan, OrEqualTo
num = Number("0")
p_n_c = PickNChoose(Pattern=smaller.SmallerThan, Stream0=pdecon.YComponent, Stream1=num)
merge = Merge(Data1=pdecon.XComponent, Data2=p_n_c, Data3=pdecon.ZComponent)
data_3 = Data(merge)
data_4 = ClusterOutput(data_3)

# ==== cluster BakeWithUserData: Bake geometry with associated user data. You can embed Rhino geometry with an arbitrary amount of additional data which can be retrieved at a later time. Options to clear the dictionary with each refresh.
clear = ClusterInput()  # Clear user dictionaries on each refresh (prevents build-up of unwanted KV pairs over multiple iterations). Defaults to true.
field_names = ClusterInput()  # The field names - or keys - associated with the data you're embedding. You can use this to later retrieve data from your geometry. For example, a field name might be "Color" while a field value is "Red".
bake = ClusterInput()  # Set to true to bake geometry with user data.
geometry = ClusterInput()  # Geometry to bake
field_values = ClusterInput()  # The values of the data you're embedding. This data can be retrieved later from your geometry. For example, a field name might be "Color" while a field value is "Red".
object_attributes = ClusterInput()  # The optional object attributes to use when baking. Use an "Object Attributes" component from Human to construct these, including layer name, color, and other properties.
bake_2 = Boolean(bake)
geo = Geometry(geometry)
fn = Text(field_names)
att = Data(object_attributes)
bool = Boolean(clear)
fv = Text(field_values)
bakeuserdict = BakeWithUserDictionary(bake=bake_2, G=geo, FN=fn, FV=fv, att=att, clear=bool)  # -> out, A; inputs bake: Boolean, G: GeometryBase, FN: list of String, FV: list of String, clear: Boolean
# ---------- bakeuserdict: C# ----------
    ObjectAttributes oAtt = att as ObjectAttributes;
    if(oAtt == null) oAtt = RhinoDocument.CreateDefaultAttributes();
    if(clear){
      G.UserDictionary.Clear();
    }
    for(int i = 0;i < FN.Count;i++){
      G.UserDictionary.Set(FN[i], FV[i]);
    }
    if(bake){
      RhinoDocument.Objects.Add(G, oAtt);
    }
    A = G;
# ---------- end bakeuserdict ----------
G = Geometry(bakeuserdict.A)
geometry_2 = ClusterOutput(G)  # Geometry with embedded data.

# ==== cluster ReadUserData: Reads embedded user data from a piece of geometry. Data can be embedded in geometry with the Bake User Data component.
geometry = ClusterInput()  # Geometry that has been embedded with User Data. The Bake User Data component can create this kind of geometry.
field_filter = ClusterInput()  # Optional Filter, if you want to retrieve a particular field from the geometry's data.
geo = Geometry(geometry)
filter = Text(field_filter)
readuser_data = CSharpScript(G=geo)  # -> out, A, B; inputs G: GeometryBase
# ---------- readuser_data: C# ----------
    A = G.UserDictionary.Keys;
    B = G.UserDictionary.Values;
# ---------- end readuser_data ----------
fsim = FindSimilarMember(Data=filter, Set=readuser_data.A)  # -> Hit, Index
item = ListItem(List=readuser_data.B, Index=fsim.Index, Wrap=True)
backup = BackupData(priority_data=fsim.Hit, secondary_data=readuser_data.A)
backup_2 = BackupData(priority_data=item, secondary_data=readuser_data.B)
field_names = Text(backup)
field_values = Text(backup_2)
field_names_2 = ClusterOutput(field_names)  # The names of the fields embedded in the geometry.
field_values_2 = ClusterOutput(field_values)  # The data values embedded in the geometry.

# ==== cluster Cluster
N = ClusterInput()
T = ClusterInput()
N_2 = Text(N)
split = TextSplit(Text=T, Separators=".")
fn = ClusterInput()
dm = ClusterInput()
item = ListItem(List=split, Index=0, Wrap=True)
dc = ClusterInput()
pan = Panel("""HDT_Reference
HDTReference""")
pan_2 = Panel("""Human
Human""")
lng = ListLength(List=T)
len = TextLength(Text=N_2)
contains = ContainsAB(B=N_2)
dm_2 = Text(dm)
dc_2 = Text(dc)
fn_2 = Text(fn)
replace = ReplaceMembers(Set=item, Find=pan, Replace=pan_2)
cset = CreateSet(List=flatten(replace))  # -> Set, Map
txt = Text(["ScriptComponents", "Grasshopper", "MathComponents", "GalapagosComponents", "FieldComponents", "VectorComponents", "AnalysisComponents", "CurveComponents", "LegacyScriptComponents", "SurfaceComponents", "TriangulationComponents", "MassXForms", "LinearXForms"])
format = Format(Format="Definition by {0}", Culture=127, Data0=N_2)
difference = SetDifference(SetA=cset.Set, SetB=txt)
lng_2 = ListLength(List=flatten(difference))
dispatch = Dispatch(List=format, DispatchPattern=contains)  # -> ListA, ListB
format_2 = Format(Format="Object Count: {0:0}", Culture=127, Data0=lng)
format_3 = Format(Format="Date Modified: {0}", Culture=127, Data0=dm_2)
format_4 = Format(Format="Date Created: {0}", Culture=127, Data0=dc_2)
dependencies = Text(flatten(difference))
author = Text(flatten(dispatch.ListB))
larger = LargerThan(FirstNumber=lng_2, SecondNumber="1")  # -> LargerThan, OrEqualTo
objcount = Text(flatten(format_2))
author_2 = ClusterOutput(author)
dm_3 = Text(flatten(format_3))
fn_3 = ClusterOutput(fn_2)
dc_3 = Text(flatten(format_4))
objcount_2 = ClusterOutput(objcount)
dc_4 = ClusterOutput(dc_3)
filter = StreamFilter(
    Gate=larger.LargerThan,
    Stream0="This definition requires the following plug-in:",
    Stream1="This definition requires the following plug-ins:")
dm_4 = ClusterOutput(dm_3)
pan_3 = Panel("""{0}
{1}""")
join = TextJoin(Text=dependencies)
format_5 = Format(Format=pan_3, Culture=127, Data0=filter, Data1=join)
clean = CleanTree(Tree=format_5, CleanInvalid=True, CleanEmpty=False)
T_2 = ClusterOutput(clean)

# ==== cluster BackupData: Passes the list without nulls
secondary_data = ClusterInput()
priority_data = ClusterInput()
null = NullItem(
    A=null.ResultA,
    InternalDocument_plugin_version=(0, 9, 76),
    InternalDocument_DocumentHeader_PreviewMeshType=1,
    InternalDocument_DocumentHeader_PreviewNormal=RGBA(150, 0, 0, 100),
    InternalDocument_DocumentHeader_PreviewSelected=RGBA(0, 120, 0, 100),
    InternalDocument_DefinitionProperties_Projection_Zoom=1.25)  # -> A, A_2
priority_data_2 = Data([priority_data, null.A_2])
secondary_data_2 = Data(secondary_data)
clean = CleanTree(Tree=priority_data_2, CleanInvalid=True, CleanEmpty=False)
lng = ListLength(List=clean)
null_2 = NullItem(Items=clean)  # -> NullFlags, InvalidFlags
equals = Equality(FirstNumber="0", SecondNumber=lng)  # -> Equality, Inequality
clean_2 = CleanTree(Data=clean, CleanInvalid=True, CleanEmpty=False)
not = GateNot(A=null_2.NullFlags)
ma = MassAddition(Input=flatten(not))  # -> Result, PartialResult
bool = Boolean(ma.Result)
filter = StreamFilter(Gate=bool, Stream0=secondary_data_2, Stream1=clean_2)
data = Data(filter)
data_2 = ClusterOutput(data)

# ==== cluster ContainsAB: Tests if a string contains another string.
B = ClusterInput()
A = ClusterInput()
A_2 = String(A)
B_2 = String(B)
eval = Evaluate(F="Contains(x,y)", x=A_2, y=B_2)
c = Boolean(eval)
c_2 = ClusterOutput(c)
