# Grasshopper definition basic geo analysis + owl-MSyp 007.ghx (Grasshopper 0.9.76)
# plug-ins: Python Interpreter, treesloth01, Human, LunchBox, MetaHopper, TT Toolbox, Telepathy, Owl.GH

# ----
# NUMBER OF INDIVIDUAL PRIMITIVES
number_slider = Slider(100, range=0..100)

panel = Panel("BASE PLANE")
pln = Plane(PlaneXY(0.08767023439, 0.0884122404, 0))

num = Number(50)
range = Range(Domain=num, Steps=number_slider)
num_2 = Number(0)
geometry = GeometryPipeline(
    GroupByLayer=False,
    GroupByType=False,
    IncludeHidden=True,
    IncludeLocked=True,
    LayerFilter="Geometry",
    NameFilter="*",
    TypeFilter=1073741880)
cull_i = CullIndex(List=range, Indices=num_2, Wrap=True)
geoattrib = GetGeometryAttributes(Geometry=geometry)  # -> GeometryNames, GUID, Layer
geometry_meshes = RemoteSender(geometry)
panel_2 = Panel(cull_i)
geometry_bins = RemoteSender(geoattrib.GeometryNames)

python = PythonScript()  # -> out, random_int
# ---------- python: Python ----------
import Rhino.Geometry as rg
import rhinoscriptsyntax as rs
import math

from random import randint
random_int = (randint(0, 100))
# ---------- end python ----------
python_2 = PythonScript()  # -> out, random_int; same code as python
python_3 = PythonScript()  # -> out, random_int; same code as python
python_4 = PythonScript()  # -> out, random_int; same code as python
python_5 = PythonScript()  # -> out, random_int; same code as python
python_6 = PythonScript()  # -> out, random_int; same code as python
python_7 = PythonScript()  # -> out, random_int; same code as python
python_8 = PythonScript()  # -> out, random_int; same code as python
# Generate Test Geo
panel_3 = Panel("RANDOMIZE SHIT")
jitter = Jitter(List=panel_2, Jitter=1, Seed=python.random_int)  # -> Values, Indices
jitter_2 = Jitter(List=panel_2, Jitter=1, Seed=python_3.random_int)  # -> Values, Indices
jitter_3 = Jitter(List=panel_2, Jitter=1, Seed=python_4.random_int)  # -> Values, Indices
jitter_4 = Jitter(List=panel_2, Jitter=1, Seed=python_5.random_int)  # -> Values, Indices
jitter_5 = Jitter(List=panel_2, Jitter=1, Seed=python_2.random_int)  # -> Values, Indices
jitter_6 = Jitter(List=panel_2, Jitter=1, Seed=python_6.random_int)  # -> Values, Indices
jitter_7 = Jitter(List=panel_2, Jitter=1, Seed=python_7.random_int)  # -> Values, Indices
jitter_8 = Jitter(List=panel_2, Jitter=1, Seed=python_8.random_int)  # -> Values, Indices

geometry_meshes_2 = RemoteReceiver(geometry_meshes)
geometry_bins_2 = RemoteReceiver(geometry_bins)
color_groups_clusters = Button(ExpressionNormal="True")
geo = Geometry(geometry_meshes_2)

# ---- group: create dodecahedron points
relpath = RelativePath(Path="dodecahedron.csv")
file = ReadFile(File=relpath, PerLineParse=True)
csv = ReadCSV(CSVString=file, Delimiter=",")  # -> Headers, Values
flip = FlipMatrix(Data=csv.Values)
item = ListItem(List=flip, Index="0", Wrap=True)
item_2 = ListItem(List=flip, Index="1", Wrap=True)
item_3 = ListItem(List=flip, Index="2", Wrap=True)
pt = ConstructPoint(XCoordinate=item, YCoordinate=item_2, ZCoordinate=item_3)

# ----
panel_4 = Panel("PRIMITIVE CREATION")
box = CenterBox(Base=pln, X=jitter_2.Values, Y=jitter_3.Values, Z=jitter_4.Values)
cone = Cone(Base=pln, Radius=jitter_7.Values, Length=jitter_8.Values)  # -> Cone, Tip
sph = Sphere(Base=pln, Radius=jitter_6.Values)
cyl = Cylinder(Base=pln, Radius=jitter.Values, Length=jitter_5.Values)

col = Colour([RGBA(4, 0, 255, 135), RGBA(0, 128, 255, 133), RGBA(210, 255, 148, 141), RGBA(255, 0, 0, 122), RGBA(224, 224, 224, 211)])
capex = CapHolesEx(Brep=sph)  # -> Brep, Caps, Solid
capex_2 = CapHolesEx(Brep=box)  # -> Brep, Caps, Solid
capex_3 = CapHolesEx(Brep=cyl)  # -> Brep, Caps, Solid
capex_4 = CapHolesEx(Brep=cone.Cone)  # -> Brep, Caps, Solid
panel_5 = Panel(capex.Brep)
panel_6 = Panel(capex_4.Brep)
panel_7 = Panel(capex_3.Brep)
panel_8 = Panel(capex_2.Brep)
demesh = DeconstructMesh(Mesh=geo)  # -> Vertices, Faces, Colours, Normals
volume = Volume(Geometry=geo)  # -> Volume, Centroid
geo_2 = Geometry(demesh.Vertices)
move = Move(Geometry=pt, Motion=volume.Centroid)  # -> Geometry, Transform
cullpt = CullDuplicates(Points=move.Geometry, Tolerance=0.1, CullMode=3)  # -> Points, Indices, Valence
entwine = Entwine(Branch00=capex_4.Brep, Branch01=capex_3.Brep, Branch02=capex_2.Brep, FlattenInputs=True)  # -> flatten(Result)
bbox = BoundingBox(Content=geo, Plane=PlaneXY(0, 0, 0))  # -> Box, Box_2
dist = Distance(PointA=volume.Centroid, PointB=geo_2)
flip_2 = FlipMatrix(Data=cullpt.Points)
debrep = DeconstructBrep(Brep=bbox.Box)  # -> Faces, Edges, Vertices

# ---- group: cpt
geo_3 = Geometry(volume.Centroid)

# ----
data = Data(capex_2.Brep)
data_2 = Data(capex_3.Brep)
data_3 = Data(capex_4.Brep)
python_9 = PythonScript(sphere_tree_in=flip_2, cpt_lst_in=geo_3, bound_srf_lst_in=debrep.Faces)  # -> ray_tree, header_lst; inputs sphere_tree_in: tree, cpt_lst_in: list, bound_srf_lst_in: tree
# ---------- python_9: Python ----------
import rhinoscriptsyntax as rs
import Rhino as rc
import scriptcontext as sc
#import ghpythonlib as gh
import Grasshopper as gh

""" Calculate View Factor

"""
class ViewFactor(object):
    def __init__(self):
        self.sphere_nested = []
        self.cpt = []
        self.bound_nested = []
        self.bld_num = None
        self.ray_num = None
        # Outputs
        self.raycast_distance = None
        self.raycast_pt_x = None
        self.raycast_pt_y = None
        self.raycast_pt_z = None

    def process_raw_inputs(self,sphere_tree_in,bound_srf_lst_in,cpt_lst_in):
        self.cpt = map(lambda c: rs.coerce3dpoint(c), cpt_lst_in)
        # convert tree to nested list of sphere pts
        for i in range(sphere_tree_in.BranchCount):
            branchList = sphere_tree_in.Branch(i)
            self.sphere_nested.append(branchList)

        # convert tree to nested list of bound srfs
        for i in range(bound_srf_lst_in.BranchCount):
            branchList = bound_srf_lst_in.Branch(i)
            branchList = map(lambda s: rs.coercebrep(s), branchList)
            self.bound_nested.append(branchList)

        # convert guids to rc points
        for i in xrange(len(self.sphere_nested)):
            sphere_per_bld = list(self.sphere_nested[i])
            for j in xrange(len(sphere_per_bld)):
                sphere_per_bld[j] = rs.coerce3dpoint(sphere_per_bld[j])
            self.sphere_nested[i] = sphere_per_bld

        self.bld_num = len(self.sphere_nested)
        self.ray_num = len(self.sphere_nested[0])

    def ray_cast(self):
        """
        base_vector
        direction_vector
        srf2int
        """
        self.ray_int_nested = []
        self.ray_dist_nested = []

        for i in xrange(self.bld_num):
            raypts = []
            raydist = []
            for j in xrange(self.ray_num):
                srf2int_lst = self.bound_nested[i]
                r0 = self.cpt[i] #base_vector
                r1 = self.sphere_nested[i][j] #direction_vector
                #convert pts to vectors
                r1 = rc.Geometry.Vector3d(r1) - rc.Geometry.Vector3d(r0)

                ray = rc.Geometry.Ray3d(r0,r1)
                point_intersect_lst = rc.Geometry.Intersect.Intersection.RayShoot(ray,srf2int_lst,1)
                if point_intersect_lst:
                    point_intersect_lst = list(point_intersect_lst)
                    rpt = point_intersect_lst[0]
                    raypts.append(rpt)
                    raydist.append(rs.Distance(rpt,r0))
                    #rc.Geometry.Vector3d.Multiply(
            self.ray_dist_nested.append(raydist)
            self.ray_int_nested.append(raypts)
        #print len(self.ray_int_nested)
    def generate_viewfactor_matrix(self):
        # flip the matrix
        self.raycast_distance = map(lambda r: [None] * self.ray_num, [None] * self.bld_num)

        self.raycast_x = map(lambda r: [None] * self.ray_num, [None] * self.bld_num)
        self.raycast_y = map(lambda r: [None] * self.ray_num, [None] * self.bld_num)
        self.raycast_z = map(lambda r: [None] * self.ray_num, [None] * self.bld_num)
        self.ray_mtx = []

        self.header_lst = []
        for ri in xrange(self.ray_num):
            hstr = "RAY_{b}_".format(b=ri)
            self.header_lst.extend([hstr+"dist",hstr+"x",hstr+"y",hstr+"z"])
        print len(self.header_lst)
        print self.header_lst
        for i in xrange(self.bld_num):
            self.bld_lst = []
            for j in xrange(self.ray_num):
                d = self.ray_dist_nested[i][j]
                x = self.ray_int_nested[i][j][0]
                y = self.ray_int_nested[i][j][1]
                z = self.ray_int_nested[i][j][2]

                self.bld_lst.extend([d,x,y,z])

                #self.ray_dist_nested[i][j]
                #self.raycast_distance[i][j]
            self.ray_mtx.append(self.bld_lst)
    def pythonListTGhDataTree(self,pythonList):
        """ Converts a  nested Python list to a GH datatree """
        # Create GH datatree
        dataTree = gh.DataTree[object]()

        # Add pythonlist sub lists to dataTree
        for i,l in enumerate(pythonList):
            for v in l:
                dataTree.Add(v,gh.Kernel.Data.GH_Path(i))

        return dataTree
vf = ViewFactor()
vf.process_raw_inputs(sphere_tree_in, bound_srf_lst_in, cpt_lst_in)
vf.ray_cast()
vf.generate_viewfactor_matrix()

header_lst = vf.header_lst
ray_tree = vf.pythonListTGhDataTree(vf.ray_mtx)
#header_tree
print len(vf.ray_mtx)
print len(vf.bld_lst)

#sphere_out = vf.sphere_nested
#cpt_out = vf.cpt




ray_out = reduce(lambda x,y: x+y, vf.ray_int_nested)
# ---------- end python_9 ----------
lng = ListLength(List=data)

# ---- group: find farthest vertex
sort = SortList(Keys=dist)  # -> Keys, ValuesA
rev = ReverseList(List=sort.Keys)
item_4 = ListItem(List=rev, Index=0, Wrap=True)

# ----
lng_2 = ListLength(List=data_2)
lng_3 = ListLength(List=data_3)

# ---- group: vertexDistanceMean
avr = Average(Input=dist)

# ----
dup = DuplicateData(Data="Box", Number=lng, Order=True)  # -> flatten(Data)
dup_2 = DuplicateData(Data="Cylinder", Number=lng_2, Order=True)  # -> flatten(Data)
dup_3 = DuplicateData(Data="Cone", Number=lng_3, Order=True)  # -> flatten(Data)
path_mapper = PathMapper(python_9.ray_tree, source="{A}", target="{0;A}")
number_slider_2 = Slider(0.5, range=0..1)
merge = Merge(Data1=dup_3, Data2=dup_2, Data3=dup)

mindex = MemberIndex(Set=dist, Member=item_4)  # -> Index, Count
item_5 = ListItem(List=mindex.Index, Index=0, Wrap=True)
item_6 = ListItem(List=geo_2, Index=item_5, Wrap=True)
pdecon = Deconstruct(Point=item_6)  # -> simplify(XComponent), simplify(YComponent), simplify(ZComponent)

jitter_9 = Jitter(List=merge, Jitter=number_slider_2, Seed=2)  # -> Values, Indices
jitter_10 = Jitter(List=entwine, Jitter=number_slider_2, Seed=2)  # -> Values, Indices
data_4 = Data(simplify(graft(jitter_9.Values)))
graft = GraftTree(Tree=jitter_10.Values, IncludeEmptyLists=True, IncludeNullItems=True)
path_mapper_2 = PathMapper(pdecon.XComponent, source="{A}", target="{0;A}")
path_mapper_3 = PathMapper(pdecon.YComponent, source="{a}", target="{0;a}")
path_mapper_4 = PathMapper(pdecon.ZComponent, source="{a}", target="{0;a}")
merge_2 = Merge(
    Data1="vertexDistanceMean",
    Data2="vertexFarthestDistance",
    Data3="vertexFarthestX",
    Data4="vertexFarthestY",
    Data5="vertexFarthestZ")
long = LongestList(ListA=Slider(111, range=70..130), ListB=graft, PaddingMode=2)  # -> ListA, ListB
merge_3 = Merge(Data1=avr, Data2=item_4, Data3=path_mapper_2, Data4=path_mapper_3, Data5=path_mapper_4)
path_mapper_5 = PathMapper(merge_2, source="{A}", target="{0;A}")
ma = MassAddition(Input=flatten(long.ListA))  # -> Result, PartialResults
volume_2 = Volume(Geometry=long.ListB)  # -> Volume, Centroid
merge_4 = Merge(Data1=path_mapper_5, Data2=python_9.header_lst)  # -> simplify(Result)
merge_5 = Merge(Data1=merge_3, Data2=path_mapper)  # -> simplify(Result)
pt_2 = ConstructPoint(XCoordinate=0, YCoordinate=ma.PartialResults, ZCoordinate=0)  # -> graft(Point)
shift = ShiftPaths(Data=merge_4, Offset=-1)
orient = Orient(Geometry=long.ListB, Source=volume_2.Centroid, Target=pt_2)  # -> Geometry, Transform
geometry_shapenames = RemoteSender("Building")
features_values_viewfactor = RemoteSender(merge_5)
geometry_primitives = RemoteSender(orient.Geometry)
features_names_viewfactor = RemoteSender(shift)
geometry_meshes_3 = RemoteReceiver(graft(geometry_meshes))
data_5 = Data("5")
mesh = Mesh(geometry_meshes_3)
geo_4 = Geometry(simplify(mesh))
geo_5 = Geometry(geo_4)

geo_6 = Geometry(geo_5)
data_6 = Data(data_5)
contour = Contour(Shape=geo_6, Point=Point(0, 0, 0), Direction=Vector(0, 0, 1), Distance=data_6)  # -> simplify(Contours)
crv = Curve(contour)

geo_7 = Geometry(geo_4)
geo_8 = Geometry(geo_4)

crv_2 = Curve(simplify(crv))
cluster = Cluster_4(C=crv_2)
trim = TrimTree(Tree=cluster, Depth=1)
G = Geometry(trim)

area = Area(Geometry=geo_7)  # -> Area, Centroid

data_7 = Data(Slider(45, range=0..100))
range_2 = Range(Domain="0 to 90", Steps=data_7)
cull_i_2 = CullIndex(List=range_2, Indices=data_7, Wrap=True)
data_8 = Data(cull_i_2)
rad = Radians(Degrees=data_8)
data_9 = Data(rad)

geometry_meshes_4 = RemoteReceiver(graft(geometry_meshes))
pt_3 = Point(area.Centroid)
geometry_primitives_2 = RemoteReceiver(geometry_primitives)
pt_4 = Point(pt_3)

G_2 = Geometry(G)
area_2 = Area(Geometry=G_2)  # -> Area, Centroid
data_10 = Data(area_2.Area)

K = Keys(data_10)
sort_2 = SortList(Keys=K)  # -> Keys, ValuesA
item_7 = ListItem(List=sort_2.Keys, Index=0, Wrap=True)  # -> Item1, Item
item_8 = ListItem(List=sort_2.Keys, Index=0, Wrap=True)
data_11 = Data(item_8)
data_12 = Data(item_7.Item1)
division = Division(A=data_11, B=data_12)
data_13 = Data(division)

# ---- group: input geometry
geo_9 = Geometry(geometry_meshes_4)

# ----
geo_10 = Geometry(geo_8)
volume_3 = Volume(Geometry=geo_10)  # -> Volume, Centroid
pt_5 = Point(volume_3.Centroid)
xy = XYPlane(Origin=pt_5)
prot = RotatePlane(Plane=xy, Angle=data_9)

data_14 = Data(data_10)
data_15 = Data(data_5)
multiplication = Multiplication(A=data_14, B=data_15)  # -> simplify(Result)
data_16 = Data(multiplication)

volume_4 = Volume(Geometry=geo_9)  # -> simplify(Volume), Centroid

data_17 = Data(data_16)
avr_2 = Average(Input=data_17)
data_18 = Data(avr_2)

bbox_2 = BoundingBox(Content=volume_4.Centroid, Plane=PlaneXY(0, 0, 0))  # -> Box, Box_2
pt_6 = Point(pt_4)
G_3 = Geometry(geo_4)
pdecon_2 = Deconstruct(Point=pt_6)  # -> XComponent, YComponent, ZComponent
bbox_3 = BoundingBox(Content=geo_9, Plane=PlaneXY(0, 0, 0))  # -> Box, Box_2
box_2 = EvaluateBox(Box=bbox_2.Box, UParameter=0.5, VParameter=0.5, WParameter=0.5)  # -> Plane, Point, Include
pt_7 = Point(pt_4)
# NATE'S FEATURES
area_3 = Area(Geometry=geo_9)  # -> simplify(Area), Centroid

data_19 = Data(data_16)
ma_2 = MassAddition(Input=data_19)  # -> Result, PartialResults
data_20 = Data(ma_2.Result)

debox = DeconstructBox(Box=bbox_3.Box)  # -> Plane, simplify(X), simplify(Y), simplify(Z)
relative = RelativeCoordinates(Plane=box_2.Plane, Point=box_2.Point)  # -> RelativePoint, RelativeX, RelativeY, RelativeZ

geo_11 = Geometry(geo_8)
P = Plane(prot)
bbox_4 = BoundingBox(Content=geo_11, Plane=P)  # -> Box, Box_2
trim_2 = TrimTree(Tree=bbox_4.Box, Depth=1)
geo_12 = Geometry(simplify(trim_2))

dlength = DLength(I=debox.Y)
dlength_2 = DLength(I=debox.Z)
pdecon_3 = Deconstruct(Point=relative.RelativePoint)  # -> simplify(XComponent), simplify(YComponent), simplify(ZComponent)
dlength_3 = DLength(I=debox.X)
panel_9 = Panel(dlength_3)
panel_10 = Panel(dlength)
panel_11 = Panel(dlength_2)
pt_8 = Point(pt_7)
panel_12 = Panel(volume_4.Volume)
panel_13 = Panel(area_3.Area)
panel_14 = Panel(pdecon_3.XComponent)
panel_15 = Panel(pdecon_3.YComponent)
panel_16 = Panel(pdecon_3.ZComponent)
G_4 = Geometry(G)
item_9 = ListItem(List=G_4, Index=0, Wrap=True)
G_5 = Geometry(item_9)
G_6 = Geometry(G_5)
G_7 = Geometry(G_6)
area_4 = Area(Geometry=G_7)  # -> Area, Centroid
pt_9 = Point(area_4.Centroid)
vec2pt = Vector2Pt(PointA=pt_9, PointB=pt_8, Unitize=False)  # -> Vector, Length
data_21 = Data(vec2pt.Vector)

geo_13 = Geometry(simplify(geo_12))
volume_5 = Volume(Geometry=geo_13)  # -> Volume, Centroid
sort_3 = SortList(Keys=volume_5.Volume, ValuesA=geo_13, ValuesC=data_8)  # -> Keys, ValuesA, ValuesB, ValuesC, ValuesD
item_10 = ListItem(List=sort_3.ValuesC, Index=0, Wrap=True)
item_11 = ListItem(List=sort_3.ValuesA, Index=0, Wrap=True)
data_22 = Data(item_10)
data_23 = Data(item_11)

data_24 = Data(data_21)
cluster_2 = Cluster_3(data=data_24)
string_name = Panel("Shape")
field_titles = Panel("""Area
Volume
centroid y 
centroid z
low_slice_length
mid_slice_length
upper_slice_length
slice_ratio""")
data_25 = Data(data_22)
data_26 = Data(simplify(cluster_2))
data_27 = Data(simplify(data_23))
data_28 = Data(simplify(data_27))
debox_2 = DeconstructBox(Box=data_28)  # -> Plane, simplify(X), simplify(Y), simplify(Z)
pdecon_4 = Deconstruct(Point=debox_2.Plane)  # -> XComponent, YComponent, ZComponent
dlength_4 = DLength_2(data=pdecon_4.ZComponent, I=debox_2.Z)  # -> data_6, data_5, y
dlength_5 = DLength_2(data=pdecon_4.YComponent, I=debox_2.Y)  # -> data_6, data_5, y
dlength_6 = DLength_2(data=pdecon_4.XComponent, I=debox_2.X)  # -> data_6, data_5, y
data_29 = Data(dlength_4.data_6)
data_30 = Data(data_29)
addition = Addition(A=data_30, B="0.001")
data_31 = Data(dlength_4.y)
data_32 = Data(dlength_5.y)
data_33 = Data(dlength_6.y)
pt_10 = ConstructPoint(XCoordinate=pdecon_2.XComponent, YCoordinate=pdecon_2.YComponent, ZCoordinate=addition)
O = Origin(pt_10)
O_2 = Origin(O)
xy_2 = XYPlane(Origin=O_2)
pln_2 = Plane(xy_2)

data_34 = Data(simplify(data_27))
volume_6 = Volume(Geometry=data_34)  # -> Volume, Centroid
data_35 = Data(volume_6.Volume)

d1 = Data1(data_33)
d2 = Data2(data_32)
d1_2 = Data1(data_33)
d2_2 = Data2(data_32)
d1_3 = Data1(data_31)
d2_3 = Data2(data_32)
d1_4 = Data1(data_31)
d2_4 = Data2(data_33)
integer_division = IntegerDivision(A=d1_3, B=d2_3)
integer_division_2 = IntegerDivision(A=d1_4, B=d2_4)
integer_division_3 = IntegerDivision(A=d2_2, B=d1_2)
integer_division_4 = IntegerDivision(A=d1, B=d2)
max = Maximum(A=integer_division_4, B=integer_division_3)
data_36 = Data(integer_division_2)
data_37 = Data(integer_division)
data_38 = Data(max)
# Volume
data_39 = Data(data_20)
data_40 = Data(data_39)
data_41 = Data(data_39)

data_42 = Data(data_40)
G_8 = Geometry(G_3)
area_5 = Area(Geometry=G_8)  # -> Area, Centroid
data_43 = Data(area_5.Area)
data_44 = Data(data_43)
division_2 = Division(A=data_42, B=data_44)
data_45 = Data(division_2)

data_46 = Data(data_41)
# Min / Max  Slice Area
data_47 = Data(data_13)
# Orientation
data_48 = Data(simplify(data_25))
# Average Slice Area
data_49 = Data(data_18)
# Height Aspect Ratio 2
data_50 = Data(data_37)
# Aspect Ratio XY
data_51 = Data(data_38)
# Height Aspect Ratio 1
data_52 = Data(data_36)
# Bounding box volume
data_53 = Data(data_35)
data_54 = Data(data_53)
data_55 = Data(data_54)
division_3 = Division(A=data_46, B=data_55)
data_56 = Data(division_3)
# Eccentricity
# X, Y, Z
data_57 = Data(data_26)
# Volume / Bounding Box Volume
data_58 = Data(data_56)
# Surface Area to Volume Ratio
data_59 = Data(data_45)
features_names_nate = RemoteSender(field_titles)
panel_17 = Panel("""Orientation
Height Aspect Ratio X
Height Aspect Ratio Y
Aspect Ratio XY
Volume
Average Slice Area
Min / Max  Slice Area
Eccentricity X
Eccentricity Y
Eccentricity Z
Volume / Bounding Box Volume
Surface Area to Volume Ratio""")
merge_6 = Merge(
    Data1=data_53,
    Data2=data_48,
    Data3=data_52,
    Data4=data_50,
    Data5=data_51,
    Data6=data_39,
    Data7=data_49,
    Data8=data_47,
    Data9=data_57,
    Data10=data_58,
    Data11=data_59)
data_60 = Data(merge_6)
features_values_mark = RemoteSender(data_60)
features_names_mark = RemoteSender(panel_17)
features_names_viewfactor_2 = RemoteReceiver(features_names_viewfactor)
features_values_viewfactor_2 = RemoteReceiver(features_values_viewfactor)
features_names_mark_2 = RemoteReceiver(features_names_mark)
# MERGE DATA
features_names_nate_2 = RemoteReceiver(features_names_nate)
features_values_mark_2 = RemoteReceiver(features_values_mark)
merge_7 = Merge(Data1=features_names_nate_2, Data2=features_names_mark_2, Data3=features_names_viewfactor_2)
geometry_primitives_3 = RemoteReceiver(geometry_primitives)  # disabled
geometry_meshes_5 = RemoteReceiver(graft(geometry_meshes))
features_names = RemoteSender(merge_7)
geometry_shapenames_2 = RemoteReceiver(geometry_shapenames)
merge_8 = Merge(
    Data1=ColourSwatch(SwatchColor=RGB(10, 255, 71)),
    Data2=ColourSwatch(SwatchColor=RGB(255, 215, 54)),
    Data3=ColourSwatch(SwatchColor=RGB(213, 61, 255)),
    Data4=ColourSwatch(SwatchColor=RGB(61, 213, 255)),
    Data5=ColourSwatch(SwatchColor=RGB(68, 61, 255)))  # -> graft(Result)
# Visualization Stuffs
features_names_2 = RemoteReceiver(features_names)
geometry_shapenames_3 = RemoteReceiver(geometry_shapenames)
wires = BrepWireframe(Density=-1)

# ----
# ToolDescription: Enter a description of this definition's functionality and use
update_file_info = Button()
group_prefixes = Panel("""out_
in_
action_
warning_
cluster""")
c_script = CSharpScript(update=color_groups_clusters, name=group_prefixes, col=col)  # -> out, A; inputs update: Boolean, name: list of String, col: list of Color
# ---------- c_script: C# ----------
    Color clusterColor = Color.Transparent;
    for(int i = 0;i < name.Count;i++){
      if(name[i].Contains("cluster")){
        clusterColor = col[i];
        break;
      }
    }



    if(update){
      List<Guid> guids = new List<Guid>();
      List<Grasshopper.Kernel.Special.GH_Group> grps = new List<Grasshopper.Kernel.Special.GH_Group>();
      List<Grasshopper.Kernel.Special.GH_Group> alreadygrps = new List<Grasshopper.Kernel.Special.GH_Group>();


      foreach(IGH_DocumentObject o in GrasshopperDocument.Objects){
        Grasshopper.Kernel.Special.GH_Group g = o as Grasshopper.Kernel.Special.GH_Group;
        if(g != null){
          for(int j = 0;j < name.Count;j++){
            if(g.NickName.ToUpper().Contains(name[j].ToUpper())){
              g.Colour = col[j % col.Count];
            }

          }
        }


        if(o is Grasshopper.Kernel.Special.GH_Cluster){
          Grasshopper.Kernel.Special.GH_Cluster cluster = o as  Grasshopper.Kernel.Special.GH_Cluster;
          string filepath = cluster.FilePath;
          if(!String.IsNullOrEmpty(filepath)){
            cluster.Name = System.IO.Path.GetFileNameWithoutExtension(filepath);
            cluster.NickName = System.IO.Path.GetFileNameWithoutExtension(filepath);
            cluster.Attributes.ExpireLayout();
          }
          guids.Add(cluster.InstanceGuid);
          Grasshopper.Kernel.Special.GH_Group grp = new Grasshopper.Kernel.Special.GH_Group();
          grps.Add(grp);

        } else if (o is Grasshopper.Kernel.Special.GH_Group){
          Grasshopper.Kernel.Special.GH_Group alreadygrp = o as Grasshopper.Kernel.Special.GH_Group;
          alreadygrps.Add(alreadygrp);
        }





      }

      List<bool> isAlreadyInGroup = IsAlreadyInGroup(guids, alreadygrps);

      for(int i = 0;i < grps.Count;i++){
        Grasshopper.Kernel.Special.GH_Group grp = grps[i];
        grp.Colour = clusterColor;
        grp.NickName = "";
        grp.AddObject(guids[i]);
        if(!isAlreadyInGroup[i]){
          grp.ExpireCaches();
          GrasshopperDocument.AddObject(grp, false, 1000);
        }
      }



    }
# ---------- c_script: C# additional code ----------
  List<bool> IsAlreadyInGroup(List<Guid> guids, List<Grasshopper.Kernel.Special.GH_Group> grps){
    List<bool> results = new List<bool>();
    foreach(Guid g in guids){
      results.Add(false);
    }
    foreach(Grasshopper.Kernel.Special.GH_Group grp in grps){ //for every group in the pre-existing groups
      if(grp.Objects().Count == 1){ //if that group only has one object in it
        for (int j = 0;j < guids.Count;j++){
          Guid g = guids[j];
          if(grp.ObjectIDs.Contains(g)){
            results[j] = true;
            break;
          }
        }
      }
    }
    return results;
  }
# ---------- end c_script ----------

data_61 = Data(update_file_info)

c_script_2 = CSharpScript(x=data_61)  # -> out, A, B, C, D, E
# ---------- c_script_2: C# ----------
    List < IGH_DocumentObject> objectsRecursive = new List<IGH_DocumentObject>();
    objectsRecursive.AddRange(clusterObjectsRecursive(GrasshopperDocument));


    B = GrasshopperDocument.Author.Name + " " + GrasshopperDocument.Author.Email;
    D = GrasshopperDocument.Properties.DateTag;
    if(GrasshopperDocument.IsFilePathDefined){
      C = GrasshopperDocument.FilePath;
      System.IO.FileInfo info = new System.IO.FileInfo(GrasshopperDocument.FilePath);
      if(info.LastWriteTime != null){
        E = info.LastWriteTime;
      } else {
        E = "";
      }
    } else {
      C = "Unsaved Document";
      E = "";
    }
    A = objectsRecursive;
# ---------- c_script_2: C# additional code ----------
  List<IGH_DocumentObject> clusterObjectsRecursive(GH_Document doc){
    List<IGH_DocumentObject> objList = new List<IGH_DocumentObject>();
    objList.AddRange(doc.Objects);
    foreach(IGH_DocumentObject obj in doc.Objects){
      Grasshopper.Kernel.Special.GH_Cluster cluster = obj as Grasshopper.Kernel.Special.GH_Cluster;
      try{
        objList.AddRange(clusterObjectsRecursive(cluster.Document("")));
      } catch {

      }
    }
    return objList;
  }
# ---------- end c_script_2 ----------
cluster_3 = Cluster_2(T=c_script_2.A, N=c_script_2.B, fn=c_script_2.C, dc=c_script_2.D, dm=c_script_2.E)
file_info = Panel(cluster_3)

# ---- group: length of slice at low mid and high
panel_18 = Panel("""0.1
0.5
0.9""")
box_3 = EvaluateBox(Box=bbox_3.Box, UParameter="0", VParameter="0", WParameter=panel_18)  # -> Plane, Point, Include

# ----
sec = MeshPlane(Mesh=geo_9, Plane=box_3.Plane)

# ---- group: length of slice at low mid and high (continued)
trim_3 = TrimTree(Tree=sec, Depth=1)
len = Length(Curve=trim_3)
item_12 = ListItem(List=simplify(len), Index=0, Wrap=True)  # -> Item, Item1, Item2

# ----
eval = Evaluate(F="z/y + z/x + y/z + y/x + x/z + x/y", x=item_12.Item, y=item_12.Item1, z=item_12.Item2)
merge_9 = Merge(
    Data2=panel_13,
    Data4=panel_14,
    Data5=panel_15,
    Data6=panel_16,
    Data10=item_12.Item,
    Data11=item_12.Item1,
    Data12=item_12.Item2,
    Data13=eval)
features_values_nate = RemoteSender(merge_9)
features_values_nate_2 = RemoteReceiver(features_values_nate)
merge_10 = Merge(Data1=features_values_nate_2, Data2=features_values_mark_2, Data3=features_values_viewfactor_2)
features_values = RemoteSender(merge_10)
# ADD METADATA
bakeud = BakeWithUserData(geometry=geometry_meshes_5, field_names=features_names, field_values=features_values, clear=True)
bakeud_2 = BakeWithUserData(geometry=bakeud, field_names="Shape", field_values=geometry_shapenames_2, clear=False)
geometry_withdata = RemoteSender(bakeud_2)
# ML Stuffs
features_values_2 = RemoteReceiver(features_values)
flip_3 = FlipMatrix(Data=features_values_2)
bnd = Bounds(Numbers=flip_3)  # -> flatten(Domain)
remap = RemapNumbers(Value=features_values_2, Source=bnd, Target=Domain(0, 1))  # -> Mapped, Clipped
datatree_to_tensorset = DataTreeToTensorSet(DataTree=remap.Mapped)  # "DT->TS"
kmeans = KMeansClustering(Data=datatree_to_tensorset, Clusters=Slider(5, range=0..10), Iterations=Slider(100, range=0..7300), Seed=66)  # -> Clusters, Indices
mll_stuff = RemoteSender(kmeans.Indices)
mll_stuff_2 = RemoteReceiver(mll_stuff)
geometry_withdata_2 = RemoteReceiver(geometry_withdata)
item_13 = ListItem(List=flatten(geometry_withdata_2), Index=mll_stuff_2, Wrap=True)
readud = ReadUserData(geometry=item_13)  # -> field_names_2, field_values_2
keysearch = KeyValueSearch(Keys=readud.field_names_2, Values=readud.field_values_2, Search="Shape")
long_2 = LongestList(ListA=item_13, ListB=merge_8, PaddingMode=2)  # -> flatten(ListA), flatten(ListB)
mll_stuff_3 = RemoteReceiver(mll_stuff)
pshift = ShiftPaths(Data=keysearch, Offset=-1)
mcol = MeshColours(Mesh=long_2.ListA, Colours=long_2.ListB)
preview = CustomPreview(Geometry=flatten(long_2.ListA), Shader=long_2.ListB)
cset = CreateSet(List=pshift)  # -> Set, Map
item_14 = ListItem(List=flatten(geometry_shapenames_3), Index=mll_stuff_2, Wrap=True)
mindex_2 = MemberIndex(Set=pshift, Member=cset.Set)  # -> Index, Count
sort_4 = SortList(Keys=mindex_2.Count, ValuesA=cset.Set)  # -> Keys, reverse(ValuesA)
item_15 = ListItem(List=sort_4.ValuesA, Index=0, Wrap=True)
panel_19 = Panel(item_14)
tmatch = MatchText(Text=pshift, Pattern=item_15, Case=True)  # -> graft(Match)
cull = CullPattern(List=wires, CullPattern=invert(tmatch))
previewlw = CustomPreviewLineweights(Geometry=cull, Shader=ColourSwatch(SwatchColor=RGB(255, 0, 0)), Thickness=Slider(8, range=0..10), Absolute=False)

# ==== cluster Cluster_2
T = ClusterInput()
N = ClusterInput()
fn = ClusterInput()
dc = ClusterInput()
dm = ClusterInput()
cluster = Cluster(T=T, N=N, fn=fn, dc=dc, dm=dm)  # -> T_2, author_2, objcount_2, fn_3, dc_4, dm_4
merge = Merge(
    Data1=cluster.author_2,
    Data2=cluster.T_2,
    Data3=cluster.objcount_2,
    Data4=cluster.fn_3,
    Data5=cluster.dc_4,
    Data6=cluster.dm_4)
R = ClusterOutput(merge)

# ==== cluster DLength: computes length of a domain
I = ClusterInput()
dedomain = DeconstructDomain(Domain=I)  # -> Start, End
subtraction = Subtraction(A=dedomain.Start, B=dedomain.End)
abs = Absolute(Value=subtraction)
y = ClusterOutput(abs)

# ==== cluster BakeWithUserData: Bake geometry with associated user data. You can embed Rhino geometry with an arbitrary amount of additional data which can be retrieved at a later time. Options to clear the dictionary with each refresh.
clear = ClusterInput()  # Clear user dictionaries on each refresh (prevents build-up of unwanted KV pairs over multiple iterations). Defaults to true.
field_names = ClusterInput()  # The field names - or keys - associated with the data you're embedding. You can use this to later retrieve data from your geometry. For example, a field name might be "Color" while a field value is "Red".
bake = ClusterInput()  # Set to true to bake geometry with user data.
geometry = ClusterInput()  # Geometry to bake
field_values = ClusterInput()  # The values of the data you're embedding. This data can be retrieved later from your geometry. For example, a field name might be "Color" while a field value is "Red".
object_attributes = ClusterInput()  # The optional object attributes to use when baking. Use an "Object Attributes" component from Human to construct these, including layer name, color, and other properties.
bake_2 = Boolean(bake)
geo = Geometry(geometry)
fn = Text(field_names)
att = Data(object_attributes)
bool = Boolean(clear)
fv = Text(field_values)
bakeuserdict = BakeWithUserDictionary(bake=bake_2, G=geo, FN=fn, FV=fv, att=att, clear=bool)  # -> out, A; inputs bake: Boolean, G: GeometryBase, FN: list of String, FV: list of String, clear: Boolean
# ---------- bakeuserdict: C# ----------
    ObjectAttributes oAtt = att as ObjectAttributes;
    if(oAtt == null) oAtt = RhinoDocument.CreateDefaultAttributes();
    if(clear){
      G.UserDictionary.Clear();
    }
    for(int i = 0;i < FN.Count;i++){
      G.UserDictionary.Set(FN[i], FV[i]);
    }
    if(bake){
      RhinoDocument.Objects.Add(G, oAtt);
    }
    A = G;
# ---------- end bakeuserdict ----------
G = Geometry(bakeuserdict.A)
geometry_2 = ClusterOutput(G)  # Geometry with embedded data.

# ==== cluster ReadUserData: Reads embedded user data from a piece of geometry. Data can be embedded in geometry with the Bake User Data component.
geometry = ClusterInput()  # Geometry that has been embedded with User Data. The Bake User Data component can create this kind of geometry.
field_filter = ClusterInput()  # Optional Filter, if you want to retrieve a particular field from the geometry's data.
geo = Geometry(geometry)
filter = Text(field_filter)
readuser_data = CSharpScript(G=geo)  # -> out, A, B; inputs G: GeometryBase
# ---------- readuser_data: C# ----------
    A = G.UserDictionary.Keys;
    B = G.UserDictionary.Values;
# ---------- end readuser_data ----------
fsim = FindSimilarMember(Data=filter, Set=readuser_data.A)  # -> Hit, Index
item = ListItem(List=readuser_data.B, Index=fsim.Index, Wrap=True)
backup = BackupData(priority_data=fsim.Hit, secondary_data=readuser_data.A)
backup_2 = BackupData(priority_data=item, secondary_data=readuser_data.B)
field_names = Text(backup)
field_values = Text(backup_2)
field_names_2 = ClusterOutput(field_names)  # The names of the fields embedded in the geometry.
field_values_2 = ClusterOutput(field_values)  # The data values embedded in the geometry.

# ==== cluster DLength_2: computes length of a domain
data = ClusterInput()
I = ClusterInput()
data_2 = Data(data)
dedomain = DeconstructDomain(Domain=I)  # -> Start, End
addition = Addition(A=data_2, B=dedomain.Start)
addition_2 = Addition(A=data_2, B=dedomain.End)
subtraction = Subtraction(A=dedomain.Start, B=dedomain.End)
data_3 = Data(addition)
abs = Absolute(Value=subtraction)
data_4 = Data(addition_2)
data_5 = ClusterOutput(data_4)
data_6 = ClusterOutput(data_3)
y = ClusterOutput(abs)

# ==== cluster Cluster_3
data = ClusterInput()
data_2 = Data(data)
pdecon = Deconstruct(Point=data_2)  # -> XComponent, YComponent, ZComponent
merge = Merge(Data1=pdecon.XComponent, Data2=pdecon.YComponent, Data3=pdecon.ZComponent)
data_3 = Data(merge)
data_4 = ClusterOutput(data_3)

# ==== cluster Cluster_4
C = ClusterInput()
explode = Explode(Curve=C, Recursive=True)  # -> Segments, Vertices
trim = TrimTree(Tree=explode.Vertices, Depth=1)
hull = ConvexHull(Points=trim, Plane=PlaneXY(0, 0, 0))  # -> Hull, HullZ, Indices
hz = ClusterOutput(hull.HullZ)

# ==== cluster Cluster
N = ClusterInput()
T = ClusterInput()
N_2 = Text(N)
split = TextSplit(Text=T, Separators=".")
fn = ClusterInput()
dm = ClusterInput()
item = ListItem(List=split, Index=0, Wrap=True)
dc = ClusterInput()
pan = Panel("""HDT_Reference
HDTReference""")
pan_2 = Panel("""Human
Human""")
lng = ListLength(List=T)
len = TextLength(Text=N_2)
contains = ContainsAB(B=N_2)
dm_2 = Text(dm)
dc_2 = Text(dc)
fn_2 = Text(fn)
replace = ReplaceMembers(Set=item, Find=pan, Replace=pan_2)
cset = CreateSet(List=flatten(replace))  # -> Set, Map
txt = Text(["ScriptComponents", "Grasshopper", "MathComponents", "GalapagosComponents", "FieldComponents", "VectorComponents", "AnalysisComponents", "CurveComponents", "LegacyScriptComponents", "SurfaceComponents", "TriangulationComponents", "MassXForms", "LinearXForms"])
format = Format(Format="Definition by {0}", Culture=127, Data0=N_2)
difference = SetDifference(SetA=cset.Set, SetB=txt)
lng_2 = ListLength(List=flatten(difference))
dispatch = Dispatch(List=format, DispatchPattern=contains)  # -> ListA, ListB
format_2 = Format(Format="Object Count: {0:0}", Culture=127, Data0=lng)
format_3 = Format(Format="Date Modified: {0}", Culture=127, Data0=dm_2)
format_4 = Format(Format="Date Created: {0}", Culture=127, Data0=dc_2)
dependencies = Text(flatten(difference))
author = Text(flatten(dispatch.ListB))
larger = LargerThan(FirstNumber=lng_2, SecondNumber="1")  # -> LargerThan, OrEqualTo
objcount = Text(flatten(format_2))
author_2 = ClusterOutput(author)
dm_3 = Text(flatten(format_3))
fn_3 = ClusterOutput(fn_2)
dc_3 = Text(flatten(format_4))
objcount_2 = ClusterOutput(objcount)
dc_4 = ClusterOutput(dc_3)
filter = StreamFilter(
    Gate=larger.LargerThan,
    Stream0="This definition requires the following plug-in:",
    Stream1="This definition requires the following plug-ins:")
dm_4 = ClusterOutput(dm_3)
pan_3 = Panel("""{0}
{1}""")
join = TextJoin(Text=dependencies)
format_5 = Format(Format=pan_3, Culture=127, Data0=filter, Data1=join)
clean = CleanTree(Tree=format_5, CleanInvalid=True, CleanEmpty=False)
T_2 = ClusterOutput(clean)

# ==== cluster BackupData: Passes the list without nulls
secondary_data = ClusterInput()
priority_data = ClusterInput()
null = NullItem(
    A=null.ResultA,
    InternalDocument_plugin_version=(0, 9, 76),
    InternalDocument_DocumentHeader_PreviewMeshType=1,
    InternalDocument_DocumentHeader_PreviewNormal=RGBA(150, 0, 0, 100),
    InternalDocument_DocumentHeader_PreviewSelected=RGBA(0, 120, 0, 100),
    InternalDocument_DefinitionProperties_Projection_Zoom=1.25)  # -> A, A_2
priority_data_2 = Data([priority_data, null.A_2])
secondary_data_2 = Data(secondary_data)
clean = CleanTree(Tree=priority_data_2, CleanInvalid=True, CleanEmpty=False)
lng = ListLength(List=clean)
null_2 = NullItem(Items=clean)  # -> NullFlags, InvalidFlags
equals = Equality(FirstNumber="0", SecondNumber=lng)  # -> Equality, Inequality
clean_2 = CleanTree(Data=clean, CleanInvalid=True, CleanEmpty=False)
not = GateNot(A=null_2.NullFlags)
ma = MassAddition(Input=flatten(not))  # -> Result, PartialResult
bool = Boolean(ma.Result)
filter = StreamFilter(Gate=bool, Stream0=secondary_data_2, Stream1=clean_2)
data = Data(filter)
data_2 = ClusterOutput(data)

# ==== cluster ContainsAB: Tests if a string contains another string.
B = ClusterInput()
A = ClusterInput()
A_2 = String(A)
B_2 = String(B)
eval = Evaluate(F="Contains(x,y)", x=A_2, y=B_2)
c = Boolean(eval)
c_2 = ClusterOutput(c)
