# Grasshopper definition MLGeometry_NH03.ghx (Grasshopper 0.9.76)
# plug-ins: Python Interpreter, MetaHopper, Owl.Accord.GH, Telepathy, Owl.GH

# ----
# NUMBER OF INDIVIDUAL PRIMITIVES
number_slider = Slider(100, range=0..100)

panel = Panel("BASE PLANE")
pln = Plane(PlaneXY(0.08767023439, 0.0884122404, 0))

num = Number(50)
num_2 = Number(0)
range = Range(Domain=num, Steps=number_slider)
cull_i = CullIndex(List=range, Indices=num_2, Wrap=True)
panel_2 = Panel(cull_i)
color_groups_clusters = Button(ExpressionNormal="True")

python = PythonScript()  # -> out, random_int
# ---------- python: Python ----------
import Rhino.Geometry as rg
import rhinoscriptsyntax as rs
import math

from random import randint
random_int = (randint(0, 100))
# ---------- end python ----------
python_2 = PythonScript()  # -> out, random_int; same code as python
python_3 = PythonScript()  # -> out, random_int; same code as python
python_4 = PythonScript()  # -> out, random_int; same code as python
python_5 = PythonScript()  # -> out, random_int; same code as python
python_6 = PythonScript()  # -> out, random_int; same code as python
python_7 = PythonScript()  # -> out, random_int; same code as python
python_8 = PythonScript()  # -> out, random_int; same code as python
# Generate TRAINING Geo
panel_3 = Panel("RANDOMIZE SHIT")
jitter = Jitter(List=panel_2, Jitter=1, Seed=python.random_int)  # -> Values, Indices
jitter_2 = Jitter(List=panel_2, Jitter=1, Seed=python_3.random_int)  # -> Values, Indices
jitter_3 = Jitter(List=panel_2, Jitter=1, Seed=python_4.random_int)  # -> Values, Indices
jitter_4 = Jitter(List=panel_2, Jitter=1, Seed=python_5.random_int)  # -> Values, Indices
jitter_5 = Jitter(List=panel_2, Jitter=1, Seed=python_2.random_int)  # -> Values, Indices
jitter_6 = Jitter(List=panel_2, Jitter=1, Seed=python_6.random_int)  # -> Values, Indices
jitter_7 = Jitter(List=panel_2, Jitter=1, Seed=python_7.random_int)  # -> Values, Indices
jitter_8 = Jitter(List=panel_2, Jitter=1, Seed=python_8.random_int)  # -> Values, Indices

col = Colour([RGBA(4, 0, 255, 135), RGBA(0, 128, 255, 133), RGBA(210, 255, 148, 141), RGBA(255, 0, 0, 122), RGBA(224, 224, 224, 211)])

panel_4 = Panel("PRIMITIVE CREATION")
box = CenterBox(Base=pln, X=jitter_2.Values, Y=jitter_3.Values, Z=jitter_4.Values)
cone = Cone(Base=pln, Radius=jitter_7.Values, Length=jitter_8.Values)  # -> Cone, Tip
sph = Sphere(Base=pln, Radius=jitter_6.Values)
cyl = Cylinder(Base=pln, Radius=jitter.Values, Length=jitter_5.Values)

capex = CapHolesEx(Brep=sph)  # -> Brep, Caps, Solid
capex_2 = CapHolesEx(Brep=box)  # -> Brep, Caps, Solid
capex_3 = CapHolesEx(Brep=cyl)  # -> Brep, Caps, Solid
capex_4 = CapHolesEx(Brep=cone.Cone)  # -> Brep, Caps, Solid
panel_5 = Panel(capex.Brep)
panel_6 = Panel(capex_4.Brep)
panel_7 = Panel(capex_3.Brep)
panel_8 = Panel(capex_2.Brep)

number_slider_2 = Slider(12, range=0..100)
random = Random(Range="3 to 15", Number=number_slider_2, Seed=Slider(5, range=0..10))
random_2 = Random(Range="3 to 15", Number=number_slider_2, Seed=Slider(20, range=0..100))
random_3 = Random(Range="3 to 15", Number=number_slider_2, Seed=Slider(4, range=0..10))
box_2 = CenterBox(Base=PlaneXY(0, 0, 0), X=random, Y=random_2, Z=random_3)
cap = CapHoles(Brep=box_2)
dup = DuplicateData(Data=graft("Box"), Number=number_slider_2, Order=True)  # -> flatten(Data)

number_slider_3 = Slider(22, range=0..100)
random_4 = Random(Range="3 to 15", Number=number_slider_3, Seed=Slider(9, range=0..10))
random_5 = Random(Range="3 to 15", Number=number_slider_3, Seed=Slider(15, range=0..100))
cyl_2 = Cylinder(Base=PlaneXY(0, 0, 0), Radius=random_5, Length=random_4)
cap_2 = CapHoles(Brep=cyl_2)
dup_2 = DuplicateData(Data=graft("Cylinder"), Number=number_slider_3, Order=True)  # -> flatten(Data)

number_slider_4 = Slider(6, range=0..10)
random_6 = Random(Range="3 to 15", Number=number_slider_4, Seed=Slider(4, range=0..10))
sph_2 = Sphere(Base=PlaneXY(0, 0, 0), Radius=random_6)
dup_3 = DuplicateData(Data=graft("Sphere"), Number=number_slider_4, Order=True)  # -> flatten(Data)

# ----
# Generate TEST Geo
number_slider_5 = Slider(15, range=0..100)
random_7 = Random(Range="3 to 15", Number=number_slider_5, Seed=Slider(5, range=0..10))
random_8 = Random(Range="3 to 15", Number=number_slider_5, Seed=Slider(20, range=0..100))
cone_2 = Cone(Base=PlaneXY(0, 0, 0), Radius=random_8, Length=random_7)  # -> Cone, Tip
cap_3 = CapHoles(Brep=cone_2.Cone)
dup_4 = DuplicateData(Data=graft("Cone"), Number=number_slider_5, Order=True)  # -> flatten(Data)

entwine = Entwine(Branch00=capex_4.Brep, Branch01=capex_3.Brep, Branch02=capex.Brep, Branch03=capex_2.Brep, FlattenInputs=True)  # -> flatten(Result)
data = Data(capex_2.Brep)
data_2 = Data(capex.Brep)
data_3 = Data(capex_3.Brep)
data_4 = Data(capex_4.Brep)
lng = ListLength(List=data)
lng_2 = ListLength(List=data_2)
lng_3 = ListLength(List=data_3)
lng_4 = ListLength(List=data_4)
merge = Merge(Data1=cap_3, Data2=cap, Data3=sph_2, Data4=cap_2)
merge_2 = Merge(Data1=dup_4, Data2=dup, Data3=dup_3, Data4=dup_2)
dup_5 = DuplicateData(Data="Box", Number=lng, Order=True)  # -> flatten(Data)
dup_6 = DuplicateData(Data="Sphere", Number=lng_2, Order=True)  # -> flatten(Data)
dup_7 = DuplicateData(Data="Cylinder", Number=lng_3, Order=True)  # -> flatten(Data)
dup_8 = DuplicateData(Data="Cone", Number=lng_4, Order=True)  # -> flatten(Data)

# ---- group: MANUAL STUFF
pan = Panel("""thing 1
THING 2""")
geo = Geometry([<brep referenced from the Rhino model> x2])

# ----
merge_3 = Merge(Data1=dup_8, Data2=dup_7, Data3=dup_6, Data4=dup_5)

# ---- group: INPUT NAMES
data_5 = Data(simplify(graft(merge_2)))

# ----
data_6 = Data(simplify(graft(merge_3)))

# ---- group: input geometry
geo_2 = Geometry(graft(merge))

geo_3 = Geometry(graft(entwine))

# ----
panel_9 = Panel(data_5)
brep = Brep(simplify(graft(geo_2)))
brep_2 = Brep(simplify(graft(geo_3)))
brep_3 = Brep(brep)
brep_4 = Brep(brep)
brep_5 = Brep(brep)
brep_6 = Brep(brep_2)
brep_7 = Brep(brep_2)
brep_8 = Brep(brep)
brep_9 = Brep(brep_2)
brep_10 = Brep(brep_2)
vmoments = VolumeMoments(Geometry=brep_5)  # -> simplify(Volume), simplify(Centroid), simplify(Inertia), simplify(InertiaError), simplify(Secondary), simplify(SecondaryError), simplify(Gyration)
debrep = DeconstructBrep(Brep=brep_4)  # -> simplify(Faces), simplify(Edges), simplify(Vertices)
bbox = BoundingBox(Content=brep_8, Plane=PlaneXY(0, 0, 0))  # -> Box, Box_2
debrep_2 = DeconstructBrep(Brep=brep_3)  # -> Faces, Edges, Vertices
vmoments_2 = VolumeMoments(Geometry=brep_9)  # -> simplify(Volume), simplify(Centroid), simplify(Inertia), simplify(InertiaError), simplify(Secondary), simplify(SecondaryError), simplify(Gyration)
debrep_3 = DeconstructBrep(Brep=brep_7)  # -> simplify(Faces), simplify(Edges), simplify(Vertices)
bbox_2 = BoundingBox(Content=brep_10, Plane=PlaneXY(0, 0, 0))  # -> Box, Box_2
debrep_4 = DeconstructBrep(Brep=brep_6)  # -> Faces, Edges, Vertices
brep_11 = Brep(bbox.Box_2)
brep_12 = Brep(debrep_2.Faces)
data_7 = Data(vmoments.Secondary)
brep_13 = Brep(bbox_2.Box_2)
lng_5 = ListLength(List=debrep.Vertices)
lng_6 = ListLength(List=debrep.Faces)
lng_7 = ListLength(List=debrep.Edges)
brep_14 = Brep(debrep_4.Faces)
data_8 = Data(vmoments_2.Secondary)
lng_8 = ListLength(List=debrep_3.Vertices)
lng_9 = ListLength(List=debrep_3.Faces)
lng_10 = ListLength(List=debrep_3.Edges)
area = Area(Geometry=brep_12)  # -> Area, Centroid
volume = Volume(Geometry=brep_8)  # -> Volume, Centroid
volume_2 = Volume(Geometry=brep_11)  # -> Volume, Centroid
area_2 = Area(Geometry=brep_14)  # -> Area, Centroid
volume_3 = Volume(Geometry=brep_10)  # -> Volume, Centroid
volume_4 = Volume(Geometry=brep_13)  # -> Volume, Centroid
data_9 = Data(lng_5)
data_10 = Data(lng_6)
data_11 = Data(lng_7)
data_12 = Data(lng_8)
data_13 = Data(lng_9)
data_14 = Data(lng_10)
pdecon = Deconstruct(Point=area.Centroid)  # -> XComponent, YComponent, ZComponent
pdecon_2 = Deconstruct(Point=area_2.Centroid)  # -> XComponent, YComponent, ZComponent
data_15 = Data(volume.Volume)
data_16 = Data(volume_2.Volume)
data_17 = Data(volume_3.Volume)
data_18 = Data(volume_4.Volume)
volume_5 = Volume(Geometry=brep_3)  # -> Volume, Centroid
data_19 = Data(pdecon.ZComponent)
volume_6 = Volume(Geometry=brep_6)  # -> Volume, Centroid
division = Division(A=data_16, B=data_15)
data_20 = Data(pdecon_2.ZComponent)
division_2 = Division(A=data_18, B=data_17)
bbox_3 = BoundingBox(Content=geo_2, Plane=PlaneXY(0, 0, 0))  # -> Box, Box_2

# ---- group: length of slice at low mid and high
panel_10 = Panel("""0.1
0.5
0.9""")
box_3 = EvaluateBox(Box=bbox_3.Box, UParameter="0", VParameter="0", WParameter=panel_10)  # -> Plane, Point, Include
sec = BrepPlane(Brep=geo_2, Plane=box_3.Plane)  # -> Curves, Points
trim = TrimTree(Tree=sec.Curves, Depth=1)
len = Length(Curve=trim)
item = ListItem(List=simplify(len), Index=0, Wrap=True)  # -> Item, Item1, Item2

# ----
sort = SortList(Keys=data_19, ValuesA=data_19, ValuesB=brep_12, ValuesC=area.Centroid)  # -> Keys, ValuesA, ValuesB, ValuesC
bbox_4 = BoundingBox(Content=geo_3, Plane=PlaneXY(0, 0, 0))  # -> Box, Box_2

# ---- group: length of slice at low mid and high
panel_11 = Panel("""0.1
0.5
0.9""")
box_4 = EvaluateBox(Box=bbox_4.Box, UParameter="0", VParameter="0", WParameter=panel_11)  # -> Plane, Point, Include
sec_2 = BrepPlane(Brep=geo_3, Plane=box_4.Plane)  # -> Curves, Points
trim_2 = TrimTree(Tree=sec_2.Curves, Depth=1)
len_2 = Length(Curve=trim_2)
item_2 = ListItem(List=simplify(len_2), Index=0, Wrap=True)  # -> Item, Item1, Item2

# ----
sort_2 = SortList(Keys=data_20, ValuesA=data_20, ValuesB=brep_14, ValuesC=area_2.Centroid)  # -> Keys, ValuesA, ValuesB, ValuesC
data_21 = Data(division)
item_3 = ListItem(List=sort.ValuesC, Index=0, Wrap=True)
data_22 = Data(division_2)
field_titles = Panel("""Shape
Area
Volume
centroid x
centroid y 
centroid z
BB_Height
BB_Width
BB_Depth
low_slice_length
mid_slice_length
upper_slice_length""")
# Analysis Stuffs - TRAINING
panel_12 = Panel("""x
y
z
lxx
lyy
lzy
num_faces
num_edges
num_vertices
vol-bb_ratio""")
debox = DeconstructBox(Box=bbox_3.Box)  # -> Plane, simplify(X), simplify(Y), simplify(Z)
item_4 = ListItem(List=sort_2.ValuesC, Index=0, Wrap=True)
debox_2 = DeconstructBox(Box=bbox_4.Box)  # -> Plane, simplify(X), simplify(Y), simplify(Z)
volume_7 = Volume(Geometry=geo_2)  # -> simplify(Volume), Centroid
# Analysis Stuffs  - TESTING
area_3 = Area(Geometry=geo_2)  # -> simplify(Area), Centroid
pt = Point(volume_5.Centroid)
volume_8 = Volume(Geometry=geo_3)  # -> simplify(Volume), Centroid
pt_2 = Point(item_3)
area_4 = Area(Geometry=geo_3)  # -> simplify(Area), Centroid
pt_3 = Point(volume_6.Centroid)
pt_4 = Point(item_4)
dlength = DLength(I=debox.Y)
vec2pt = Vector2Pt(PointA=pt_2, PointB=pt, Unitize=False)  # -> Vector, Length
dlength_2 = DLength(I=debox.Z)
pdecon_3 = Deconstruct(Point=volume_7.Centroid)  # -> simplify(XComponent), simplify(YComponent), simplify(ZComponent)
dlength_3 = DLength(I=debox.X)
dlength_4 = DLength(I=debox_2.Y)
vec2pt_2 = Vector2Pt(PointA=pt_4, PointB=pt_3, Unitize=False)  # -> Vector, Length
dlength_5 = DLength(I=debox_2.Z)
pdecon_4 = Deconstruct(Point=volume_8.Centroid)  # -> simplify(XComponent), simplify(YComponent), simplify(ZComponent)
dlength_6 = DLength(I=debox_2.X)
features_names_mark = RemoteSender(panel_12)
features_names_nate = RemoteSender(field_titles)
data_23 = Data(vec2pt.Vector)
panel_13 = Panel(dlength_3)
panel_14 = Panel(dlength)
panel_15 = Panel(dlength_2)
panel_16 = Panel(volume_7.Volume)
panel_17 = Panel(area_3.Area)
panel_18 = Panel(pdecon_3.XComponent)
data_24 = Data(vec2pt_2.Vector)
panel_19 = Panel(pdecon_3.YComponent)
panel_20 = Panel(pdecon_3.ZComponent)
panel_21 = Panel(dlength_6)
panel_22 = Panel(dlength_4)
panel_23 = Panel(dlength_5)
shape_type = Data(data_5)
panel_24 = Panel(volume_8.Volume)
panel_25 = Panel(area_4.Area)
panel_26 = Panel(pdecon_4.XComponent)
panel_27 = Panel(pdecon_4.YComponent)
panel_28 = Panel(pdecon_4.ZComponent)
shape_type_2 = Data(data_6)
data_25 = Data(data_7)
data_26 = Data(data_23)
data_27 = Data(data_8)
data_28 = Data(data_24)
cluster = Cluster_3(data=data_25)
cluster_2 = Cluster_3(data=data_26)
cluster_3 = Cluster_3(data=data_27)
cluster_4 = Cluster_3(data=data_28)
features_names_mark_2 = RemoteReceiver(features_names_mark)
features_names_nate_2 = RemoteReceiver(features_names_nate)
data_29 = Data(simplify(cluster))
data_30 = Data(simplify(cluster_2))
data_31 = Data(simplify(cluster_3))
data_32 = Data(simplify(cluster_4))
data_33 = Data(simplify(data_10))
data_34 = Data(simplify(data_11))
data_35 = Data(simplify(data_9))
data_36 = Data(simplify(data_21))
data_37 = Data(simplify(data_13))
data_38 = Data(simplify(data_14))
data_39 = Data(simplify(data_12))
data_40 = Data(simplify(data_22))
merge_4 = Merge(Data1=features_names_nate_2, Data2=features_names_mark_2)
merge_5 = Merge(Data1=data_30, Data2=data_29, Data3=data_33, Data4=data_34, Data5=data_35, Data6=data_36)
merge_6 = Merge(Data1=data_32, Data2=data_31, Data3=data_37, Data4=data_38, Data5=data_39, Data6=data_40)
data_41 = Data(merge_5)
panel_29 = Panel(merge_4)
data_42 = Data(merge_6)
data_43 = Data(data_41)
merge_7 = Merge(
    Data1=simplify(shape_type),
    Data2=panel_17,
    Data3=panel_16,
    Data4=panel_18,
    Data5=panel_19,
    Data6=panel_20,
    Data7=panel_13,
    Data8=panel_14,
    Data9=panel_15,
    Data10=item.Item,
    Data11=item.Item1,
    Data12=item.Item2,
    Data13=data_43)
analyis_data_test = RemoteSender(merge_7)
data_44 = Data(data_42)
merge_8 = Merge(
    Data1=simplify(shape_type_2),
    Data2=panel_25,
    Data3=panel_24,
    Data4=panel_26,
    Data5=panel_27,
    Data6=panel_28,
    Data7=panel_21,
    Data8=panel_22,
    Data9=panel_23,
    Data10=item_2.Item,
    Data11=item_2.Item1,
    Data12=item_2.Item2,
    Data13=data_44)
path_mapper = PathMapper(panel_29, source="{0}", target="{0}")
path_mapper_2 = PathMapper(merge_8, source="{A}", target="{A+1}")
# [second moment of inertia]
# Ixx
# Iyy
# Izy
panel_30 = Panel(data_29)
# [eccentricity]
# x
# y
# z
panel_31 = Panel(data_30)
# [second moment of inertia]
# Ixx
# Iyy
# Izy
panel_32 = Panel(data_31)
# [eccentricity]
# x
# y
# z
panel_33 = Panel(data_32)
# [brep topology]
# number of faces
# number of edges
# number of vertexs
panel_34 = Panel(data_34)
panel_35 = Panel(data_35)
# volume/ bb volume ratio
panel_36 = Panel(data_36)
panel_37 = Panel(data_33)
# [brep topology]
# number of faces
# number of edges
# number of vertexs
panel_38 = Panel(data_38)
panel_39 = Panel(data_39)
# volume/ bb volume ratio
panel_40 = Panel(data_40)
panel_41 = Panel(data_37)
merge_9 = Merge(Data1=path_mapper, Data2=path_mapper_2)
analyis_data = RemoteSender(merge_9)
analyis_data_test_2 = RemoteReceiver(analyis_data_test)
split = SplitTree(Data=analyis_data_test_2, Masks=flatten("{0}"))  # -> Positive, Negative

# ---- group: JITTER TEST DATA
wrap = WrapList(Data=split.Negative)  # -> flatten(WrappedData)
jitter_9 = Jitter(List=wrap, Jitter=1, Seed=2)  # -> Values, Indices
unwrap = UnwrapList(WrappedData=jitter_9.Values)  # -> simplify(UnwrappedData)

# ----
analyis_data_2 = RemoteReceiver(analyis_data)
# TRAINING DATA
split_2 = SplitTree(Data=analyis_data_2, Masks=flatten("{0}"))  # -> Positive, Negative

# ---- group: TEST DATA FEATURES
# TEST DATA
number_slider_6 = Slider(1, range=0..1)
split_3 = SplitList(List=unwrap, Index=number_slider_6)  # -> flatten(ListA), ListB
flip = FlipMatrix(Data=split_3.ListB)
bnd = Bounds(Numbers=flip)  # -> flatten(Domain)
remap = RemapNumbers(Value=split_3.ListB, Source=bnd, Target=Domain(0, 1))  # -> Mapped, Clipped
datatree_to_tensorset = DataTreeToTensorSet(DataTree=remap.Mapped)  # "DT->TS"

# ----
split_4 = SplitList(List=split_2.Negative, Index=Slider(1, range=0..1))  # -> ListA, ListB

# ---- group: TRAINING DATA ANSWERS
cset = CreateSet(List=flatten(split_4.ListA))  # -> Set, flatten(Map)
bnd_2 = Bounds(Numbers=cset.Map)
remap_2 = RemapNumbers(Value=cset.Map, Source=bnd_2, Target=Domain(0, 1))  # -> Mapped, Clipped
featurets = FeatureTensorSet(Feature0=remap_2.Mapped)

# ---- group: TRAINING DATA FEATURES
flip_2 = FlipMatrix(Data=split_4.ListB)
bnd_3 = Bounds(Numbers=flip_2)  # -> flatten(Domain)
remap_3 = RemapNumbers(Value=split_4.ListB, Source=bnd_3, Target=Domain(0, 1))  # -> Mapped, Clipped
datatree_to_tensorset_2 = DataTreeToTensorSet(DataTree=remap_3.Mapped)  # "DT->TS"

# ----
# ML Stuffs
lng_11 = ListLength(List=bnd)
number_slider_7 = Slider(2, range=0..10)
number_slider_8 = Slider(10, range=0..10)
panel_42 = Panel("ANSWER")
panel_43 = Panel(split_3.ListA)

# ----
# ToolDescription: Enter a description of this definition's functionality and use
update_file_info = Button()
group_prefixes = Panel("""out_
in_
action_
warning_
cluster""")
c_script = CSharpScript(update=color_groups_clusters, name=group_prefixes, col=col)  # -> out, A; inputs update: Boolean, name: list of String, col: list of Color
# ---------- c_script: C# ----------
    Color clusterColor = Color.Transparent;
    for(int i = 0;i < name.Count;i++){
      if(name[i].Contains("cluster")){
        clusterColor = col[i];
        break;
      }
    }



    if(update){
      List<Guid> guids = new List<Guid>();
      List<Grasshopper.Kernel.Special.GH_Group> grps = new List<Grasshopper.Kernel.Special.GH_Group>();
      List<Grasshopper.Kernel.Special.GH_Group> alreadygrps = new List<Grasshopper.Kernel.Special.GH_Group>();


      foreach(IGH_DocumentObject o in GrasshopperDocument.Objects){
        Grasshopper.Kernel.Special.GH_Group g = o as Grasshopper.Kernel.Special.GH_Group;
        if(g != null){
          for(int j = 0;j < name.Count;j++){
            if(g.NickName.ToUpper().Contains(name[j].ToUpper())){
              g.Colour = col[j % col.Count];
            }

          }
        }


        if(o is Grasshopper.Kernel.Special.GH_Cluster){
          Grasshopper.Kernel.Special.GH_Cluster cluster = o as  Grasshopper.Kernel.Special.GH_Cluster;
          string filepath = cluster.FilePath;
          if(!String.IsNullOrEmpty(filepath)){
            cluster.Name = System.IO.Path.GetFileNameWithoutExtension(filepath);
            cluster.NickName = System.IO.Path.GetFileNameWithoutExtension(filepath);
            cluster.Attributes.ExpireLayout();
          }
          guids.Add(cluster.InstanceGuid);
          Grasshopper.Kernel.Special.GH_Group grp = new Grasshopper.Kernel.Special.GH_Group();
          grps.Add(grp);

        } else if (o is Grasshopper.Kernel.Special.GH_Group){
          Grasshopper.Kernel.Special.GH_Group alreadygrp = o as Grasshopper.Kernel.Special.GH_Group;
          alreadygrps.Add(alreadygrp);
        }





      }

      List<bool> isAlreadyInGroup = IsAlreadyInGroup(guids, alreadygrps);

      for(int i = 0;i < grps.Count;i++){
        Grasshopper.Kernel.Special.GH_Group grp = grps[i];
        grp.Colour = clusterColor;
        grp.NickName = "";
        grp.AddObject(guids[i]);
        if(!isAlreadyInGroup[i]){
          grp.ExpireCaches();
          GrasshopperDocument.AddObject(grp, false, 1000);
        }
      }



    }
# ---------- c_script: C# additional code ----------
  List<bool> IsAlreadyInGroup(List<Guid> guids, List<Grasshopper.Kernel.Special.GH_Group> grps){
    List<bool> results = new List<bool>();
    foreach(Guid g in guids){
      results.Add(false);
    }
    foreach(Grasshopper.Kernel.Special.GH_Group grp in grps){ //for every group in the pre-existing groups
      if(grp.Objects().Count == 1){ //if that group only has one object in it
        for (int j = 0;j < guids.Count;j++){
          Guid g = guids[j];
          if(grp.ObjectIDs.Contains(g)){
            results[j] = true;
            break;
          }
        }
      }
    }
    return results;
  }
# ---------- end c_script ----------

data_45 = Data(update_file_info)

c_script_2 = CSharpScript(x=data_45)  # -> out, A, B, C, D, E
# ---------- c_script_2: C# ----------
    List < IGH_DocumentObject> objectsRecursive = new List<IGH_DocumentObject>();
    objectsRecursive.AddRange(clusterObjectsRecursive(GrasshopperDocument));


    B = GrasshopperDocument.Author.Name + " " + GrasshopperDocument.Author.Email;
    D = GrasshopperDocument.Properties.DateTag;
    if(GrasshopperDocument.IsFilePathDefined){
      C = GrasshopperDocument.FilePath;
      System.IO.FileInfo info = new System.IO.FileInfo(GrasshopperDocument.FilePath);
      if(info.LastWriteTime != null){
        E = info.LastWriteTime;
      } else {
        E = "";
      }
    } else {
      C = "Unsaved Document";
      E = "";
    }
    A = objectsRecursive;
# ---------- c_script_2: C# additional code ----------
  List<IGH_DocumentObject> clusterObjectsRecursive(GH_Document doc){
    List<IGH_DocumentObject> objList = new List<IGH_DocumentObject>();
    objList.AddRange(doc.Objects);
    foreach(IGH_DocumentObject obj in doc.Objects){
      Grasshopper.Kernel.Special.GH_Cluster cluster = obj as Grasshopper.Kernel.Special.GH_Cluster;
      try{
        objList.AddRange(clusterObjectsRecursive(cluster.Document("")));
      } catch {

      }
    }
    return objList;
  }
# ---------- end c_script_2 ----------
cluster_5 = Cluster_2(T=c_script_2.A, N=c_script_2.B, fn=c_script_2.C, dc=c_script_2.D, dm=c_script_2.E)
file_info = Panel(cluster_5)

panel_44 = Panel("""20
1""")

merge_10 = Merge(Data1=lng_11, Data2=panel_44)

network = ConstructNetwork(Layers=merge_10, Activation=Slider(1, range=0..1), Alpha=1, Seed=Slider(58, range=0..100))

backprop = Backpropagation(
    ActivationNetwork=network,
    Input=datatree_to_tensorset_2,
    Output=featurets,
    LearningRate=0.01,
    Momentum=0.001,
    Epoch=10,
    Iterations=Slider(700, range=0..10000))  # -> ActivationNetwork, Error

_2dpreview = NetworkPreview(Network=backprop.ActivationNetwork, Lines=Domain(1, 5), Radius=5)
compute = Compute(ActivationNetwork=backprop.ActivationNetwork, Input=datatree_to_tensorset)

# ---- group: REMAP TO NUMBER OF TEST SHAPES
detset = DeconstructTensorSet(TensorSet=compute)
lng_12 = ListLength(List=cset.Set)
detensor = DeconstructTensor(Tensor=detset)  # -> flatten(Values)
subtraction = Subtraction(A=lng_12, B=1)
remap_4 = RemapNumbers(Value=detensor, Source=Domain(0, 1), Target=subtraction)  # -> Mapped, Clipped
item_5 = ListItem(List=cset.Set, Index=remap_4.Mapped, Wrap=True)

# ----
tmatch = MatchText(Text=graft(item_5), RegEx=graft(split_3.ListA), Case=True)  # -> flatten(Match)
panel_45 = Panel(remap_4.Mapped)
ma = MassAddition(Input=tmatch)  # -> Result, PartialResults
lng_13 = ListLength(List=tmatch)
panel_46 = Panel(item_5)
division_3 = Division(A=ma.Result, B=lng_13)
multiplication = Multiplication(A=division_3, B=100)
panel_47 = Panel(multiplication)

# ==== cluster Cluster_2
T = ClusterInput()
N = ClusterInput()
fn = ClusterInput()
dc = ClusterInput()
dm = ClusterInput()
cluster = Cluster(T=T, N=N, fn=fn, dc=dc, dm=dm)  # -> T_2, author_2, objcount_2, fn_3, dc_4, dm_4
merge = Merge(
    Data1=cluster.author_2,
    Data2=cluster.T_2,
    Data3=cluster.objcount_2,
    Data4=cluster.fn_3,
    Data5=cluster.dc_4,
    Data6=cluster.dm_4)
R = ClusterOutput(merge)

# ==== cluster DLength: computes length of a domain
I = ClusterInput()
dedomain = DeconstructDomain(Domain=I)  # -> Start, End
subtraction = Subtraction(A=dedomain.Start, B=dedomain.End)
abs = Absolute(Value=subtraction)
y = ClusterOutput(abs)

# ==== cluster Cluster_3
data = ClusterInput()
data_2 = Data(data)
pdecon = Deconstruct(Point=data_2)  # -> XComponent, YComponent, ZComponent
merge = Merge(Data1=pdecon.XComponent, Data2=pdecon.YComponent, Data3=pdecon.ZComponent)
data_3 = Data(merge)
data_4 = ClusterOutput(data_3)

# ==== cluster Cluster
N = ClusterInput()
T = ClusterInput()
N_2 = Text(N)
split = TextSplit(Text=T, Separators=".")
fn = ClusterInput()
dm = ClusterInput()
item = ListItem(List=split, Index=0, Wrap=True)
dc = ClusterInput()
pan = Panel("""HDT_Reference
HDTReference""")
pan_2 = Panel("""Human
Human""")
lng = ListLength(List=T)
len = TextLength(Text=N_2)
contains = ContainsAB(B=N_2)
dm_2 = Text(dm)
dc_2 = Text(dc)
fn_2 = Text(fn)
replace = ReplaceMembers(Set=item, Find=pan, Replace=pan_2)
cset = CreateSet(List=flatten(replace))  # -> Set, Map
txt = Text(["ScriptComponents", "Grasshopper", "MathComponents", "GalapagosComponents", "FieldComponents", "VectorComponents", "AnalysisComponents", "CurveComponents", "LegacyScriptComponents", "SurfaceComponents", "TriangulationComponents", "MassXForms", "LinearXForms"])
format = Format(Format="Definition by {0}", Culture=127, Data0=N_2)
difference = SetDifference(SetA=cset.Set, SetB=txt)
lng_2 = ListLength(List=flatten(difference))
dispatch = Dispatch(List=format, DispatchPattern=contains)  # -> ListA, ListB
format_2 = Format(Format="Object Count: {0:0}", Culture=127, Data0=lng)
format_3 = Format(Format="Date Modified: {0}", Culture=127, Data0=dm_2)
format_4 = Format(Format="Date Created: {0}", Culture=127, Data0=dc_2)
dependencies = Text(flatten(difference))
author = Text(flatten(dispatch.ListB))
larger = LargerThan(FirstNumber=lng_2, SecondNumber="1")  # -> LargerThan, OrEqualTo
objcount = Text(flatten(format_2))
author_2 = ClusterOutput(author)
dm_3 = Text(flatten(format_3))
fn_3 = ClusterOutput(fn_2)
dc_3 = Text(flatten(format_4))
objcount_2 = ClusterOutput(objcount)
dc_4 = ClusterOutput(dc_3)
filter = StreamFilter(
    Gate=larger.LargerThan,
    Stream0="This definition requires the following plug-in:",
    Stream1="This definition requires the following plug-ins:")
dm_4 = ClusterOutput(dm_3)
pan_3 = Panel("""{0}
{1}""")
join = TextJoin(Text=dependencies)
format_5 = Format(Format=pan_3, Culture=127, Data0=filter, Data1=join)
clean = CleanTree(Tree=format_5, CleanInvalid=True, CleanEmpty=False)
T_2 = ClusterOutput(clean)

# ==== cluster ContainsAB: Tests if a string contains another string.
B = ClusterInput()
A = ClusterInput()
A_2 = String(A)
B_2 = String(B)
eval = Evaluate(F="Contains(x,y)", x=A_2, y=B_2)
c = Boolean(eval)
c_2 = ClusterOutput(c)
