# Grasshopper definition basic geo analysis + owl-NH 001.ghx (Grasshopper 0.9.76)
# plug-ins: Python Interpreter, MetaHopper, Owl.Accord.GH, Telepathy, Owl.GH

number_slider = Slider(1, range=0..100)

# ----
# NUMBER OF INDIVIDUAL PRIMITIVES
number_slider_2 = Slider(30, range=0..100)

panel = Panel("""cone
cylindar
box""")
random = Random(Range="3 to 15", Number=number_slider, Seed=Slider(4, range=0..10))
random_2 = Random(Range="3 to 15", Number=number_slider, Seed=Slider(20, range=0..100))
random_3 = Random(Range="3 to 15", Number=number_slider, Seed=Slider(5, range=0..10))
random_4 = Random(Range="3 to 15", Number=number_slider, Seed=Slider(15, range=0..100))
random_5 = Random(Range="3 to 15", Number=number_slider, Seed=Slider(9, range=0..10))

panel_2 = Panel("BASE PLANE")
pln = Plane(PlaneXY(0.08767023439, 0.0884122404, 0))

num = Number(50)
cone = Cone(Base=PlaneXY(0, 0, 0), Radius=random_2, Length=random_3)  # -> Cone, Tip
box = CenterBox(Base=PlaneXY(0, 0, 0), X=random_3, Y=random_2, Z=random)
dup = DuplicateData(Data=graft(panel), Number=number_slider, Order=True)  # -> flatten(Data)
cyl = Cylinder(Base=PlaneXY(0, 0, 0), Radius=random_4, Length=random_5)
num_2 = Number(0)
range = Range(Domain=num, Steps=number_slider_2)
cap = CapHoles(Brep=box)
cap_2 = CapHoles(Brep=cone.Cone)
cap_3 = CapHoles(Brep=cyl)
cull_i = CullIndex(List=range, Indices=num_2, Wrap=True)
panel_3 = Panel(cull_i)
panel_4 = Panel(dup)
color_groups_clusters = Button(ExpressionNormal="True")

python = PythonScript()  # -> out, random_int
# ---------- python: Python ----------
import Rhino.Geometry as rg
import rhinoscriptsyntax as rs
import math

from random import randint
random_int = (randint(0, 100))
# ---------- end python ----------
python_2 = PythonScript()  # -> out, random_int; same code as python
python_3 = PythonScript()  # -> out, random_int; same code as python
python_4 = PythonScript()  # -> out, random_int; same code as python
python_5 = PythonScript()  # -> out, random_int; same code as python
python_6 = PythonScript()  # -> out, random_int; same code as python
python_7 = PythonScript()  # -> out, random_int; same code as python
python_8 = PythonScript()  # -> out, random_int; same code as python
# Generate Test Geo
panel_5 = Panel("RANDOMIZE SHIT")
jitter = Jitter(List=panel_3, Jitter=1, Seed=python.random_int)  # -> Values, Indices
jitter_2 = Jitter(List=panel_3, Jitter=1, Seed=python_3.random_int)  # -> Values, Indices
jitter_3 = Jitter(List=panel_3, Jitter=1, Seed=python_4.random_int)  # -> Values, Indices
jitter_4 = Jitter(List=panel_3, Jitter=1, Seed=python_5.random_int)  # -> Values, Indices
jitter_5 = Jitter(List=panel_3, Jitter=1, Seed=python_2.random_int)  # -> Values, Indices
jitter_6 = Jitter(List=panel_3, Jitter=1, Seed=python_6.random_int)  # -> Values, Indices
jitter_7 = Jitter(List=panel_3, Jitter=1, Seed=python_7.random_int)  # -> Values, Indices
jitter_8 = Jitter(List=panel_3, Jitter=1, Seed=python_8.random_int)  # -> Values, Indices

col = Colour([RGBA(4, 0, 255, 135), RGBA(0, 128, 255, 133), RGBA(210, 255, 148, 141), RGBA(255, 0, 0, 122), RGBA(224, 224, 224, 211)])
data = Data(simplify(graft(dup)))

# ---- group: input geometry
geo = Geometry(graft([cap_2, cap, cap_3]))

# ----
panel_6 = Panel("PRIMITIVE CREATION")
box_2 = CenterBox(Base=pln, X=jitter_2.Values, Y=jitter_3.Values, Z=jitter_4.Values)
cone_2 = Cone(Base=pln, Radius=jitter_7.Values, Length=jitter_8.Values)  # -> Cone, Tip
sph = Sphere(Base=pln, Radius=jitter_6.Values)
cyl_2 = Cylinder(Base=pln, Radius=jitter.Values, Length=jitter_5.Values)

capex = CapHolesEx(Brep=sph)  # -> Brep, Caps, Solid
capex_2 = CapHolesEx(Brep=box_2)  # -> Brep, Caps, Solid
capex_3 = CapHolesEx(Brep=cyl_2)  # -> Brep, Caps, Solid
capex_4 = CapHolesEx(Brep=cone_2.Cone)  # -> Brep, Caps, Solid
panel_7 = Panel(capex.Brep)
panel_8 = Panel(capex_4.Brep)
panel_9 = Panel(capex_3.Brep)
panel_10 = Panel(capex_2.Brep)
entwine = Entwine(Branch00=capex_4.Brep, Branch01=capex_3.Brep, Branch02=capex_2.Brep, FlattenInputs=True)  # -> flatten(Result)
brep = Brep(simplify(graft(geo)))
data_2 = Data(capex_2.Brep)
data_3 = Data(capex_3.Brep)
data_4 = Data(capex_4.Brep)
lng = ListLength(List=data_2)
lng_2 = ListLength(List=data_3)
lng_3 = ListLength(List=data_4)
brep_2 = Brep(brep)
brep_3 = Brep(brep)
brep_4 = Brep(brep)
brep_5 = Brep(brep)
dup_2 = DuplicateData(Data="Box", Number=lng, Order=True)  # -> flatten(Data)
dup_3 = DuplicateData(Data="Cylinder", Number=lng_2, Order=True)  # -> flatten(Data)
vmoments = VolumeMoments(Geometry=brep_4)  # -> simplify(Volume), simplify(Centroid), simplify(Inertia), simplify(InertiaError), simplify(Secondary), simplify(SecondaryError), simplify(Gyration)
debrep = DeconstructBrep(Brep=brep_3)  # -> simplify(Faces), simplify(Edges), simplify(Vertices)
dup_4 = DuplicateData(Data="Cone", Number=lng_3, Order=True)  # -> flatten(Data)
bbox = BoundingBox(Content=brep_5, Plane=PlaneXY(0, 0, 0))  # -> Box, Box_2
debrep_2 = DeconstructBrep(Brep=brep_2)  # -> Faces, Edges, Vertices
brep_6 = Brep(bbox.Box_2)
brep_7 = Brep(debrep_2.Faces)
data_5 = Data(vmoments.Secondary)
lng_4 = ListLength(List=debrep.Vertices)
lng_5 = ListLength(List=debrep.Faces)
lng_6 = ListLength(List=debrep.Edges)
area = Area(Geometry=brep_7)  # -> Area, Centroid
volume = Volume(Geometry=brep_5)  # -> Volume, Centroid
volume_2 = Volume(Geometry=brep_6)  # -> Volume, Centroid
data_6 = Data(lng_4)
merge = Merge(Data1=dup_4, Data2=dup_3, Data3=dup_2)
data_7 = Data(lng_5)
data_8 = Data(lng_6)
pdecon = Deconstruct(Point=area.Centroid)  # -> XComponent, YComponent, ZComponent
data_9 = Data(volume.Volume)
data_10 = Data(volume_2.Volume)
data_11 = Data(simplify(graft(merge)))
volume_3 = Volume(Geometry=brep_2)  # -> Volume, Centroid
data_12 = Data(pdecon.ZComponent)
division = Division(A=data_10, B=data_9)

# ---- group: input geometry
geo_2 = Geometry(graft(entwine))

# ----
field_titles = Panel("""Shape
Area
Volume
centroid x
centroid y 
centroid z
BB_Height
BB_Width
BB_Depth
low_slice_length
mid_slice_length
upper_slice_length""")
bbox_2 = BoundingBox(Content=geo, Plane=PlaneXY(0, 0, 0))  # -> Box, Box_2

# ---- group: length of slice at low mid and high
panel_11 = Panel("""0.1
0.5
0.9""")
box_3 = EvaluateBox(Box=bbox_2.Box, UParameter="0", VParameter="0", WParameter=panel_11)  # -> Plane, Point, Include
sec = BrepPlane(Brep=geo, Plane=box_3.Plane)  # -> Curves, Points
trim = TrimTree(Tree=sec.Curves, Depth=1)
len = Length(Curve=trim)
item = ListItem(List=simplify(len), Index=0, Wrap=True)  # -> Item, Item1, Item2

# ----
sort = SortList(Keys=data_12, ValuesA=data_12, ValuesB=brep_7, ValuesC=area.Centroid)  # -> Keys, ValuesA, ValuesB, ValuesC
data_13 = Data(division)
item_2 = ListItem(List=sort.ValuesC, Index=0, Wrap=True)
debox = DeconstructBox(Box=bbox_2.Box)  # -> Plane, simplify(X), simplify(Y), simplify(Z)
volume_4 = Volume(Geometry=geo)  # -> simplify(Volume), Centroid
# Analysis Stuffs
area_2 = Area(Geometry=geo)  # -> simplify(Area), Centroid
pt = Point(volume_3.Centroid)
pt_2 = Point(item_2)
dlength = DLength(I=debox.Y)
vec2pt = Vector2Pt(PointA=pt_2, PointB=pt, Unitize=False)  # -> Vector, Length
dlength_2 = DLength(I=debox.Z)
pdecon_2 = Deconstruct(Point=volume_4.Centroid)  # -> simplify(XComponent), simplify(YComponent), simplify(ZComponent)
dlength_3 = DLength(I=debox.X)
data_14 = Data(vec2pt.Vector)
panel_12 = Panel(dlength_3)
panel_13 = Panel(dlength)
panel_14 = Panel(dlength_2)
panel_15 = Panel(volume_4.Volume)
panel_16 = Panel(area_2.Area)
panel_17 = Panel(pdecon_2.XComponent)
panel_18 = Panel(pdecon_2.YComponent)
panel_19 = Panel(pdecon_2.ZComponent)
shape_type = Data(data)
data_15 = Data(data_5)
data_16 = Data(data_14)
cluster = Cluster_3(data=data_15)
cluster_2 = Cluster_3(data=data_16)
brep_8 = Brep(simplify(graft(geo_2)))
data_17 = Data(simplify(cluster))
data_18 = Data(simplify(cluster_2))
data_19 = Data(simplify(data_7))
data_20 = Data(simplify(data_8))
data_21 = Data(simplify(data_6))
data_22 = Data(simplify(data_13))
merge_2 = Merge(Data1=data_18, Data2=data_17, Data3=data_19, Data4=data_20, Data5=data_21, Data6=data_22)
brep_9 = Brep(brep_8)
brep_10 = Brep(brep_8)
brep_11 = Brep(brep_8)
brep_12 = Brep(brep_8)
vmoments_2 = VolumeMoments(Geometry=brep_11)  # -> simplify(Volume), simplify(Centroid), simplify(Inertia), simplify(InertiaError), simplify(Secondary), simplify(SecondaryError), simplify(Gyration)
debrep_3 = DeconstructBrep(Brep=brep_10)  # -> simplify(Faces), simplify(Edges), simplify(Vertices)
data_23 = Data(merge_2)
bbox_3 = BoundingBox(Content=brep_12, Plane=PlaneXY(0, 0, 0))  # -> Box, Box_2
debrep_4 = DeconstructBrep(Brep=brep_9)  # -> Faces, Edges, Vertices
brep_13 = Brep(bbox_3.Box_2)
brep_14 = Brep(debrep_4.Faces)
data_24 = Data(vmoments_2.Secondary)
lng_7 = ListLength(List=debrep_3.Vertices)
lng_8 = ListLength(List=debrep_3.Faces)
lng_9 = ListLength(List=debrep_3.Edges)
data_25 = Data(data_23)
merge_3 = Merge(
    Data1=simplify(shape_type),
    Data2=panel_16,
    Data3=panel_15,
    Data4=panel_17,
    Data5=panel_18,
    Data6=panel_19,
    Data7=panel_12,
    Data8=panel_13,
    Data9=panel_14,
    Data10=item.Item,
    Data11=item.Item1,
    Data12=item.Item2,
    Data13=data_25)
path_mapper = PathMapper(field_titles, source="{0}", target="{0}")
area_3 = Area(Geometry=brep_14)  # -> Area, Centroid
path_mapper_2 = PathMapper(merge_3, source="{A}", target="{A+1}")
volume_5 = Volume(Geometry=brep_12)  # -> Volume, Centroid
volume_6 = Volume(Geometry=brep_13)  # -> Volume, Centroid
data_26 = Data(lng_7)
data_27 = Data(lng_8)
data_28 = Data(lng_9)
# [second moment of inertia]
# Ixx
# Iyy
# Izy
panel_20 = Panel(data_17)
# [eccentricity]
# x
# y
# z
panel_21 = Panel(data_18)
pdecon_3 = Deconstruct(Point=area_3.Centroid)  # -> XComponent, YComponent, ZComponent
# [brep topology]
# number of faces
# number of edges
# number of vertexs
panel_22 = Panel(data_20)
panel_23 = Panel(data_21)
# volume/ bb volume ratio
panel_24 = Panel(data_22)
panel_25 = Panel(data_19)
data_29 = Data(volume_5.Volume)
data_30 = Data(volume_6.Volume)
panel_26 = Panel("""x
y
z
lxx
lyy
lzy
num_faces
num_edges
num_vertices
vol-bb_ratio""")
volume_7 = Volume(Geometry=brep_9)  # -> Volume, Centroid
data_31 = Data(pdecon_3.ZComponent)
division_2 = Division(A=data_30, B=data_29)
field_titles_2 = Panel("""Shape
Area
Volume
centroid x
centroid y 
centroid z
BB_Height
BB_Width
BB_Depth
low_slice_length
mid_slice_length
upper_slice_length""")
bbox_4 = BoundingBox(Content=geo_2, Plane=PlaneXY(0, 0, 0))  # -> Box, Box_2

# ---- group: length of slice at low mid and high
panel_27 = Panel("""0.1
0.5
0.9""")
box_4 = EvaluateBox(Box=bbox_4.Box, UParameter="0", VParameter="0", WParameter=panel_27)  # -> Plane, Point, Include
sec_2 = BrepPlane(Brep=geo_2, Plane=box_4.Plane)  # -> Curves, Points
trim_2 = TrimTree(Tree=sec_2.Curves, Depth=1)
len_2 = Length(Curve=trim_2)
item_3 = ListItem(List=simplify(len_2), Index=0, Wrap=True)  # -> Item, Item1, Item2

# ----
sort_2 = SortList(Keys=data_31, ValuesA=data_31, ValuesB=brep_14, ValuesC=area_3.Centroid)  # -> Keys, ValuesA, ValuesB, ValuesC
merge_4 = Merge(Data1=path_mapper, Data2=path_mapper_2)
data_32 = Data(division_2)
# Analysis Stuffs
panel_28 = Panel("""x
y
z
lxx
lyy
lzy
num_faces
num_edges
num_vertices
vol-bb_ratio""")
item_4 = ListItem(List=sort_2.ValuesC, Index=0, Wrap=True)
debox_2 = DeconstructBox(Box=bbox_4.Box)  # -> Plane, simplify(X), simplify(Y), simplify(Z)
join = TextJoin(Text=merge_4, Join=",")
volume_8 = Volume(Geometry=geo_2)  # -> simplify(Volume), Centroid
area_4 = Area(Geometry=geo_2)  # -> simplify(Area), Centroid
pt_3 = Point(volume_7.Centroid)
pt_4 = Point(item_4)
dlength_4 = DLength(I=debox_2.Y)
vec2pt_2 = Vector2Pt(PointA=pt_4, PointB=pt_3, Unitize=False)  # -> Vector, Length
dlength_5 = DLength(I=debox_2.Z)
pdecon_4 = Deconstruct(Point=volume_8.Centroid)  # -> simplify(XComponent), simplify(YComponent), simplify(ZComponent)
dlength_6 = DLength(I=debox_2.X)
data_33 = Data(vec2pt_2.Vector)
panel_29 = Panel(dlength_6)
panel_30 = Panel(dlength_4)
panel_31 = Panel(dlength_5)
panel_32 = Panel(volume_8.Volume)
panel_33 = Panel(area_4.Area)
panel_34 = Panel(pdecon_4.XComponent)
panel_35 = Panel(pdecon_4.YComponent)
panel_36 = Panel(pdecon_4.ZComponent)
shape_type_2 = Data(data_11)
features_names_nate = RemoteSender(field_titles_2)
panel_37 = Panel(merge_4)
features_names_mark = RemoteSender(panel_28)
data_34 = Data(data_24)
data_35 = Data(data_33)
cluster_3 = Cluster_3(data=data_34)
cluster_4 = Cluster_3(data=data_35)
data_36 = Data(simplify(cluster_3))
data_37 = Data(simplify(cluster_4))
split = SplitTree(Data=merge_4, Masks=flatten("{0}"))  # -> Positive, Negative
data_38 = Data(simplify(data_27))
data_39 = Data(simplify(data_28))
data_40 = Data(simplify(data_26))
data_41 = Data(simplify(data_32))
features_names_mark_2 = RemoteReceiver(features_names_mark)
features_names_nate_2 = RemoteReceiver(features_names_nate)
jitter_9 = Jitter(Jitter=1, Seed=2)  # -> Values, Indices
analyis_data_test = RemoteSender(merge_4)
merge_5 = Merge(Data1=data_37, Data2=data_36, Data3=data_38, Data4=data_39, Data5=data_40, Data6=data_41)
merge_6 = Merge(Data1=features_names_nate_2, Data2=features_names_mark_2)
data_42 = Data(merge_5)
data_43 = Data(data_42)
merge_7 = Merge(
    Data1=simplify(shape_type_2),
    Data2=panel_33,
    Data3=panel_32,
    Data4=panel_34,
    Data5=panel_35,
    Data6=panel_36,
    Data7=panel_29,
    Data8=panel_30,
    Data9=panel_31,
    Data10=item_3.Item,
    Data11=item_3.Item1,
    Data12=item_3.Item2,
    Data13=data_43)
panel_38 = Panel(merge_6)
path_mapper_3 = PathMapper(field_titles_2, source="{0}", target="{0}")
path_mapper_4 = PathMapper(merge_7, source="{A}", target="{A+1}")
# [second moment of inertia]
# Ixx
# Iyy
# Izy
panel_39 = Panel(data_36)
# [eccentricity]
# x
# y
# z
panel_40 = Panel(data_37)
# [brep topology]
# number of faces
# number of edges
# number of vertexs
panel_41 = Panel(data_39)
panel_42 = Panel(data_40)
# volume/ bb volume ratio
panel_43 = Panel(data_41)
panel_44 = Panel(data_38)
merge_8 = Merge(Data1=path_mapper_3, Data2=path_mapper_4)
join_2 = TextJoin(Text=merge_8, Join=",")
panel_46 = Panel(merge_8)
split_2 = SplitTree(Data=merge_8, Masks=flatten("{0}"))  # -> Positive, Negative
analyis_data = RemoteSender(merge_8)
analyis_data_2 = RemoteReceiver(analyis_data)
# ML Stuffs
split_3 = SplitTree(Data=analyis_data_2, Masks=flatten("{0}"))  # -> Positive, Negative
path = FilePath("C:\Users\nholland\Downloads\ml_house_data_set_test.csv")
item_5 = ListItem(List=split_3.Negative, Index=0, Wrap=True)  # -> flatten(Item), Item1, Item2, Item3
file = ReadFile(File=path, PerLineParse=True)
bnd = Bounds(Numbers=flatten(item_5.Item1))
bnd_2 = Bounds(Numbers=flatten(item_5.Item2))
bnd_3 = Bounds(Numbers=flatten(item_5.Item3))
split_4 = TextSplit(Text=file, Separators=",")
remap = RemapNumbers(Value=item_5.Item1, Source=bnd, Target=Domain(0, 1))  # -> Mapped, Clipped
remap_2 = RemapNumbers(Value=item_5.Item2, Source=bnd_2, Target=Domain(0, 1))  # -> Mapped, Clipped
remap_3 = RemapNumbers(Value=item_5.Item3, Source=bnd_3, Target=Domain(0, 1))  # -> Mapped, Clipped
featurets = FeatureTensorSet(Feature0=flatten(remap.Mapped), Feature1=flatten(remap_2.Mapped), Feature2=flatten(remap_3.Mapped))
remap_4 = RemapTSet(TensorSet=featurets, Source=Domain(0, 1), Target=Domain(0, 1))

panel_47 = Panel("Test With")
path_2 = FilePath("C:\Users\584\OneDrive - KIERANTIMBERLAKE\KT\002_Resources\Datasets\ml_house_data_set_test.csv")
number_slider_3 = Slider(0, range=0..100)

analyis_data_3 = RemoteReceiver(analyis_data)
kmeans = KMeansClustering(Data=remap_4, Clusters=Slider(3, range=0..10), Iterations=Slider(100, range=0..100), Seed=123)  # -> Clusters, Indices
analyis_data_test_2 = RemoteReceiver(analyis_data_test)
mll_stuff = RemoteSender(kmeans.Indices)
split_5 = SplitTree(Data=analyis_data_test_2, Masks=flatten("{0}"))  # -> Positive, Negative
wrap = WrapList(Data=split_5.Negative)  # -> flatten(WrappedData)

item_6 = ListItem(List=split_4, Index=Slider(0, range=0..100), Wrap=True)
item_7 = ListItem(List=split_4, Index=Slider(2, range=0..100), Wrap=True)
item_8 = ListItem(List=split_4, Index=Slider(5, range=0..100), Wrap=True)
item_9 = ListItem(List=split_4, Index=Slider(19, range=0..100), Wrap=True)
flatten = FlattenTree(Tree=item_9, Path="{0}")
flatten_2 = FlattenTree(Tree=item_6, Path="{0}")
flatten_3 = FlattenTree(Tree=item_7, Path="{0}")
flatten_4 = FlattenTree(Tree=item_8, Path="{0}")

jitter_10 = Jitter(List=wrap, Jitter=1, Seed=2)  # -> Values, Indices
mll_stuff_2 = RemoteReceiver(mll_stuff)
unwrap = UnwrapList(WrappedData=jitter_10.Values)  # -> simplify(UnwrappedData)
split_6 = SplitTree(Data=analyis_data_3, Masks=flatten("{0}"))  # -> Positive, Negative
item_10 = ListItem(List=split_5.Negative, Index=0, Wrap=True)  # -> flatten(Item), Item1, Item2
item_11 = ListItem(List=split_5.Negative, Index=9, Wrap=True)  # -> Item, Item1, Item2
item_12 = ListItem(List=split_5.Negative, Index=Slider(18, range=0..100), Wrap=True)  # -> Item, Item1, Item2
item_13 = ListItem(List=split_6.Negative, Index=0, Wrap=True)  # -> Item, Item1, Item2
item_14 = ListItem(List=split_6.Negative, Index=9, Wrap=True)  # -> Item, Item1, Item2
item_15 = ListItem(List=split_6.Negative, Index=Slider(18, range=0..100), Wrap=True)  # -> Item, Item1, Item2

panel_48 = Panel(flatten_2)
panel_49 = Panel(flatten_3)
panel_50 = Panel(flatten_4)
panel_51 = Panel(flatten)

bnd_4 = Bounds(Numbers=flatten(item_10.Item2))
bnd_5 = Bounds(Numbers=flatten(item_10.Item1))
bnd_6 = Bounds(Numbers=flatten(item_11.Item))
bnd_7 = Bounds(Numbers=flatten(item_11.Item2))
bnd_8 = Bounds(Numbers=flatten(item_11.Item1))
bnd_9 = Bounds(Numbers=flatten(item_12.Item))
bnd_10 = Bounds(Numbers=flatten(item_12.Item2))  # disabled
bnd_11 = Bounds(Numbers=flatten(item_12.Item1))
bnd_12 = Bounds(Numbers=flatten(item_13.Item1))
bnd_13 = Bounds(Numbers=flatten(item_13.Item2))
bnd_14 = Bounds(Numbers=flatten(item_14.Item))
bnd_15 = Bounds(Numbers=flatten(item_14.Item2))
cset = CreateSet(List=flatten(item_13.Item))  # -> Set, flatten(Map)
bnd_16 = Bounds(Numbers=flatten(item_14.Item1))
bnd_17 = Bounds(Numbers=flatten(item_15.Item))
bnd_18 = Bounds(Numbers=flatten(item_15.Item2))  # disabled
bnd_19 = Bounds(Numbers=flatten(item_15.Item1))
bnd_20 = Bounds(Numbers=cset.Map)
remap_5 = RemapNumbers(Value=item_10.Item1, Source=bnd_5, Target=Domain(0, 1))  # -> Mapped, Clipped
remap_6 = RemapNumbers(Value=item_10.Item2, Source=bnd_4, Target=Domain(0, 1))  # -> Mapped, Clipped
remap_7 = RemapNumbers(Value=item_11.Item, Source=bnd_6, Target=Domain(0, 1))  # -> Mapped, Clipped
remap_8 = RemapNumbers(Value=item_12.Item, Source=bnd_9, Target=Domain(0, 1))  # -> Mapped, Clipped
remap_9 = RemapNumbers(Value=item_11.Item1, Source=bnd_8, Target=Domain(0, 1))  # -> Mapped, Clipped
remap_10 = RemapNumbers(Value=item_11.Item2, Source=bnd_7, Target=Domain(0, 1))  # -> Mapped, Clipped
remap_11 = RemapNumbers(Value=item_12.Item1, Source=bnd_11, Target=Domain(0, 1))  # -> Mapped, Clipped
remap_12 = RemapNumbers(Value=item_12.Item2, Source=bnd_10, Target=Domain(0, 1))  # -> Mapped, Clipped; disabled
remap_13 = RemapNumbers(Value=item_13.Item1, Source=bnd_12, Target=Domain(0, 1))  # -> Mapped, Clipped
remap_14 = RemapNumbers(Value=item_13.Item2, Source=bnd_13, Target=Domain(0, 1))  # -> Mapped, Clipped
remap_15 = RemapNumbers(Value=item_14.Item, Source=bnd_14, Target=Domain(0, 1))  # -> Mapped, Clipped
remap_16 = RemapNumbers(Value=item_14.Item1, Source=bnd_16, Target=Domain(0, 1))  # -> Mapped, Clipped
remap_17 = RemapNumbers(Value=item_14.Item2, Source=bnd_15, Target=Domain(0, 1))  # -> Mapped, Clipped
remap_18 = RemapNumbers(Value=item_15.Item, Source=bnd_17, Target=Domain(0, 1))  # -> Mapped, Clipped
remap_19 = RemapNumbers(Value=item_15.Item1, Source=bnd_19, Target=Domain(0, 1))  # -> Mapped, Clipped
remap_20 = RemapNumbers(Value=item_15.Item2, Source=bnd_18, Target=Domain(0, 1))  # -> Mapped, Clipped; disabled

cull_i_2 = CullIndex(List=panel_51, Indices=number_slider_3, Wrap=True)
cull_i_3 = CullIndex(List=panel_49, Indices=number_slider_3, Wrap=True)
cull_i_4 = CullIndex(List=panel_50, Indices=number_slider_3, Wrap=True)
cull_i_5 = CullIndex(List=panel_48, Indices=number_slider_3, Wrap=True)

remap_21 = RemapNumbers(Value=cset.Map, Source=bnd_20, Target=Slider(1000, range=0..1000))  # -> Mapped, Clipped
featurets_2 = FeatureTensorSet(
    Feature0=flatten(remap_5.Mapped),
    Feature1=flatten(remap_6.Mapped),
    Feature2=flatten(remap_7.Mapped),
    Feature3=flatten(remap_9.Mapped),
    Feature4=flatten(remap_10.Mapped),
    Feature5=flatten(remap_8.Mapped),
    Feature6=flatten(remap_11.Mapped),
    Feature7=flatten(remap_12.Mapped))

multiplication = Multiplication(A=cull_i_3, B=Slider(1000, range=0..1000))
subtraction = Subtraction(A=Slider(2017, range=0..10000), B=cull_i_5)
multiplication_2 = Multiplication(A=subtraction, B=Slider(100, range=0..1000))

featurets_3 = FeatureTensorSet(Feature0=remap_21.Mapped)
featurets_4 = FeatureTensorSet(
    Feature0=flatten(remap_13.Mapped),
    Feature1=flatten(remap_14.Mapped),
    Feature2=flatten(remap_15.Mapped),
    Feature3=flatten(remap_16.Mapped),
    Feature4=flatten(remap_17.Mapped),
    Feature5=flatten(remap_18.Mapped),
    Feature6=flatten(remap_19.Mapped),
    Feature7=flatten(remap_20.Mapped))
featurets_5 = FeatureTensorSet(Feature0=flatten(remap_8.Mapped), Feature1=flatten(remap_11.Mapped), Feature2=flatten(remap_5.Mapped))
item_16 = ListItem(List=flatten(item_5.Item1), Index=mll_stuff_2, Wrap=True)
item_17 = ListItem(List=flatten(item_5.Item3), Index=mll_stuff_2, Wrap=True)
item_18 = ListItem(List=flatten(item_5.Item2), Index=mll_stuff_2, Wrap=True)
item_19 = ListItem(List=flatten(item_5.Item), Index=mll_stuff_2, Wrap=True)
item_20 = ListItem(List=flatten(geo_2), Index=mll_stuff_2, Wrap=True)
featurets_6 = FeatureTensorSet(Feature0=flatten(remap_18.Mapped), Feature1=flatten(remap_19.Mapped), Feature2=flatten(remap_13.Mapped))
flatten_5 = FlattenTree(Tree=item_15.Item2, Path="{0}")
panel_52 = Panel(item_20)
# Visualization Stuffs
panel_53 = Panel(item_19)

featurets_7 = FeatureTensorSet(Feature0=multiplication_2, Feature1=multiplication, Feature2=cull_i_4)
remap_22 = RemapTSet(TensorSet=featurets_7, Source="0 to 10000", Target=Domain(0, 1))

pt_5 = Point(Point(0, 0, 0))
pt_6 = ConstructPoint(XCoordinate=item_16, YCoordinate=item_18, ZCoordinate=item_17)
scale = Scale(Geometry=pt_6, Center=pt_5, Factor=Slider(0.01, range=0..0.01))  # -> Geometry, Transform
series = Series(Start=Slider(100, range=0..1000), Step=1, Count=Slider(100, range=0..1000))
series_2 = Series(Start=Slider(100, range=0..1000), Step=1, Count=Slider(100, range=0..1000))
number_slider_4 = Slider(2, range=0..10)
noise = AddNoise(TensorSet=featurets_3, Amplitude=Slider(0.02, range=0..0.1), Seed=series, Constrain=Domain(0, 1))

panel_54 = Panel("""3
3
1""")
network = ConstructNetwork(Layers=panel_54, Activation=Slider(1, range=0..1), Alpha=1, Seed=Slider(58, range=0..100))

noise_2 = AddNoise(TensorSet=featurets_6, Amplitude=Slider(0.02, range=0..0.1), Seed=series_2, Constrain=Domain(0, 1))
move = Move(Geometry=item_20, Motion=scale.Geometry)  # -> Geometry, Transform

detset = DeconstructTensorSet(TensorSet=remap_22)
panel_55 = Panel(detset)

merge_9 = Merge(
    Data1=ColourSwatch(SwatchColor=RGB(0, 255, 166)),
    Data2=ColourSwatch(SwatchColor=RGB(255, 215, 54)),
    Data3=ColourSwatch(SwatchColor=RGB(255, 0, 0)))  # -> graft(Result)
preview = CustomPreview(Geometry=move.Geometry, Shader=merge_9)

mergets = MergeTSet(TensorSets=noise_2)
mergets_2 = MergeTSet(TensorSets=noise)
backprop = Backpropagation(
    ActivationNetwork=network,
    Input=mergets,
    Output=mergets_2,
    LearningRate=0.01,
    Momentum=0.001,
    Epoch=10,
    Iterations=Slider(700, range=0..10000))  # -> ActivationNetwork, Error

_2dpreview = NetworkPreview(Network=backprop.ActivationNetwork, Lines=Domain(1, 5), Radius=5)
compute = Compute(ActivationNetwork=backprop.ActivationNetwork, Input=featurets_5)
detset_2 = DeconstructTensorSet(TensorSet=compute)

detensor = DeconstructTensor(Tensor=detset_2)  # -> flatten(Values)
panel_56 = Panel(detensor)

panel_57 = Panel("Actual Price")
panel_58 = Panel(cull_i_2)
panel_59 = Panel("Predicted Price")
panel_60 = Panel(detensor)
subtraction_2 = Subtraction(A=panel_58, B=panel_60)
panel_61 = Panel("Price Difference")
panel_62 = Panel(subtraction_2)
division_3 = Division(A=panel_62, B=panel_58)
multiplication_3 = Multiplication(A=division_3, B=Slider(100, range=0..100))
panel_63 = Panel("% Diff")
panel_64 = Panel(multiplication_3)

item_21 = ListItem(List=cset.Set, Index=detensor, Wrap=True)
panel_65 = Panel(item_21)
entwine_2 = Entwine(Branch00=panel_58, Branch01=detensor, FlattenInputs=True)
panel_66 = Panel(item_10.Item)

graph = QuickGraph(panel_58)
graph_2 = QuickGraph(detensor)
graph_3 = QuickGraph(entwine_2)
panel_67 = Panel("Actual Sale Price")
panel_68 = Panel("Approximated Sale Price")

# ----
# ToolDescription: Enter a description of this definition's functionality and use
update_file_info = Button()
group_prefixes = Panel("""out_
in_
action_
warning_
cluster""")
c_script = CSharpScript(update=color_groups_clusters, name=group_prefixes, col=col)  # -> out, A; inputs update: Boolean, name: list of String, col: list of Color
# ---------- c_script: C# ----------
    Color clusterColor = Color.Transparent;
    for(int i = 0;i < name.Count;i++){
      if(name[i].Contains("cluster")){
        clusterColor = col[i];
        break;
      }
    }



    if(update){
      List<Guid> guids = new List<Guid>();
      List<Grasshopper.Kernel.Special.GH_Group> grps = new List<Grasshopper.Kernel.Special.GH_Group>();
      List<Grasshopper.Kernel.Special.GH_Group> alreadygrps = new List<Grasshopper.Kernel.Special.GH_Group>();


      foreach(IGH_DocumentObject o in GrasshopperDocument.Objects){
        Grasshopper.Kernel.Special.GH_Group g = o as Grasshopper.Kernel.Special.GH_Group;
        if(g != null){
          for(int j = 0;j < name.Count;j++){
            if(g.NickName.ToUpper().Contains(name[j].ToUpper())){
              g.Colour = col[j % col.Count];
            }

          }
        }


        if(o is Grasshopper.Kernel.Special.GH_Cluster){
          Grasshopper.Kernel.Special.GH_Cluster cluster = o as  Grasshopper.Kernel.Special.GH_Cluster;
          string filepath = cluster.FilePath;
          if(!String.IsNullOrEmpty(filepath)){
            cluster.Name = System.IO.Path.GetFileNameWithoutExtension(filepath);
            cluster.NickName = System.IO.Path.GetFileNameWithoutExtension(filepath);
            cluster.Attributes.ExpireLayout();
          }
          guids.Add(cluster.InstanceGuid);
          Grasshopper.Kernel.Special.GH_Group grp = new Grasshopper.Kernel.Special.GH_Group();
          grps.Add(grp);

        } else if (o is Grasshopper.Kernel.Special.GH_Group){
          Grasshopper.Kernel.Special.GH_Group alreadygrp = o as Grasshopper.Kernel.Special.GH_Group;
          alreadygrps.Add(alreadygrp);
        }





      }

      List<bool> isAlreadyInGroup = IsAlreadyInGroup(guids, alreadygrps);

      for(int i = 0;i < grps.Count;i++){
        Grasshopper.Kernel.Special.GH_Group grp = grps[i];
        grp.Colour = clusterColor;
        grp.NickName = "";
        grp.AddObject(guids[i]);
        if(!isAlreadyInGroup[i]){
          grp.ExpireCaches();
          GrasshopperDocument.AddObject(grp, false, 1000);
        }
      }



    }
# ---------- c_script: C# additional code ----------
  List<bool> IsAlreadyInGroup(List<Guid> guids, List<Grasshopper.Kernel.Special.GH_Group> grps){
    List<bool> results = new List<bool>();
    foreach(Guid g in guids){
      results.Add(false);
    }
    foreach(Grasshopper.Kernel.Special.GH_Group grp in grps){ //for every group in the pre-existing groups
      if(grp.Objects().Count == 1){ //if that group only has one object in it
        for (int j = 0;j < guids.Count;j++){
          Guid g = guids[j];
          if(grp.ObjectIDs.Contains(g)){
            results[j] = true;
            break;
          }
        }
      }
    }
    return results;
  }
# ---------- end c_script ----------

data_44 = Data(update_file_info)

c_script_2 = CSharpScript(x=data_44)  # -> out, A, B, C, D, E
# ---------- c_script_2: C# ----------
    List < IGH_DocumentObject> objectsRecursive = new List<IGH_DocumentObject>();
    objectsRecursive.AddRange(clusterObjectsRecursive(GrasshopperDocument));


    B = GrasshopperDocument.Author.Name + " " + GrasshopperDocument.Author.Email;
    D = GrasshopperDocument.Properties.DateTag;
    if(GrasshopperDocument.IsFilePathDefined){
      C = GrasshopperDocument.FilePath;
      System.IO.FileInfo info = new System.IO.FileInfo(GrasshopperDocument.FilePath);
      if(info.LastWriteTime != null){
        E = info.LastWriteTime;
      } else {
        E = "";
      }
    } else {
      C = "Unsaved Document";
      E = "";
    }
    A = objectsRecursive;
# ---------- c_script_2: C# additional code ----------
  List<IGH_DocumentObject> clusterObjectsRecursive(GH_Document doc){
    List<IGH_DocumentObject> objList = new List<IGH_DocumentObject>();
    objList.AddRange(doc.Objects);
    foreach(IGH_DocumentObject obj in doc.Objects){
      Grasshopper.Kernel.Special.GH_Cluster cluster = obj as Grasshopper.Kernel.Special.GH_Cluster;
      try{
        objList.AddRange(clusterObjectsRecursive(cluster.Document("")));
      } catch {

      }
    }
    return objList;
  }
# ---------- end c_script_2 ----------
cluster_5 = Cluster_2(T=c_script_2.A, N=c_script_2.B, fn=c_script_2.C, dc=c_script_2.D, dm=c_script_2.E)
file_info = Panel(cluster_5)

# ==== cluster Cluster_2
T = ClusterInput()
N = ClusterInput()
fn = ClusterInput()
dc = ClusterInput()
dm = ClusterInput()
cluster = Cluster(T=T, N=N, fn=fn, dc=dc, dm=dm)  # -> T_2, author_2, objcount_2, fn_3, dc_4, dm_4
merge = Merge(
    Data1=cluster.author_2,
    Data2=cluster.T_2,
    Data3=cluster.objcount_2,
    Data4=cluster.fn_3,
    Data5=cluster.dc_4,
    Data6=cluster.dm_4)
R = ClusterOutput(merge)

# ==== cluster DLength: computes length of a domain
I = ClusterInput()
dedomain = DeconstructDomain(Domain=I)  # -> Start, End
subtraction = Subtraction(A=dedomain.Start, B=dedomain.End)
abs = Absolute(Value=subtraction)
y = ClusterOutput(abs)

# ==== cluster Cluster_3
data = ClusterInput()
data_2 = Data(data)
pdecon = Deconstruct(Point=data_2)  # -> XComponent, YComponent, ZComponent
merge = Merge(Data1=pdecon.XComponent, Data2=pdecon.YComponent, Data3=pdecon.ZComponent)
data_3 = Data(merge)
data_4 = ClusterOutput(data_3)

# ==== cluster Cluster
N = ClusterInput()
T = ClusterInput()
N_2 = Text(N)
split = TextSplit(Text=T, Separators=".")
fn = ClusterInput()
dm = ClusterInput()
item = ListItem(List=split, Index=0, Wrap=True)
dc = ClusterInput()
pan = Panel("""HDT_Reference
HDTReference""")
pan_2 = Panel("""Human
Human""")
lng = ListLength(List=T)
len = TextLength(Text=N_2)
contains = ContainsAB(B=N_2)
dm_2 = Text(dm)
dc_2 = Text(dc)
fn_2 = Text(fn)
replace = ReplaceMembers(Set=item, Find=pan, Replace=pan_2)
cset = CreateSet(List=flatten(replace))  # -> Set, Map
txt = Text(["ScriptComponents", "Grasshopper", "MathComponents", "GalapagosComponents", "FieldComponents", "VectorComponents", "AnalysisComponents", "CurveComponents", "LegacyScriptComponents", "SurfaceComponents", "TriangulationComponents", "MassXForms", "LinearXForms"])
format = Format(Format="Definition by {0}", Culture=127, Data0=N_2)
difference = SetDifference(SetA=cset.Set, SetB=txt)
lng_2 = ListLength(List=flatten(difference))
dispatch = Dispatch(List=format, DispatchPattern=contains)  # -> ListA, ListB
format_2 = Format(Format="Object Count: {0:0}", Culture=127, Data0=lng)
format_3 = Format(Format="Date Modified: {0}", Culture=127, Data0=dm_2)
format_4 = Format(Format="Date Created: {0}", Culture=127, Data0=dc_2)
dependencies = Text(flatten(difference))
author = Text(flatten(dispatch.ListB))
larger = LargerThan(FirstNumber=lng_2, SecondNumber="1")  # -> LargerThan, OrEqualTo
objcount = Text(flatten(format_2))
author_2 = ClusterOutput(author)
dm_3 = Text(flatten(format_3))
fn_3 = ClusterOutput(fn_2)
dc_3 = Text(flatten(format_4))
objcount_2 = ClusterOutput(objcount)
dc_4 = ClusterOutput(dc_3)
filter = StreamFilter(
    Gate=larger.LargerThan,
    Stream0="This definition requires the following plug-in:",
    Stream1="This definition requires the following plug-ins:")
dm_4 = ClusterOutput(dm_3)
pan_3 = Panel("""{0}
{1}""")
join = TextJoin(Text=dependencies)
format_5 = Format(Format=pan_3, Culture=127, Data0=filter, Data1=join)
clean = CleanTree(Tree=format_5, CleanInvalid=True, CleanEmpty=False)
T_2 = ClusterOutput(clean)

# ==== cluster ContainsAB: Tests if a string contains another string.
B = ClusterInput()
A = ClusterInput()
A_2 = String(A)
B_2 = String(B)
eval = Evaluate(F="Contains(x,y)", x=A_2, y=B_2)
c = Boolean(eval)
c_2 = ClusterOutput(c)
