# Grasshopper definition grouping.gh (Grasshopper 0.9.76)

geo = Geometry([<brep referenced from the Rhino model> x24])
jitter = Jitter(List=geo, Jitter=1, Seed=2)  # -> Values, Indices
split = SplitList(List=jitter.Values, Index="4")  # -> ListA, ListB
split_2 = SplitList(List=split.ListB, Index=Slider(4, range=0..10))  # -> ListA, ListB
split_3 = SplitList(List=split_2.ListB, Index=Slider(8, range=0..10))  # -> ListA, ListB
split_4 = SplitList(List=split_3.ListB, Index=Slider(4, range=0..10))  # -> ListA, ListB
entwine = Entwine(
    Branch00=split.ListA,
    Branch01=split_2.ListA,
    Branch02=split_3.ListA,
    Branch03=split_4.ListA,
    Branch04=split_4.ListB,
    FlattenInputs=True)
color_groups_clusters = Button(ExpressionNormal="True")
geo_2 = Geometry(entwine)
lng = ListLength(List=geo_2)
sort = SortList(Keys=flatten(lng))  # -> Keys, ValuesA
bbox = BoundingBox(Content=geo_2, Plane=PlaneXY(0, 0, 0))  # -> Box, Box_2
col = Colour([RGBA(4, 0, 255, 135), RGBA(0, 128, 255, 133), RGBA(210, 255, 148, 141), RGBA(255, 0, 0, 122), RGBA(224, 224, 224, 211)])
lng_2 = ListLength(List=flatten(lng))
box_corners = BoxCorners(Box=bbox.Box)  # -> CornerA, CornerB, CornerC, CornerD, CornerE, CornerF, CornerG, CornerH
item = ListItem(List=reverse(sort.Keys), Index=0, Wrap=True)
sqrt = SquareRoot(Value=lng_2)
sqrt_2 = SquareRoot(Value=item)
expression = Expression(x=sqrt, Expression="Ceiling(x)-1")
expression_2 = Expression(x=sqrt_2, Expression="Ceiling(x)")
sqgrid = Square(Plane=PlaneXY(0, 0, 0), Size=Slider(115, range=0..1000), ExtentX=expression, ExtentY=expression)  # -> Cells, Points
split_5 = SplitList(List=flatten(sqgrid.Points), Index=lng_2)  # -> ListA, ListB
sqgrid_2 = Square(Plane=split_5.ListA, Size=Slider(31, range=0..1000), ExtentX=expression_2, ExtentY=expression_2)  # -> Cells, Points
trim = TrimTree(Tree=sqgrid_2.Points, Depth=1)
split_6 = SplitList(List=trim, Index=lng)  # -> ListA, ListB
vec2pt = Vector2Pt(PointA=box_corners.CornerA, PointB=split_6.ListA, Unitize=False)  # -> Vector, Length
move = Move(Geometry=geo_2, Motion=vec2pt.Vector)  # -> Geometry, Transform

# ----
# ToolDescription: Enter a description of this definition's functionality and use
update_file_info = Button()
group_prefixes = Panel("""out_
in_
action_
warning_
cluster""")
c_script = CSharpScript(update=color_groups_clusters, name=group_prefixes, col=col)  # -> out, A; inputs update: Boolean, name: list of String, col: list of Color
# ---------- c_script: C# ----------
    Color clusterColor = Color.Transparent;
    for(int i = 0;i < name.Count;i++){
      if(name[i].Contains("cluster")){
        clusterColor = col[i];
        break;
      }
    }



    if(update){
      List<Guid> guids = new List<Guid>();
      List<Grasshopper.Kernel.Special.GH_Group> grps = new List<Grasshopper.Kernel.Special.GH_Group>();
      List<Grasshopper.Kernel.Special.GH_Group> alreadygrps = new List<Grasshopper.Kernel.Special.GH_Group>();


      foreach(IGH_DocumentObject o in GrasshopperDocument.Objects){
        Grasshopper.Kernel.Special.GH_Group g = o as Grasshopper.Kernel.Special.GH_Group;
        if(g != null){
          for(int j = 0;j < name.Count;j++){
            if(g.NickName.ToUpper().Contains(name[j].ToUpper())){
              g.Colour = col[j % col.Count];
            }

          }
        }


        if(o is Grasshopper.Kernel.Special.GH_Cluster){
          Grasshopper.Kernel.Special.GH_Cluster cluster = o as  Grasshopper.Kernel.Special.GH_Cluster;
          string filepath = cluster.FilePath;
          if(!String.IsNullOrEmpty(filepath)){
            cluster.Name = System.IO.Path.GetFileNameWithoutExtension(filepath);
            cluster.NickName = System.IO.Path.GetFileNameWithoutExtension(filepath);
            cluster.Attributes.ExpireLayout();
          }
          guids.Add(cluster.InstanceGuid);
          Grasshopper.Kernel.Special.GH_Group grp = new Grasshopper.Kernel.Special.GH_Group();
          grps.Add(grp);

        } else if (o is Grasshopper.Kernel.Special.GH_Group){
          Grasshopper.Kernel.Special.GH_Group alreadygrp = o as Grasshopper.Kernel.Special.GH_Group;
          alreadygrps.Add(alreadygrp);
        }





      }

      List<bool> isAlreadyInGroup = IsAlreadyInGroup(guids, alreadygrps);

      for(int i = 0;i < grps.Count;i++){
        Grasshopper.Kernel.Special.GH_Group grp = grps[i];
        grp.Colour = clusterColor;
        grp.NickName = "";
        grp.AddObject(guids[i]);
        if(!isAlreadyInGroup[i]){
          grp.ExpireCaches();
          GrasshopperDocument.AddObject(grp, false, 1000);
        }
      }



    }
# ---------- c_script: C# additional code ----------
  List<bool> IsAlreadyInGroup(List<Guid> guids, List<Grasshopper.Kernel.Special.GH_Group> grps){
    List<bool> results = new List<bool>();
    foreach(Guid g in guids){
      results.Add(false);
    }
    foreach(Grasshopper.Kernel.Special.GH_Group grp in grps){ //for every group in the pre-existing groups
      if(grp.Objects().Count == 1){ //if that group only has one object in it
        for (int j = 0;j < guids.Count;j++){
          Guid g = guids[j];
          if(grp.ObjectIDs.Contains(g)){
            results[j] = true;
            break;
          }
        }
      }
    }
    return results;
  }
# ---------- end c_script ----------

data = Data(update_file_info)

c_script_2 = CSharpScript(x=data)  # -> out, A, B, C, D, E
# ---------- c_script_2: C# ----------
    List < IGH_DocumentObject> objectsRecursive = new List<IGH_DocumentObject>();
    objectsRecursive.AddRange(clusterObjectsRecursive(GrasshopperDocument));


    B = GrasshopperDocument.Author.Name + " " + GrasshopperDocument.Author.Email;
    D = GrasshopperDocument.Properties.DateTag;
    if(GrasshopperDocument.IsFilePathDefined){
      C = GrasshopperDocument.FilePath;
      System.IO.FileInfo info = new System.IO.FileInfo(GrasshopperDocument.FilePath);
      if(info.LastWriteTime != null){
        E = info.LastWriteTime;
      } else {
        E = "";
      }
    } else {
      C = "Unsaved Document";
      E = "";
    }
    A = objectsRecursive;
# ---------- c_script_2: C# additional code ----------
  List<IGH_DocumentObject> clusterObjectsRecursive(GH_Document doc){
    List<IGH_DocumentObject> objList = new List<IGH_DocumentObject>();
    objList.AddRange(doc.Objects);
    foreach(IGH_DocumentObject obj in doc.Objects){
      Grasshopper.Kernel.Special.GH_Cluster cluster = obj as Grasshopper.Kernel.Special.GH_Cluster;
      try{
        objList.AddRange(clusterObjectsRecursive(cluster.Document("")));
      } catch {

      }
    }
    return objList;
  }
# ---------- end c_script_2 ----------
cluster = Cluster_2(T=c_script_2.A, N=c_script_2.B, fn=c_script_2.C, dc=c_script_2.D, dm=c_script_2.E)
file_info = Panel(cluster)

# ==== cluster Cluster_2
T = ClusterInput()
N = ClusterInput()
fn = ClusterInput()
dc = ClusterInput()
dm = ClusterInput()
cluster = Cluster(T=T, N=N, fn=fn, dc=dc, dm=dm)  # -> T_2, author_2, objcount_2, fn_3, dc_4, dm_4
merge = Merge(
    Data1=cluster.author_2,
    Data2=cluster.T_2,
    Data3=cluster.objcount_2,
    Data4=cluster.fn_3,
    Data5=cluster.dc_4,
    Data6=cluster.dm_4)
R = ClusterOutput(merge)

# ==== cluster Cluster
N = ClusterInput()
T = ClusterInput()
N_2 = Text(N)
split = TextSplit(Text=T, Separators=".")
fn = ClusterInput()
dm = ClusterInput()
item = ListItem(List=split, Index=0, Wrap=True)
dc = ClusterInput()
pan = Panel("""HDT_Reference
HDTReference""")
pan_2 = Panel("""Human
Human""")
lng = ListLength(List=T)
len = TextLength(Text=N_2)
contains = ContainsAB(B=N_2)
dm_2 = Text(dm)
dc_2 = Text(dc)
fn_2 = Text(fn)
replace = ReplaceMembers(Set=item, Find=pan, Replace=pan_2)
cset = CreateSet(List=flatten(replace))  # -> Set, Map
txt = Text(["ScriptComponents", "Grasshopper", "MathComponents", "GalapagosComponents", "FieldComponents", "VectorComponents", "AnalysisComponents", "CurveComponents", "LegacyScriptComponents", "SurfaceComponents", "TriangulationComponents", "MassXForms", "LinearXForms"])
format = Format(Format="Definition by {0}", Culture=127, Data0=N_2)
difference = SetDifference(SetA=cset.Set, SetB=txt)
lng_2 = ListLength(List=flatten(difference))
dispatch = Dispatch(List=format, DispatchPattern=contains)  # -> ListA, ListB
format_2 = Format(Format="Object Count: {0:0}", Culture=127, Data0=lng)
format_3 = Format(Format="Date Modified: {0}", Culture=127, Data0=dm_2)
format_4 = Format(Format="Date Created: {0}", Culture=127, Data0=dc_2)
dependencies = Text(flatten(difference))
author = Text(flatten(dispatch.ListB))
larger = LargerThan(FirstNumber=lng_2, SecondNumber="1")  # -> LargerThan, OrEqualTo
objcount = Text(flatten(format_2))
author_2 = ClusterOutput(author)
dm_3 = Text(flatten(format_3))
fn_3 = ClusterOutput(fn_2)
dc_3 = Text(flatten(format_4))
objcount_2 = ClusterOutput(objcount)
dc_4 = ClusterOutput(dc_3)
filter = StreamFilter(
    Gate=larger.LargerThan,
    Stream0="This definition requires the following plug-in:",
    Stream1="This definition requires the following plug-ins:")
dm_4 = ClusterOutput(dm_3)
pan_3 = Panel("""{0}
{1}""")
join = TextJoin(Text=dependencies)
format_5 = Format(Format=pan_3, Culture=127, Data0=filter, Data1=join)
clean = CleanTree(Tree=format_5, CleanInvalid=True, CleanEmpty=False)
T_2 = ClusterOutput(clean)

# ==== cluster ContainsAB: Tests if a string contains another string.
B = ClusterInput()
A = ClusterInput()
A_2 = String(A)
B_2 = String(B)
eval = Evaluate(F="Contains(x,y)", x=A_2, y=B_2)
c = Boolean(eval)
c_2 = ClusterOutput(c)
