# Grasshopper definition 3d field integration.gh (Grasshopper 0.9.76)
# plug-ins: Dodo

number_slider = Slider(10, range=0..10)
pt = Point(Point(-1.728048253, 2.065883438, 3.013170814))
pt_2 = ConstructPoint(XCoordinate=0, YCoordinate=0, ZCoordinate=0)
fspin = SpinForce(Plane=PlaneXY(0, 0, 0), Strength=1, Radius=5, Decay=2)
pcharge = PointCharge(Point=pt_2, Charge=1, Decay=2)
sph = Sphere(Base=pt, Radius=Slider(0.3, range=0..1))
box = CenterBox(Base=PlaneXY(0, 0, 0), X=number_slider, Y=number_slider, Z=number_slider)
mergef = MergeFields(Fields=[fspin, pcharge])
customfield = CustomField(U="x", V="x - y")
preview = CustomPreview(Geometry=sph, Shader=ColourSwatch(SwatchColor=RGB(207, 207, 207)))
crv = Curve(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)
fdir = DirectionDisplay(Field=customfield, Section=crv, Samples=1000)
ftensor = TensorDisplay(Field=customfield, Section=crv, Samples=1000)
pop3d = Populate3D(Region=box, Count=Slider(700, range=0..1000), Seed=1)
preview_2 = CustomPreview(Geometry=pop3d, Shader=ColourSwatch(SwatchColor=RGB(130, 130, 130)))
evf = EvaluateField(Field=mergef, Point=pop3d)  # -> Tensor, Strength
nickname = GH_VectorField(Points=pop3d, Vectors=evf.Tensor)
brep = Brep(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)
integfieldpoint = PointTrajectory(Field=mergef, Point=pt, Steps=3000, Mass=1)
nickname_2 = GH_IntegrateVFOnObject(Field=mergef, Point=pt, Steps=1000, Accuracy=0.1, Method=3, Object=brep)
fline = FieldLine(Field=mergef, Point=pt, Steps=1000, Accuracy=0.1, Method=3)
fline_2 = FieldLine(Field=nickname, Point=pt, Steps=1000, Accuracy=Slider(0.05, range=0..0.1), Method=Slider(4, range=0..10))
preview_3 = CustomPreview(Geometry=nickname_2, Shader=ColourSwatch(SwatchColor=RGB(171, 108, 0)))
preview_4 = CustomPreview(Geometry=fline, Shader=ColourSwatch(SwatchColor=RGB(0, 0, 0)))
preview_5 = CustomPreview(Geometry=fline_2, Shader=ColourSwatch(SwatchColor=RGB(60, 0, 255)))
preview_6 = CustomPreview(Geometry=integfieldpoint, Shader=ColourSwatch(SwatchColor=RGB(0, 162, 171)))
