# Grasshopper definition Dmaths.gh (Grasshopper 0.9.76)
# plug-ins: Dodo

panel = Panel("""1
2
4
3
5
54""")
panel_2 = Panel("""45
4
56
4
674
3""")
panel_3 = Panel("""2
3""")
panel_4 = Panel("""56565
3""")
number_slider = Slider(3, range=0..10)
sqr = Square(Value=number_slider)
complex = CreateComplex(Real=panel_3, Imaginary=panel_4)
complex_2 = CreateComplex(Real=panel_4, Imaginary=panel_3)
series = Series(Start=0, Step=1, Count=sqr)
concat = Concatenate(FragmentA=Slider(2, range=0..10), FragmentB="* x +", FragmentC=Slider(1, range=0..10))
panel_5 = Panel("NL-Least Square.")
jitter = Jitter(List=series, Jitter=1, Seed=2)  # -> Values, Indices
# Dodo and GH matrices
series_2 = Series(Start=0, Step=1, Count=Slider(6, range=0..10))
# Vector and matrix manipulation
dvect = DVector(Numbers=panel)
dvect_2 = DVector(Numbers=panel_2)
dvect_3 = DVector(Numbers=complex)
dvect_4 = DVector(Numbers=complex_2)
matrix = ConstructMatrix(Rows=3, Columns=Slider(1, range=0..1))
# Linear Least Square.
# Please note that you need to add 1 at the end of your input vectors if you want the resulting hyperplane not to be forced to pass through the origin.
# In other words, if you want to find the constant factor
panel_6 = Panel("2 * x + 1")
panel_7 = Panel("2 * x + 1")
panel_8 = Panel("Fourier Transform")
series_3 = Series(Start=0, Step=1, Count=Slider(6, range=0..10))
series_4 = Series(Start=0, Step=1, Count=Slider(6, range=0..10))
matrix_2 = ConstructMatrix(Rows=number_slider, Columns=number_slider, Values=jitter.Values)
panel_9 = Panel(series_2)
matrix_3 = DisplayMatrix(matrix)
dvect_5 = DodoVector([dvect_3, dvect_4])
dvect_6 = DodoVector([dvect, dvect_2])
eval = Evaluate(F=panel_6, x=series_3)
eval_2 = Evaluate(F=concat, x=series_4)
dtranspose = MatrixTranspose(DodoMatrix=matrix_2)
M = DodoMatrix(matrix)
M_2 = DodoMatrix(matrix)
matrix_4 = Matrix(M)
matrix_5 = Matrix(matrix)
dsum = Sum(A=dtranspose, B=matrix_2)
dft = DFourierTransform(Complex=panel_9, DodoData_FourierType=2)
M_3 = DodoMatrix(matrix_4)
M_4 = DodoMatrix(matrix_5)
M_5 = DodoMatrix(matrix)
dvect_7 = DodoVector(M_3)
dvect_8 = DodoVector(M_2)
dvect_9 = DodoVector(M_4)
dvect_10 = DodoVector(matrix)
dvect_11 = DodoVector(M_5)
dmatrix = DodoMatrix(DodoVector=dvect_6)
dvect2 = Vector2(N1=series_3, N2="1")
dvect2_2 = Vector2(N1=series_4, N2="1")
ddiv = Divide(L=dsum, Complex="2")
panel_10 = Panel(dft)
M_6 = DodoMatrix(ddiv)
leastsqrs = LeastSquares(DodoVector=dvect2, Results=eval, DodoData_DecompositionLeastSquares=0)
leastsqrs_2 = LeastSquares(DodoVector=dvect2_2, Results=eval_2, DodoData_DecompositionLeastSquares=0)
nlleastsqrs = NLLeastSquares(DodoVector=dvect2_2, Results=series_4, A1="a1", A2="1")
panel_11 = Panel(dvect2_2)
dmatinfo = MatrixInfo(DodoMatrix=M_6)  # -> Info, Determinant, IsHermitian, IsSymmetric, Rank, ConditionNumber
dmatrix_2 = DodoMatrix(DodoVector=dvect_5)
panel_12 = Panel(leastsqrs)
panel_13 = Panel(leastsqrs_2)
panel_14 = Panel(nlleastsqrs)
panel_15 = Panel(dmatinfo.Info)
extractrow = ExtractRow(DodoMatrix=dmatrix_2, Row=Slider(1, range=0..1))
nickname = GH_ExtractColumn(DodoMatrix=dmatrix_2, Row=Slider(0, range=0..100))
deconmatr = DeconstructMatrix(DodoMatrix=M_6)  # -> Elements, Columns, Row
matrfactoriz = MatrixFactorization(DodoMatrix=M_6, DodoData_DodoFactorization=0)
matrfactoriz_2 = MatrixFactorization(DodoMatrix=M_6, DodoData_DodoFactorization=3)
matrfactoriz_3 = MatrixFactorization(DodoMatrix=M_6, DodoData_DodoFactorization=4)
matrfactoriz_4 = MatrixFactorization(DodoMatrix=M_6, DodoData_DodoFactorization=5)
matrfactoriz_5 = MatrixFactorization(DodoMatrix=M_6, DodoData_DodoFactorization=6)
matrfactoriz_6 = MatrixFactorization(DodoMatrix=M_6, DodoData_DodoFactorization=2)
matrfactoriz_7 = MatrixFactorization(DodoMatrix=M_6, DodoData_DodoFactorization=1)
matrfactoriz_8 = MatrixFactorization(DodoMatrix=M_6, DodoData_DodoFactorization=7)
matrix_6 = DisplayMatrix(M_6)
panel_16 = Panel(nickname)
panel_17 = Panel(extractrow)
conmatr = ConstructMatrix(Elements=deconmatr.Elements, Columns=deconmatr.Columns, Row=deconmatr.Row)
dyadprod = DyadicProduct(L=dvect, R=dvect_2)
number_slider_2 = Slider(5, range=0..10)
number_slider_3 = Slider(7, range=0..10)
number_slider_4 = Slider(8, range=0..10)
matrix_7 = DisplayMatrix(conmatr)
matrix_8 = DisplayMatrix(matrfactoriz)
matrix_9 = DisplayMatrix(matrfactoriz_8)
matrix_10 = DisplayMatrix(matrfactoriz_6)
matrix_11 = DisplayMatrix(matrfactoriz_7)
matrix_12 = DisplayMatrix(matrfactoriz_2)
matrix_13 = DisplayMatrix(matrfactoriz_3)
matrix_14 = DisplayMatrix(matrfactoriz_4)
matrix_15 = DisplayMatrix(matrfactoriz_5)
dmultiply = DMultiply(L=dyadprod, R=dmatrix)
dtranspose_2 = TransposeAVectorOrAMatrix(DodoMatrix=dmatrix_2)
dmultiply_2 = DMultiply(L=dvect_2, R=dmultiply)
panel_18 = Panel("""1
0""")
complex_3 = CreateComplex(Real=number_slider_2, Imaginary=Slider(8, range=0..10))
dnorm = FrenetNorm(DodoMatrix=dtranspose_2, NormType=1, DodoData_Dnorm=1)
dmultiply_3 = Multiply(L=matrfactoriz_2, R=matrfactoriz_3)
dmultiply_4 = Multiply(L=matrfactoriz_8, R=matrfactoriz_4)
dmultiply_5 = Multiply(L=matrfactoriz_6, R=matrfactoriz_7)
complex_4 = CreateComplex(Real=number_slider_3, Imaginary=number_slider_4)
matrix_16 = DisplayMatrix(dmultiply_4)
matrix_17 = DisplayMatrix(dmultiply_3)
matrix_18 = DisplayMatrix(dmultiply_5)
dvect2_3 = DVector2(N1=Slider(4, range=0..10), N2=number_slider_3, N3=number_slider_4, N4=complex_4, N5=number_slider_2, N6=complex_3)
panel_19 = Panel(dnorm)
dvect_12 = DVector(Numbers=panel_18)
dinvmatr = InvertMatrix(DodoMatrix=dtranspose_2)
dmultiply_6 = Multiply(L=dmultiply_4, R=matrfactoriz_5)
dmultiply_7 = DMultiply(L=dmultiply_2, R=dmultiply_2)
matrix_19 = DisplayMatrix(dmultiply_6)
dmatinfo_2 = MatrixInfo(DodoMatrix=dinvmatr)  # -> Info, Determinant, IsHermitian, IsSymmetric, Rank, ConditionNumber
deigen = DEigen(DodoMatrix=dinvmatr)  # -> λ, V
C = Complex(dmultiply_7)
panel_20 = Panel(dmatinfo_2.Info)
panel_21 = Panel(deigen.V)
dmultiply_8 = DMultiply(L=C, R=dvect_2)
dmultiply_9 = DMultiply(L=dinvmatr, R=dvect_12)
dmultiply_10 = DMultiply(L=dvect_12, R=dmultiply_9)
dsubtract = DSubtract(A=dmultiply_8, B=dvect2_3)
complex_5 = ComplexComponents(Complex=dmultiply_10)  # -> Real, Imaginary
dsum_2 = DSum(A=dsubtract, B=dvect, C=dvect_2, D=dsubtract)
panel_22 = Panel(dsum_2)
