# Grasshopper definition convex hull.gh (Grasshopper 0.9.76)
# plug-ins: Dodo

pop3d = Populate3D(
    Region={Plane=PlaneXY(-59.67482601, -63.44641077, 0), X=Domain(0, 133.797844), Y=Domain(0, 132.2177716), Z=Domain(0, 183.538447)},
    Count=Slider(1000, range=0..1000),
    Seed=1)
split = SplitList(List=pop3d, Index=Slider(25, range=0..1000))  # -> ListA, ListB
hull3d = ConvexHull3D(Points=split.ListA)
