# Grasshopper definition geodesics.gh (Grasshopper 0.9.76)
# plug-ins: MeshEdit Components, Kangaroo Components, Dodo

number_slider = Slider(30, range=0..100)
number_slider_2 = Slider(60, range=0..100)
one_over_x = OneOverX(Value=number_slider)
one_over_x_2 = OneOverX(Value=number_slider_2)
addition = Addition(A=number_slider_2, B=1)
addition_2 = Addition(A=number_slider, B=1)
dom = ConstructDomain(DomainStart=0, DomainEnd=1)
series = Series(Start=0, Step=one_over_x_2, Count=addition)
series_2 = Series(Start=0, Step=one_over_x, Count=addition_2)
brep = Brep(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)
srf = Surface(reparameterize(brep))
pt = ConstructPoint(XCoordinate=graft(series), YCoordinate=series_2, ZCoordinate=0)
evalsrf = EvaluateSurface(Surface=reparameterize(srf), Point=pt)  # -> Point, Normal, Frame
frompoints = MeshFromPoints(Points=flatten(evalsrf.Point), UDirection=addition, VDirection=addition_2)
clean = CombineClean(Meshes=frompoints)

pt_2 = Point(Point(-3.844442385, -1.771556527, -2.084350824))
pt_3 = Point(Point(3.159493051, 38.77589288, 3.275814228))

number_slider_3 = Slider(0, range=0..100)
srf_cp = SurfaceClosestPoint(Point=pt_3, Surface=srf)  # -> Point, UVPoint, Distance
meshcp = MeshClosestPoint(Point=pt_3, Mesh=clean)  # -> Point, Index, Parameter
srf_cp_2 = SurfaceClosestPoint(Point=pt_2, Surface=srf)  # -> Point, UVPoint, Distance
meshcp_2 = MeshClosestPoint(Point=pt_2, Mesh=clean)  # -> Point, Index, Parameter
geodesicmesh = Geodesic(Mesh=clean, Start=meshcp_2.Point, End=meshcp.Point)
integrate_curvature_field = IntegrateCurvatureField(Surface=srf, Point=srf_cp_2.Point, Angle=0, Tolerance=number_slider_3)  # -> M, m
geodesic = Geodesic(Surface=srf, Start=srf_cp_2.Point, End=srf_cp.Point)
integratemshcrv = IntegrateMeshCurvature(Mesh=clean, Poitns=meshcp_2.Point, Strict=True, Angle=0, Tolerance=number_slider_3)  # -> UDirection, VDirection
len = Length(Curve=[geodesic, geodesicmesh])
preview = CustomPreview(Geometry=[integrate_curvature_field.M, integrate_curvature_field.m], Shader=ColourSwatch(SwatchColor=RGB(0, 85, 255)))
preview_2 = CustomPreview(Geometry=[integratemshcrv.UDirection, integratemshcrv.VDirection], Shader=ColourSwatch(SwatchColor=RGB(255, 0, 0)))
preview_3 = CustomPreview(Geometry=geodesic, Shader=ColourSwatch(SwatchColor=RGB(0, 0, 0)))
preview_4 = CustomPreview(Geometry=geodesicmesh, Shader=ColourSwatch(SwatchColor=RGB(255, 255, 255)))
preview_5 = CustomPreview(Geometry=clean, Shader=ColourSwatch(SwatchColor=RGB(158, 158, 158)))
panel = Panel(len)
