# Grasshopper definition graph search.gh (Grasshopper 0.9.76)
# plug-ins: Dodo

brep = Brep(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)
pop3d = Populate3D(Region=brep, Count=Slider(400, range=0..1000), Seed=1)
pdecon = Deconstruct(Point=pop3d)  # -> XComponent, YComponent, ZComponent
entwine = Entwine(Branch00=pdecon.XComponent, Branch01=pdecon.YComponent, Branch02=pdecon.ZComponent, FlattenInputs=True)
flip = FlipMatrix(Data=entwine)
conkdnode = ConstructKDNode(Coordinates=flip, Object=graft(pop3d))  # -> flatten(HPointVal)
conkdnode_2 = ConstructKDNode(Coordinates=flip)  # -> flatten(HPointVal)
conkdtree = ConstructKDTree(HPointVal=conkdnode)
number_slider = Slider(3, range=0..10)
nearkdnnum = NearestNeighoboursNumber(KDTree=conkdtree, HPointVal=conkdnode_2, Neighbours=number_slider)
series = Series(Start=0, Step=1, Count=number_slider)
deconkdnode = DeconstructKDNode(HPointVal=nearkdnnum)  # -> Coordinates, Object
jitter = Jitter(List=pop3d, Jitter=1, Seed=series)  # -> Values, Indices
graft = GraftTree(Tree=pop3d, IncludeEmptyLists=True, IncludeNullItems=True)
flip_2 = FlipMatrix(Data=jitter.Values)
pline = PolyLine(Vertices=flip_2, Closed=False)
ln = Line(StartPoint=graft, EndPoint=deconkdnode.Object)
cull_i = CullIndex(List=ln, Indices=0, Wrap=True)  # -> flatten(List)
explode = Explode(Curve=pline, Recursive=True)  # -> flatten(Segments), Vertices
crv = Curve([explode.Segments, cull_i])
preview = CustomPreview(Geometry=crv, Shader=ColourSwatch(SwatchColor=RGBA(235, 181, 181, 100)))
pt = Point(pop3d)
nickname = GH_BDFirstSearch(LinesOrMesh=crv)
item = ListItem(List=pt, Index=Slider(577, range=0..1000), Wrap=True)
item_2 = ListItem(List=pt, Index=Slider(2, range=0..100), Wrap=True)
sph = Sphere(Base=item, Radius=1)
sph_2 = Sphere(Base=item_2, Radius=1)
preview_2 = CustomPreview(Geometry=sph, Shader=ColourSwatch(SwatchColor=RGB(0, 0, 0)))
preview_3 = CustomPreview(Geometry=sph_2, Shader=ColourSwatch(SwatchColor=RGB(201, 201, 201)))
graphsrch = GraphSearch(DodoGraph=nickname, Point=item_2, DodoData_GraphSearch=0)  # -> Info, DodoGraph
graphsrch_2 = GraphSearch(DodoGraph=nickname, Point=item_2, DodoData_GraphSearch=2)  # -> Info, DodoGraph
panel = Panel(graphsrch_2.Info)
panel_2 = Panel(graphsrch.Info)
graphnode = GraphNode(DodoGraph=graphsrch.DodoGraph, Point=item)  # -> Info, Points
graphnode_2 = GraphNode(DodoGraph=graphsrch_2.DodoGraph, Point=item)  # -> Info, Points
panel_3 = Panel(graphnode.Info)
pline_2 = PolyLine(Vertices=graphnode_2.Points, Closed=False)
pline_3 = PolyLine(Vertices=graphnode.Points, Closed=False)
panel_4 = Panel(graphnode_2.Info)
pipe = Pipe(Curve=pline_3, Radius=Slider(0.3, range=0..1), Caps=0)
pipe_2 = Pipe(Curve=pline_2, Radius=Slider(0.3, range=0..1), Caps=0)
preview_4 = CustomPreview(Geometry=pipe, Shader=ColourSwatch(SwatchColor=RGB(0, 163, 33)))
preview_5 = CustomPreview(Geometry=pipe_2, Shader=ColourSwatch(SwatchColor=RGB(0, 65, 163)))
len = Length(Curve=pline_2)
len_2 = Length(Curve=pline_3)
panel_5 = Panel(len_2)
panel_6 = Panel(len)
