# Grasshopper definition mesh analysis.gh (Grasshopper 0.9.76)
# plug-ins: Dodo

mesh = Mesh(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)
meshcrv = MeshCurvature(Mesh=mesh)  # -> WeightedNormals, UDirection, VDirection, UCurvature, VCurvature
demesh = DeconstructMesh(Mesh=mesh)  # -> Vertices, Faces, Colours, Normals
jitter = Jitter(List=demesh.Vertices, Jitter=1, Seed=2)  # -> Values, Indices
number_slider = Slider(2, range=0..100)
split = SplitList(List=jitter.Values, Index=Slider(5, range=0..100))  # -> ListA, ListB
pt = Point(split.ListA)
integratemshcrv = IntegrateMeshCurvature(Mesh=mesh, Poitns=pt, Strict=True, Angle=0, Tolerance=0.05)  # -> UDirection, VDirection
multiplication = Multiplication(A=meshcrv.WeightedNormals, B=number_slider)
multiplication_2 = Multiplication(A=meshcrv.UDirection, B=number_slider)
multiplication_3 = Multiplication(A=meshcrv.VDirection, B=number_slider)
vdisex = VectorDisplayEx(Point=demesh.Vertices, Vector=multiplication, Colour=ColourSwatch(SwatchColor=RGB(0, 0, 0)), Width=2)
vdisex_2 = VectorDisplayEx(Point=demesh.Vertices, Vector=multiplication_2, Colour=ColourSwatch(SwatchColor=RGB(125, 168, 255)), Width=2)
vdisex_3 = VectorDisplayEx(Point=demesh.Vertices, Vector=multiplication_3, Colour=ColourSwatch(SwatchColor=RGB(255, 158, 158)), Width=2)
multiplication_4 = Multiplication(A=meshcrv.UCurvature, B=meshcrv.VCurvature)

preview = CustomPreview(Geometry=integratemshcrv.UDirection, Shader=ColourSwatch(SwatchColor=RGB(47, 0, 255)))
preview_2 = CustomPreview(Geometry=integratemshcrv.VDirection, Shader=ColourSwatch(SwatchColor=RGB(255, 0, 0)))

lng = ListLength(List=multiplication_4)
series = Series(Start=0, Step=1, Count=lng)
sort = SortList(Keys=multiplication_4, ValuesA=series)  # -> Keys, ValuesA
multiplication_5 = Multiplication(A=lng, B=Slider(0.16, range=0..0.3))
split_2 = SplitList(List=sort.Keys, Index=multiplication_5)  # -> ListA, ListB
split_3 = SplitList(List=reverse(split_2.ListB), Index=multiplication_5)  # -> ListA, reverse(ListB)
sort_2 = SortList(Keys=split_3.ListB)  # -> Keys, ValuesA
bnd = Bounds(Numbers=split_3.ListB)
panel = Panel(sort_2.Keys)
dedomain = DeconstructDomain(Domain=bnd)  # -> Start, End
bar_graph = BarGraph(sort_2.Keys, BarColor=RGB(255, 0, 90))
gradient = Gradient(
    LowerLimit=dedomain.Start,
    UpperLimit=dedomain.End,
    Parameter=multiplication_4,
    stops=[0: RGB(255, 255, 255), 1: RGB(0, 0, 0)])
conmesh = ConstructMesh(Vertices=demesh.Vertices, Faces=demesh.Faces, Colours=gradient)
