# Grasshopper definition nlopt constrained.gh (Grasshopper 0.9.76)
# plug-ins: MeshEdit Components, Dodo

series = Series(Start="-1", Step=Slider(0.05, range=0..0.1), Count="100")
pt = ConstructPoint(XCoordinate=series, YCoordinate=graft(series), ZCoordinate=0)
optimum = Panel("x = 2, y = 1")
pdecon = Deconstruct(Point=pt)  # -> XComponent, YComponent, ZComponent
constrained_optimum = Panel("x = 1, y = 2")
eval = Evaluate(F="(x-2)^2 + (y-1)^2", x=pdecon.XComponent, y=pdecon.YComponent)
nl_opt = NLOptimization(fitness=num_2, gene=[genes, bool])
num = Number(flatten(eval))
bnd = Bounds(Numbers=num)
dedomain = DeconstructDomain(Domain=bnd)  # -> Start, End
gradient = Gradient(
    LowerLimit=dedomain.Start,
    UpperLimit=dedomain.End,
    Parameter=num,
    stops=[0: RGB(0, 128, 0), 0.5: RGB(255, 255, 0), 1: RGB(255, 0, 0)])
pt_2 = ConstructPoint(XCoordinate=pdecon.XComponent, YCoordinate=pdecon.YComponent, ZCoordinate=eval)

# ---- group: funtion surface
frompoints = MeshFromPoints(Points=flatten(pt_2), UDirection="100", VDirection="100", Colour=gradient)

# ---- group: Variables
genes = GenePool(Decimals=0, Maximum=10, Minimum=0, Value=[1, 3])

# ----
item = ListItem(List=genes, Index=0, Wrap=True)  # -> Item, Item1
smaller = SmallerThan(FirstNumber=item.Item, SecondNumber=item.Item1)  # -> SmallerThan, OrEqualTo

# ---- group: Variables (continued)
bool = Boolean(smaller.SmallerThan)

# ----
eval_2 = Evaluate(F="(x-2)^2 + (y-1)^2", x=item.Item, y=item.Item1)
pt_3 = ConstructPoint(XCoordinate=item.Item, YCoordinate=item.Item1, ZCoordinate=eval_2)
num_2 = Number(eval_2)
panel = Panel(num_2)
panel_2 = Panel(bool)
sph = Sphere(Base=pt_3, Radius=1)
