# Grasshopper definition nlopt.gh (Grasshopper 0.9.76)
# plug-ins: Dodo

genes = GenePool(Decimals=0, Maximum=10, Minimum=0, Value=[8, 0, 0, 5, 4, 3, 7, 2, 7, 1])
number_slider = Slider(3, range=0..10)
number_slider_2 = Slider(8, range=0..10)
number_slider_3 = Slider(4, range=0..10)
number_slider_4 = Slider(2, range=0..10)
number_slider_5 = Slider(0, range=0..10)
number_slider_6 = Slider(8, range=0..10)
number_slider_7 = Slider(4, range=0..10)
number_slider_8 = Slider(2, range=0..10)
number_slider_9 = Slider(10, range=0..10)
number_slider_10 = Slider(1, range=0..10)
merge = Merge(
    Data1=number_slider_6,
    Data2=number_slider_7,
    Data3=number_slider_8,
    Data4=number_slider_9,
    Data5=number_slider_10,
    Data6=number_slider,
    Data7=number_slider_2,
    Data8=number_slider_3,
    Data9=number_slider_4,
    Data10=number_slider_5,
    Data11=genes)
lng = ListLength(List=merge)
random = Random(Range=Domain(0, 1), Number=lng, Seed=2)
multiplication = Multiplication(A=random, B=10)
round = Round(Number=multiplication)  # -> Nearest, Floor, Ceiling
targets = Panel(round.Nearest)
subtraction = Subtraction(A=merge, B=targets)
sqr = Square(Value=subtraction)
ma = MassAddition(Input=sqr)  # -> Result, PartialResults
nl_opt = NLOptimization(
    fitness=num,
    gene=[number_slider_6, number_slider_7, number_slider_8, number_slider_9, number_slider_10, number_slider, number_slider_2, number_slider_3, number_slider_4, number_slider_5, genes])
num = Number(ma.Result)
panel = Panel(num)
