# Grasshopper definition nn classification.gh (Grasshopper 0.9.76)
# plug-ins: Dodo

pt = ConstructPoint(XCoordinate=0, YCoordinate=0, ZCoordinate=0)
pt_2 = ConstructPoint(XCoordinate=0, YCoordinate=0, ZCoordinate=0)
pt_3 = ConstructPoint(XCoordinate=Slider(7, range=0..10), YCoordinate=Slider(8, range=0..10), ZCoordinate=Slider(6, range=0..10))
pt_4 = ConstructPoint(XCoordinate=Slider(7, range=0..10), YCoordinate=Slider(8, range=0..10), ZCoordinate=Slider(6, range=0..10))
box = Box2Pt(PointA=pt, PointB=pt_3, Plane=PlaneXY(0, 0, 0))
box_2 = Box2Pt(PointA=pt_2, PointB=pt_4, Plane=PlaneXY(0, 0, 0))
debrep = DeconstructBrep(Brep=box)  # -> Faces, Edges, Vertices
debrep_2 = DeconstructBrep(Brep=box_2)  # -> Faces, Edges, Vertices
pt_5 = Point(debrep.Vertices)
pt_6 = Point(debrep_2.Vertices)
repeat = RepeatData(Data=Slider(1, range=0..1), Length="4")
repeat_2 = RepeatData(Data=Slider(0, range=0..1), Length="4")
pdecon = Deconstruct(Point=pt_5)  # -> XComponent, YComponent, ZComponent
pdecon_2 = Deconstruct(Point=pt_6)  # -> XComponent, YComponent, ZComponent
lng = ListLength(List=pt_6)
panel = Panel("Perceptron Learning")
entwine = Entwine(Branch00=pdecon.XComponent, Branch01=pdecon.YComponent, Branch02=pdecon.ZComponent, FlattenInputs=True)
entwine_2 = Entwine(Branch00=pdecon_2.XComponent, Branch01=pdecon_2.YComponent, Branch02=pdecon_2.ZComponent, FlattenInputs=True)
random = Random(Range=Domain(0, 1), Number=lng, Seed=Slider(5, range=0..10))
number_slider = Slider(10, range=0..100)
flip = FlipMatrix(Data=entwine)  # -> simplify(Data)
number_slider_2 = Slider(10, range=0..100)
flip_2 = FlipMatrix(Data=entwine_2)  # -> simplify(Data)
round = Round(Number=random)  # -> Nearest, Floor, Ceiling
merge = Merge(Data1=repeat, Data2=repeat_2)
series = Series(Start=0, Step=1, Count=number_slider)
series_2 = Series(Start=0, Step=1, Count=number_slider_2)
division = Division(A=series, B=number_slider)
division_2 = Division(A=series_2, B=number_slider_2)
crossref = CrossReference(ListA=division, ListB=division, CrossMode=1)  # -> ListA, ListB
crossref_2 = CrossReference(ListA=division_2, ListB=division_2, CrossMode=1)  # -> ListA, ListB
box_3 = EvaluateBox(
    Box=box,
    UParameter=Slider(0.686, range=0..1),
    VParameter=Slider(0.525, range=0..1),
    WParameter=Slider(0.633, range=0..1))  # -> Plane, Point, Include
box_4 = EvaluateBox(Box=box, UParameter=crossref.ListA, VParameter=crossref.ListB, WParameter=graft(division))  # -> Plane, Point, Include
box_5 = EvaluateBox(
    Box=box_2,
    UParameter=Slider(0.686, range=0..1),
    VParameter=Slider(0.525, range=0..1),
    WParameter=Slider(0.633, range=0..1))  # -> Plane, Point, Include
box_6 = EvaluateBox(Box=box_2, UParameter=crossref_2.ListA, VParameter=crossref_2.ListB, WParameter=graft(division_2))  # -> Plane, Point, Include
graft = GraftTree(Tree=merge, IncludeEmptyLists=True, IncludeNullItems=True)
graft_2 = GraftTree(Tree=round.Nearest, IncludeEmptyLists=True, IncludeNullItems=True)
flip_3 = FlipMatrix(Data=box_4.Point)  # -> simplify(Data)
flip_4 = FlipMatrix(Data=box_6.Point)  # -> simplify(Data)
pdecon_3 = Deconstruct(Point=graft(box_3.Point))  # -> XComponent, YComponent, ZComponent
pdecon_4 = Deconstruct(Point=graft(box_5.Point))  # -> XComponent, YComponent, ZComponent
pdecon_5 = Deconstruct(Point=graft(flip_3))  # -> XComponent, YComponent, ZComponent
pdecon_6 = Deconstruct(Point=graft(flip_4))  # -> XComponent, YComponent, ZComponent
merge_2 = Merge(Data1=pdecon_3.XComponent, Data2=pdecon_3.YComponent, Data3=pdecon_3.ZComponent)
merge_3 = Merge(Data1=pdecon_4.XComponent, Data2=pdecon_4.YComponent, Data3=pdecon_4.ZComponent)
trainnn = TrainNeuralNetwork(D=flip, O=graft)
trainnn_2 = TrainNeuralNetwork(D=flip_2, O=graft_2)
merge_4 = Merge(Data1=pdecon_5.XComponent, Data2=pdecon_5.YComponent, Data3=pdecon_5.ZComponent)
merge_5 = Merge(Data1=pdecon_6.XComponent, Data2=pdecon_6.YComponent, Data3=pdecon_6.ZComponent)
panel_2 = Panel(trainnn)
panel_3 = Panel(trainnn_2)
nickname = GH_RunNN(NeuralNetwork=trainnn, Data=merge_2)  # -> flatten(Data), Weights
nickname_2 = GH_RunNN(NeuralNetwork=trainnn_2, Data=merge_3)  # -> flatten(Data), Weights
nickname_3 = GH_RunNN(NeuralNetwork=trainnn, Data=merge_4)  # -> flatten(Data), Weights
nickname_4 = GH_RunNN(NeuralNetwork=trainnn_2, Data=merge_5)  # -> flatten(Data), Weights
unflatten = UnflattenTree(Tree=nickname_3.Data, Guide=flip_3)
unflatten_2 = UnflattenTree(Tree=nickname_4.Data, Guide=flip_4)
panel_4 = Panel(nickname_3.Data)
panel_5 = Panel(nickname_4.Data)
equals = Equality(FirstNumber=unflatten, SecondNumber=Slider(1, range=0..1))  # -> Equality, Inequality
equals_2 = Equality(FirstNumber=unflatten_2, SecondNumber=Slider(1, range=0..1))  # -> Equality, Inequality
cull = CullPattern(List=flip_3, CullPattern=equals.Equality)
cull_2 = CullPattern(List=flip_4, CullPattern=equals_2.Equality)

sph = Sphere(Base=box_3.Point, Radius=Slider(0.1, range=0..0.1))
int = Integer(merge)
hull3d = ConvexHull3D(Points=flatten(cull))
preview = CustomPreview(
    Geometry=sph,
    Shader={ambient=RGB(0, 0, 0), diffuse=RGB(255, 105, 180), emission=RGB(76, 32, 54), shine=0.5, specular=RGB(255, 255, 255), transparency=0})
tag = TextTag(Location=pt_5, Text=int, Colour=ColourSwatch(SwatchColor=RGB(255, 255, 255)))
tag_2 = TextTag(Location=box_3.Point, Text=nickname.Data, Colour=ColourSwatch(SwatchColor=RGB(0, 0, 0)))

sph_2 = Sphere(Base=box_5.Point, Radius=Slider(0.1, range=0..0.1))
int_2 = Integer(round.Nearest)
hull3d_2 = ConvexHull3D(Points=flatten(cull_2))
preview_2 = CustomPreview(
    Geometry=sph_2,
    Shader={ambient=RGB(0, 0, 0), diffuse=RGB(255, 105, 180), emission=RGB(76, 32, 54), shine=0.5, specular=RGB(255, 255, 255), transparency=0})
tag_3 = TextTag(Location=pt_6, Text=int_2, Colour=ColourSwatch(SwatchColor=RGB(255, 255, 255)))
tag_4 = TextTag(Location=box_5.Point, Text=nickname_2.Data, Colour=ColourSwatch(SwatchColor=RGB(0, 0, 0)))
