# Grasshopper definition nn elastic network TSP.gh (Grasshopper 0.9.76)
# plug-ins: Dodo

# ---- group: minimum path
pt = Point([Point(12.43342921, 5.537198859, 0), Point(49.89455256, 43.7910757, 0), Point(4.150979642, 46.2988269, 0), Point(47.48145502, 7.514784838, 0), Point(22.99391505, 31.12516603, 0), Point(30.1266659, 49.30560621, 0)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])
pdecon = Deconstruct(Point=pt)  # -> XComponent, YComponent, ZComponent
entwine = Entwine(Branch00=pdecon.XComponent, Branch01=pdecon.YComponent, FlattenInputs=True)
flip = FlipMatrix(Data=entwine)
unsuptrainnn = UnsupervisedTrainNeuralNetwork(Data=flip)
# Elastic network
# Iterations: 3000
# Learning ratio: 0.5
# Radius 0.5
# Neurons: 100
panel = Panel(unsuptrainnn)
runnn = RunNN(NeuralNetwork=unsuptrainnn, Data=flip)  # -> Data, Weights, Threshold
item = ListItem(List=runnn.Weights, Index=0, Wrap=True)  # -> Item, Item1
item_2 = ListItem(List=runnn.Data, Index=0, Wrap=True)  # -> Item, Item1
pt_2 = ConstructPoint(XCoordinate=item.Item, YCoordinate=item.Item1, ZCoordinate=0)  # -> flatten(Point)
pt_3 = ConstructPoint(XCoordinate=item_2.Item, YCoordinate=item_2.Item1, ZCoordinate=0)  # -> flatten(Point)
pline = PolyLine(Vertices=pt_2, Closed=invert(False))
dist = Distance(PointA=pt_3, PointB=pt)
ma = MassAddition(Input=dist)  # -> Result, PartialResults
r2_data_fit = Panel(ma.Result)

# ---- group: self organizing map
pt_4 = Point([Point(46.86051181, 33.09653547, 0), Point(3.540920351, 4.386186369, 0), Point(1.688185754, 49.46594164, 0), Point(44.93983963, 0.3431244755, 0), Point(19.97775013, 31.77382857, 0), Point(0.4656070147, 24.53630891, 0)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])
pdecon_2 = Deconstruct(Point=pt_4)  # -> XComponent, YComponent, ZComponent
entwine_2 = Entwine(Branch00=pdecon_2.XComponent, Branch01=pdecon_2.YComponent, FlattenInputs=True)
flip_2 = FlipMatrix(Data=entwine_2)
# Elastic network
# Iterations: 5000
# Learning ratio: 0.7
# Radius 0.1
# Neurons: 400
unsuptrainnn_2 = UnsupervisedTrainNeuralNetwork(Data=flip_2)
runnn_2 = RunNN(NeuralNetwork=unsuptrainnn_2, Data=flip_2)  # -> Data, Weights, Threshold
panel_2 = Panel(unsuptrainnn_2)
item_3 = ListItem(List=runnn_2.Data, Index=0, Wrap=True)  # -> Item, Item1
item_4 = ListItem(List=runnn_2.Weights, Index=0, Wrap=True)  # -> Item, Item1
pt_5 = ConstructPoint(XCoordinate=item_3.Item, YCoordinate=item_3.Item1, ZCoordinate=0)  # -> flatten(Point)
pt_6 = ConstructPoint(XCoordinate=item_4.Item, YCoordinate=item_4.Item1, ZCoordinate=0)  # -> flatten(Point)
pline_2 = PolyLine(Vertices=pt_6, Closed=invert(False))
circle = CircleCNR(Center=pt_5, Normal=Vector(0, 0, 1), Radius=1)
