# Grasshopper definition nn prediction.gh (Grasshopper 0.9.76)
# plug-ins: Dodo

exponential_sinusoid = Panel("""40
43.545
47.214
50.518
52.959
54.102
53.639
51.449
47.621
42.47
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""")
sigmoid = Panel("""2.018
2.021
2.025
2.029
2.034
2.039
2.046
2.053
2.062
2.072
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""")
sinusoid = Panel("""2
2.327
2.618
2.841
2.972
2.995
2.909
2.723
2.457
2.141
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""")

# ---- group: slide me!
number_slider = Slider(15, range=0..100)

# ----
sinusoid_2 = Panel("""2
2.327
2.618
2.841
2.972
2.995
2.909
2.723
2.457
2.141
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""")
split = SplitList(List=sinusoid_2, Index=number_slider)  # -> ListA, ListB
graft = GraftTree(Tree=split.ListA, IncludeEmptyLists=True, IncludeNullItems=True)
split_2 = SplitList(List=split.ListA, Index="5")  # -> ListA, ListB
trainnn = TrainNeuralNetwork(D=graft)
lng = ListLength(List=split_2.ListB)
panel = Panel(trainnn)
series = Series(Start=0, Step=1, Count=lng)
split_3 = SplitList(List=split.ListA, Index=series)  # -> ListA, ListB
split_4 = SplitList(List=split_3.ListB, Index="5")  # -> simplify(ListA), ListB
nickname = GH_RunNN(NeuralNetwork=trainnn, Data=split_4.ListA)  # -> flatten(Data), Weights, Threshold
entwine = Entwine(Branch00=split_2.ListB, Branch01=nickname.Data, FlattenInputs=True)
graph = QuickGraph(entwine)

graft_2 = GraftTree(Tree=sigmoid, IncludeEmptyLists=True, IncludeNullItems=True)
split_5 = SplitList(List=sigmoid, Index="5")  # -> ListA, ListB
lng_2 = ListLength(List=split_5.ListB)
series_2 = Series(Start=0, Step=1, Count=lng_2)
split_6 = SplitList(List=sigmoid, Index=series_2)  # -> ListA, ListB
split_7 = SplitList(List=split_6.ListB, Index="5")  # -> simplify(ListA), ListB

trainnn_2 = TrainNeuralNetwork(D=graft_2)

number_slider_2 = Slider(0, range=0..45)
split_8 = SplitList(List=sigmoid, Index=number_slider_2)  # -> ListA, ListB
split_9 = SplitList(List=split_8.ListB, Index="5")  # -> ListA, ListB
addition = Addition(A=number_slider_2, B="5")
nickname_2 = GH_RunNN(NeuralNetwork=trainnn_2, Data=split_9.ListA)  # -> flatten(Data), Weights, Threshold
item = ListItem(List=sigmoid, Index=addition, Wrap=True)
panel_2 = Panel(item)
panel_3 = Panel(nickname_2.Data)

panel_4 = Panel(trainnn_2)
nickname_3 = GH_RunNN(NeuralNetwork=trainnn_2, Data=split_7.ListA)  # -> flatten(Data), Weights, Threshold
entwine_2 = Entwine(Branch00=split_5.ListB, Branch01=nickname_3.Data, FlattenInputs=True)

graph_2 = QuickGraph(entwine_2)

graft_3 = GraftTree(Tree=exponential_sinusoid, IncludeEmptyLists=True, IncludeNullItems=True)
split_10 = SplitList(List=exponential_sinusoid, Index="5")  # -> ListA, ListB
lng_3 = ListLength(List=split_10.ListB)
series_3 = Series(Start=0, Step=1, Count=lng_3)
split_11 = SplitList(List=exponential_sinusoid, Index=series_3)  # -> ListA, ListB
split_12 = SplitList(List=split_11.ListB, Index="5")  # -> simplify(ListA), ListB

trainnn_3 = TrainNeuralNetwork(D=graft_3)

number_slider_3 = Slider(0, range=0..45)
split_13 = SplitList(List=exponential_sinusoid, Index=number_slider_3)  # -> ListA, ListB
split_14 = SplitList(List=split_13.ListB, Index="5")  # -> ListA, ListB
addition_2 = Addition(A=number_slider_3, B="5")
nickname_4 = GH_RunNN(NeuralNetwork=trainnn_3, Data=split_14.ListA)  # -> flatten(Data), Weights, Threshold
item_2 = ListItem(List=exponential_sinusoid, Index=addition_2, Wrap=True)
panel_5 = Panel(item_2)
panel_6 = Panel(nickname_4.Data)

panel_7 = Panel(trainnn_3)
nickname_5 = GH_RunNN(NeuralNetwork=trainnn_3, Data=split_12.ListA)  # -> flatten(Data), Weights, Threshold
entwine_3 = Entwine(Branch00=split_10.ListB, Branch01=nickname_5.Data, FlattenInputs=True)

graph_3 = QuickGraph(entwine_3)

graft_4 = GraftTree(Tree=sinusoid, IncludeEmptyLists=True, IncludeNullItems=True)
split_15 = SplitList(List=sinusoid, Index="5")  # -> ListA, ListB
lng_4 = ListLength(List=split_15.ListB)
series_4 = Series(Start=0, Step=1, Count=lng_4)
split_16 = SplitList(List=sinusoid, Index=series_4)  # -> ListA, ListB
split_17 = SplitList(List=split_16.ListB, Index="5")  # -> simplify(ListA), ListB

trainnn_4 = TrainNeuralNetwork(D=graft_4)

number_slider_4 = Slider(0, range=0..45)
split_18 = SplitList(List=sinusoid, Index=number_slider_4)  # -> ListA, ListB
split_19 = SplitList(List=split_18.ListB, Index="5")  # -> ListA, ListB
addition_3 = Addition(A=number_slider_4, B="5")
nickname_6 = GH_RunNN(NeuralNetwork=trainnn_4, Data=split_19.ListA)  # -> flatten(Data), Weights, Threshold
item_3 = ListItem(List=sinusoid, Index=addition_3, Wrap=True)
panel_8 = Panel(item_3)
panel_9 = Panel(nickname_6.Data)

# ----
# Neurons per Layer: 4
# Layers: 2
# Prediction
panel_10 = Panel(trainnn_4)
nickname_7 = GH_RunNN(NeuralNetwork=trainnn_4, Data=split_17.ListA)  # -> flatten(Data), Weights, Threshold
entwine_4 = Entwine(Branch00=split_15.ListB, Branch01=nickname_7.Data, FlattenInputs=True)

graph_4 = QuickGraph(entwine_4)
