# Grasshopper definition perceptron.gh (Grasshopper 0.9.76)
# plug-ins: Dodo

pt = Point([Point(2.183047591, 4.279392584, 0), Point(3.692620891, 6.402230037, 0), Point(3.079356738, 8.572241655, 0), Point(2.08869926, 6.779623362, 0)])
pt_2 = Point([Point(5.296542523, 0.97720099, 0), Point(6.098503338, 3.194386774, 0), Point(7.796773301, 2.48677429, 0), Point(7.985469963, 0.4582851681, 0), Point(6.664593326, 1.779161806, 0)])
pt_3 = Point([Point(9.164824104, 9.751595796, 0), Point(10.06113325, 6.543752533, 0), Point(8.551559951, 6.496578368, 0), Point(8.513130264, 7.726328324, 0), Point(10.58004907, 8.289196662, 0)])
entwine = Entwine(Branch00=pt, Branch01=pt_2, Branch02=pt_3, FlattenInputs=True)
pdecon = Deconstruct(Point=entwine)  # -> XComponent, YComponent, ZComponent
entwine_2 = Entwine(Branch00="0,0,1", Branch01="0,1,0", Branch02="1,0,0", FlattenInputs=True)
entwine_3 = Entwine(Branch00=pdecon.XComponent, Branch01=pdecon.YComponent, FlattenInputs=True)
lng = ListLength(List=entwine)
flip = FlipMatrix(Data=entwine_3)
dup = DuplicateData(Data=graft(entwine_2), Number=lng, Order=True)  # -> simplify(flatten(Data))
item = ListItem(List=flip, Index=0, Wrap=True)  # -> Item, Item1
pt_4 = ConstructPoint(XCoordinate=item.Item, YCoordinate=item.Item1, ZCoordinate=0)  # -> simplify(Point)
split = TextSplit(Text=dup, Separators=",")
pt_5 = Point(Point(8.512496939, 3.494288822, 0))
pdecon_2 = Deconstruct(Point=pt_5)  # -> XComponent, YComponent, ZComponent
cluster = Cluster(C=pt_4, A=split)
trainnn = TrainNeuralNetwork(D=flip, O=split)
entwine_4 = Entwine(Branch00=pdecon_2.XComponent, Branch01=pdecon_2.YComponent, FlattenInputs=True)
panel = Panel(trainnn)
flip_2 = FlipMatrix(Data=entwine_4)
runnn = RunNN(NeuralNetwork=trainnn, Data=flip_2)  # -> Data, Weights, Threshold

# ---- group: decision boundaries
item_2 = ListItem(List=runnn.Weights, Index=0, Wrap=True)  # -> Item, Item1
neg = Negative(Value=item_2.Item)
vec = VectorXYZ(XComponent=item_2.Item1, YComponent=neg, ZComponent=0)  # -> Vector, Length
division = Division(A=runnn.Threshold, B=item_2.Item1)
neg_2 = Negative(Value=division)
number_slider = Slider(100, range=0..100)
pt_6 = ConstructPoint(XCoordinate=0, YCoordinate=neg_2, ZCoordinate=0)
line = LineSDL(Start=pt_6, Direction=vec.Vector, Length=number_slider)
ext = ExtendCurve(Curve=line, Type=0, Start=number_slider, End=number_slider)

# ----
cluster_2 = Cluster(C=pt_5, A=runnn.Data)

# ==== cluster Cluster
A = ClusterInput()
C = ClusterInput()
multiplication = Multiplication(A=A, B=255)
circle = CircleCNR(Center=C, Normal=Vector(0, 0, 1), Radius=Slider(0.8, range=0..10))
int = Integer(multiplication)
boundary = BoundarySurfaces(Edges=circle)
join = TextJoin(Text=int, Join=",")
preview = CustomPreview(Geometry=boundary, Shader=join)
