# Grasshopper definition umbilics.gh (Grasshopper 0.9.76)
# plug-ins: MeshEdit Components, Kangaroo Components, Dodo

number_slider = Slider(30, range=0..100)
number_slider_2 = Slider(60, range=0..100)
one_over_x = OneOverX(Value=number_slider)
one_over_x_2 = OneOverX(Value=number_slider_2)
addition = Addition(A=number_slider_2, B=1)
addition_2 = Addition(A=number_slider, B=1)
series = Series(Start=0, Step=one_over_x_2, Count=addition)
series_2 = Series(Start=0, Step=one_over_x, Count=addition_2)
srf = Surface(reparameterize(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))
pt = ConstructPoint(XCoordinate=graft(series), YCoordinate=series_2, ZCoordinate=0)
evalsrf = EvaluateSurface(Surface=reparameterize(graft(srf)), Point=flatten(pt))  # -> Point, Normal, Frame
frompoints = MeshFromPoints(Points=evalsrf.Point, UDirection=addition, VDirection=addition_2)
clean = CombineClean(Meshes=frompoints)
weldvertices = MeshWeldVertices(Mesh=clean, Tolerance=0.01)  # -> RuntimeMessage, Mesh
srf_2 = Surface(srf)

nickname = GH_UmbilicPoints(Mesh=weldvertices.Mesh, UmbilicalPoints=100, DodoData_DecompositionLeastSquares=4)
umbilicpoints = UmbilicPoints(Surface=srf_2, UmbilicalPoints=100, DodoData_DecompositionLeastSquares=4)
preview = CustomPreview(Geometry=umbilicpoints, Shader=ColourSwatch(SwatchColor=RGB(255, 255, 255)))
preview_2 = CustomPreview(Geometry=nickname, Shader=ColourSwatch(SwatchColor=RGB(0, 0, 0)))

demesh = DeconstructMesh(Mesh=weldvertices.Mesh)  # -> Vertices, Faces, Colours, Normals
meshcrv = MeshCurvature(Mesh=weldvertices.Mesh)  # -> WeightedNormals, UDirection, VDirection, UCurvature, VCurvature
srf_cp = SurfaceClosestPoint(Point=umbilicpoints, Surface=srf_2)  # -> Point, UVPoint, Distance
number_slider_3 = Slider(0.68, range=0..1)
multiplication = Multiplication(A=meshcrv.UDirection, B=number_slider_3)
multiplication_2 = Multiplication(A=meshcrv.VDirection, B=number_slider_3)
curvature = PrincipalCurvature(Surface=graft(srf), Point=srf_cp.UVPoint)  # -> Frame, Min, Max, MinDirection, MaxDirection
vdisex = VectorDisplayEx(Point=demesh.Vertices, Vector=meshcrv.WeightedNormals, Colour=ColourSwatch(SwatchColor=RGB(0, 0, 0)), Width=2)
vdisex_2 = VectorDisplayEx(Point=demesh.Vertices, Vector=multiplication, Colour=ColourSwatch(SwatchColor=RGB(255, 0, 0)), Width=2)
vdisex_3 = VectorDisplayEx(Point=demesh.Vertices, Vector=multiplication_2, Colour=ColourSwatch(SwatchColor=RGB(68, 0, 255)), Width=2)
cluster = Cluster(num=meshcrv.UCurvature, pt=nickname, mesh=weldvertices.Mesh)
cluster_2 = Cluster(num=meshcrv.VCurvature, pt=nickname, mesh=weldvertices.Mesh)
subtraction = Subtraction(A=curvature.Min, B=curvature.Max)
multiplication_3 = Multiplication(A=curvature.Min, B=curvature.Max)
subtraction_2 = Subtraction(A=cluster, B=cluster_2)
multiplication_4 = Multiplication(A=cluster, B=cluster_2)
mean_curvature = Panel(subtraction_2)
mean_curvature_2 = Panel(subtraction)
gaussian_curvature = Panel(multiplication_4)
gaussian_curvature_2 = Panel(multiplication_3)

# ==== cluster Cluster
mesh = ClusterInput()
num = ClusterInput()
pt = ClusterInput()
mesh_2 = Mesh(mesh)
num_2 = Number(num)
pt_2 = Point(pt)
demesh = DeconstructMesh(Mesh=mesh_2)  # -> Vertices, Faces, Colours, Normals
c_script = CSharpScript(p=pt_2, m=mesh_2)  # -> out, A, B, C; inputs p: Point3d, m: Mesh
# ---------- c_script: C# ----------
    var mp = m.ClosestMeshPoint(m.ClosestPoint(p), 0);

    int a,b,c;


    A = mp.FaceIndex;
    B = mp.T;
    //    C = c;
# ---------- end c_script ----------
meshcp = MeshClosestPoint(Point=pt_2, Mesh=mesh_2)  # -> Point, Index, Parameter
item = ListItem(List=demesh.Faces, Index=meshcp.Index, Wrap=True)
deface = DeconstructFace(Face=item)  # -> CornerA, CornerB, CornerC, CornerD
item_2 = ListItem(List=num_2, Index=deface.CornerA, Wrap=True)
item_3 = ListItem(List=num_2, Index=deface.CornerC, Wrap=True)
item_4 = ListItem(List=num_2, Index=deface.CornerD, Wrap=True)
item_5 = ListItem(List=num_2, Index=deface.CornerB, Wrap=True)
item_6 = ListItem(List=c_script.B, Index=0, Wrap=True)  # -> flatten(Item), flatten(Item1), flatten(Item2), flatten(Item3)
multiplication = Multiplication(A=item_2, B=item_6.Item)
multiplication_2 = Multiplication(A=item_3, B=item_6.Item2)
multiplication_3 = Multiplication(A=item_4, B=item_6.Item3)
multiplication_4 = Multiplication(A=item_5, B=item_6.Item1)
addition = Addition(A=multiplication, B=multiplication_4, C=multiplication_2, D=multiplication_3)
R = ClusterOutput(addition)
