# Grasshopper definition Dodo_House Approximation_0.3.gh (Grasshopper 0.9.76)
# plug-ins: LunchBoxML, Dodo, LunchBox

panel = Panel("Train & Activate")
panel_2 = Panel("Test With")

panel_4 = Panel("INPUT - CONTROL")

path = FilePath("C:\Users\584\OneDrive - KIERANTIMBERLAKE\KT\002_Resources\Datasets\ml_house_data_set_short.csv")
excelread = ExcelReader(ReadExcelData=Toggle(True), WorkbookPath=path, WorksheetName="ml_house_data_set_short")  # -> Exceptions, ExcelData

path_2 = FilePath("C:\Users\584\OneDrive - KIERANTIMBERLAKE\KT\002_Resources\Datasets\ml_house_data_set_test.csv")
excelread_2 = ExcelReader(ReadExcelData=Toggle(True), WorkbookPath=path_2, WorksheetName="ml_house_data_set_test")  # -> Exceptions, ExcelData

panel_6 = Panel("INPUT - FIXED")

flip = FlipMatrix(Data=excelread.ExcelData)
item = ListItem(List=flip, Index=Slider(19, range=0..100), Wrap=True)
item_2 = ListItem(List=flip, Index=Slider(5, range=0..100), Wrap=True)
flatten = FlattenTree(Tree=item, Path="{0}")
flatten_2 = FlattenTree(Tree=item_2, Path="{0}")

flip_2 = FlipMatrix(Data=excelread_2.ExcelData)
item_3 = ListItem(List=flip_2, Index=Slider(19, range=0..100), Wrap=True)
item_4 = ListItem(List=flip_2, Index=Slider(5, range=0..100), Wrap=True)
flatten_3 = FlattenTree(Tree=item_3, Path="{0}")
flatten_4 = FlattenTree(Tree=item_4, Path="{0}")

panel_8 = Panel("INPUT - PARSE")

number_slider = Slider(0, range=0..100)
number_slider_2 = Slider(0, range=0..100)

panel_9 = Panel(flatten_4)
panel_10 = Panel(flatten_3)

panel_11 = Panel(flatten_2)
panel_12 = Panel(flatten)

panel_14 = Panel("LISTS")

cull_i = CullIndex(List=panel_12, Indices=number_slider, Wrap=True)
cull_i_2 = CullIndex(List=panel_11, Indices=number_slider, Wrap=True)

cull_i_3 = CullIndex(List=panel_10, Indices=number_slider_2, Wrap=True)
cull_i_4 = CullIndex(List=panel_9, Indices=number_slider_2, Wrap=True)

panel_15 = Panel(cull_i_2)
panel_16 = Panel(cull_i)

panel_18 = Panel("LOGIC - PRIMARY")

graft = GraftTree(Tree=panel_16, IncludeEmptyLists=True, IncludeNullItems=True)
graft_2 = GraftTree(Tree=panel_15, IncludeEmptyLists=True, IncludeNullItems=True)
trainnn = TrainNeuralNetwork(D=graft_2, O=graft)
panel_19 = Panel(trainnn)
nickname = GH_RunNN(NeuralNetwork=trainnn, Data=graft(cull_i_4))  # -> flatten(Data), Weights, Threshold

number_slider_3 = Slider(1594, range=0..10000)
fsim = FindSimilarMember(Data=number_slider_3, Set=panel_15)  # -> Hit, Index
nickname_2 = GH_RunNN(NeuralNetwork=trainnn, Data=graft(number_slider_3))  # -> flatten(Data), Weights, Threshold
item_5 = ListItem(List=panel_16, Index=fsim.Index, Wrap=True)
panel_20 = Panel(nickname_2.Data)
panel_21 = Panel(item_5)

panel_23 = Panel("LOGIC - SECONDARY")

panel_25 = Panel("LOGIC - AUXILLARY")

linereg = LinearRegression(TestData=cull_i_4, Inputs=cull_i_2, Output=cull_i)

panel_26 = Panel(cull_i_3)
panel_27 = Panel("Actual Prices")
panel_28 = Panel("Predicted Prices")
panel_29 = Panel(nickname.Data)

panel_31 = Panel("WRITE - MODEL")

panel_32 = Panel(linereg)
entwine = Entwine(Branch00=panel_29, Branch01=panel_26, FlattenInputs=True)
entwine_2 = Entwine(FlattenInputs=True)
subtraction = Subtraction(A=panel_29, B=panel_26)

panel_34 = Panel("WRITE - DATA")

graph = QuickGraph(entwine)
panel_35 = Panel("Approximated Sale Price")
panel_36 = Panel("Actual Sale Price")

panel_38 = Panel("DOC - ANNOTATE")

panel_40 = Panel("DOC - WATCH")

panel_41 = Panel("Price Difference")
panel_42 = Panel(subtraction)
panel_43 = Panel("% Diff")

division = Division(A=panel_42, B=panel_26)
multiplication = Multiplication(A=division, B=Slider(100, range=0..100))

panel_44 = Panel(multiplication)
