# Grasshopper definition OWL_House Prediction_0.5.gh (Grasshopper 0.9.76)
# plug-ins: LunchBox, Owl.Accord.GH, Owl.GH

path = FilePath("C:\Users\584\OneDrive - KIERANTIMBERLAKE\KT\002_Resources\Datasets\ml_house_data_set_test.csv")
excelread = ExcelReader(ReadExcelData=Toggle(True), WorkbookPath=path, WorksheetName="ml_house_data_set_test")  # -> Exceptions, ExcelData

panel = Panel("Test With")
number_slider = Slider(0, range=0..100)

path_2 = FilePath("C:\Users\584\OneDrive - KIERANTIMBERLAKE\KT\002_Resources\Datasets\ml_house_data_set_short.csv")
excelread_2 = ExcelReader(ReadExcelData=Toggle(True), WorkbookPath=path_2, WorksheetName="ml_house_data_set_short")  # -> Exceptions, ExcelData

panel_3 = Panel("INPUT - CONTROL")

flip = FlipMatrix(Data=excelread_2.ExcelData)
item = ListItem(List=flip, Index=Slider(19, range=0..100), Wrap=True)
item_2 = ListItem(List=flip, Index=Slider(0, range=0..100), Wrap=True)
item_3 = ListItem(List=flip, Index=Slider(2, range=0..100), Wrap=True)
item_4 = ListItem(List=flip, Index=Slider(5, range=0..100), Wrap=True)
flatten = FlattenTree(Tree=item, Path="{0}")
flatten_2 = FlattenTree(Tree=item_2, Path="{0}")
flatten_3 = FlattenTree(Tree=item_4, Path="{0}")
flatten_4 = FlattenTree(Tree=item_3, Path="{0}")

panel_5 = Panel("INPUT - FIXED")

flip_2 = FlipMatrix(Data=excelread.ExcelData)
item_5 = ListItem(List=flip_2, Index=Slider(0, range=0..100), Wrap=True)
item_6 = ListItem(List=flip_2, Index=Slider(2, range=0..100), Wrap=True)
item_7 = ListItem(List=flip_2, Index=Slider(5, range=0..100), Wrap=True)
item_8 = ListItem(List=flip_2, Index=Slider(19, range=0..100), Wrap=True)
flatten_5 = FlattenTree(Tree=item_8, Path="{0}")
flatten_6 = FlattenTree(Tree=item_5, Path="{0}")
flatten_7 = FlattenTree(Tree=item_6, Path="{0}")
flatten_8 = FlattenTree(Tree=item_7, Path="{0}")

panel_7 = Panel("INPUT - PARSE")

panel_8 = Panel(flatten_2)
panel_9 = Panel(flatten_4)
panel_10 = Panel(flatten)
panel_11 = Panel(flatten_3)

panel_12 = Panel(flatten_6)
panel_13 = Panel(flatten_7)
panel_14 = Panel(flatten_5)
panel_15 = Panel(flatten_8)

panel_17 = Panel("LISTS")

cull_i = CullIndex(List=panel_14, Indices=number_slider, Wrap=True)
cull_i_2 = CullIndex(List=panel_13, Indices=number_slider, Wrap=True)
cull_i_3 = CullIndex(List=panel_15, Indices=number_slider, Wrap=True)
cull_i_4 = CullIndex(List=panel_12, Indices=number_slider, Wrap=True)

multiplication = Multiplication(A=cull_i_2, B=Slider(1000, range=0..1000))
subtraction = Subtraction(A=Slider(2017, range=0..10000), B=cull_i_4)
multiplication_2 = Multiplication(A=subtraction, B=Slider(100, range=0..1000))

panel_19 = Panel("LOGIC - PRIMARY")

featurets = FeatureTensorSet(Feature0=multiplication_2, Feature1=multiplication, Feature2=cull_i_3)
remap = RemapTSet(TensorSet=featurets, Source="0 to 10000", Target=Domain(0, 1))

panel_21 = Panel("LOGIC - SECONDARY")

panel_22 = Panel("""3
20
1""")
network = ConstructNetwork(Layers=panel_22, Activation=Slider(1, range=0..1), Alpha=2, Seed=123)

detset = DeconstructTensorSet(TensorSet=remap)
panel_23 = Panel(detset)

panel_25 = Panel("LOGIC - AUXILLARY")

panel_27 = Panel("WRITE - MODEL")

panel_29 = Panel("WRITE - DATA")

panel_31 = Panel("DOC - ANNOTATE")

panel_33 = Panel("DOC - WATCH")

panel_34 = Panel("Train & Activate")
number_slider_2 = Slider(0, range=0..100)

cull_i_5 = CullIndex(List=panel_8, Indices=number_slider_2, Wrap=True)
cull_i_6 = CullIndex(List=panel_10, Indices=number_slider_2, Wrap=True)
cull_i_7 = CullIndex(List=panel_9, Indices=number_slider_2, Wrap=True)
cull_i_8 = CullIndex(List=panel_11, Indices=number_slider_2, Wrap=True)

subtraction_2 = Subtraction(A=Slider(2017, range=0..10000), B=cull_i_5)
multiplication_3 = Multiplication(A=cull_i_7, B=Slider(1000, range=0..1000))
multiplication_4 = Multiplication(A=subtraction_2, B=Slider(100, range=0..1000))

featurets_2 = FeatureTensorSet(Feature0=multiplication_4, Feature1=multiplication_3, Feature2=cull_i_8)
featurets_3 = FeatureTensorSet(Feature0=cull_i_6)

remap_2 = RemapTSet(TensorSet=featurets_3, Source="0 to 10000000", Target=Domain(0, 1))
remap_3 = RemapTSet(TensorSet=featurets_2, Source="0 to 10000", Target=Domain(0, 1))

series = Series(Start=Slider(200, range=0..1000), Step=1, Count=Slider(100, range=0..1000))
series_2 = Series(Start=Slider(100, range=0..1000), Step=1, Count=Slider(100, range=0..1000))
noise = AddNoise(TensorSet=remap_2, Amplitude=Slider(0.02, range=0..0.1), Seed=series, Constrain=Domain(0, 1))
noise_2 = AddNoise(TensorSet=remap_3, Amplitude=Slider(0.02, range=0..0.1), Seed=series_2, Constrain=Domain(0, 1))

mergets = MergeTSet(TensorSets=remap_3)
mergets_2 = MergeTSet(TensorSets=remap_2)
backprop = Backpropagation(
    ActivationNetwork=network,
    Input=mergets,
    Output=mergets_2,
    LearningRate=0.01,
    Momentum=0.001,
    Epoch=10,
    Iterations=Slider(750, range=0..10000))  # -> ActivationNetwork, Error

detset_2 = DeconstructTensorSet(TensorSet=remap_2)
panel_35 = Panel(detset_2)

compute = Compute(ActivationNetwork=backprop.ActivationNetwork, Input=remap)
remap_4 = RemapTSet(TensorSet=compute, Source=Domain(0, 1), Target="50000 to 5000000")

_2dpreview = NetworkPreview(Network=backprop.ActivationNetwork, Lines=Domain(1, 5), Radius=5)
detset_3 = DeconstructTensorSet(TensorSet=remap_4)

detensor = DeconstructTensor(Tensor=detset_3)  # -> flatten(Values)

panel_36 = Panel("Actual Price")
panel_37 = Panel(cull_i)
panel_38 = Panel("Predicted Price")
panel_39 = Panel(detensor)
subtraction_3 = Subtraction(A=panel_37, B=panel_39)
panel_40 = Panel("Price Difference")
panel_41 = Panel(subtraction_3)
division = Division(A=panel_41, B=panel_37)
multiplication_5 = Multiplication(A=division, B=Slider(100, range=0..100))
panel_42 = Panel("% Diff")
panel_43 = Panel(multiplication_5)

entwine = Entwine(Branch00=panel_37, Branch01=detensor, FlattenInputs=True)

graph = QuickGraph(panel_37)
graph_2 = QuickGraph(detensor)
graph_3 = QuickGraph(entwine)
panel_44 = Panel("Actual Sale Price")
panel_45 = Panel("Approximated Sale Price")
