# Grasshopper definition MLGeometry_PM_0.5.ghx (Grasshopper 0.9.76)
# plug-ins: Python Interpreter, Telepathy, Owl.GH

# ----
# NUMBER OF INDIVIDUAL PRIMITIVES
number_slider = Slider(15, range=0..100)

color_groups_clusters = Button(ExpressionNormal="True")

panel = Panel("BASE PLANE")
pln = Plane(PlaneXY(0.08767023439, 0.0884122404, 0))

num = Number(50)
range = Range(Domain=num, Steps=number_slider)
num_2 = Number(0)
cull_i = CullIndex(List=range, Indices=num_2, Wrap=True)
col = Colour([RGBA(4, 0, 255, 135), RGBA(0, 128, 255, 133), RGBA(210, 255, 148, 141), RGBA(255, 0, 0, 122), RGBA(224, 224, 224, 211)])
panel_2 = Panel(cull_i)

python = PythonScript()  # -> out, random_int
# ---------- python: Python ----------
import Rhino.Geometry as rg
import rhinoscriptsyntax as rs
import math

from random import randint
random_int = (randint(0, 100))
# ---------- end python ----------
python_2 = PythonScript()  # -> out, random_int; same code as python
python_3 = PythonScript()  # -> out, random_int; same code as python
python_4 = PythonScript()  # -> out, random_int; same code as python
python_5 = PythonScript()  # -> out, random_int; same code as python
python_6 = PythonScript()  # -> out, random_int; same code as python
python_7 = PythonScript()  # -> out, random_int; same code as python
python_8 = PythonScript()  # -> out, random_int; same code as python
# Generate Test Geo
panel_3 = Panel("RANDOMIZE SHIT")
jitter = Jitter(List=panel_2, Jitter=1, Seed=python.random_int)  # -> Values, Indices
jitter_2 = Jitter(List=panel_2, Jitter=1, Seed=python_3.random_int)  # -> Values, Indices
jitter_3 = Jitter(List=panel_2, Jitter=1, Seed=python_4.random_int)  # -> Values, Indices
jitter_4 = Jitter(List=panel_2, Jitter=1, Seed=python_5.random_int)  # -> Values, Indices
jitter_5 = Jitter(List=panel_2, Jitter=1, Seed=python_2.random_int)  # -> Values, Indices
jitter_6 = Jitter(List=panel_2, Jitter=1, Seed=python_6.random_int)  # -> Values, Indices
jitter_7 = Jitter(List=panel_2, Jitter=1, Seed=python_7.random_int)  # -> Values, Indices
jitter_8 = Jitter(List=panel_2, Jitter=1, Seed=python_8.random_int)  # -> Values, Indices

panel_4 = Panel("PRIMITIVE CREATION")
box = CenterBox(Base=pln, X=jitter_2.Values, Y=jitter_3.Values, Z=jitter_4.Values)
cone = Cone(Base=pln, Radius=jitter_7.Values, Length=jitter_8.Values)  # -> Cone, Tip
sph = Sphere(Base=pln, Radius=jitter_6.Values)
cyl = Cylinder(Base=pln, Radius=jitter.Values, Length=jitter_5.Values)

capex = CapHolesEx(Brep=sph)  # -> Brep, Caps, Solid
capex_2 = CapHolesEx(Brep=box)  # -> Brep, Caps, Solid
capex_3 = CapHolesEx(Brep=cyl)  # -> Brep, Caps, Solid
capex_4 = CapHolesEx(Brep=cone.Cone)  # -> Brep, Caps, Solid
panel_5 = Panel(capex.Brep)
panel_6 = Panel(capex_3.Brep)
panel_7 = Panel(capex_4.Brep)
panel_8 = Panel(capex_2.Brep)
entwine = Entwine(Branch00=capex_4.Brep, Branch01=capex_3.Brep, Branch02=capex_2.Brep, FlattenInputs=True)  # -> flatten(Result)
data = Data(capex_2.Brep)
data_2 = Data(capex_3.Brep)
data_3 = Data(capex_4.Brep)
lng = ListLength(List=data)
lng_2 = ListLength(List=data_2)
lng_3 = ListLength(List=data_3)
dup = DuplicateData(Data="Box", Number=lng, Order=True)  # -> flatten(Data)
dup_2 = DuplicateData(Data="Cylinder", Number=lng_2, Order=True)  # -> flatten(Data)
dup_3 = DuplicateData(Data="Cone", Number=lng_3, Order=True)  # -> flatten(Data)
merge = Merge(Data1=dup_3, Data2=dup_2, Data3=dup)
graft = GraftTree(Tree=entwine, IncludeEmptyLists=True, IncludeNullItems=True)
data_4 = Data(simplify(graft(merge)))
geometry_shapenames = RemoteSender(data_4)
geometry_primitives = RemoteSender(graft)
geometry_primitives_2 = RemoteReceiver(geometry_primitives)
brep = Brep(simplify(geometry_primitives_2))
geometry_primitives_3 = RemoteReceiver(geometry_primitives)
brep_2 = Brep(brep)
brep_3 = Brep(brep)
brep_4 = Brep(brep)
brep_5 = Brep(brep)
vmoments = VolumeMoments(Geometry=brep_4)  # -> simplify(Volume), simplify(Centroid), simplify(Inertia), simplify(InertiaError), simplify(Secondary), simplify(SecondaryError), simplify(Gyration)
debrep = DeconstructBrep(Brep=brep_3)  # -> simplify(Faces), simplify(Edges), simplify(Vertices)
bbox = BoundingBox(Content=brep_5, Plane=PlaneXY(0, 0, 0))  # -> Box, Box_2
debrep_2 = DeconstructBrep(Brep=brep_2)  # -> Faces, Edges, Vertices
brep_6 = Brep(bbox.Box_2)
brep_7 = Brep(debrep_2.Faces)
data_5 = Data(vmoments.Secondary)
lng_4 = ListLength(List=debrep.Vertices)

# ---- group: input geometry
geo = Geometry(geometry_primitives_3)

# ----
lng_5 = ListLength(List=debrep.Faces)
lng_6 = ListLength(List=debrep.Edges)
area = Area(Geometry=brep_7)  # -> Area, Centroid
volume = Volume(Geometry=brep_5)  # -> Volume, Centroid
volume_2 = Volume(Geometry=brep_6)  # -> Volume, Centroid
data_6 = Data(lng_4)
data_7 = Data(lng_5)
data_8 = Data(lng_6)
pdecon = Deconstruct(Point=area.Centroid)  # -> XComponent, YComponent, ZComponent
data_9 = Data(volume.Volume)
data_10 = Data(volume_2.Volume)
# MARK'S FEATURES
volume_3 = Volume(Geometry=brep_2)  # -> Volume, Centroid
data_11 = Data(pdecon.ZComponent)
division = Division(A=data_10, B=data_9)
sort = SortList(Keys=data_11, ValuesA=data_11, ValuesB=brep_7, ValuesC=area.Centroid)  # -> Keys, ValuesA, ValuesB, ValuesC
bbox_2 = BoundingBox(Content=geo, Plane=PlaneXY(0, 0, 0))  # -> Box, Box_2

# ---- group: length of slice at low mid and high
panel_9 = Panel("""0.1
0.5
0.9""")
box_2 = EvaluateBox(Box=bbox_2.Box, UParameter="0", VParameter="0", WParameter=panel_9)  # -> Plane, Point, Include
sec = BrepPlane(Brep=geo, Plane=box_2.Plane)  # -> Curves, Points
trim = TrimTree(Tree=sec.Curves, Depth=1)
len = Length(Curve=trim)
item = ListItem(List=simplify(len), Index=0, Wrap=True)  # -> Item, Item1, Item2

# ----
data_12 = Data(division)
# NATE'S FEATURES
geometry_shapenames_2 = RemoteReceiver(geometry_shapenames)
item_2 = ListItem(List=sort.ValuesC, Index=0, Wrap=True)
debox = DeconstructBox(Box=bbox_2.Box)  # -> Plane, simplify(X), simplify(Y), simplify(Z)
pt = Point(volume_3.Centroid)
pt_2 = Point(item_2)
volume_4 = Volume(Geometry=geo)  # -> simplify(Volume), Centroid
area_2 = Area(Geometry=geo)  # -> simplify(Area), Centroid
vec2pt = Vector2Pt(PointA=pt_2, PointB=pt, Unitize=False)  # -> Vector, Length
dlength = DLength(I=debox.Y)
dlength_2 = DLength(I=debox.Z)
pdecon_2 = Deconstruct(Point=volume_4.Centroid)  # -> simplify(XComponent), simplify(YComponent), simplify(ZComponent)
dlength_3 = DLength(I=debox.X)
data_13 = Data(vec2pt.Vector)
panel_10 = Panel(dlength_3)
panel_11 = Panel(dlength)
panel_12 = Panel(dlength_2)
panel_13 = Panel(volume_4.Volume)
panel_14 = Panel(area_2.Area)
panel_15 = Panel(pdecon_2.XComponent)
panel_16 = Panel(pdecon_2.YComponent)
panel_17 = Panel(pdecon_2.ZComponent)
data_14 = Data(data_5)
data_15 = Data(data_13)
shape_type = Data(geometry_shapenames_2)
cluster = Cluster_3(data=data_14)
cluster_2 = Cluster_3(data=data_15)
data_16 = Data(simplify(cluster))
data_17 = Data(simplify(cluster_2))
data_18 = Data(simplify(data_7))
data_19 = Data(simplify(data_8))
data_20 = Data(simplify(data_6))
data_21 = Data(simplify(data_12))
field_titles = Panel("""Shape
Area
Volume
centroid x
centroid y 
centroid z
BB_Height
BB_Width
BB_Depth
low_slice_length
mid_slice_length
upper_slice_length""")
merge_2 = Merge(Data1=data_17, Data2=data_16, Data3=data_18, Data4=data_19, Data5=data_20, Data6=data_21)
merge_3 = Merge(
    Data2=panel_14,
    Data3=panel_13,
    Data4=panel_15,
    Data5=panel_16,
    Data6=panel_17,
    Data7=panel_10,
    Data8=panel_11,
    Data9=panel_12,
    Data10=item.Item,
    Data11=item.Item1,
    Data12=item.Item2)
data_22 = Data(merge_2)
features_values_nate = RemoteSender(merge_3)
features_values_mark = RemoteSender(data_22)
# [second moment of inertia]
# Ixx
# Iyy
# Izy
panel_18 = Panel(data_16)
panel_19 = Panel(data_17)
features_names_nate = RemoteSender(field_titles)
panel_20 = Panel("""x
y
z
lxx
lyy
lzy
num_faces
num_edges
num_vertices
vol-bb_ratio""")
# [brep topology]
# number of faces
# number of edges
# number of vertexs
panel_21 = Panel(data_19)
panel_22 = Panel(data_20)
# volume/ bb volume ratio
panel_23 = Panel(data_21)
panel_24 = Panel(data_18)
# [eccentricity]
# x
# y
# z
features_names_mark = RemoteSender(panel_20)
mesh = Mesh([<mesh referenced from the Rhino model> x28])
bbox_3 = BoundingBox(Content=mesh, Plane=PlaneXY(0, 0, 0))  # -> Box, Box_2
debox_2 = DeconstructBox(Box=bbox_3.Box)  # -> Plane, simplify(X), simplify(Y), simplify(Z)
volume_5 = Volume(Geometry=mesh)  # -> simplify(Volume), Centroid
area_3 = Area(Geometry=mesh)  # -> simplify(Area), Centroid
dlength_4 = DLength(I=debox_2.Y)
dlength_5 = DLength(I=debox_2.Z)
pdecon_3 = Deconstruct(Point=volume_5.Centroid)  # -> simplify(XComponent), simplify(YComponent), simplify(ZComponent)
dlength_6 = DLength(I=debox_2.X)
panel_25 = Panel(dlength_6)
panel_26 = Panel(dlength_4)
panel_27 = Panel(dlength_5)
panel_28 = Panel(pdecon_3.XComponent)
panel_29 = Panel(area_3.Area)
panel_30 = Panel(volume_5.Volume)
panel_31 = Panel(pdecon_3.YComponent)
panel_32 = Panel(pdecon_3.ZComponent)
features_names_mark_2 = RemoteReceiver(features_names_mark)
features_values_mark_2 = RemoteReceiver(features_values_mark)
# MERGE DATA
features_names_nate_2 = RemoteReceiver(features_names_nate)
features_values_nate_2 = RemoteReceiver(features_values_nate)
merge_4 = Merge(Data1=features_names_nate_2, Data2=features_names_mark_2)
merge_5 = Merge(Data1=features_values_nate_2, Data2=features_values_mark_2)
features_names = RemoteSender(merge_4)
features_values = RemoteSender(merge_5)
partition = PartitionList(Size=[3, 2])
features_values_2 = RemoteReceiver(features_values)
flip = FlipMatrix(Data=features_values_2)
bnd = Bounds(Numbers=flip)  # -> flatten(Domain)
# ML Stuffs
remap = RemapNumbers(Value=features_values_2, Source=bnd, Target=Domain(0, 1))  # -> Mapped, Clipped
panel_33 = Panel(features_values_2)
datatree_to_tensorset = DataTreeToTensorSet(DataTree=remap.Mapped)  # "DT->TS"
item_3 = ListItem(List=features_values_2, Index=0, Wrap=True)  # -> Item, Item1, Item2, Item3
kmeans = KMeansClustering(Data=datatree_to_tensorset, Clusters=Slider(3, range=0..10), Iterations=Slider(4, range=0..100), Seed=123)  # -> Clusters, Indices
mll_stuff = RemoteSender(kmeans.Indices)
mll_stuff_2 = RemoteReceiver(mll_stuff)
geometry_shapenames_3 = RemoteReceiver(geometry_shapenames)
geometry_primitives_4 = RemoteReceiver(geometry_primitives)
features_names_2 = RemoteReceiver(features_names)
item_4 = ListItem(List=flatten(item_3.Item), Index=mll_stuff_2, Wrap=True)
item_5 = ListItem(List=flatten(item_3.Item2), Index=mll_stuff_2, Wrap=True)
item_6 = ListItem(List=flatten(item_3.Item1), Index=mll_stuff_2, Wrap=True)
item_7 = ListItem(List=flatten(geometry_shapenames_3), Index=mll_stuff_2, Wrap=True)
item_8 = ListItem(List=flatten(geometry_primitives_4), Index=mll_stuff_2, Wrap=True)
panel_34 = Panel(item_8)
geometry_primitives_5 = RemoteReceiver(geometry_primitives)
geometry = RemoteReceiver([geometry_primitives, geometry_shapenames])
# Visualization Stuffs
panel_35 = Panel(item_7)
pt_3 = Point(Point(0, 0, 0))
pt_4 = ConstructPoint(XCoordinate=item_4, YCoordinate=item_6, ZCoordinate=item_5)
panel_36 = Panel(geometry)
scale = Scale(Geometry=pt_4, Center=pt_3, Factor=Slider(0.01, range=0..0.01))  # -> Geometry, Transform
move = Move(Geometry=item_8, Motion=scale.Geometry)  # -> Geometry, Transform
merge_6 = Merge(
    Data1=ColourSwatch(SwatchColor=RGB(0, 255, 166)),
    Data2=ColourSwatch(SwatchColor=RGB(255, 215, 54)),
    Data3=ColourSwatch(SwatchColor=RGB(255, 0, 0)))  # -> graft(Result)
preview = CustomPreview(Geometry=move.Geometry, Shader=merge_6)

# ----
# ToolDescription: Enter a description of this definition's functionality and use
update_file_info = Button()
group_prefixes = Panel("""out_
in_
action_
warning_
cluster""")
c_script = CSharpScript(update=color_groups_clusters, name=group_prefixes, col=col)  # -> out, A; inputs update: Boolean, name: list of String, col: list of Color
# ---------- c_script: C# ----------
    Color clusterColor = Color.Transparent;
    for(int i = 0;i < name.Count;i++){
      if(name[i].Contains("cluster")){
        clusterColor = col[i];
        break;
      }
    }



    if(update){
      List<Guid> guids = new List<Guid>();
      List<Grasshopper.Kernel.Special.GH_Group> grps = new List<Grasshopper.Kernel.Special.GH_Group>();
      List<Grasshopper.Kernel.Special.GH_Group> alreadygrps = new List<Grasshopper.Kernel.Special.GH_Group>();


      foreach(IGH_DocumentObject o in GrasshopperDocument.Objects){
        Grasshopper.Kernel.Special.GH_Group g = o as Grasshopper.Kernel.Special.GH_Group;
        if(g != null){
          for(int j = 0;j < name.Count;j++){
            if(g.NickName.ToUpper().Contains(name[j].ToUpper())){
              g.Colour = col[j % col.Count];
            }

          }
        }


        if(o is Grasshopper.Kernel.Special.GH_Cluster){
          Grasshopper.Kernel.Special.GH_Cluster cluster = o as  Grasshopper.Kernel.Special.GH_Cluster;
          string filepath = cluster.FilePath;
          if(!String.IsNullOrEmpty(filepath)){
            cluster.Name = System.IO.Path.GetFileNameWithoutExtension(filepath);
            cluster.NickName = System.IO.Path.GetFileNameWithoutExtension(filepath);
            cluster.Attributes.ExpireLayout();
          }
          guids.Add(cluster.InstanceGuid);
          Grasshopper.Kernel.Special.GH_Group grp = new Grasshopper.Kernel.Special.GH_Group();
          grps.Add(grp);

        } else if (o is Grasshopper.Kernel.Special.GH_Group){
          Grasshopper.Kernel.Special.GH_Group alreadygrp = o as Grasshopper.Kernel.Special.GH_Group;
          alreadygrps.Add(alreadygrp);
        }





      }

      List<bool> isAlreadyInGroup = IsAlreadyInGroup(guids, alreadygrps);

      for(int i = 0;i < grps.Count;i++){
        Grasshopper.Kernel.Special.GH_Group grp = grps[i];
        grp.Colour = clusterColor;
        grp.NickName = "";
        grp.AddObject(guids[i]);
        if(!isAlreadyInGroup[i]){
          grp.ExpireCaches();
          GrasshopperDocument.AddObject(grp, false, 1000);
        }
      }



    }
# ---------- c_script: C# additional code ----------
  List<bool> IsAlreadyInGroup(List<Guid> guids, List<Grasshopper.Kernel.Special.GH_Group> grps){
    List<bool> results = new List<bool>();
    foreach(Guid g in guids){
      results.Add(false);
    }
    foreach(Grasshopper.Kernel.Special.GH_Group grp in grps){ //for every group in the pre-existing groups
      if(grp.Objects().Count == 1){ //if that group only has one object in it
        for (int j = 0;j < guids.Count;j++){
          Guid g = guids[j];
          if(grp.ObjectIDs.Contains(g)){
            results[j] = true;
            break;
          }
        }
      }
    }
    return results;
  }
# ---------- end c_script ----------

data_23 = Data(update_file_info)

c_script_2 = CSharpScript(x=data_23)  # -> out, A, B, C, D, E
# ---------- c_script_2: C# ----------
    List < IGH_DocumentObject> objectsRecursive = new List<IGH_DocumentObject>();
    objectsRecursive.AddRange(clusterObjectsRecursive(GrasshopperDocument));


    B = GrasshopperDocument.Author.Name + " " + GrasshopperDocument.Author.Email;
    D = GrasshopperDocument.Properties.DateTag;
    if(GrasshopperDocument.IsFilePathDefined){
      C = GrasshopperDocument.FilePath;
      System.IO.FileInfo info = new System.IO.FileInfo(GrasshopperDocument.FilePath);
      if(info.LastWriteTime != null){
        E = info.LastWriteTime;
      } else {
        E = "";
      }
    } else {
      C = "Unsaved Document";
      E = "";
    }
    A = objectsRecursive;
# ---------- c_script_2: C# additional code ----------
  List<IGH_DocumentObject> clusterObjectsRecursive(GH_Document doc){
    List<IGH_DocumentObject> objList = new List<IGH_DocumentObject>();
    objList.AddRange(doc.Objects);
    foreach(IGH_DocumentObject obj in doc.Objects){
      Grasshopper.Kernel.Special.GH_Cluster cluster = obj as Grasshopper.Kernel.Special.GH_Cluster;
      try{
        objList.AddRange(clusterObjectsRecursive(cluster.Document("")));
      } catch {

      }
    }
    return objList;
  }
# ---------- end c_script_2 ----------
cluster_3 = Cluster_2(T=c_script_2.A, N=c_script_2.B, fn=c_script_2.C, dc=c_script_2.D, dm=c_script_2.E)
file_info = Panel(cluster_3)

# ---- group: length of slice at low mid and high
panel_37 = Panel("""0.1
0.5
0.9""")
box_3 = EvaluateBox(Box=bbox_3.Box, UParameter="0", VParameter="0", WParameter=panel_37)  # -> Plane, Point, Include

# ----
sec_2 = MeshPlane(Mesh=mesh, Plane=box_3.Plane)

# ---- group: length of slice at low mid and high (continued)
trim_2 = TrimTree(Tree=sec_2, Depth=1)
len_2 = Length(Curve=trim_2)
item_9 = ListItem(List=simplify(len_2), Index=0, Wrap=True)  # -> Item, Item1, Item2

# ----
area_4 = Area(Geometry=trim_2)  # -> Area, Centroid
# field titles: Shape
# Area
# Volume
# centroid x
# centroid y
# centroid z
# BB_Height
# BB_Width
# BB_Depth
# low_slice_length
# mid_slice_length
# upper_slice_length
merge_7 = Merge(
    Data2=panel_29,
    Data3=panel_30,
    Data4=panel_28,
    Data5=panel_31,
    Data6=panel_32,
    Data7=panel_25,
    Data8=panel_26,
    Data9=panel_27,
    Data10=item_9.Item,
    Data11=item_9.Item1,
    Data12=item_9.Item2)
python_9 = PythonScript(unjoined_curve=trim_2)  # -> init_point, end_point, combined_list; inputs unjoined_curve: list of Polyline; disabled
# ---------- python_9: Python ----------
import Rhino.Geometry as rg
import rhinoscriptsyntax as rs
import math

init_list = []
end_list = []
curve_list = []
joined_curves = []

from clr import AddReference as addr
addr("Grasshopper")

for i in unjoined_curve:
    combined_list = []
    init_point = i.PointAt(0)
    end_point = i.PointAt(1)
    init_list.append(init_point)
    end_list.append(end_point)
    bounding_line = rg.Line(init_point, end_point)
    #curve_list.append(rg.NurbsCurve.CreateFromLine(bounding_line))
    combined_list.append(rg.NurbsCurve.CreateFromLine(bounding_line))
    combined_list.append(i)
    joined_curves.append(rg.Curve.JoinCurves(combined_list))
# ---------- end python_9 ----------
panel_38 = Panel(python_9.combined_list)

# ==== cluster Cluster_2
T = ClusterInput()
N = ClusterInput()
fn = ClusterInput()
dc = ClusterInput()
dm = ClusterInput()
cluster = Cluster(T=T, N=N, fn=fn, dc=dc, dm=dm)  # -> T_2, author_2, objcount_2, fn_3, dc_4, dm_4
merge = Merge(
    Data1=cluster.author_2,
    Data2=cluster.T_2,
    Data3=cluster.objcount_2,
    Data4=cluster.fn_3,
    Data5=cluster.dc_4,
    Data6=cluster.dm_4)
R = ClusterOutput(merge)

# ==== cluster DLength: computes length of a domain
I = ClusterInput()
dedomain = DeconstructDomain(Domain=I)  # -> Start, End
subtraction = Subtraction(A=dedomain.Start, B=dedomain.End)
abs = Absolute(Value=subtraction)
y = ClusterOutput(abs)

# ==== cluster Cluster_3
data = ClusterInput()
data_2 = Data(data)
pdecon = Deconstruct(Point=data_2)  # -> XComponent, YComponent, ZComponent
merge = Merge(Data1=pdecon.XComponent, Data2=pdecon.YComponent, Data3=pdecon.ZComponent)
data_3 = Data(merge)
data_4 = ClusterOutput(data_3)

# ==== cluster Cluster
N = ClusterInput()
T = ClusterInput()
N_2 = Text(N)
split = TextSplit(Text=T, Separators=".")
fn = ClusterInput()
dm = ClusterInput()
item = ListItem(List=split, Index=0, Wrap=True)
dc = ClusterInput()
pan = Panel("""HDT_Reference
HDTReference""")
pan_2 = Panel("""Human
Human""")
lng = ListLength(List=T)
len = TextLength(Text=N_2)
contains = ContainsAB(B=N_2)
dm_2 = Text(dm)
dc_2 = Text(dc)
fn_2 = Text(fn)
replace = ReplaceMembers(Set=item, Find=pan, Replace=pan_2)
cset = CreateSet(List=flatten(replace))  # -> Set, Map
txt = Text(["ScriptComponents", "Grasshopper", "MathComponents", "GalapagosComponents", "FieldComponents", "VectorComponents", "AnalysisComponents", "CurveComponents", "LegacyScriptComponents", "SurfaceComponents", "TriangulationComponents", "MassXForms", "LinearXForms"])
format = Format(Format="Definition by {0}", Culture=127, Data0=N_2)
difference = SetDifference(SetA=cset.Set, SetB=txt)
lng_2 = ListLength(List=flatten(difference))
dispatch = Dispatch(List=format, DispatchPattern=contains)  # -> ListA, ListB
format_2 = Format(Format="Object Count: {0:0}", Culture=127, Data0=lng)
format_3 = Format(Format="Date Modified: {0}", Culture=127, Data0=dm_2)
format_4 = Format(Format="Date Created: {0}", Culture=127, Data0=dc_2)
dependencies = Text(flatten(difference))
author = Text(flatten(dispatch.ListB))
larger = LargerThan(FirstNumber=lng_2, SecondNumber="1")  # -> LargerThan, OrEqualTo
objcount = Text(flatten(format_2))
author_2 = ClusterOutput(author)
dm_3 = Text(flatten(format_3))
fn_3 = ClusterOutput(fn_2)
dc_3 = Text(flatten(format_4))
objcount_2 = ClusterOutput(objcount)
dc_4 = ClusterOutput(dc_3)
filter = StreamFilter(
    Gate=larger.LargerThan,
    Stream0="This definition requires the following plug-in:",
    Stream1="This definition requires the following plug-ins:")
dm_4 = ClusterOutput(dm_3)
pan_3 = Panel("""{0}
{1}""")
join = TextJoin(Text=dependencies)
format_5 = Format(Format=pan_3, Culture=127, Data0=filter, Data1=join)
clean = CleanTree(Tree=format_5, CleanInvalid=True, CleanEmpty=False)
T_2 = ClusterOutput(clean)

# ==== cluster ContainsAB: Tests if a string contains another string.
B = ClusterInput()
A = ClusterInput()
A_2 = String(A)
B_2 = String(B)
eval = Evaluate(F="Contains(x,y)", x=A_2, y=B_2)
c = Boolean(eval)
c_2 = ClusterOutput(c)
