# Grasshopper definition MLGeometry_PM_0.8.ghx (Grasshopper 0.9.76)
# plug-ins: Python Interpreter, treesloth01, Human UI, Human, LunchBox, MetaHopper, TT Toolbox, Telepathy, Owl.GH

color_groups_clusters = Button(ExpressionNormal="True")
number_slider = Slider(50, range=0..100)

balance = Slider(0, range=-5..5)
objfromgroup = GetObjectsInGroup()

textbox = CreateTextBox(UpdateButton=invert(True), showLabel=True)
col = Colour([RGBA(4, 0, 255, 135), RGBA(0, 128, 255, 133), RGBA(210, 255, 148, 141), RGBA(255, 0, 0, 122), RGBA(224, 224, 224, 211)])
pulldown = CreatePulldownMenu(Label=" ", ListItems=" ", showLabel=True)
dup = DuplicateData(Data=objfromgroup, Number=number_slider, Order=True)
dup_2 = DuplicateData(Data="Normalize", Number=number_slider, Order=True)
dup_3 = DuplicateData(Data=" ", Number=number_slider, Order=True)
merge = Merge(Data1=textbox, Data2=pulldown)
number_slider_2 = Slider(9, range=0..100)
button = CreateButton(ButtonName="save", ButtonStyle=0)
button_2 = CreateButton(ButtonName="restore", ButtonStyle=0)
values = ValueListener(Elements=textbox, SomeProperty=True)  # -> Values, Indices
checkbox = CreateCheckbox(Label=dup_2, StartingValue=False)  # -> simplify(graft(Checkbox))
values_2 = ValueListener(Elements=pulldown, SomeProperty=True)  # -> Values, Indices
width_start = Slider(0.04, range=0..1)
width_end = Slider(0.31, range=0..1)
height_start = Slider(0.2, range=0..1)
height_end = Slider(0.96, range=0..1)
checkbox_2 = CreateCheckbox(Label=dup_3, StartingValue=invert(False))  # -> simplify(graft(Checkbox))
slider = CreateSlider(Slider=dup, ShowBounds=False, showLabel=False, ShowTicks=False, ShowTooltip=False, ShowValLabel=True)  # -> simplify(graft(Sliders))
number_slider_3 = Slider(13, range=0..100)
window_name = Panel("Metashape")
merge_2 = Merge(Data1=button, Data2=button_2)
taskbar_hidden = BooleanToggle(False)
values_3 = ValueListener(Elements=button, SomeProperty=True)  # -> Values, Indices
values_4 = ValueListener(Elements=button_2, SomeProperty=True)  # -> Values, Indices

# ----
# NUMBER OF INDIVIDUAL PRIMITIVES
number_slider_4 = Slider(100, range=0..100)

entwine = Entwine(Branch00=merge, Branch01=merge_2, FlattenInputs=True)
# HUI
snap = ValueList({"Off": 0, "On": 1}, selected="On")
series = Series(Start=0, Step=1, Count=number_slider)
merge_3 = Merge(Data1=checkbox_2, Data2=checkbox, Data3=slider)  # -> graft(Result)
css_stretchhorizontal = RemoteSender(entwine)
savestates = SaveElementStates(
    Elements=flatten(merge_3),
    SaveState=values_3.Values,
    StateName=values.Values,
    ClearSavedStates=Button(),
    stateSetChunk_State0_stateName="Default",
    stateSetChunk_State0_stateItem0_ElementIndex=0,
    stateSetChunk_State0_stateItem0_ElementValue="True",
    stateSetChunk_State0_stateItem0_ElementValueType="System.Boolean",
    stateSetChunk_State0_stateItem1_ElementIndex=0,
    stateSetChunk_State0_stateItem1_ElementValue="False",
    stateSetChunk_State0_stateItem1_ElementValueType="System.Boolean",
    stateSetChunk_State0_stateItem2_ElementIndex=0,
    stateSetChunk_State0_stateItem2_ElementValue="0",
    stateSetChunk_State0_stateItem2_ElementValueType="System.Double",
    stateSetChunk_State0_stateItem3_ElementIndex=1,
    stateSetChunk_State0_stateItem3_ElementValue="True",
    stateSetChunk_State0_stateItem3_ElementValueType="System.Boolean",
    stateSetChunk_State0_stateItem4_ElementIndex=1,
    stateSetChunk_State0_stateItem4_ElementValue="False",
    stateSetChunk_State0_stateItem4_ElementValueType="System.Boolean",
    stateSetChunk_State0_stateItem5_ElementIndex=1,
    stateSetChunk_State0_stateItem5_ElementValue="0",
    stateSetChunk_State0_stateItem5_ElementValueType="System.Double",
    stateSetChunk_State0_stateItem6_ElementIndex=2,
    stateSetChunk_State0_stateItem6_ElementValue="True",
    stateSetChunk_State0_stateItem6_ElementValueType="System.Boolean",
    stateSetChunk_State0_stateItem7_ElementIndex=2,
    stateSetChunk_State0_stateItem7_ElementValue="False",
    stateSetChunk_State0_stateItem7_ElementValueType="System.Boolean",
    stateSetChunk_State0_stateItem8_ElementIndex=2,
    stateSetChunk_State0_stateItem8_ElementValue="0",
    stateSetChunk_State0_stateItem8_ElementValueType="System.Double",
    stateSetChunk_State0_stateItem9_ElementIndex=3,
    stateSetChunk_State0_stateItem9_ElementValue="True"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)  # -> SavedStates, SavedStateNames
geometry = GeometryPipeline(
    GroupByLayer=False,
    GroupByType=False,
    IncludeHidden=True,
    IncludeLocked=True,
    LayerFilter="Geometry",
    NameFilter="*",
    TypeFilter=1073741880)
panel = Panel("""4*
1*""")

panel_2 = Panel("BASE PLANE")
pln = Plane(PlaneXY(0.08767023439, 0.0884122404, 0))

merge_4 = Merge(Data1=graft(series), Data2=graft(series), Data3=graft(series))  # -> flatten(Result)
restore = RestoreElementStates(Restore=values_4.Values, SavedStates=savestates.SavedStates, StateNameToRestore=values_2.Values)
num = Number(50)
panel_3 = Panel("""3.4*
2*
6*""")
setlist = SetListContents(ListToModify=pulldown, NewListContents=savestates.SavedStateNames)
geoattrib = GetGeometryAttributes(Geometry=geometry)  # -> GeometryNames, GUID, Layer
range = Range(Domain=num, Steps=number_slider_4)
num_2 = Number(0)
simplegrid = CreateSimpleGrid(UIElements=entwine, RowDefinitions="Auto", ColumnDefinitions=panel)
filter = StreamFilter(Gate=values_3.Values)
simplegrid_2 = CreateSimpleGrid(UIElements=merge_3, GridMembership=merge_4, RowDefinitions="Auto", ColumnDefinitions=panel_3)  # -> simplify(graft(SimpleGrid))
geometry_meshes = RemoteSender(geometry)
geometry_bins = RemoteSender(geoattrib.GeometryNames)
geom_guid = RemoteSender(geoattrib.GUID)
css_stretchhorizontal_2 = RemoteSender(simplegrid)
settextbox = SetTextBoxContents(TextBoxToModify=textbox, NewTextBoxContents=filter)
cull_i = CullIndex(List=range, Indices=num_2, Wrap=True)
css_stretchhorizontal_3 = RemoteSender(simplegrid_2)
button_3 = CreateButton(ButtonName="update", ButtonStyle=0)
css_margintop = RemoteSender(simplegrid_2)
geometry_meshes_2 = RemoteReceiver(geometry_meshes)
geometry_bins_2 = RemoteReceiver(geometry_bins)
css_stretchhorizontal_4 = RemoteSender(button_3)
panel_4 = Panel(cull_i)
geo = Geometry(geometry_meshes_2)

# ---- group: create dodecahedron points
relpath = RelativePath(Path="dodecahedron.csv")
file = ReadFile(File=relpath, PerLineParse=True)
csv = ReadCSV(CSVString=file, Delimiter=",")  # -> Headers, Values
flip = FlipMatrix(Data=csv.Values)
item = ListItem(List=flip, Index="0", Wrap=True)
item_2 = ListItem(List=flip, Index="1", Wrap=True)
item_3 = ListItem(List=flip, Index="2", Wrap=True)
pt = ConstructPoint(XCoordinate=item, YCoordinate=item_2, ZCoordinate=item_3)

# ----
values_5 = ValueListener(Elements=button_3, SomeProperty=True)  # -> Values, Indices

python = PythonScript()  # -> out, random_int
# ---------- python: Python ----------
import Rhino.Geometry as rg
import rhinoscriptsyntax as rs
import math

from random import randint
random_int = (randint(0, 100))
# ---------- end python ----------
python_2 = PythonScript()  # -> out, random_int; same code as python
python_3 = PythonScript()  # -> out, random_int; same code as python
python_4 = PythonScript()  # -> out, random_int; same code as python
python_5 = PythonScript()  # -> out, random_int; same code as python
python_6 = PythonScript()  # -> out, random_int; same code as python
python_7 = PythonScript()  # -> out, random_int; same code as python
python_8 = PythonScript()  # -> out, random_int; same code as python
# Generate Test Geo
panel_5 = Panel("RANDOMIZE SHIT")
jitter = Jitter(List=panel_4, Jitter=1, Seed=python.random_int)  # -> Values, Indices
jitter_2 = Jitter(List=panel_4, Jitter=1, Seed=python_3.random_int)  # -> Values, Indices
jitter_3 = Jitter(List=panel_4, Jitter=1, Seed=python_4.random_int)  # -> Values, Indices
jitter_4 = Jitter(List=panel_4, Jitter=1, Seed=python_5.random_int)  # -> Values, Indices
jitter_5 = Jitter(List=panel_4, Jitter=1, Seed=python_2.random_int)  # -> Values, Indices
jitter_6 = Jitter(List=panel_4, Jitter=1, Seed=python_6.random_int)  # -> Values, Indices
jitter_7 = Jitter(List=panel_4, Jitter=1, Seed=python_7.random_int)  # -> Values, Indices
jitter_8 = Jitter(List=panel_4, Jitter=1, Seed=python_8.random_int)  # -> Values, Indices

hui_values_update = RemoteSender(values_5.Values)
hui_values_update_2 = RemoteReceiver(hui_values_update)
values_6 = ValueListener(Elements=checkbox_2, Trigger=hui_values_update_2, SomeProperty=False)  # -> Values, Indices
css_stretchhorizontal_5 = RemoteReceiver([css_stretchhorizontal_4, css_stretchhorizontal_3, css_stretchhorizontal, css_stretchhorizontal_2])
number_slider_5 = Slider(0, range=0..10)
number_slider_6 = Slider(0, range=0..10)

panel_6 = Panel("PRIMITIVE CREATION")
box = CenterBox(Base=pln, X=jitter_2.Values, Y=jitter_3.Values, Z=jitter_4.Values)
cone = Cone(Base=pln, Radius=jitter_7.Values, Length=jitter_8.Values)  # -> Cone, Tip
sph = Sphere(Base=pln, Radius=jitter_6.Values)
cyl = Cylinder(Base=pln, Radius=jitter.Values, Length=jitter_5.Values)

adjustpos = AdjustElementPositioning(ElementsToAdjust=css_stretchhorizontal_5, AbsolutePositioning=False, HorizontalAlignment=3)
demesh = DeconstructMesh(Mesh=geo)  # -> Vertices, Faces, Colours, Normals
volume = Volume(Geometry=geo)  # -> Volume, Centroid
capex = CapHolesEx(Brep=sph)  # -> Brep, Caps, Solid
capex_2 = CapHolesEx(Brep=box)  # -> Brep, Caps, Solid
capex_3 = CapHolesEx(Brep=cyl)  # -> Brep, Caps, Solid
capex_4 = CapHolesEx(Brep=cone.Cone)  # -> Brep, Caps, Solid
geo_2 = Geometry(demesh.Vertices)
css_margintop_2 = RemoteReceiver(css_margintop)
move = Move(Geometry=pt, Motion=volume.Centroid)  # -> Geometry, Transform

# ---- group: Create Margin String
set_margin = SetMargin(int=Slider(0, range=0..10), int_3=number_slider_5, int_4=number_slider_5, int_2=Slider(-13, range=-20..10))

# ----
panel_7 = Panel(capex.Brep)
cullpt = CullDuplicates(Points=move.Geometry, Tolerance=0.1, CullMode=3)  # -> Points, Indices, Valence
bbox = BoundingBox(Content=geo, Plane=PlaneXY(0, 0, 0))  # -> Box, Box_2
panel_8 = Panel(capex_4.Brep)
panel_9 = Panel(capex_3.Brep)
dist = Distance(PointA=volume.Centroid, PointB=geo_2)
panel_10 = Panel(capex_2.Brep)
adjustpos_2 = AdjustElementPositioning(ElementsToAdjust=css_margintop_2, Margin=set_margin, AbsolutePositioning=False)
flip_2 = FlipMatrix(Data=cullpt.Points)
debrep = DeconstructBrep(Brep=bbox.Box)  # -> Faces, Edges, Vertices

# ---- group: cpt
geo_3 = Geometry(volume.Centroid)

# ----
merge_5 = Merge(Data2=flatten(simplegrid), Data3=flatten(simplegrid_2), Data4=flatten(button_3))
merge_6 = Merge()
panel_11 = Panel("""Features
Visualization""")
python_9 = PythonScript(sphere_tree_in=flip_2, cpt_lst_in=geo_3, bound_srf_lst_in=debrep.Faces)  # -> ray_tree, header_lst; inputs sphere_tree_in: tree, cpt_lst_in: list, bound_srf_lst_in: tree
# ---------- python_9: Python ----------
import rhinoscriptsyntax as rs
import Rhino as rc
import scriptcontext as sc
#import ghpythonlib as gh
import Grasshopper as gh

""" Calculate View Factor

"""
class ViewFactor(object):
    def __init__(self):
        self.sphere_nested = []
        self.cpt = []
        self.bound_nested = []
        self.bld_num = None
        self.ray_num = None
        # Outputs
        self.raycast_distance = None
        self.raycast_pt_x = None
        self.raycast_pt_y = None
        self.raycast_pt_z = None

    def process_raw_inputs(self,sphere_tree_in,bound_srf_lst_in,cpt_lst_in):
        self.cpt = map(lambda c: rs.coerce3dpoint(c), cpt_lst_in)
        # convert tree to nested list of sphere pts
        for i in range(sphere_tree_in.BranchCount):
            branchList = sphere_tree_in.Branch(i)
            self.sphere_nested.append(branchList)

        # convert tree to nested list of bound srfs
        for i in range(bound_srf_lst_in.BranchCount):
            branchList = bound_srf_lst_in.Branch(i)
            branchList = map(lambda s: rs.coercebrep(s), branchList)
            self.bound_nested.append(branchList)

        # convert guids to rc points
        for i in xrange(len(self.sphere_nested)):
            sphere_per_bld = list(self.sphere_nested[i])
            for j in xrange(len(sphere_per_bld)):
                sphere_per_bld[j] = rs.coerce3dpoint(sphere_per_bld[j])
            self.sphere_nested[i] = sphere_per_bld

        self.bld_num = len(self.sphere_nested)
        self.ray_num = len(self.sphere_nested[0])

    def ray_cast(self):
        """
        base_vector
        direction_vector
        srf2int
        """
        self.ray_int_nested = []
        self.ray_dist_nested = []

        for i in xrange(self.bld_num):
            raypts = []
            raydist = []
            for j in xrange(self.ray_num):
                srf2int_lst = self.bound_nested[i]
                r0 = self.cpt[i] #base_vector
                r1 = self.sphere_nested[i][j] #direction_vector
                #convert pts to vectors
                r1 = rc.Geometry.Vector3d(r1) - rc.Geometry.Vector3d(r0)

                ray = rc.Geometry.Ray3d(r0,r1)
                point_intersect_lst = rc.Geometry.Intersect.Intersection.RayShoot(ray,srf2int_lst,1)
                if point_intersect_lst:
                    point_intersect_lst = list(point_intersect_lst)
                    rpt = point_intersect_lst[0]
                    raypts.append(rpt)
                    raydist.append(rs.Distance(rpt,r0))
                    #rc.Geometry.Vector3d.Multiply(
            self.ray_dist_nested.append(raydist)
            self.ray_int_nested.append(raypts)
        #print len(self.ray_int_nested)
    def generate_viewfactor_matrix(self):
        # flip the matrix
        self.raycast_distance = map(lambda r: [None] * self.ray_num, [None] * self.bld_num)

        self.raycast_x = map(lambda r: [None] * self.ray_num, [None] * self.bld_num)
        self.raycast_y = map(lambda r: [None] * self.ray_num, [None] * self.bld_num)
        self.raycast_z = map(lambda r: [None] * self.ray_num, [None] * self.bld_num)
        self.ray_mtx = []

        self.header_lst = []
        for ri in xrange(self.ray_num):
            hstr = "RAY_{b}_".format(b=ri)
            self.header_lst.extend([hstr+"dist",hstr+"x",hstr+"y",hstr+"z"])
        print len(self.header_lst)
        print self.header_lst
        for i in xrange(self.bld_num):
            self.bld_lst = []
            for j in xrange(self.ray_num):
                d = self.ray_dist_nested[i][j]
                x = self.ray_int_nested[i][j][0]
                y = self.ray_int_nested[i][j][1]
                z = self.ray_int_nested[i][j][2]

                self.bld_lst.extend([d,x,y,z])

                #self.ray_dist_nested[i][j]
                #self.raycast_distance[i][j]
            self.ray_mtx.append(self.bld_lst)
    def pythonListTGhDataTree(self,pythonList):
        """ Converts a  nested Python list to a GH datatree """
        # Create GH datatree
        dataTree = gh.DataTree[object]()

        # Add pythonlist sub lists to dataTree
        for i,l in enumerate(pythonList):
            for v in l:
                dataTree.Add(v,gh.Kernel.Data.GH_Path(i))

        return dataTree
vf = ViewFactor()
vf.process_raw_inputs(sphere_tree_in, bound_srf_lst_in, cpt_lst_in)
vf.ray_cast()
vf.generate_viewfactor_matrix()

header_lst = vf.header_lst
ray_tree = vf.pythonListTGhDataTree(vf.ray_mtx)
#header_tree
print len(vf.ray_mtx)
print len(vf.bld_lst)

#sphere_out = vf.sphere_nested
#cpt_out = vf.cpt




ray_out = reduce(lambda x,y: x+y, vf.ray_int_nested)
# ---------- end python_9 ----------

# ---- group: find farthest vertex
sort = SortList(Keys=dist)  # -> Keys, ValuesA
rev = ReverseList(List=sort.Keys)
item_4 = ListItem(List=rev, Index=0, Wrap=True)

# ---- group: vertexDistanceMean
avr = Average(Input=dist)

# ----
tabs = TabbedView(TabNames=panel_11, Tab0=flatten(merge_5), Tab1=flatten(merge_6))
entwine_2 = Entwine(Branch00=capex_4.Brep, Branch01=capex_3.Brep, Branch02=capex_2.Brep, FlattenInputs=True)  # -> flatten(Result)
field_titles = Panel("""10
11
11
11
11""")
path_mapper = PathMapper(python_9.ray_tree, source="{A}", target="{0;A}")
data = Data(capex_2.Brep)
merge_7 = Merge(Data2=tabs)

mindex = MemberIndex(Set=dist, Member=item_4)  # -> Index, Count
item_5 = ListItem(List=mindex.Index, Index=0, Wrap=True)
item_6 = ListItem(List=geo_2, Index=item_5, Wrap=True)
pdecon = Deconstruct(Point=item_6)  # -> simplify(XComponent), simplify(YComponent), simplify(ZComponent)

data_2 = Data(capex_3.Brep)
data_3 = Data(capex_4.Brep)
lng = ListLength(List=data)
lng_2 = ListLength(List=data_2)
lng_3 = ListLength(List=data_3)
dup_4 = DuplicateData(Data="Box", Number=lng, Order=True)  # -> flatten(Data)
dup_5 = DuplicateData(Data="Cylinder", Number=lng_2, Order=True)  # -> flatten(Data)
dup_6 = DuplicateData(Data="Cone", Number=lng_3, Order=True)  # -> flatten(Data)
number_slider_7 = Slider(0.5, range=0..1)
merge_8 = Merge(Data1=dup_6, Data2=dup_5, Data3=dup_4)
path_mapper_2 = PathMapper(pdecon.XComponent, source="{A}", target="{0;A}")
path_mapper_3 = PathMapper(pdecon.YComponent, source="{a}", target="{0;a}")
path_mapper_4 = PathMapper(pdecon.ZComponent, source="{a}", target="{0;a}")
jitter_9 = Jitter(List=merge_8, Jitter=number_slider_7, Seed=2)  # -> Values, Indices
jitter_10 = Jitter(List=entwine_2, Jitter=number_slider_7, Seed=2)  # -> Values, Indices
merge_9 = Merge(
    Data1="vertexDistanceMean",
    Data2="vertexFarthestDistance",
    Data3="vertexFarthestX",
    Data4="vertexFarthestY",
    Data5="vertexFarthestZ")
path_mapper_5 = PathMapper(merge_9, source="{A}", target="{0;A}")
merge_10 = Merge(Data1=avr, Data2=item_4, Data3=path_mapper_2, Data4=path_mapper_3, Data5=path_mapper_4)
data_4 = Data(simplify(graft(jitter_9.Values)))
graft = GraftTree(Tree=jitter_10.Values, IncludeEmptyLists=True, IncludeNullItems=True)
merge_11 = Merge(Data1=merge_10, Data2=path_mapper)  # -> simplify(Result)
merge_12 = Merge(Data1=path_mapper_5, Data2=python_9.header_lst)  # -> simplify(Result)
long = LongestList(ListA=Slider(111, range=70..130), ListB=graft, PaddingMode=2)  # -> ListA, ListB
lng_4 = ListLength(List=python_9.header_lst)  # -> flatten(Length)
series_2 = Series(Start=0, Step=1, Count=10)
shift = ShiftPaths(Data=merge_12, Offset=-1)
ma = MassAddition(Input=flatten(long.ListA))  # -> Result, PartialResults
dup_7 = DuplicateData(Data="Viewfactor", Number=lng_4, Order=True)
dup_8 = DuplicateData(Data="13", Number=lng_4, Order=True)
volume_2 = Volume(Geometry=long.ListB)  # -> Volume, Centroid
features_names_viewfactor = RemoteSender(shift)
features_values_viewfactor = RemoteSender(merge_11)
pt_2 = ConstructPoint(XCoordinate=0, YCoordinate=ma.PartialResults, ZCoordinate=0)  # -> graft(Point)
field_titles_2 = Panel("""VertexMeanDist
VertextFart
VertextFart
VertextFart
VertextFart""")
int = Integer(dup_8)
merge_13 = Merge(Data1=flatten(field_titles), Data2=flatten(int))
features_groups_viewfactor = RemoteSender(merge_13)
orient = Orient(Geometry=long.ListB, Source=volume_2.Centroid, Target=pt_2)  # -> Geometry, Transform
geometry_shapenames = RemoteSender("Building")
geometry_primitives = RemoteSender(orient.Geometry)
merge_14 = Merge(Data1=flatten(field_titles_2), Data2=flatten(dup_7))
features_groupnames_viewfactor = RemoteSender(merge_14)
geometry_meshes_3 = RemoteReceiver(graft(geometry_meshes))
geo_4 = Geometry(simplify(geometry_meshes_3))
geometry_meshes_4 = RemoteReceiver(graft(geometry_meshes))
geometry_primitives_2 = RemoteReceiver(geometry_primitives)
geo_5 = Geometry(geo_4)
data_5 = Data("5")
G = Geometry(geo_4)

# ---- group: input geometry
geo_6 = Geometry(geometry_meshes_4)

# ----
geo_7 = Geometry(geo_4)
# MARK'S FEATURES
# Bounding box volume
geo_8 = Geometry(geo_4)
# NATE'S FEATURES
volume_3 = Volume(Geometry=geo_6)  # -> simplify(Volume), Centroid

geo_9 = Geometry(geo_5)
data_6 = Data(data_5)
contour = Contour(Shape=geo_9, Point=Point(0, 0, 0), Direction=Vector(0, 0, 1), Distance=data_6)  # -> simplify(Contours)
crv = Curve(contour)

area = Area(Geometry=geo_7)  # -> Area, Centroid

# ----
# Orientation
panel_12 = Panel("0 to 90")
data_7 = Data(Slider(45, range=0..100))
range_2 = Range(Domain=panel_12, Steps=data_7)
cull_i_2 = CullIndex(List=range_2, Indices=data_7, Wrap=True)
data_8 = Data(cull_i_2)
rad = Radians(Degrees=data_8)
data_9 = Data(rad)

crv_2 = Curve(crv)
lng_5 = ListLength(List=crv_2)
data_10 = Data(lng_5)

pt_3 = Point(area.Centroid)
bbox_2 = BoundingBox(Content=volume_3.Centroid, Plane=PlaneXY(0, 0, 0))  # -> Box, Box_2
pt_4 = Point(pt_3)
pt_5 = Point(pt_4)
pt_6 = Point(pt_4)
pdecon_2 = Deconstruct(Point=pt_6)  # -> XComponent, YComponent, ZComponent
bbox_3 = BoundingBox(Content=geo_6, Plane=PlaneXY(0, 0, 0))  # -> Box, Box_2
box_2 = EvaluateBox(Box=bbox_2.Box, UParameter=0.5, VParameter=0.5, WParameter=0.5)  # -> Plane, Point, Include
area_2 = Area(Geometry=geo_6)  # -> simplify(Area), Centroid

crv_3 = Curve(simplify(crv))
cluster = Cluster_4(C=crv_3)
trim = TrimTree(Tree=cluster, Depth=1)
G_2 = Geometry(trim)

debox = DeconstructBox(Box=bbox_3.Box)  # -> Plane, simplify(X), simplify(Y), simplify(Z)
relative = RelativeCoordinates(Plane=box_2.Plane, Point=box_2.Point)  # -> RelativePoint, RelativeX, RelativeY, RelativeZ

geo_10 = Geometry(geo_8)
volume_4 = Volume(Geometry=geo_10)  # -> Volume, Centroid
pt_7 = Point(volume_4.Centroid)
xy = XYPlane(Origin=pt_7)
prot = RotatePlane(Plane=xy, Angle=data_9)

dlength = DLength(I=debox.Y)
dlength_2 = DLength(I=debox.Z)
pdecon_3 = Deconstruct(Point=relative.RelativePoint)  # -> simplify(XComponent), simplify(YComponent), simplify(ZComponent)
dlength_3 = DLength(I=debox.X)
panel_13 = Panel(dlength_3)
panel_14 = Panel(dlength)
panel_15 = Panel(dlength_2)
panel_16 = Panel(volume_3.Volume)
panel_17 = Panel(area_2.Area)
panel_18 = Panel(pdecon_3.XComponent)
panel_19 = Panel(pdecon_3.YComponent)
panel_20 = Panel(pdecon_3.ZComponent)

G_3 = Geometry(G_2)
area_3 = Area(Geometry=G_3)  # -> Area, Centroid
data_11 = Data(area_3.Area)

data_12 = Data(data_11)

L = List(data_12)
lng_6 = ListLength(List=L)
multiplication = Multiplication(A=lng_6, B=Slider(0.95, range=0..1))
B = DomainEnd(multiplication)
dom = ConstructDomain(DomainStart=0, DomainEnd=B)
subset = SubList(List=L, Domain=dom, Wrap=True)  # -> List, Index
data_13 = Data(simplify(subset.List))

pt_8 = Point(pt_5)

K = Keys(data_13)
sort_2 = SortList(Keys=K)  # -> Keys, ValuesA
item_7 = ListItem(List=sort_2.Keys, Index=0, Wrap=True)  # -> Item1, Item
item_8 = ListItem(List=sort_2.Keys, Index=0, Wrap=True)
data_14 = Data(item_8)
data_15 = Data(item_7.Item1)
division = Division(A=data_14, B=data_15)
data_16 = Data(division)

data_17 = Data(data_16)
data_18 = Data(Slider(0.2, range=0..1))
multiplication_2 = Multiplication(A=data_17, B=data_18)
data_19 = Data(multiplication_2)

data_20 = Data(simplify(data_13))
data_21 = Data(data_19)
pt_9 = ConstructPoint(XCoordinate=data_20, YCoordinate=0, ZCoordinate=0)
cullduppoints = RemoveDuplicatePoints(InputPoints=pt_9, Tolerance=data_21)  # -> OutputPoints, FirstPointIndexes
null = NullItem(Item=cullduppoints.OutputPoints)  # -> NullFlags, InvalidFlags, Description
dispatch = Dispatch(List=cullduppoints.OutputPoints, DispatchPattern=null.InvalidFlags)  # -> ListA, ListB
data_22 = Data(simplify(dispatch.ListB))

data_23 = Data(data_11)
data_24 = Data(data_5)
multiplication_3 = Multiplication(A=data_23, B=data_24)  # -> simplify(Result)
data_25 = Data(multiplication_3)

data_26 = Data(data_25)
avr_2 = Average(Input=data_26)
data_27 = Data(avr_2)

geo_11 = Geometry(geo_8)
P = Plane(prot)
bbox_4 = BoundingBox(Content=geo_11, Plane=P)  # -> Box, Box_2
trim_2 = TrimTree(Tree=bbox_4.Box, Depth=1)
geo_12 = Geometry(simplify(trim_2))

lng_7 = ListLength(List=data_22)
larger = LargerThan(FirstNumber=lng_7, SecondNumber="3")  # -> LargerThan, OrEqualTo
data_28 = Data(larger.LargerThan)

dispatch_2 = Dispatch(List=geo_5, DispatchPattern=data_28)  # -> ListA, ListB; disabled
mesh = Mesh(dispatch_2.ListA)  # disabled
mesh_2 = Mesh(dispatch_2.ListB)  # disabled
swatch = ColourSwatch(SwatchColor=RGB(255, 69, 69))  # disabled
swatch_2 = ColourSwatch(SwatchColor=RGB(132, 0, 255))  # disabled
preview = CustomPreview(Geometry=mesh, Shader=swatch)  # disabled
preview_2 = CustomPreview(Geometry=mesh_2, Shader=swatch_2)  # disabled

string_name = Panel("Shape")
field_titles_3 = Panel("""Area
centroid x
centroid y 
centroid z
low_slice_length
mid_slice_length
upper_slice_length
slice_ratio""")
data_29 = Data(data_14)

data_30 = Data(data_25)
ma_2 = MassAddition(Input=data_30)  # -> Result, PartialResults
data_31 = Data(ma_2.Result)

geo_13 = Geometry(simplify(geo_12))
volume_5 = Volume(Geometry=geo_13)  # -> Volume, Centroid
sort_3 = SortList(Keys=volume_5.Volume, ValuesA=geo_13, ValuesC=data_8)  # -> Keys, ValuesA, ValuesB, ValuesC, ValuesD
item_9 = ListItem(List=sort_3.ValuesC, Index=0, Wrap=True)
item_10 = ListItem(List=sort_3.ValuesA, Index=0, Wrap=True)
data_32 = Data(item_9)
data_33 = Data(item_10)

G_4 = Geometry(G_2)
item_11 = ListItem(List=G_4, Index=0, Wrap=True)
G_5 = Geometry(item_11)
G_6 = Geometry(G_5)
G_7 = Geometry(G_6)
area_4 = Area(Geometry=G_7)  # -> Area, Centroid
pt_10 = Point(area_4.Centroid)
vec2pt = Vector2Pt(PointA=pt_10, PointB=pt_8, Unitize=False)  # -> Vector, Length
data_34 = Data(vec2pt.Vector)
data_35 = Data(data_34)
cluster_2 = Cluster_3(data=data_35)
data_36 = Data(simplify(cluster_2))
features_names_nate = RemoteSender(field_titles_3)
data_37 = Data(data_32)
data_38 = Data(simplify(data_33))
# Height Aspect Ratio 1
# Height Aspect Ratio 2
data_39 = Data(simplify(data_38))
debox_2 = DeconstructBox(Box=data_39)  # -> Plane, simplify(X), simplify(Y), simplify(Z)
pdecon_4 = Deconstruct(Point=debox_2.Plane)  # -> XComponent, YComponent, ZComponent
dlength_4 = DLength_2(data=pdecon_4.ZComponent, I=debox_2.Z)  # -> data_6, data_5, y
dlength_5 = DLength_2(data=pdecon_4.YComponent, I=debox_2.Y)  # -> data_6, data_5, y
dlength_6 = DLength_2(data=pdecon_4.XComponent, I=debox_2.X)  # -> data_6, data_5, y
data_40 = Data(dlength_4.data_6)
data_41 = Data(data_40)
addition = Addition(A=data_41, B="0.001")
pt_11 = ConstructPoint(XCoordinate=pdecon_2.XComponent, YCoordinate=pdecon_2.YComponent, ZCoordinate=addition)
O = Origin(pt_11)
O_2 = Origin(O)
xy_2 = XYPlane(Origin=O_2)
pln_2 = Plane(xy_2)
data_42 = Data(dlength_4.y)
data_43 = Data(data_42)
data_44 = Data(dlength_5.y)
data_45 = Data(dlength_6.y)

data_46 = Data(simplify(data_38))
volume_6 = Volume(Geometry=data_46)  # -> Volume, Centroid
data_47 = Data(volume_6.Volume)

d1 = Data1(data_45)
d2 = Data2(data_44)
d1_2 = Data1(data_45)
d2_2 = Data2(data_44)
d1_3 = Data1(data_42)
d2_3 = Data2(data_45)
d1_4 = Data1(data_42)
d2_4 = Data2(data_44)
integer_division = IntegerDivision(A=d1_4, B=d2_4)
integer_division_2 = IntegerDivision(A=d1_3, B=d2_3)
integer_division_3 = IntegerDivision(A=d2_2, B=d1_2)
integer_division_4 = IntegerDivision(A=d1, B=d2)
max = Maximum(A=integer_division_4, B=integer_division_3)
data_48 = Data(integer_division_2)
data_49 = Data(integer_division)
data_50 = Data(max)
data_51 = Data(data_47)
data_52 = Data(data_51)
data_53 = Data(data_52)
data_54 = Data(data_37)
field_titles_4 = Panel("""-2
-1
-1
-1
3
3
3
3""")
# Volume
data_55 = Data(data_31)
data_56 = Data(data_55)
data_57 = Data(data_55)

data_58 = Data(data_56)
G_8 = Geometry(G)
area_5 = Area(Geometry=G_8)  # -> Area, Centroid
data_59 = Data(area_5.Area)
data_60 = Data(data_59)
division_2 = Division(A=data_58, B=data_60)
data_61 = Data(division_2)

data_62 = Data(data_57)
division_3 = Division(A=data_62, B=data_53)
data_63 = Data(division_3)
# Average Slice Area
data_64 = Data(data_27)
# Min / Max  Slice Area
data_65 = Data(data_16)
data_66 = Data(data_49)
data_67 = Data(data_48)
# Aspect Ratio XY
data_68 = Data(data_50)
# Number of Terraces
data_69 = Data(lng_7)
# Eccentricity
# X, Y, Z
data_70 = Data(data_36)
# Volume / Bounding Box Volume
data_71 = Data(data_63)
# Surface Area to Volume Ratio
data_72 = Data(data_61)
panel_21 = Panel(data_65)
features_groups_nate = RemoteSender(field_titles_4)
panel_22 = Panel("""Bounding Box Volume
Orientation
Height Aspect Ratio X
Height Aspect Ratio Y
Aspect Ratio XY
Volume
Average Slice Area
Min / Max  Slice Area
Eccentricity X
Eccentricity Y
Eccentricity Z
Volume / Bounding Box Volume
Surface Area to Volume Ratio
Number of Terraces""")
panel_23 = Panel("""2
0
1
1
1
2
3
3
4
4
4
5
6
8""")
merge_15 = Merge(
    Data1=simplify(data_51),
    Data2=simplify(data_54),
    Data3=simplify(data_67),
    Data4=simplify(data_66),
    Data5=simplify(data_68),
    Data6=simplify(data_55),
    Data7=simplify(data_64),
    Data8=simplify(data_65),
    Data9=simplify(data_70),
    Data10=simplify(data_71),
    Data11=simplify(data_72),
    Data12=simplify(data_69))
field_titles_5 = Panel("""Area
Centroid
Centroid
Centroid
Slice Area
Slice Area
Slice Area
Slice Area""")
data_73 = Data(merge_15)
features_names_mark = RemoteSender(panel_22)
features_groups_mark = RemoteSender(panel_23)
features_values_mark = RemoteSender(data_73)
features_groupnames_nate = RemoteSender(field_titles_5)
panel_24 = Panel("""Vol/Box
Orientation
Aspect Ratio
Aspect Ratio
Aspect Ratio
Volume
Slice Area
Slice Area
Eccentricity
Eccentricity
Eccentricity
Vol/Box
Srf to Volume
Terraces""")
features_groupnames_mark = RemoteSender(panel_24)
features_groupnames_viewfactor_2 = RemoteReceiver(features_groupnames_viewfactor)
features_groups_viewfactor_2 = RemoteReceiver(features_groups_viewfactor)
features_groupnames_mark_2 = RemoteReceiver(features_groupnames_mark)
features_groupnames_nate_2 = RemoteReceiver(features_groupnames_nate)
features_groups_mark_2 = RemoteReceiver(features_groups_mark)
features_names_viewfactor_2 = RemoteReceiver(features_names_viewfactor)
features_groups_nate_2 = RemoteReceiver(features_groups_nate)
features_values_viewfactor_2 = RemoteReceiver(features_values_viewfactor)
features_names_mark_2 = RemoteReceiver(features_names_mark)
# MERGE DATA
features_names_nate_2 = RemoteReceiver(features_names_nate)
features_values_mark_2 = RemoteReceiver(features_values_mark)
merge_16 = Merge(Data1=features_names_nate_2, Data2=features_names_mark_2, Data3=features_names_viewfactor_2)
merge_17 = Merge(Data1=features_groups_nate_2, Data2=features_groups_mark_2, Data3=features_groups_viewfactor_2)
merge_18 = Merge(Data1=features_groupnames_nate_2, Data2=features_groupnames_mark_2, Data3=features_groupnames_viewfactor_2)
features_names = RemoteSender(merge_16)
cset = CreateSet(List=merge_18)  # -> Set, Map
tsort = SortText(Keys=cset.Set, Culture=127)  # -> Keys, Values
features_groups = RemoteSender(merge_17)
panel_25 = Panel(merge_16)
geometry_meshes_5 = RemoteReceiver(graft(geometry_meshes))
toggle = BooleanToggle(True)
mindex_2 = MemberIndex(Set=merge_18, Member=graft(tsort.Keys))  # -> Index, Count
features_groupnames = RemoteSender(tsort.Keys)
features_groupnames_2 = RemoteReceiver(features_groupnames)
setcheckbox = SetCheckBox(CheckBoxToModify=flatten(checkbox_2), NewCheckBoxLabel=features_groupnames_2)
lng_8 = ListLength(List=features_groupnames_2)
subtraction = Subtraction(A=lng_8, B=1)
subset_2 = SubList(List=values_6.Values, Domain=subtraction, Wrap=True)  # -> List, Index
dup_9 = DuplicateData(Data="True", Number=lng_8, Order=True)
panel_26 = Panel(subset_2.List)
hui_values_featureactive = RemoteSender(subset_2.List)
merge_19 = Merge(Data1=flatten(dup_9), Data2=flatten("False"))
hideshow = HideShowElement(ElementToHideShow=flatten(simplegrid_2), Show=merge_19, Collapse=True, Disable=False)
hui_values_featureactive_2 = RemoteReceiver(hui_values_featureactive)
geometry_shapenames_2 = RemoteReceiver(geometry_shapenames)
long_2 = LongestList(ListA=graft(hui_values_featureactive_2), ListB=mindex_2.Index, PaddingMode=2)  # -> flatten(ListA), flatten(ListB)
sort_4 = SortList(Keys=long_2.ListB, ValuesA=long_2.ListA)  # -> Keys, ValuesA
panel_27 = Panel(geometry_meshes_5)
values_feedtomodel = RemoteSender(sort_4.ValuesA)
values_feedtomodel_2 = RemoteReceiver(values_feedtomodel)
cull = CullPattern(List=features_names, CullPattern=values_feedtomodel_2)
panel_28 = Panel(mindex_2.Index)
mesh_3 = Mesh(<mesh referenced from the Rhino model>)
geom_guid_2 = RemoteReceiver(geom_guid)
geometry_meshes_6 = RemoteReceiver(geometry_meshes)
panel_29 = Panel(mesh_3)
merge_20 = Merge(
    Data1=ColourSwatch(SwatchColor=RGB(10, 255, 71)),
    Data2=ColourSwatch(SwatchColor=RGB(255, 215, 54)),
    Data3=ColourSwatch(SwatchColor=RGB(213, 61, 255)),
    Data4=ColourSwatch(SwatchColor=RGB(61, 213, 255)),
    Data5=ColourSwatch(SwatchColor=RGB(68, 61, 255)))  # -> graft(Result)
txt = Text(flatten(panel_29))
rep = ReplaceText(Text=txt, Find="Referenced", RecursiveReplace=False)
panel_30 = Panel(rep)
# Visualization Stuffs
features_names_2 = RemoteReceiver(features_names)
geometry_shapenames_3 = RemoteReceiver(geometry_shapenames)
number_slider_8 = Slider(0.64, range=0..1)
panel_31 = Panel("QA CHECK STRING")
eval = Evaluate(F="1-x", x=number_slider_8)
wires = BrepWireframe(Density=-1)
panel_32 = Panel("QA CHECK GUID")

# ----
# ToolDescription: Enter a description of this definition's functionality and use
update_file_info = Button()
group_prefixes = Panel("""out_
in_
action_
warning_
cluster""")
c_script = CSharpScript(update=color_groups_clusters, name=group_prefixes, col=col)  # -> out, A; inputs update: Boolean, name: list of String, col: list of Color
# ---------- c_script: C# ----------
    Color clusterColor = Color.Transparent;
    for(int i = 0;i < name.Count;i++){
      if(name[i].Contains("cluster")){
        clusterColor = col[i];
        break;
      }
    }



    if(update){
      List<Guid> guids = new List<Guid>();
      List<Grasshopper.Kernel.Special.GH_Group> grps = new List<Grasshopper.Kernel.Special.GH_Group>();
      List<Grasshopper.Kernel.Special.GH_Group> alreadygrps = new List<Grasshopper.Kernel.Special.GH_Group>();


      foreach(IGH_DocumentObject o in GrasshopperDocument.Objects){
        Grasshopper.Kernel.Special.GH_Group g = o as Grasshopper.Kernel.Special.GH_Group;
        if(g != null){
          for(int j = 0;j < name.Count;j++){
            if(g.NickName.ToUpper().Contains(name[j].ToUpper())){
              g.Colour = col[j % col.Count];
            }

          }
        }


        if(o is Grasshopper.Kernel.Special.GH_Cluster){
          Grasshopper.Kernel.Special.GH_Cluster cluster = o as  Grasshopper.Kernel.Special.GH_Cluster;
          string filepath = cluster.FilePath;
          if(!String.IsNullOrEmpty(filepath)){
            cluster.Name = System.IO.Path.GetFileNameWithoutExtension(filepath);
            cluster.NickName = System.IO.Path.GetFileNameWithoutExtension(filepath);
            cluster.Attributes.ExpireLayout();
          }
          guids.Add(cluster.InstanceGuid);
          Grasshopper.Kernel.Special.GH_Group grp = new Grasshopper.Kernel.Special.GH_Group();
          grps.Add(grp);

        } else if (o is Grasshopper.Kernel.Special.GH_Group){
          Grasshopper.Kernel.Special.GH_Group alreadygrp = o as Grasshopper.Kernel.Special.GH_Group;
          alreadygrps.Add(alreadygrp);
        }





      }

      List<bool> isAlreadyInGroup = IsAlreadyInGroup(guids, alreadygrps);

      for(int i = 0;i < grps.Count;i++){
        Grasshopper.Kernel.Special.GH_Group grp = grps[i];
        grp.Colour = clusterColor;
        grp.NickName = "";
        grp.AddObject(guids[i]);
        if(!isAlreadyInGroup[i]){
          grp.ExpireCaches();
          GrasshopperDocument.AddObject(grp, false, 1000);
        }
      }



    }
# ---------- c_script: C# additional code ----------
  List<bool> IsAlreadyInGroup(List<Guid> guids, List<Grasshopper.Kernel.Special.GH_Group> grps){
    List<bool> results = new List<bool>();
    foreach(Guid g in guids){
      results.Add(false);
    }
    foreach(Grasshopper.Kernel.Special.GH_Group grp in grps){ //for every group in the pre-existing groups
      if(grp.Objects().Count == 1){ //if that group only has one object in it
        for (int j = 0;j < guids.Count;j++){
          Guid g = guids[j];
          if(grp.ObjectIDs.Contains(g)){
            results[j] = true;
            break;
          }
        }
      }
    }
    return results;
  }
# ---------- end c_script ----------

data_74 = Data(update_file_info)

c_script_2 = CSharpScript(x=data_74)  # -> out, A, B, C, D, E
# ---------- c_script_2: C# ----------
    List < IGH_DocumentObject> objectsRecursive = new List<IGH_DocumentObject>();
    objectsRecursive.AddRange(clusterObjectsRecursive(GrasshopperDocument));


    B = GrasshopperDocument.Author.Name + " " + GrasshopperDocument.Author.Email;
    D = GrasshopperDocument.Properties.DateTag;
    if(GrasshopperDocument.IsFilePathDefined){
      C = GrasshopperDocument.FilePath;
      System.IO.FileInfo info = new System.IO.FileInfo(GrasshopperDocument.FilePath);
      if(info.LastWriteTime != null){
        E = info.LastWriteTime;
      } else {
        E = "";
      }
    } else {
      C = "Unsaved Document";
      E = "";
    }
    A = objectsRecursive;
# ---------- c_script_2: C# additional code ----------
  List<IGH_DocumentObject> clusterObjectsRecursive(GH_Document doc){
    List<IGH_DocumentObject> objList = new List<IGH_DocumentObject>();
    objList.AddRange(doc.Objects);
    foreach(IGH_DocumentObject obj in doc.Objects){
      Grasshopper.Kernel.Special.GH_Cluster cluster = obj as Grasshopper.Kernel.Special.GH_Cluster;
      try{
        objList.AddRange(clusterObjectsRecursive(cluster.Document("")));
      } catch {

      }
    }
    return objList;
  }
# ---------- end c_script_2 ----------
cluster_3 = Cluster_2(T=c_script_2.A, N=c_script_2.B, fn=c_script_2.C, dc=c_script_2.D, dm=c_script_2.E)
file_info = Panel(cluster_3)

cluster_4 = Cluster_5(G_2=snap, G=taskbar_hidden, d1=width_start, d2=width_end, d1_2=height_start, d2_2=height_end)  # -> s_1, R, R_2

# ---- group: Width (plug in to Launch Window)
data_75 = Data(cluster_4.R)

# ---- group: Height (plug in to Launch Window)
data_76 = Data(cluster_4.R_2)

# ---- group: Window Position (plug in to Window Appearance)
# DOMAIN WINDOW
pt_12 = Point(cluster_4.s_1)

# ----
launchwin = LaunchWindow(Show=Toggle(True), Name=window_name, Width=data_75, Height=data_76, ChildStatus=1, EnableHorizScroll=False)
winprops = SetWindowProperties(Window=launchwin, StartingLocation=pt_12, ShowTitleBar=True, ScaleFactor=1)
data_77 = Data(launchwin)

hui_windows = RemoteSender(data_77)
addelems = AddElements(Window=launchwin, Elements=flatten(merge_7), DoVLChecking=True)  # -> AddedElements, ElementNames

# ---- group: length of slice at low mid and high
panel_33 = Panel("""0.1
0.5
0.9""")
box_3 = EvaluateBox(Box=bbox_3.Box, UParameter="0", VParameter="0", WParameter=panel_33)  # -> Plane, Point, Include

# ----
sec = MeshPlane(Mesh=geo_6, Plane=box_3.Plane)

# ---- group: length of slice at low mid and high (continued)
trim_3 = TrimTree(Tree=sec, Depth=1)
len = Length(Curve=trim_3)
item_12 = ListItem(List=simplify(len), Index=0, Wrap=True)  # -> Item, Item1, Item2

# ----
eval_2 = Evaluate(F="z/y + z/x + y/z + y/x + x/z + x/y", x=item_12.Item, y=item_12.Item1, z=item_12.Item2)
merge_21 = Merge(
    Data2=panel_17,
    Data4=panel_18,
    Data5=panel_19,
    Data6=panel_20,
    Data10=item_12.Item,
    Data11=item_12.Item1,
    Data12=item_12.Item2,
    Data13=eval_2)
features_values_nate = RemoteSender(merge_21)
features_values_nate_2 = RemoteReceiver(features_values_nate)
merge_22 = Merge(Data1=features_values_nate_2, Data2=features_values_mark_2, Data3=features_values_viewfactor_2)
cull_2 = CullPattern(List=merge_22, CullPattern=values_feedtomodel_2)
features_values = RemoteSender(cull_2)
# ADD METADATA
bakeud = BakeWithUserData(geometry=geometry_meshes_5, field_names=cull, field_values=features_values, clear=True)
bakeud_2 = BakeWithUserData(geometry=bakeud, field_names="Shape", field_values=geometry_shapenames_2, clear=False)
geometry_withdata = RemoteSender(bakeud_2)

# ----
# ML Stuffs
features_values_2 = RemoteReceiver(features_values)
flip_3 = FlipMatrix(Data=features_values_2)
bnd = Bounds(Numbers=flip_3)  # -> flatten(Domain)
remap = RemapNumbers(Value=features_values_2, Source=bnd, Target=Domain(0, 1))  # -> Mapped, Clipped
datatree_to_tensorset = DataTreeToTensorSet(DataTree=features_values_2)  # "DT->TS"
kmeans = KMeansClustering(Data=datatree_to_tensorset, Clusters=Slider(4, range=0..20), Iterations=Slider(509, range=0..7300), Seed=66)  # -> Clusters, Indices
mll_stuff = RemoteSender(kmeans.Indices)

percent_diff = RemoteSender(kmeans.Clusters)
geometry_withdata_2 = RemoteReceiver(geometry_withdata)
percent_diff_2 = RemoteReceiver(percent_diff)
mll_stuff_2 = RemoteReceiver(mll_stuff)
geometry_withdata_3 = RemoteReceiver(geometry_withdata)
# Visualization Stuffs
mll_stuff_3 = RemoteReceiver(mll_stuff)
# Percent Diff - Peter
average = AverageTSet(TensorSet=percent_diff_2)
item_13 = ListItem(List=flatten(geometry_withdata_2), Index=mll_stuff_2, Wrap=True)
item_14 = ListItem(List=flatten(geometry_withdata_3), Index=mll_stuff_3, Wrap=True)
detset = DeconstructTensorSet(TensorSet=average)
item_15 = ListItem(List=flatten(percent_diff_2), Index=mll_stuff_2, Wrap=True)
lng_9 = ListLength(List=item_14)
detensor = DeconstructTensor(Tensor=detset)
lng_10 = ListLength(List=flatten(lng_9))
panel_34 = Panel(item_15)
panel_35 = Panel(average)
panel_36 = Panel(detensor)
range_3 = Range(Domain=Domain(0, 1), Steps=expr("x-1", lng_10))
gradient = Gradient(
    LowerLimit=0,
    UpperLimit=1,
    Parameter=range_3,
    stops=[0: RGB(243, 57, 0), 0.1: RGB(236, 27, 60), 0.2: RGB(210, 0, 118), 0.3: RGB(103, 0, 120), 0.4: RGB(39, 72, 161), 0.5: RGB(1, 192, 229), 0.6: RGB(18, 178, 90), 0.7: RGB(79, 186, 8), 0.8: RGB(220, 237, 32), 0.9: RGB(247, 159, 20), 1: RGB(243, 57, 0)])
equals = Equality(FirstNumber=item_13, SecondNumber=mesh_3)  # -> Equality, Inequality
readud = ReadUserData(geometry=item_14)  # -> field_names_2, field_values_2
keysearch = KeyValueSearch(Keys=readud.field_names_2, Values=readud.field_values_2, Search="Shape")
ma_3 = MassAddition(Input=equals.Equality)  # -> Result, PartialResults
panel_37 = Panel(readud.field_names_2)
panel_38 = Panel(item_13)
txt_2 = Text(flatten(panel_38))
tmatch = MatchText(Text=txt_2, Pattern=panel_30, Case=Toggle(False))
data_78 = Data(graft(gradient))
mll_stuff_4 = RemoteReceiver(mll_stuff)
panel_39 = Panel(tmatch)
pshift = ShiftPaths(Data=keysearch, Offset=-1)
panel_40 = Panel(txt_2)
long_3 = LongestList(ListA=data_78, ListB=ColourSwatch(SwatchColor=RGB(255, 255, 255)), PaddingMode=2)  # -> ListA, ListB
item_16 = ListItem(List=panel_34, Index=0, Wrap=True)
merge_23 = Merge(Data1=long_3.ListA, Data2=long_3.ListB)
cset_2 = CreateSet(List=pshift)  # -> Set, Map
item_17 = ListItem(List=flatten(geometry_shapenames_3), Index=mll_stuff_3, Wrap=True)
panel_41 = Panel(item_16)
mindex_3 = MemberIndex(Set=pshift, Member=cset_2.Set)  # -> Index, Count
sort_5 = SortList(Keys=panel_39)  # -> Keys, ValuesA
mindex_4 = MemberIndex(Set=panel_39, Member="True")  # -> Index, Count
sort_6 = SortList(Keys=mindex_3.Count, ValuesA=cset_2.Set)  # -> Keys, reverse(ValuesA)
panel_42 = Panel(sort_5.Keys)
panel_43 = Panel(mindex_4.Index)
item_18 = ListItem(List=sort_6.ValuesA, Index=0, Wrap=True)
panel_44 = Panel(item_17)
tmatch_2 = MatchText(Text=pshift, Pattern=item_18, Case=True)  # -> graft(Match)
wav = WeightedAverage(Input=merge_23, Weights=[number_slider_8, eval])
panel_45 = Panel(ma_3.Result)
cull_3 = CullPattern(List=wires, CullPattern=invert(tmatch_2))
material = CreateMaterial(Diffuse=wav, Specular=wav, Emission=ColourSwatch(SwatchColor=RGB(48, 48, 48)), Transparency=0, Shine=0)
previewlw = CustomPreviewLineweights(Geometry=cull_3, Shader=ColourSwatch(SwatchColor=RGB(255, 0, 0)), Thickness=Slider(8, range=0..10), Absolute=False)
long_4 = LongestList(ListA=item_14, ListB=material, PaddingMode=2)  # -> ListA, ListB
panel_46 = Panel(material)
preview_3 = CustomPreview(Geometry=long_4.ListA, Shader=long_4.ListB)

# ==== cluster Cluster_2
T = ClusterInput()
N = ClusterInput()
fn = ClusterInput()
dc = ClusterInput()
dm = ClusterInput()
cluster = Cluster(T=T, N=N, fn=fn, dc=dc, dm=dm)  # -> T_2, author_2, objcount_2, fn_3, dc_4, dm_4
merge = Merge(
    Data1=cluster.author_2,
    Data2=cluster.T_2,
    Data3=cluster.objcount_2,
    Data4=cluster.fn_3,
    Data5=cluster.dc_4,
    Data6=cluster.dm_4)
R = ClusterOutput(merge)

# ==== cluster DLength: computes length of a domain
I = ClusterInput()
dedomain = DeconstructDomain(Domain=I)  # -> Start, End
subtraction = Subtraction(A=dedomain.Start, B=dedomain.End)
abs = Absolute(Value=subtraction)
y = ClusterOutput(abs)

# ==== cluster BakeWithUserData: Bake geometry with associated user data. You can embed Rhino geometry with an arbitrary amount of additional data which can be retrieved at a later time. Options to clear the dictionary with each refresh.
clear = ClusterInput()  # Clear user dictionaries on each refresh (prevents build-up of unwanted KV pairs over multiple iterations). Defaults to true.
field_names = ClusterInput()  # The field names - or keys - associated with the data you're embedding. You can use this to later retrieve data from your geometry. For example, a field name might be "Color" while a field value is "Red".
bake = ClusterInput()  # Set to true to bake geometry with user data.
geometry = ClusterInput()  # Geometry to bake
field_values = ClusterInput()  # The values of the data you're embedding. This data can be retrieved later from your geometry. For example, a field name might be "Color" while a field value is "Red".
object_attributes = ClusterInput()  # The optional object attributes to use when baking. Use an "Object Attributes" component from Human to construct these, including layer name, color, and other properties.
bake_2 = Boolean(bake)
geo = Geometry(geometry)
fn = Text(field_names)
att = Data(object_attributes)
bool = Boolean(clear)
fv = Text(field_values)
bakeuserdict = BakeWithUserDictionary(bake=bake_2, G=geo, FN=fn, FV=fv, att=att, clear=bool)  # -> out, A; inputs bake: Boolean, G: GeometryBase, FN: list of String, FV: list of String, clear: Boolean
# ---------- bakeuserdict: C# ----------
    ObjectAttributes oAtt = att as ObjectAttributes;
    if(oAtt == null) oAtt = RhinoDocument.CreateDefaultAttributes();
    if(clear){
      G.UserDictionary.Clear();
    }
    for(int i = 0;i < FN.Count;i++){
      G.UserDictionary.Set(FN[i], FV[i]);
    }
    if(bake){
      RhinoDocument.Objects.Add(G, oAtt);
    }
    A = G;
# ---------- end bakeuserdict ----------
G = Geometry(bakeuserdict.A)
geometry_2 = ClusterOutput(G)  # Geometry with embedded data.

# ==== cluster ReadUserData: Reads embedded user data from a piece of geometry. Data can be embedded in geometry with the Bake User Data component.
geometry = ClusterInput()  # Geometry that has been embedded with User Data. The Bake User Data component can create this kind of geometry.
field_filter = ClusterInput()  # Optional Filter, if you want to retrieve a particular field from the geometry's data.
geo = Geometry(geometry)
filter = Text(field_filter)
readuser_data = CSharpScript(G=geo)  # -> out, A, B; inputs G: GeometryBase
# ---------- readuser_data: C# ----------
    A = G.UserDictionary.Keys;
    B = G.UserDictionary.Values;
# ---------- end readuser_data ----------
fsim = FindSimilarMember(Data=filter, Set=readuser_data.A)  # -> Hit, Index
item = ListItem(List=readuser_data.B, Index=fsim.Index, Wrap=True)
backup = BackupData(priority_data=fsim.Hit, secondary_data=readuser_data.A)
backup_2 = BackupData(priority_data=item, secondary_data=readuser_data.B)
field_names = Text(backup)
field_values = Text(backup_2)
field_names_2 = ClusterOutput(field_names)  # The names of the fields embedded in the geometry.
field_values_2 = ClusterOutput(field_values)  # The data values embedded in the geometry.

# ==== cluster DLength_2: computes length of a domain
data = ClusterInput()
I = ClusterInput()
data_2 = Data(data)
dedomain = DeconstructDomain(Domain=I)  # -> Start, End
addition = Addition(A=data_2, B=dedomain.Start)
addition_2 = Addition(A=data_2, B=dedomain.End)
subtraction = Subtraction(A=dedomain.Start, B=dedomain.End)
data_3 = Data(addition)
abs = Absolute(Value=subtraction)
data_4 = Data(addition_2)
data_5 = ClusterOutput(data_4)
data_6 = ClusterOutput(data_3)
y = ClusterOutput(abs)

# ==== cluster Cluster_3
data = ClusterInput()
data_2 = Data(data)
pdecon = Deconstruct(Point=data_2)  # -> XComponent, YComponent, ZComponent
merge = Merge(Data1=pdecon.XComponent, Data2=pdecon.YComponent, Data3=pdecon.ZComponent)
data_3 = Data(merge)
data_4 = ClusterOutput(data_3)

# ==== cluster Cluster_4
C = ClusterInput()
explode = Explode(Curve=C, Recursive=True)  # -> Segments, Vertices
trim = TrimTree(Tree=explode.Vertices, Depth=1)
hull = ConvexHull(Points=trim, Plane=PlaneXY(0, 0, 0))  # -> Hull, HullZ, Indices
hz = ClusterOutput(hull.HullZ)

# ==== cluster Cluster_5
getscreen = GetScreenDimensions()  # -> Width, Height
toolbarheight = Slider(40, range=0..100)
d1 = ClusterInput()
d2 = ClusterInput()
d1_2 = ClusterInput()
d2_2 = ClusterInput()
G = ClusterInput()
merge = Merge(Data1=flatten(d1), Data2=flatten(d2))
includes_dpi_scaling = Panel([getscreen.Width, getscreen.Height])
merge_2 = Merge(Data1=flatten(d1_2), Data2=flatten(d2_2))
subtraction = Subtraction(A=getscreen.Height, B=toolbarheight)
sort = SortList(Keys=merge)  # -> Keys, ValuesA
sort_2 = SortList(Keys=merge_2)  # -> Keys, ValuesA
filter = StreamFilter(Gate=G, Stream0=subtraction, Stream1=getscreen.Height)
item = ListItem(List=sort.Keys, Index=0, Wrap=True)  # -> Item, Item1
item_2 = ListItem(List=sort_2.Keys, Index=0, Wrap=True)  # -> Item, Item1
multiplication = Multiplication(A=filter, B=item_2.Item)
subtraction_2 = Subtraction(A=item.Item1, B=item.Item)
multiplication_2 = Multiplication(A=getscreen.Width, B=item.Item)
subtraction_3 = Subtraction(A=item_2.Item1, B=item_2.Item)
G_2 = ClusterInput()
multiplication_3 = Multiplication(A=getscreen.Width, B=subtraction_2)
multiplication_4 = Multiplication(A=getscreen.Height, B=subtraction_3)
pt = ConstructPoint(XCoordinate=multiplication_2, YCoordinate=multiplication, ZCoordinate=0)
R = ClusterOutput(multiplication_3)
R_2 = ClusterOutput(multiplication_4)
filter_2 = StreamFilter(Gate=G_2, Stream1=pt)
s_1 = ClusterOutput(filter_2)

# ==== cluster SetMargin
int = ClusterInput()
int_2 = ClusterInput()
int_3 = ClusterInput()
int_4 = ClusterInput()
int_5 = Integer(int)
int_6 = Integer(int_2)
int_7 = Integer(int_3)
int_8 = Integer(int_4)
merge = Merge(Data1=int_5, Data2=int_7, Data3=int_8, Data5=int_6)
join = TextJoin(Text=merge, Join=",")
R = ClusterOutput(join)

# ==== cluster Cluster
N = ClusterInput()
T = ClusterInput()
N_2 = Text(N)
split = TextSplit(Text=T, Separators=".")
fn = ClusterInput()
dm = ClusterInput()
item = ListItem(List=split, Index=0, Wrap=True)
dc = ClusterInput()
pan = Panel("""HDT_Reference
HDTReference""")
pan_2 = Panel("""Human
Human""")
lng = ListLength(List=T)
len = TextLength(Text=N_2)
contains = ContainsAB(B=N_2)
dm_2 = Text(dm)
dc_2 = Text(dc)
fn_2 = Text(fn)
replace = ReplaceMembers(Set=item, Find=pan, Replace=pan_2)
cset = CreateSet(List=flatten(replace))  # -> Set, Map
txt = Text(["ScriptComponents", "Grasshopper", "MathComponents", "GalapagosComponents", "FieldComponents", "VectorComponents", "AnalysisComponents", "CurveComponents", "LegacyScriptComponents", "SurfaceComponents", "TriangulationComponents", "MassXForms", "LinearXForms"])
format = Format(Format="Definition by {0}", Culture=127, Data0=N_2)
difference = SetDifference(SetA=cset.Set, SetB=txt)
lng_2 = ListLength(List=flatten(difference))
dispatch = Dispatch(List=format, DispatchPattern=contains)  # -> ListA, ListB
format_2 = Format(Format="Object Count: {0:0}", Culture=127, Data0=lng)
format_3 = Format(Format="Date Modified: {0}", Culture=127, Data0=dm_2)
format_4 = Format(Format="Date Created: {0}", Culture=127, Data0=dc_2)
dependencies = Text(flatten(difference))
author = Text(flatten(dispatch.ListB))
larger = LargerThan(FirstNumber=lng_2, SecondNumber="1")  # -> LargerThan, OrEqualTo
objcount = Text(flatten(format_2))
author_2 = ClusterOutput(author)
dm_3 = Text(flatten(format_3))
fn_3 = ClusterOutput(fn_2)
dc_3 = Text(flatten(format_4))
objcount_2 = ClusterOutput(objcount)
dc_4 = ClusterOutput(dc_3)
filter = StreamFilter(
    Gate=larger.LargerThan,
    Stream0="This definition requires the following plug-in:",
    Stream1="This definition requires the following plug-ins:")
dm_4 = ClusterOutput(dm_3)
pan_3 = Panel("""{0}
{1}""")
join = TextJoin(Text=dependencies)
format_5 = Format(Format=pan_3, Culture=127, Data0=filter, Data1=join)
clean = CleanTree(Tree=format_5, CleanInvalid=True, CleanEmpty=False)
T_2 = ClusterOutput(clean)

# ==== cluster BackupData: Passes the list without nulls
secondary_data = ClusterInput()
priority_data = ClusterInput()
null = NullItem(
    A=null.ResultA,
    InternalDocument_plugin_version=(0, 9, 76),
    InternalDocument_DocumentHeader_PreviewMeshType=1,
    InternalDocument_DocumentHeader_PreviewNormal=RGBA(150, 0, 0, 100),
    InternalDocument_DocumentHeader_PreviewSelected=RGBA(0, 120, 0, 100),
    InternalDocument_DefinitionProperties_Projection_Zoom=1.25)  # -> A, A_2
priority_data_2 = Data([priority_data, null.A_2])
secondary_data_2 = Data(secondary_data)
clean = CleanTree(Tree=priority_data_2, CleanInvalid=True, CleanEmpty=False)
lng = ListLength(List=clean)
null_2 = NullItem(Items=clean)  # -> NullFlags, InvalidFlags
equals = Equality(FirstNumber="0", SecondNumber=lng)  # -> Equality, Inequality
clean_2 = CleanTree(Data=clean, CleanInvalid=True, CleanEmpty=False)
not = GateNot(A=null_2.NullFlags)
ma = MassAddition(Input=flatten(not))  # -> Result, PartialResult
bool = Boolean(ma.Result)
filter = StreamFilter(Gate=bool, Stream0=secondary_data_2, Stream1=clean_2)
data = Data(filter)
data_2 = ClusterOutput(data)

# ==== cluster ContainsAB: Tests if a string contains another string.
B = ClusterInput()
A = ClusterInput()
A_2 = String(A)
B_2 = String(B)
eval = Evaluate(F="Contains(x,y)", x=A_2, y=B_2)
c = Boolean(eval)
c_2 = ClusterOutput(c)
