# Grasshopper definition PrimitiveCreation.gh (Grasshopper 0.9.76)
# plug-ins: Python Interpreter

# ----
# NUMBER OF INDIVIDUAL PRIMITIVES
number_slider = Slider(4, range=0..100)

panel = Panel("BASE PLANE")
pln = Plane(PlaneXY(0.08767023439, 0.0884122404, 0))

num = Number(50)
num_2 = Number(0)
range = Range(Domain=num, Steps=number_slider)
cull_i = CullIndex(List=range, Indices=num_2, Wrap=True)
panel_2 = Panel("""Cone
Cylindar
Sphere
Box""")
panel_3 = Panel(cull_i)
dup = DuplicateData(Data=graft(panel_2), Number=number_slider, Order=True)  # -> flatten(Data)

python = PythonScript()  # -> out, random_int
# ---------- python: Python ----------
import Rhino.Geometry as rg
import rhinoscriptsyntax as rs
import math

from random import randint
random_int = (randint(0, 100))
# ---------- end python ----------
python_2 = PythonScript()  # -> out, random_int; same code as python
python_3 = PythonScript()  # -> out, random_int; same code as python
python_4 = PythonScript()  # -> out, random_int; same code as python
python_5 = PythonScript()  # -> out, random_int; same code as python
python_6 = PythonScript()  # -> out, random_int; same code as python
python_7 = PythonScript()  # -> out, random_int; same code as python
python_8 = PythonScript()  # -> out, random_int; same code as python
panel_4 = Panel("RANDOMIZE SHIT")
jitter = Jitter(List=panel_3, Jitter=1, Seed=python.random_int)  # -> Values, Indices
jitter_2 = Jitter(List=panel_3, Jitter=1, Seed=python_3.random_int)  # -> Values, Indices
jitter_3 = Jitter(List=panel_3, Jitter=1, Seed=python_4.random_int)  # -> Values, Indices
jitter_4 = Jitter(List=panel_3, Jitter=1, Seed=python_5.random_int)  # -> Values, Indices
jitter_5 = Jitter(List=panel_3, Jitter=1, Seed=python_2.random_int)  # -> Values, Indices
jitter_6 = Jitter(List=panel_3, Jitter=1, Seed=python_6.random_int)  # -> Values, Indices
jitter_7 = Jitter(List=panel_3, Jitter=1, Seed=python_7.random_int)  # -> Values, Indices
jitter_8 = Jitter(List=panel_3, Jitter=1, Seed=python_8.random_int)  # -> Values, Indices

python_9 = PythonScript(list_in=panel_3)  # -> random_int_list, random_int; disabled
# ---------- python_9: Python ----------
import Rhino.Geometry as rg
import rhinoscriptsyntax as rs
import math
random_int_list = []

from random import randint
for i in list_in:
    random_int = (randint(0, 100))
    random_int_list.append(random_int)
# ---------- end python_9 ----------

panel_5 = Panel("PRIMITIVE CREATION")
box = CenterBox(Base=pln, X=jitter_2.Values, Y=jitter_3.Values, Z=jitter_4.Values)
cone = Cone(Base=pln, Radius=jitter_7.Values, Length=jitter_8.Values)  # -> Cone, Tip
sph = Sphere(Base=pln, Radius=jitter_6.Values)
cyl = Cylinder(Base=pln, Radius=jitter.Values, Length=jitter_5.Values)

capex = CapHolesEx(Brep=sph)  # -> Brep, Caps, Solid
capex_2 = CapHolesEx(Brep=box)  # -> Brep, Caps, Solid
capex_3 = CapHolesEx(Brep=cyl)  # -> Brep, Caps, Solid
capex_4 = CapHolesEx(Brep=cone.Cone)  # -> Brep, Caps, Solid
shape_type = Data(dup)
panel_6 = Panel(capex.Brep)
panel_7 = Panel(capex_4.Brep)
panel_8 = Panel(capex_3.Brep)
panel_9 = Panel(capex_2.Brep)
entwine = Entwine(Branch00=capex_4.Brep, Branch01=capex_3.Brep, Branch02=capex.Brep, Branch03=capex_2.Brep, FlattenInputs=True)
