# Grasshopper definition basic geo analysis + owl.gh_pm.gh (Grasshopper 0.9.76)
# plug-ins: Python Interpreter, Owl.Accord.GH, Owl.GH

# ----
# NUMBER OF INDIVIDUAL PRIMITIVES
number_slider = Slider(15, range=0..100)

color_groups_clusters = Button(ExpressionNormal="True")
col = Colour([RGBA(4, 0, 255, 135), RGBA(0, 128, 255, 133), RGBA(210, 255, 148, 141), RGBA(255, 0, 0, 122), RGBA(224, 224, 224, 211)])

panel = Panel("BASE PLANE")
pln = Plane(PlaneXY(0.08767023439, 0.0884122404, 0))

num = Number(50)
num_2 = Number(0)
range = Range(Domain=num, Steps=number_slider)
cull_i = CullIndex(List=range, Indices=num_2, Wrap=True)
panel_2 = Panel(cull_i)

python = PythonScript()  # -> out, random_int
# ---------- python: Python ----------
import Rhino.Geometry as rg
import rhinoscriptsyntax as rs
import math

from random import randint
random_int = (randint(0, 100))
# ---------- end python ----------
python_2 = PythonScript()  # -> out, random_int; same code as python
python_3 = PythonScript()  # -> out, random_int; same code as python
python_4 = PythonScript()  # -> out, random_int; same code as python
python_5 = PythonScript()  # -> out, random_int; same code as python
python_6 = PythonScript()  # -> out, random_int; same code as python
python_7 = PythonScript()  # -> out, random_int; same code as python
python_8 = PythonScript()  # -> out, random_int; same code as python
panel_3 = Panel("RANDOMIZE SHIT")
jitter = Jitter(List=panel_2, Jitter=1, Seed=python.random_int)  # -> Values, Indices
jitter_2 = Jitter(List=panel_2, Jitter=1, Seed=python_3.random_int)  # -> Values, Indices
jitter_3 = Jitter(List=panel_2, Jitter=1, Seed=python_4.random_int)  # -> Values, Indices
jitter_4 = Jitter(List=panel_2, Jitter=1, Seed=python_5.random_int)  # -> Values, Indices
jitter_5 = Jitter(List=panel_2, Jitter=1, Seed=python_2.random_int)  # -> Values, Indices
jitter_6 = Jitter(List=panel_2, Jitter=1, Seed=python_6.random_int)  # -> Values, Indices
jitter_7 = Jitter(List=panel_2, Jitter=1, Seed=python_7.random_int)  # -> Values, Indices
jitter_8 = Jitter(List=panel_2, Jitter=1, Seed=python_8.random_int)  # -> Values, Indices

panel_4 = Panel("0 to 10000")

panel_7 = Panel("PRIMITIVE CREATION")
box = CenterBox(Base=pln, X=jitter_2.Values, Y=jitter_3.Values, Z=jitter_4.Values)
cone = Cone(Base=pln, Radius=jitter_7.Values, Length=jitter_8.Values)  # -> Cone, Tip
sph = Sphere(Base=pln, Radius=jitter_6.Values)
cyl = Cylinder(Base=pln, Radius=jitter.Values, Length=jitter_5.Values)

capex = CapHolesEx(Brep=sph)  # -> Brep, Caps, Solid
capex_2 = CapHolesEx(Brep=box)  # -> Brep, Caps, Solid
capex_3 = CapHolesEx(Brep=cyl)  # -> Brep, Caps, Solid
capex_4 = CapHolesEx(Brep=cone.Cone)  # -> Brep, Caps, Solid
panel_8 = Panel(capex.Brep)
panel_9 = Panel(capex_4.Brep)
panel_10 = Panel(capex_3.Brep)
panel_11 = Panel(capex_2.Brep)
panel_12 = Panel("""Cone
Cylindar
Sphere
Box""")
entwine = Entwine(Branch00=capex_4.Brep, Branch01=capex_3.Brep, Branch02=capex_2.Brep, FlattenInputs=True)  # -> flatten(Result)
data = Data(capex_2.Brep)
data_2 = Data(capex_4.Brep)
data_3 = Data(capex_3.Brep)
lng = ListLength(List=data)

# ---- group: input geometry
geo = Geometry(graft(entwine))

# ----
brep = Brep(simplify(graft(geo)))
brep_2 = Brep(brep)
brep_3 = Brep(brep)
brep_4 = Brep(brep)
brep_5 = Brep(brep)
lng_2 = ListLength(List=data_2)
lng_3 = ListLength(List=data_3)
vmoments = VolumeMoments(Geometry=brep_4)  # -> simplify(Volume), simplify(Centroid), simplify(Inertia), simplify(InertiaError), simplify(Secondary), simplify(SecondaryError), simplify(Gyration)
debrep = DeconstructBrep(Brep=brep_3)  # -> simplify(Faces), simplify(Edges), simplify(Vertices)
bbox = BoundingBox(Content=brep_5, Plane=PlaneXY(0, 0, 0))  # -> Box, Box_2
debrep_2 = DeconstructBrep(Brep=brep_2)  # -> Faces, Edges, Vertices
dup = DuplicateData(Data="Box", Number=lng, Order=True)  # -> flatten(Data)
dup_2 = DuplicateData(Data="Cone", Number=lng_2, Order=True)  # -> flatten(Data)
dup_3 = DuplicateData(Data="Cylinder", Number=lng_3, Order=True)  # -> flatten(Data)
brep_6 = Brep(bbox.Box_2)
data_4 = Data(vmoments.Secondary)
brep_7 = Brep(debrep_2.Faces)
lng_4 = ListLength(List=debrep.Vertices)
lng_5 = ListLength(List=debrep.Faces)
lng_6 = ListLength(List=debrep.Edges)
area = Area(Geometry=brep_7)  # -> Area, Centroid
volume = Volume(Geometry=brep_5)  # -> Volume, Centroid
volume_2 = Volume(Geometry=brep_6)  # -> Volume, Centroid
data_5 = Data(lng_4)
data_6 = Data(lng_5)
data_7 = Data(lng_6)
merge = Merge(Data1=dup_2, Data2=dup_3, Data3=dup)
pdecon = Deconstruct(Point=area.Centroid)  # -> XComponent, YComponent, ZComponent
data_8 = Data(volume.Volume)
data_9 = Data(volume_2.Volume)
volume_3 = Volume(Geometry=brep_2)  # -> Volume, Centroid
data_10 = Data(pdecon.ZComponent)
division = Division(A=data_9, B=data_8)
sort = SortList(Keys=data_10, ValuesA=data_10, ValuesB=brep_7, ValuesC=area.Centroid)  # -> Keys, ValuesA, ValuesB, ValuesC
panel_13 = Panel(merge)
data_11 = Data(simplify(graft(merge)))
data_12 = Data(division)
item = ListItem(List=sort.ValuesC, Index=0, Wrap=True)
pt = Point(volume_3.Centroid)
pt_2 = Point(item)
bbox_2 = BoundingBox(Content=geo, Plane=PlaneXY(0, 0, 0))  # -> Box, Box_2

# ---- group: length of slice at low mid and high
panel_14 = Panel("""0.1
0.5
0.9""")
box_2 = EvaluateBox(Box=bbox_2.Box, UParameter="0", VParameter="0", WParameter=panel_14)  # -> Plane, Point, Include
sec = BrepPlane(Brep=geo, Plane=box_2.Plane)  # -> Curves, Points
trim = TrimTree(Tree=sec.Curves, Depth=1)
len = Length(Curve=trim)
item_2 = ListItem(List=simplify(len), Index=0, Wrap=True)  # -> Item, Item1, Item2

# ----
vec2pt = Vector2Pt(PointA=pt_2, PointB=pt, Unitize=False)  # -> Vector, Length
debox = DeconstructBox(Box=bbox_2.Box)  # -> Plane, simplify(X), simplify(Y), simplify(Z)
volume_4 = Volume(Geometry=geo)  # -> simplify(Volume), Centroid
data_13 = Data(vec2pt.Vector)
area_2 = Area(Geometry=geo)  # -> simplify(Area), Centroid
dlength = DLength(I=debox.Y)
dlength_2 = DLength(I=debox.Z)
pdecon_2 = Deconstruct(Point=volume_4.Centroid)  # -> simplify(XComponent), simplify(YComponent), simplify(ZComponent)
dlength_3 = DLength(I=debox.X)
panel_15 = Panel(dlength_3)
panel_16 = Panel(dlength)
panel_17 = Panel(dlength_2)
data_14 = Data(data_4)
panel_18 = Panel(volume_4.Volume)
data_15 = Data(data_13)
panel_19 = Panel(area_2.Area)
panel_20 = Panel(pdecon_2.XComponent)
panel_21 = Panel(pdecon_2.YComponent)
panel_22 = Panel(pdecon_2.ZComponent)
shape_type = Data(data_11)
cluster = Cluster_3(data=data_14)
cluster_2 = Cluster_3(data=data_15)
data_16 = Data(simplify(cluster))
data_17 = Data(simplify(cluster_2))
data_18 = Data(simplify(data_6))
data_19 = Data(simplify(data_7))
data_20 = Data(simplify(data_5))
data_21 = Data(simplify(data_12))
merge_2 = Merge(Data1=data_17, Data2=data_16, Data3=data_18, Data4=data_19, Data5=data_20, Data6=data_21)
field_titles = Panel("""Shape
Area
Volume
centroid x
centroid y 
centroid z
BB_Height
BB_With
BB_Depth
low_slice_length
mid_slice_length
upper_slice_length""")
data_22 = Data(merge_2)
data_23 = Data(data_22)
merge_3 = Merge(
    Data1=simplify(shape_type),
    Data2=panel_19,
    Data3=panel_18,
    Data4=panel_20,
    Data5=panel_21,
    Data6=panel_22,
    Data7=panel_15,
    Data8=panel_16,
    Data9=panel_17,
    Data10=item_2.Item,
    Data11=item_2.Item1,
    Data12=item_2.Item2,
    Data13=data_23)
path_mapper = PathMapper(field_titles, source="{0}", target="{0}")
path_mapper_2 = PathMapper(merge_3, source="{A}", target="{A+1}")
merge_4 = Merge(Data1=path_mapper, Data2=path_mapper_2)
join = TextJoin(Text=merge_4, Join=",")
panel_23 = Panel(path_mapper_2)
panel_24 = Panel(merge_4)
# [second moment of inertia]
# Ixx
# Iyy
# Izy
panel_25 = Panel(data_16)
# [eccentricity]
# x
# y
# z
panel_26 = Panel(data_17)
# [brep topology]
# number of faces
# number of edges
# number of vertexs
panel_27 = Panel(data_19)
panel_28 = Panel(data_20)
# volume/ bb volume ratio
panel_29 = Panel(data_21)
panel_30 = Panel(data_18)
split = SplitTree(Data=merge_4, Masks=flatten("{0}"))  # -> Positive, Negative
panel_31 = Panel(split.Negative)
item_3 = ListItem(List=split.Negative, Index=0, Wrap=True)  # -> flatten(Item), Item1, Item2, Item3, Item4, Item5, Item6, Item7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
t_sne = TSNE(Perplexity=1.5, Theta=0.5, Outputs=1, Seed=123)
kmeansex = KMeansClusteringEx(Iterations=1, Energy=4.94e-324)  # -> Clusters, Indices, Iterations
bnd = Bounds(Numbers=flatten(item_3.Item1))
bnd_2 = Bounds(Numbers=flatten(item_3.Item2))
bnd_3 = Bounds(Numbers=flatten(item_3.Item3))
bnd_4 = Bounds(Numbers=flatten(item_3.Item4))
bnd_5 = Bounds(Numbers=flatten(item_3.Item5))
bnd_6 = Bounds(Numbers=flatten(item_3.Item8))
bnd_7 = Bounds(Numbers=flatten(item_3.Item6))
bnd_8 = Bounds(Numbers=flatten(item_3.Item7))
bnd_9 = Bounds(Numbers=flatten(item_3.Item9))
bnd_10 = Bounds(Numbers=flatten(item_3.Item10))
bnd_11 = Bounds(Numbers=flatten(item_3.Item11))
remap = RemapNumbers(Value=item_3.Item1, Source=bnd, Target=Domain(0, 1))  # -> Mapped, Clipped
remap_2 = RemapNumbers(Value=item_3.Item2, Source=bnd_2, Target=Domain(0, 1))  # -> Mapped, Clipped
remap_3 = RemapNumbers(Value=item_3.Item3, Source=bnd_3, Target=Domain(0, 1))  # -> Mapped, Clipped
remap_4 = RemapNumbers(Value=item_3.Item4, Source=bnd_4, Target=Domain(0, 1))  # -> Mapped, Clipped
remap_5 = RemapNumbers(Value=item_3.Item5, Source=bnd_5, Target=Domain(0, 1))  # -> Mapped, Clipped
remap_6 = RemapNumbers(Value=item_3.Item8, Source=bnd_6, Target=Domain(0, 1))  # -> Mapped, Clipped
remap_7 = RemapNumbers(Value=item_3.Item6, Source=bnd_7, Target=Domain(0, 1))  # -> Mapped, Clipped
remap_8 = RemapNumbers(Value=item_3.Item7, Source=bnd_8, Target=Domain(0, 1))  # -> Mapped, Clipped
remap_9 = RemapNumbers(Value=item_3.Item9, Source=bnd_9, Target=Domain(0, 1))  # -> Mapped, Clipped
remap_10 = RemapNumbers(Value=item_3.Item10, Source=bnd_10, Target=Domain(0, 1))  # -> Mapped, Clipped
remap_11 = RemapNumbers(Value=item_3.Item11, Source=bnd_11, Target=Domain(0, 1))  # -> Mapped, Clipped
featurets = FeatureTensorSet(
    Feature0=flatten(remap.Mapped),
    Feature1=flatten(remap_2.Mapped),
    Feature2=flatten(remap_3.Mapped),
    Feature3=flatten(remap_4.Mapped),
    Feature4=flatten(remap_5.Mapped),
    Feature5=flatten(remap_7.Mapped),
    Feature6=flatten(remap_8.Mapped),
    Feature7=flatten(remap_6.Mapped),
    Feature8=flatten(remap_9.Mapped),
    Feature9=flatten(remap_10.Mapped),
    Feature10=flatten(remap_11.Mapped))
remap_12 = RemapTSet(TensorSet=featurets, Source=Domain(0, 1), Target=Domain(0, 1))
kmeans = KMeansClustering(Data=remap_12, Clusters=Slider(3, range=0..10), Iterations=Slider(100, range=0..100), Seed=123)  # -> Clusters, Indices
panel_32 = Panel(kmeans.Clusters)
panel_33 = Panel(kmeans.Indices)
item_4 = ListItem(List=panel_32, Index=0, Wrap=True)
item_5 = ListItem(List=split.Negative, Index=0, Wrap=True)  # -> flatten(Item)
detset = DeconstructTensorSet(TensorSet=item_4)
item_6 = ListItem(List=flatten(item_3.Item1), Index=panel_33, Wrap=True)
item_7 = ListItem(List=flatten(item_3.Item2), Index=panel_33, Wrap=True)
item_8 = ListItem(List=flatten(item_5), Index=panel_33, Wrap=True)
item_9 = ListItem(List=flatten(item_3.Item3), Index=panel_33, Wrap=True)
item_10 = ListItem(List=flatten(geo), Index=panel_33, Wrap=True)

panel_34 = Panel(item_8)
panel_35 = Panel("CLUSTERS")

panel_36 = Panel(item_6)
panel_37 = Panel(item_10)
panel_38 = Panel(item_7)
panel_39 = Panel(item_9)
pt_3 = ConstructPoint(XCoordinate=item_6, YCoordinate=item_7, ZCoordinate=item_9)
move = Move(Geometry=item_10, Motion=pt_3)  # -> Geometry, Transform
merge_5 = Merge(
    Data1=ColourSwatch(SwatchColor=RGB(255, 255, 255)),
    Data2=ColourSwatch(SwatchColor=RGB(0, 255, 166)),
    Data3=ColourSwatch(SwatchColor=RGB(255, 215, 54)),
    Data4=ColourSwatch(SwatchColor=RGB(255, 0, 0)))  # -> graft(Result)
preview = CustomPreview(Geometry=pt_3, Shader=merge_5)

# ----
# ToolDescription: Enter a description of this definition's functionality and use
update_file_info = Button()
group_prefixes = Panel("""out_
in_
action_
warning_
cluster""")
c_script = CSharpScript(update=color_groups_clusters, name=group_prefixes, col=col)  # -> out, A; inputs update: Boolean, name: list of String, col: list of Color
# ---------- c_script: C# ----------
    Color clusterColor = Color.Transparent;
    for(int i = 0;i < name.Count;i++){
      if(name[i].Contains("cluster")){
        clusterColor = col[i];
        break;
      }
    }



    if(update){
      List<Guid> guids = new List<Guid>();
      List<Grasshopper.Kernel.Special.GH_Group> grps = new List<Grasshopper.Kernel.Special.GH_Group>();
      List<Grasshopper.Kernel.Special.GH_Group> alreadygrps = new List<Grasshopper.Kernel.Special.GH_Group>();


      foreach(IGH_DocumentObject o in GrasshopperDocument.Objects){
        Grasshopper.Kernel.Special.GH_Group g = o as Grasshopper.Kernel.Special.GH_Group;
        if(g != null){
          for(int j = 0;j < name.Count;j++){
            if(g.NickName.ToUpper().Contains(name[j].ToUpper())){
              g.Colour = col[j % col.Count];
            }

          }
        }


        if(o is Grasshopper.Kernel.Special.GH_Cluster){
          Grasshopper.Kernel.Special.GH_Cluster cluster = o as  Grasshopper.Kernel.Special.GH_Cluster;
          string filepath = cluster.FilePath;
          if(!String.IsNullOrEmpty(filepath)){
            cluster.Name = System.IO.Path.GetFileNameWithoutExtension(filepath);
            cluster.NickName = System.IO.Path.GetFileNameWithoutExtension(filepath);
            cluster.Attributes.ExpireLayout();
          }
          guids.Add(cluster.InstanceGuid);
          Grasshopper.Kernel.Special.GH_Group grp = new Grasshopper.Kernel.Special.GH_Group();
          grps.Add(grp);

        } else if (o is Grasshopper.Kernel.Special.GH_Group){
          Grasshopper.Kernel.Special.GH_Group alreadygrp = o as Grasshopper.Kernel.Special.GH_Group;
          alreadygrps.Add(alreadygrp);
        }





      }

      List<bool> isAlreadyInGroup = IsAlreadyInGroup(guids, alreadygrps);

      for(int i = 0;i < grps.Count;i++){
        Grasshopper.Kernel.Special.GH_Group grp = grps[i];
        grp.Colour = clusterColor;
        grp.NickName = "";
        grp.AddObject(guids[i]);
        if(!isAlreadyInGroup[i]){
          grp.ExpireCaches();
          GrasshopperDocument.AddObject(grp, false, 1000);
        }
      }



    }
# ---------- c_script: C# additional code ----------
  List<bool> IsAlreadyInGroup(List<Guid> guids, List<Grasshopper.Kernel.Special.GH_Group> grps){
    List<bool> results = new List<bool>();
    foreach(Guid g in guids){
      results.Add(false);
    }
    foreach(Grasshopper.Kernel.Special.GH_Group grp in grps){ //for every group in the pre-existing groups
      if(grp.Objects().Count == 1){ //if that group only has one object in it
        for (int j = 0;j < guids.Count;j++){
          Guid g = guids[j];
          if(grp.ObjectIDs.Contains(g)){
            results[j] = true;
            break;
          }
        }
      }
    }
    return results;
  }
# ---------- end c_script ----------

data_24 = Data(update_file_info)

c_script_2 = CSharpScript(x=data_24)  # -> out, A, B, C, D, E
# ---------- c_script_2: C# ----------
    List < IGH_DocumentObject> objectsRecursive = new List<IGH_DocumentObject>();
    objectsRecursive.AddRange(clusterObjectsRecursive(GrasshopperDocument));


    B = GrasshopperDocument.Author.Name + " " + GrasshopperDocument.Author.Email;
    D = GrasshopperDocument.Properties.DateTag;
    if(GrasshopperDocument.IsFilePathDefined){
      C = GrasshopperDocument.FilePath;
      System.IO.FileInfo info = new System.IO.FileInfo(GrasshopperDocument.FilePath);
      if(info.LastWriteTime != null){
        E = info.LastWriteTime;
      } else {
        E = "";
      }
    } else {
      C = "Unsaved Document";
      E = "";
    }
    A = objectsRecursive;
# ---------- c_script_2: C# additional code ----------
  List<IGH_DocumentObject> clusterObjectsRecursive(GH_Document doc){
    List<IGH_DocumentObject> objList = new List<IGH_DocumentObject>();
    objList.AddRange(doc.Objects);
    foreach(IGH_DocumentObject obj in doc.Objects){
      Grasshopper.Kernel.Special.GH_Cluster cluster = obj as Grasshopper.Kernel.Special.GH_Cluster;
      try{
        objList.AddRange(clusterObjectsRecursive(cluster.Document("")));
      } catch {

      }
    }
    return objList;
  }
# ---------- end c_script_2 ----------
cluster_3 = Cluster_2(T=c_script_2.A, N=c_script_2.B, fn=c_script_2.C, dc=c_script_2.D, dm=c_script_2.E)
file_info = Panel(cluster_3)

# ==== cluster Cluster_2
T = ClusterInput()
N = ClusterInput()
fn = ClusterInput()
dc = ClusterInput()
dm = ClusterInput()
cluster = Cluster(T=T, N=N, fn=fn, dc=dc, dm=dm)  # -> T_2, author_2, objcount_2, fn_3, dc_4, dm_4
merge = Merge(
    Data1=cluster.author_2,
    Data2=cluster.T_2,
    Data3=cluster.objcount_2,
    Data4=cluster.fn_3,
    Data5=cluster.dc_4,
    Data6=cluster.dm_4)
R = ClusterOutput(merge)

# ==== cluster DLength: computes length of a domain
I = ClusterInput()
dedomain = DeconstructDomain(Domain=I)  # -> Start, End
subtraction = Subtraction(A=dedomain.Start, B=dedomain.End)
abs = Absolute(Value=subtraction)
y = ClusterOutput(abs)

# ==== cluster Cluster_3
data = ClusterInput()
data_2 = Data(data)
pdecon = Deconstruct(Point=data_2)  # -> XComponent, YComponent, ZComponent
merge = Merge(Data1=pdecon.XComponent, Data2=pdecon.YComponent, Data3=pdecon.ZComponent)
data_3 = Data(merge)
data_4 = ClusterOutput(data_3)

# ==== cluster Cluster
N = ClusterInput()
T = ClusterInput()
N_2 = Text(N)
split = TextSplit(Text=T, Separators=".")
fn = ClusterInput()
dm = ClusterInput()
item = ListItem(List=split, Index=0, Wrap=True)
dc = ClusterInput()
pan = Panel("""HDT_Reference
HDTReference""")
pan_2 = Panel("""Human
Human""")
lng = ListLength(List=T)
len = TextLength(Text=N_2)
contains = ContainsAB(B=N_2)
dm_2 = Text(dm)
dc_2 = Text(dc)
fn_2 = Text(fn)
replace = ReplaceMembers(Set=item, Find=pan, Replace=pan_2)
cset = CreateSet(List=flatten(replace))  # -> Set, Map
txt = Text(["ScriptComponents", "Grasshopper", "MathComponents", "GalapagosComponents", "FieldComponents", "VectorComponents", "AnalysisComponents", "CurveComponents", "LegacyScriptComponents", "SurfaceComponents", "TriangulationComponents", "MassXForms", "LinearXForms"])
format = Format(Format="Definition by {0}", Culture=127, Data0=N_2)
difference = SetDifference(SetA=cset.Set, SetB=txt)
lng_2 = ListLength(List=flatten(difference))
dispatch = Dispatch(List=format, DispatchPattern=contains)  # -> ListA, ListB
format_2 = Format(Format="Object Count: {0:0}", Culture=127, Data0=lng)
format_3 = Format(Format="Date Modified: {0}", Culture=127, Data0=dm_2)
format_4 = Format(Format="Date Created: {0}", Culture=127, Data0=dc_2)
dependencies = Text(flatten(difference))
author = Text(flatten(dispatch.ListB))
larger = LargerThan(FirstNumber=lng_2, SecondNumber="1")  # -> LargerThan, OrEqualTo
objcount = Text(flatten(format_2))
author_2 = ClusterOutput(author)
dm_3 = Text(flatten(format_3))
fn_3 = ClusterOutput(fn_2)
dc_3 = Text(flatten(format_4))
objcount_2 = ClusterOutput(objcount)
dc_4 = ClusterOutput(dc_3)
filter = StreamFilter(
    Gate=larger.LargerThan,
    Stream0="This definition requires the following plug-in:",
    Stream1="This definition requires the following plug-ins:")
dm_4 = ClusterOutput(dm_3)
pan_3 = Panel("""{0}
{1}""")
join = TextJoin(Text=dependencies)
format_5 = Format(Format=pan_3, Culture=127, Data0=filter, Data1=join)
clean = CleanTree(Tree=format_5, CleanInvalid=True, CleanEmpty=False)
T_2 = ClusterOutput(clean)

# ==== cluster ContainsAB: Tests if a string contains another string.
B = ClusterInput()
A = ClusterInput()
A_2 = String(A)
B_2 = String(B)
eval = Evaluate(F="Contains(x,y)", x=A_2, y=B_2)
c = Boolean(eval)
c_2 = ClusterOutput(c)
