# Grasshopper definition geometry_parse_KMMT.gh (Grasshopper 0.9.76)

brep = Brep(simplify(graft([<brep referenced from the Rhino model> x2])))
brep_2 = Brep(brep)
brep_3 = Brep(brep)
brep_4 = Brep(brep)
brep_5 = Brep(brep)
vmoments = VolumeMoments(Geometry=brep_4)  # -> simplify(Volume), simplify(Centroid), simplify(Inertia), simplify(InertiaError), simplify(Secondary), simplify(SecondaryError), simplify(Gyration)
debrep = DeconstructBrep(Brep=brep_3)  # -> simplify(Faces), simplify(Edges), simplify(Vertices)
bbox = BoundingBox(Content=brep_5, Plane=PlaneXY(0, 0, 0))  # -> Box, Box_2
debrep_2 = DeconstructBrep(Brep=brep_2)  # -> Faces, Edges, Vertices
brep_6 = Brep(bbox.Box_2)
data = Data(vmoments.Secondary)
brep_7 = Brep(debrep_2.Faces)
lng = ListLength(List=debrep.Vertices)
lng_2 = ListLength(List=debrep.Faces)
lng_3 = ListLength(List=debrep.Edges)
area = Area(Geometry=brep_7)  # -> Area, Centroid
volume = Volume(Geometry=brep_5)  # -> Volume, Centroid
volume_2 = Volume(Geometry=brep_6)  # -> Volume, Centroid
data_2 = Data(lng)
data_3 = Data(lng_2)
data_4 = Data(lng_3)
pdecon = Deconstruct(Point=area.Centroid)  # -> XComponent, YComponent, ZComponent
data_5 = Data(volume.Volume)
data_6 = Data(volume_2.Volume)
volume_3 = Volume(Geometry=brep_2)  # -> Volume, Centroid
data_7 = Data(pdecon.ZComponent)
division = Division(A=data_6, B=data_5)
sort = SortList(Keys=data_7, ValuesA=data_7, ValuesB=brep_7, ValuesC=area.Centroid)  # -> Keys, ValuesA, ValuesB, ValuesC
data_8 = Data(division)
item = ListItem(List=sort.ValuesC, Index=0, Wrap=True)
pt = Point(volume_3.Centroid)
pt_2 = Point(item)
vec2pt = Vector2Pt(PointA=pt_2, PointB=pt, Unitize=False)  # -> Vector, Length
data_9 = Data(vec2pt.Vector)
data_10 = Data(data)
data_11 = Data(data_9)
cluster = Cluster(data=data_10)
cluster_2 = Cluster(data=data_11)
data_12 = Data(cluster)
data_13 = Data(cluster_2)
data_14 = Data(data_3)
data_15 = Data(data_4)
data_16 = Data(data_2)
data_17 = Data(data_8)
panel = Panel(data_12)
# [eccentricity]
# x
# y
# z
panel_2 = Panel(data_13)
# volume/ bb volume ratio
panel_3 = Panel(data_17)
panel_4 = Panel(data_15)
panel_5 = Panel(data_16)
# [second moment of inertia]
# Ixx
# Iyy
# Izy
# [brep topology]
# number of faces
# number of edges
# number of vertexs
panel_6 = Panel(data_14)

# ==== cluster Cluster
data = ClusterInput()
data_2 = Data(data)
pdecon = Deconstruct(Point=data_2)  # -> XComponent, YComponent, ZComponent
merge = Merge(Data1=pdecon.XComponent, Data2=pdecon.YComponent, Data3=pdecon.ZComponent)
data_3 = Data(merge)
data_4 = ClusterOutput(data_3)
