# Grasshopper definition backfit the city data.gh (Grasshopper 0.9.76)
# plug-ins: Python Interpreter, treesloth01, Human, Bifocals, LunchBox, MetaHopper, Owl.Accord.GH, Telepathy, Owl.GH

# Geometry In
dpipeline = DynamicGeometryPipeline(
    LayerFilter="*",
    TypeFilter="Mesh",
    NameFilter="*",
    enableFullPath=False,
    GroupByLayer=False,
    GroupByType=False,
    IncludeHidden=True,
    IncludeLocked=True,
    listenToAttriubtes=True)

# ---- group: create dodecahedron points
# Data Ingest
relpath = RelativePath(Path="dodecahedron.csv")
file = ReadFile(File=relpath, PerLineParse=True)
csv = ReadCSV(CSVString=file, Delimiter=",")  # -> Headers, Values
flip = FlipMatrix(Data=csv.Values)
item = ListItem(List=flip, Index="0", Wrap=True)
item_2 = ListItem(List=flip, Index="1", Wrap=True)
item_3 = ListItem(List=flip, Index="2", Wrap=True)
pt = ConstructPoint(XCoordinate=item, YCoordinate=item_2, ZCoordinate=item_3)

# ----
geo = Geometry(dpipeline)
objatts = ObjectAttributes(ObjectOrAttributes=geo)  # -> Name, LayerName, LayerFullPath, Color, MaterialName, LinetypeName, GroupIndices, PlotWeight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
sort = SortList(Keys=objatts.Name, ValuesA=geo)  # -> Keys, ValuesA
geometry_meshes = RemoteSender(sort.ValuesA)
geometry_meshes_2 = RemoteReceiver(geometry_meshes)
geo_2 = Geometry(geometry_meshes_2)
demesh = DeconstructMesh(Mesh=geo_2)  # -> Vertices, Faces, Colours, Normals
geometry_bins = RemoteSender(sort.Keys)
volume = Volume(Geometry=geo_2)  # -> Volume, Centroid
geo_3 = Geometry(demesh.Vertices)
color_groups_clusters = Button(ExpressionNormal="True")
dist = Distance(PointA=graft(volume.Centroid), PointB=geo_3)
ln = Line(StartPoint=graft(volume.Centroid), EndPoint=geo_3)
panel = Panel("""50
30
10
5""")
project = Project(Geometry=ln, Plane=PlaneXY(0, 0, 0))  # -> Geometry, Transform
move = Move(Geometry=pt, Motion=volume.Centroid)  # -> Geometry, Transform
cullpt = CullDuplicates(Points=move.Geometry, Tolerance=0.1, CullMode=3)  # -> Points, Indices, Valence
bbox = BoundingBox(Content=geo_2, Plane=PlaneXY(0, 0, 0))  # -> Box, Box_2
col = Colour([RGBA(4, 0, 255, 135), RGBA(0, 128, 255, 133), RGBA(210, 255, 148, 141), RGBA(255, 0, 0, 122), RGBA(224, 224, 224, 211)])
len = Length(Curve=project.Geometry)
flip_2 = FlipMatrix(Data=cullpt.Points)
debrep = DeconstructBrep(Brep=bbox.Box)  # -> Faces, Edges, Vertices

# ---- group: cpt
geo_4 = Geometry(volume.Centroid)

# ----
python = PythonScript(sphere_tree_in=flip_2, cpt_lst_in=geo_4, bound_srf_lst_in=debrep.Faces)  # -> ray_tree, header_lst; inputs sphere_tree_in: tree, cpt_lst_in: list, bound_srf_lst_in: tree
# ---------- python: Python ----------
import rhinoscriptsyntax as rs
import Rhino as rc
import scriptcontext as sc
#import ghpythonlib as gh
import Grasshopper as gh

""" Calculate View Factor

"""
class ViewFactor(object):
    def __init__(self):
        self.sphere_nested = []
        self.cpt = []
        self.bound_nested = []
        self.bld_num = None
        self.ray_num = None
        # Outputs
        self.raycast_distance = None
        self.raycast_pt_x = None
        self.raycast_pt_y = None
        self.raycast_pt_z = None

    def process_raw_inputs(self,sphere_tree_in,bound_srf_lst_in,cpt_lst_in):
        self.cpt = map(lambda c: rs.coerce3dpoint(c), cpt_lst_in)
        # convert tree to nested list of sphere pts
        for i in range(sphere_tree_in.BranchCount):
            branchList = sphere_tree_in.Branch(i)
            self.sphere_nested.append(branchList)

        # convert tree to nested list of bound srfs
        for i in range(bound_srf_lst_in.BranchCount):
            branchList = bound_srf_lst_in.Branch(i)
            branchList = map(lambda s: rs.coercebrep(s), branchList)
            self.bound_nested.append(branchList)

        # convert guids to rc points
        for i in xrange(len(self.sphere_nested)):
            sphere_per_bld = list(self.sphere_nested[i])
            for j in xrange(len(sphere_per_bld)):
                sphere_per_bld[j] = rs.coerce3dpoint(sphere_per_bld[j])
            self.sphere_nested[i] = sphere_per_bld

        self.bld_num = len(self.sphere_nested)
        self.ray_num = len(self.sphere_nested[0])

    def ray_cast(self):
        """
        base_vector
        direction_vector
        srf2int
        """
        self.ray_int_nested = []
        self.ray_dist_nested = []

        for i in xrange(self.bld_num):
            raypts = []
            raydist = []
            for j in xrange(self.ray_num):
                srf2int_lst = self.bound_nested[i]
                r0 = self.cpt[i] #base_vector
                r1 = self.sphere_nested[i][j] #direction_vector
                #convert pts to vectors
                r1 = rc.Geometry.Vector3d(r1) - rc.Geometry.Vector3d(r0)

                ray = rc.Geometry.Ray3d(r0,r1)
                point_intersect_lst = rc.Geometry.Intersect.Intersection.RayShoot(ray,srf2int_lst,1)
                if point_intersect_lst:
                    point_intersect_lst = list(point_intersect_lst)
                    rpt = point_intersect_lst[0]
                    raypts.append(rpt)
                    raydist.append(rs.Distance(rpt,r0))
                    #rc.Geometry.Vector3d.Multiply(
            self.ray_dist_nested.append(raydist)
            self.ray_int_nested.append(raypts)
        #print len(self.ray_int_nested)
    def generate_viewfactor_matrix(self):
        # flip the matrix
        self.raycast_distance = map(lambda r: [None] * self.ray_num, [None] * self.bld_num)

        self.raycast_x = map(lambda r: [None] * self.ray_num, [None] * self.bld_num)
        self.raycast_y = map(lambda r: [None] * self.ray_num, [None] * self.bld_num)
        self.raycast_z = map(lambda r: [None] * self.ray_num, [None] * self.bld_num)
        self.ray_mtx = []

        self.header_lst = []
        for ri in xrange(self.ray_num):
            hstr = "RAY_{b}_".format(b=ri)
            self.header_lst.extend([hstr+"dist",hstr+"x",hstr+"y",hstr+"z"])
        print len(self.header_lst)
        print self.header_lst
        for i in xrange(self.bld_num):
            self.bld_lst = []
            for j in xrange(self.ray_num):
                d = self.ray_dist_nested[i][j]
                x = self.ray_int_nested[i][j][0]
                y = self.ray_int_nested[i][j][1]
                z = self.ray_int_nested[i][j][2]

                self.bld_lst.extend([d,x,y,z])

                #self.ray_dist_nested[i][j]
                #self.raycast_distance[i][j]
            self.ray_mtx.append(self.bld_lst)
    def pythonListTGhDataTree(self,pythonList):
        """ Converts a  nested Python list to a GH datatree """
        # Create GH datatree
        dataTree = gh.DataTree[object]()

        # Add pythonlist sub lists to dataTree
        for i,l in enumerate(pythonList):
            for v in l:
                dataTree.Add(v,gh.Kernel.Data.GH_Path(i))

        return dataTree
vf = ViewFactor()
vf.process_raw_inputs(sphere_tree_in, bound_srf_lst_in, cpt_lst_in)
vf.ray_cast()
vf.generate_viewfactor_matrix()

header_lst = vf.header_lst
ray_tree = vf.pythonListTGhDataTree(vf.ray_mtx)
#header_tree
print len(vf.ray_mtx)
print len(vf.bld_lst)

#sphere_out = vf.sphere_nested
#cpt_out = vf.cpt




ray_out = reduce(lambda x,y: x+y, vf.ray_int_nested)
# ---------- end python ----------

# ---- group: find farthest vertex
sort_2 = SortList(Keys=len, ValuesA=geo_3, ValuesB=ln, ValuesC=project.Geometry)  # -> reverse(Keys), reverse(ValuesA), reverse(ValuesB), reverse(ValuesC)
item_4 = ListItem(List=sort_2.ValuesA, Index=0, Wrap=True)
len_2 = Length(Curve=sort_2.ValuesB)

# ----
analysis_geo = RemoteSender()
item_5 = ListItem(List=sort_2.ValuesB, Index=0, Wrap=True)
path_mapper = PathMapper(python.ray_tree, source="{A}", target="{0;A}")

# ---- group: vertexDistanceMean
avr = Average(Input=len_2)

# ----
expression = Expression(x=avr, y=len_2, Expression="Abs(x-y)")
avr_2 = Average(Input=expression)
panel_2 = Panel("""vertexXvect
vertexYvect""")
panel_3 = Panel(avr_2)
panel_4 = Panel("""Box Angles
UV Access
"Wartyness"
""")
merge = Merge(Data1="vertexDistanceMean", Data2="vertexFarthestDistance", Data3=panel_2)
merge_2 = Merge(Data1=avr, Data2=item_4)
path_mapper_2 = PathMapper(merge, source="{A}", target="{0;A}")
merge_3 = Merge(Data1=path_mapper_2, Data2=python.header_lst)  # -> simplify(Result)
merge_4 = Merge(Data1=merge_2, Data2=path_mapper)  # -> simplify(Result)
shift = ShiftPaths(Data=merge_3, Offset=-1)
# Generally Convex
# Tall versus Stout
# Compactness Score
# Directionality
features_names_viewfactor = RemoteSender(shift)
features_values_viewfactor = RemoteSender(merge_4)

# ---- group: Classification
# Analysis Stuffs
data = Data()

# ----
flip_3 = FlipMatrix()
shape_type = Data(data)
flip_4 = FlipMatrix()
merge_5 = Merge(Data1=flip_4, Data2=flip_3)
subtraction = Subtraction(B=1)
bnd = Bounds(Numbers=merge_5)
remap = RemapNumbers(Value=flip_3, Source=bnd, Target=Domain(0, 1))  # -> Mapped, Clipped
remap_2 = RemapNumbers(Value=flip_4, Source=bnd, Target=Domain(0, 1))  # -> Mapped, Clipped
remap_3 = RemapNumbers(Value=shape_type, Source=subtraction, Target=Domain(0, 1))  # -> Mapped, Clipped
flip_5 = FlipMatrix(Data=remap_2.Mapped)
flip_6 = FlipMatrix(Data=remap.Mapped)
panel_5 = Panel("""30
1""")
# ML Action
lng = ListLength()
merge_6 = Merge(Data1=lng, Data2=panel_5)
datatree_to_tensorset = DataTreeToTensorSet(DataTree=flip_6)  # "DT->TS"
datatree_to_tensorset_2 = DataTreeToTensorSet(DataTree=flip_5)  # "DT->TS"
featurets = FeatureTensorSet(Feature0=flatten(remap_3.Mapped))
panel_6 = Panel(merge_6)
panel_7 = Panel(flip_6)
network = ConstructNetwork(Layers=panel_6, Activation=1, Alpha=1, Seed=Slider(100, range=0..100))
backprop = Backpropagation(
    ActivationNetwork=network,
    Input=datatree_to_tensorset_2,
    Output=featurets,
    LearningRate=0.01,
    Momentum=0.001,
    Epoch=10,
    Iterations=Slider(10000, range=0..10000))  # -> ActivationNetwork, Error
# Visualization of Results
_2dpreview = NetworkPreview(Network=backprop.ActivationNetwork, Lines=Domain(1, 5), Radius=5)
compute = Compute(ActivationNetwork=backprop.ActivationNetwork, Input=datatree_to_tensorset)
detset = DeconstructTensorSet(TensorSet=compute)
detensor = DeconstructTensor(Tensor=detset)
tsview = TensorSetDisplay(TensorSet=detset, Range=Domain(0, 1))
remap_4 = RemapNumbers(Value=detensor, Source=Domain(0, 1), Target=subtraction)  # -> Mapped, Clipped
analysis_geo_2 = RemoteReceiver(flatten(analysis_geo))
col_2 = Colour()
round = Round(Number=remap_4.Mapped)  # -> Nearest, Floor, Ceiling
item_6 = ListItem(List=flatten(col_2), Index=round.Nearest, Wrap=True)  # -> flatten(Item)
panel_8 = Panel(round.Nearest)
preview = CustomPreview(Geometry=analysis_geo_2, Shader=item_6)

# ----
# ToolDescription: Enter a description of this definition's functionality and use
update_file_info = Button()
group_prefixes = Panel("""out_
in_
action_
warning_
cluster""")
c_script = CSharpScript(update=color_groups_clusters, name=group_prefixes, col=col)  # -> out, A; inputs update: Boolean, name: list of String, col: list of Color
# ---------- c_script: C# ----------
    Color clusterColor = Color.Transparent;
    for(int i = 0;i < name.Count;i++){
      if(name[i].Contains("cluster")){
        clusterColor = col[i];
        break;
      }
    }



    if(update){
      List<Guid> guids = new List<Guid>();
      List<Grasshopper.Kernel.Special.GH_Group> grps = new List<Grasshopper.Kernel.Special.GH_Group>();
      List<Grasshopper.Kernel.Special.GH_Group> alreadygrps = new List<Grasshopper.Kernel.Special.GH_Group>();


      foreach(IGH_DocumentObject o in GrasshopperDocument.Objects){
        Grasshopper.Kernel.Special.GH_Group g = o as Grasshopper.Kernel.Special.GH_Group;
        if(g != null){
          for(int j = 0;j < name.Count;j++){
            if(g.NickName.ToUpper().Contains(name[j].ToUpper())){
              g.Colour = col[j % col.Count];
            }

          }
        }


        if(o is Grasshopper.Kernel.Special.GH_Cluster){
          Grasshopper.Kernel.Special.GH_Cluster cluster = o as  Grasshopper.Kernel.Special.GH_Cluster;
          string filepath = cluster.FilePath;
          if(!String.IsNullOrEmpty(filepath)){
            cluster.Name = System.IO.Path.GetFileNameWithoutExtension(filepath);
            cluster.NickName = System.IO.Path.GetFileNameWithoutExtension(filepath);
            cluster.Attributes.ExpireLayout();
          }
          guids.Add(cluster.InstanceGuid);
          Grasshopper.Kernel.Special.GH_Group grp = new Grasshopper.Kernel.Special.GH_Group();
          grps.Add(grp);

        } else if (o is Grasshopper.Kernel.Special.GH_Group){
          Grasshopper.Kernel.Special.GH_Group alreadygrp = o as Grasshopper.Kernel.Special.GH_Group;
          alreadygrps.Add(alreadygrp);
        }





      }

      List<bool> isAlreadyInGroup = IsAlreadyInGroup(guids, alreadygrps);

      for(int i = 0;i < grps.Count;i++){
        Grasshopper.Kernel.Special.GH_Group grp = grps[i];
        grp.Colour = clusterColor;
        grp.NickName = "";
        grp.AddObject(guids[i]);
        if(!isAlreadyInGroup[i]){
          grp.ExpireCaches();
          GrasshopperDocument.AddObject(grp, false, 1000);
        }
      }



    }
# ---------- c_script: C# additional code ----------
  List<bool> IsAlreadyInGroup(List<Guid> guids, List<Grasshopper.Kernel.Special.GH_Group> grps){
    List<bool> results = new List<bool>();
    foreach(Guid g in guids){
      results.Add(false);
    }
    foreach(Grasshopper.Kernel.Special.GH_Group grp in grps){ //for every group in the pre-existing groups
      if(grp.Objects().Count == 1){ //if that group only has one object in it
        for (int j = 0;j < guids.Count;j++){
          Guid g = guids[j];
          if(grp.ObjectIDs.Contains(g)){
            results[j] = true;
            break;
          }
        }
      }
    }
    return results;
  }
# ---------- end c_script ----------

data_2 = Data(update_file_info)

c_script_2 = CSharpScript(x=data_2)  # -> out, A, B, C, D, E
# ---------- c_script_2: C# ----------
    List < IGH_DocumentObject> objectsRecursive = new List<IGH_DocumentObject>();
    objectsRecursive.AddRange(clusterObjectsRecursive(GrasshopperDocument));


    B = GrasshopperDocument.Author.Name + " " + GrasshopperDocument.Author.Email;
    D = GrasshopperDocument.Properties.DateTag;
    if(GrasshopperDocument.IsFilePathDefined){
      C = GrasshopperDocument.FilePath;
      System.IO.FileInfo info = new System.IO.FileInfo(GrasshopperDocument.FilePath);
      if(info.LastWriteTime != null){
        E = info.LastWriteTime;
      } else {
        E = "";
      }
    } else {
      C = "Unsaved Document";
      E = "";
    }
    A = objectsRecursive;
# ---------- c_script_2: C# additional code ----------
  List<IGH_DocumentObject> clusterObjectsRecursive(GH_Document doc){
    List<IGH_DocumentObject> objList = new List<IGH_DocumentObject>();
    objList.AddRange(doc.Objects);
    foreach(IGH_DocumentObject obj in doc.Objects){
      Grasshopper.Kernel.Special.GH_Cluster cluster = obj as Grasshopper.Kernel.Special.GH_Cluster;
      try{
        objList.AddRange(clusterObjectsRecursive(cluster.Document("")));
      } catch {

      }
    }
    return objList;
  }
# ---------- end c_script_2 ----------
cluster = Cluster_2(T=c_script_2.A, N=c_script_2.B, fn=c_script_2.C, dc=c_script_2.D, dm=c_script_2.E)
file_info = Panel(cluster)

# ==== cluster Cluster_2
T = ClusterInput()
N = ClusterInput()
fn = ClusterInput()
dc = ClusterInput()
dm = ClusterInput()
cluster = Cluster(T=T, N=N, fn=fn, dc=dc, dm=dm)  # -> T_2, author_2, objcount_2, fn_3, dc_4, dm_4
merge = Merge(
    Data1=cluster.author_2,
    Data2=cluster.T_2,
    Data3=cluster.objcount_2,
    Data4=cluster.fn_3,
    Data5=cluster.dc_4,
    Data6=cluster.dm_4)
R = ClusterOutput(merge)

# ==== cluster Cluster
N = ClusterInput()
T = ClusterInput()
N_2 = Text(N)
split = TextSplit(Text=T, Separators=".")
fn = ClusterInput()
dm = ClusterInput()
item = ListItem(List=split, Index=0, Wrap=True)
dc = ClusterInput()
pan = Panel("""HDT_Reference
HDTReference""")
pan_2 = Panel("""Human
Human""")
lng = ListLength(List=T)
len = TextLength(Text=N_2)
contains = ContainsAB(B=N_2)
dm_2 = Text(dm)
dc_2 = Text(dc)
fn_2 = Text(fn)
replace = ReplaceMembers(Set=item, Find=pan, Replace=pan_2)
cset = CreateSet(List=flatten(replace))  # -> Set, Map
txt = Text(["ScriptComponents", "Grasshopper", "MathComponents", "GalapagosComponents", "FieldComponents", "VectorComponents", "AnalysisComponents", "CurveComponents", "LegacyScriptComponents", "SurfaceComponents", "TriangulationComponents", "MassXForms", "LinearXForms"])
format = Format(Format="Definition by {0}", Culture=127, Data0=N_2)
difference = SetDifference(SetA=cset.Set, SetB=txt)
lng_2 = ListLength(List=flatten(difference))
dispatch = Dispatch(List=format, DispatchPattern=contains)  # -> ListA, ListB
format_2 = Format(Format="Object Count: {0:0}", Culture=127, Data0=lng)
format_3 = Format(Format="Date Modified: {0}", Culture=127, Data0=dm_2)
format_4 = Format(Format="Date Created: {0}", Culture=127, Data0=dc_2)
dependencies = Text(flatten(difference))
author = Text(flatten(dispatch.ListB))
larger = LargerThan(FirstNumber=lng_2, SecondNumber="1")  # -> LargerThan, OrEqualTo
objcount = Text(flatten(format_2))
author_2 = ClusterOutput(author)
dm_3 = Text(flatten(format_3))
fn_3 = ClusterOutput(fn_2)
dc_3 = Text(flatten(format_4))
objcount_2 = ClusterOutput(objcount)
dc_4 = ClusterOutput(dc_3)
filter = StreamFilter(
    Gate=larger.LargerThan,
    Stream0="This definition requires the following plug-in:",
    Stream1="This definition requires the following plug-ins:")
dm_4 = ClusterOutput(dm_3)
pan_3 = Panel("""{0}
{1}""")
join = TextJoin(Text=dependencies)
format_5 = Format(Format=pan_3, Culture=127, Data0=filter, Data1=join)
clean = CleanTree(Tree=format_5, CleanInvalid=True, CleanEmpty=False)
T_2 = ClusterOutput(clean)

# ==== cluster ContainsAB: Tests if a string contains another string.
B = ClusterInput()
A = ClusterInput()
A_2 = String(A)
B_2 = String(B)
eval = Evaluate(F="Contains(x,y)", x=A_2, y=B_2)
c = Boolean(eval)
c_2 = ClusterOutput(c)
