# Grasshopper definition Viewfactor.ghx (Grasshopper 0.9.76)
# plug-ins: Python Interpreter, LunchBox, MetaHopper, TT Toolbox, Telepathy

geometry = GeometryPipeline(
    GroupByLayer=False,
    GroupByType=False,
    IncludeHidden=True,
    IncludeLocked=True,
    LayerFilter="Geometry",
    NameFilter="*",
    TypeFilter=1073741880)
geoattrib = GetGeometryAttributes(Geometry=geometry)  # -> GeometryNames, GUID, Layer
geometry_meshes = RemoteSender(geometry)
geometry_bins = RemoteSender(geoattrib.GeometryNames)
geometry_meshes_2 = RemoteReceiver(geometry_meshes)
geometry_bins_2 = RemoteReceiver(geometry_bins)
geo = Geometry(geometry_meshes_2)

# ---- group: create dodecahedron points
relpath = RelativePath(Path="dodecahedron.csv")
file = ReadFile(File=relpath, PerLineParse=True)
csv = ReadCSV(CSVString=file, Delimiter=",")  # -> Headers, Values
flip = FlipMatrix(Data=csv.Values)
item = ListItem(List=flip, Index="0", Wrap=True)
item_2 = ListItem(List=flip, Index="1", Wrap=True)
item_3 = ListItem(List=flip, Index="2", Wrap=True)
pt = ConstructPoint(XCoordinate=item, YCoordinate=item_2, ZCoordinate=item_3)

# ----
demesh = DeconstructMesh(Mesh=geo)  # -> Vertices, Faces, Colours, Normals
volume = Volume(Geometry=geo)  # -> Volume, Centroid
geo_2 = Geometry(demesh.Vertices)
move = Move(Geometry=pt, Motion=volume.Centroid)  # -> Geometry, Transform
cullpt = CullDuplicates(Points=move.Geometry, Tolerance=0.1, CullMode=3)  # -> Points, Indices, Valence
bbox = BoundingBox(Content=geo, Plane=PlaneXY(0, 0, 0))  # -> Box, Box_2
dist = Distance(PointA=volume.Centroid, PointB=geo_2)
flip_2 = FlipMatrix(Data=cullpt.Points)
debrep = DeconstructBrep(Brep=bbox.Box)  # -> Faces, Edges, Vertices

# ---- group: cpt
geo_3 = Geometry(volume.Centroid)

# ----
python = PythonScript(sphere_tree_in=flip_2, cpt_lst_in=geo_3, bound_srf_lst_in=debrep.Faces)  # -> ray_tree, header_lst; inputs sphere_tree_in: tree, cpt_lst_in: list, bound_srf_lst_in: tree
# ---------- python: Python ----------
import rhinoscriptsyntax as rs
import Rhino as rc
import scriptcontext as sc
#import ghpythonlib as gh
import Grasshopper as gh

""" Calculate View Factor

"""
class ViewFactor(object):
    def __init__(self):
        self.sphere_nested = []
        self.cpt = []
        self.bound_nested = []
        self.bld_num = None
        self.ray_num = None
        # Outputs
        self.raycast_distance = None
        self.raycast_pt_x = None
        self.raycast_pt_y = None
        self.raycast_pt_z = None

    def process_raw_inputs(self,sphere_tree_in,bound_srf_lst_in,cpt_lst_in):
        self.cpt = map(lambda c: rs.coerce3dpoint(c), cpt_lst_in)
        # convert tree to nested list of sphere pts
        for i in range(sphere_tree_in.BranchCount):
            branchList = sphere_tree_in.Branch(i)
            self.sphere_nested.append(branchList)

        # convert tree to nested list of bound srfs
        for i in range(bound_srf_lst_in.BranchCount):
            branchList = bound_srf_lst_in.Branch(i)
            branchList = map(lambda s: rs.coercebrep(s), branchList)
            self.bound_nested.append(branchList)

        # convert guids to rc points
        for i in xrange(len(self.sphere_nested)):
            sphere_per_bld = list(self.sphere_nested[i])
            for j in xrange(len(sphere_per_bld)):
                sphere_per_bld[j] = rs.coerce3dpoint(sphere_per_bld[j])
            self.sphere_nested[i] = sphere_per_bld

        self.bld_num = len(self.sphere_nested)
        self.ray_num = len(self.sphere_nested[0])

    def ray_cast(self):
        """
        base_vector
        direction_vector
        srf2int
        """
        self.ray_int_nested = []
        self.ray_dist_nested = []

        for i in xrange(self.bld_num):
            raypts = []
            raydist = []
            for j in xrange(self.ray_num):
                srf2int_lst = self.bound_nested[i]
                r0 = self.cpt[i] #base_vector
                r1 = self.sphere_nested[i][j] #direction_vector
                #convert pts to vectors
                r1 = rc.Geometry.Vector3d(r1) - rc.Geometry.Vector3d(r0)

                ray = rc.Geometry.Ray3d(r0,r1)
                point_intersect_lst = rc.Geometry.Intersect.Intersection.RayShoot(ray,srf2int_lst,1)
                if point_intersect_lst:
                    point_intersect_lst = list(point_intersect_lst)
                    rpt = point_intersect_lst[0]
                    raypts.append(rpt)
                    raydist.append(rs.Distance(rpt,r0))
                    #rc.Geometry.Vector3d.Multiply(
            self.ray_dist_nested.append(raydist)
            self.ray_int_nested.append(raypts)
        #print len(self.ray_int_nested)
    def generate_viewfactor_matrix(self):
        # flip the matrix
        self.raycast_distance = map(lambda r: [None] * self.ray_num, [None] * self.bld_num)

        self.raycast_x = map(lambda r: [None] * self.ray_num, [None] * self.bld_num)
        self.raycast_y = map(lambda r: [None] * self.ray_num, [None] * self.bld_num)
        self.raycast_z = map(lambda r: [None] * self.ray_num, [None] * self.bld_num)
        self.ray_mtx = []

        self.header_lst = []
        for ri in xrange(self.ray_num):
            hstr = "RAY_{b}_".format(b=ri)
            self.header_lst.extend([hstr+"dist",hstr+"x",hstr+"y",hstr+"z"])
        print len(self.header_lst)
        print self.header_lst
        for i in xrange(self.bld_num):
            self.bld_lst = []
            for j in xrange(self.ray_num):
                d = self.ray_dist_nested[i][j]
                x = self.ray_int_nested[i][j][0]
                y = self.ray_int_nested[i][j][1]
                z = self.ray_int_nested[i][j][2]

                self.bld_lst.extend([d,x,y,z])

                #self.ray_dist_nested[i][j]
                #self.raycast_distance[i][j]
            self.ray_mtx.append(self.bld_lst)
    def pythonListTGhDataTree(self,pythonList):
        """ Converts a  nested Python list to a GH datatree """
        # Create GH datatree
        dataTree = gh.DataTree[object]()

        # Add pythonlist sub lists to dataTree
        for i,l in enumerate(pythonList):
            for v in l:
                dataTree.Add(v,gh.Kernel.Data.GH_Path(i))

        return dataTree
vf = ViewFactor()
vf.process_raw_inputs(sphere_tree_in, bound_srf_lst_in, cpt_lst_in)
vf.ray_cast()
vf.generate_viewfactor_matrix()

header_lst = vf.header_lst
ray_tree = vf.pythonListTGhDataTree(vf.ray_mtx)
#header_tree
print len(vf.ray_mtx)
print len(vf.bld_lst)

#sphere_out = vf.sphere_nested
#cpt_out = vf.cpt




ray_out = reduce(lambda x,y: x+y, vf.ray_int_nested)
# ---------- end python ----------

# ---- group: find farthest vertex
sort = SortList(Keys=dist)  # -> Keys, ValuesA
rev = ReverseList(List=sort.Keys)
item_4 = ListItem(List=rev, Index=0, Wrap=True)

# ---- group: vertexDistanceMean
avr = Average(Input=dist)

# ----
path_mapper = PathMapper(python.ray_tree, source="{A}", target="{0;A}")

mindex = MemberIndex(Set=dist, Member=item_4)  # -> Index, Count
item_5 = ListItem(List=mindex.Index, Index=0, Wrap=True)
item_6 = ListItem(List=geo_2, Index=item_5, Wrap=True)
pdecon = Deconstruct(Point=item_6)  # -> simplify(XComponent), simplify(YComponent), simplify(ZComponent)

path_mapper_2 = PathMapper(pdecon.XComponent, source="{A}", target="{0;A}")
path_mapper_3 = PathMapper(pdecon.YComponent, source="{a}", target="{0;a}")
path_mapper_4 = PathMapper(pdecon.ZComponent, source="{a}", target="{0;a}")
merge = Merge(
    Data1="vertexDistanceMean",
    Data2="vertexFarthestDistance",
    Data3="vertexFarthestX",
    Data4="vertexFarthestY",
    Data5="vertexFarthestZ")
merge_2 = Merge(Data1=avr, Data2=item_4, Data3=path_mapper_2, Data4=path_mapper_3, Data5=path_mapper_4)
path_mapper_5 = PathMapper(merge, source="{A}", target="{0;A}")
merge_3 = Merge(Data1=path_mapper_5, Data2=python.header_lst)
merge_4 = Merge(Data1=merge_2, Data2=path_mapper)
features_names_viewfactor = RemoteSender(merge_3)
features_values_viewfactor = RemoteSender(merge_4)
