# Grasshopper definition isosurface2.gh (Grasshopper 0.9.76)
# plug-ins: Dodo

brep = Brep(<brep referenced from the Rhino model>)
box = Box(brep)
box_corners = BoxCorners(Box=box)  # -> CornerA, CornerB, CornerC, CornerD, CornerE, CornerF, CornerG, CornerH
merge = Merge(Data1=box_corners.CornerA, Data2=box_corners.CornerB, Data3=box_corners.CornerC, Data4=box_corners.CornerD)
merge_2 = Merge(Data1=box_corners.CornerD, Data2=box_corners.CornerC, Data3=box_corners.CornerG, Data4=box_corners.CornerH)
pline = PolyLine(Vertices=merge, Closed=False)
pline_2 = PolyLine(Vertices=merge_2, Closed=False)
number_slider = Slider(200, range=0..1000)
rec = Rectangle(pline)
rec_2 = Rectangle(pline_2)
img = ImportImage(
    File="C:\Users\Public\Pictures\Sample Pictures\Jellyfish.jpg",
    Rectangle=rec,
    XSamples=number_slider,
    YSamples=number_slider)
img_2 = ImportImage(File="C:\Users\Lorenzo\Desktop\vangogh5.jpg", Rectangle=rec_2, XSamples=number_slider, YSamples=number_slider)
number_slider_2 = Slider(20, range=0..100)
number_slider_3 = Slider(1, range=0..1)
number_slider_4 = Slider(0, range=0..1)
random = Random(Range=Domain(-1, 1), Number=number_slider_2, Seed=2)
number_slider_5 = Slider(0.8, range=0..1)
number_slider_6 = Slider(6, range=0..10)
pt = Point(<point referenced from the Rhino model>)
pop3d = Populate3D(Region=box, Count=number_slider_2, Seed=1)
pcharge = PointCharge(Point=pop3d, Charge=random, Decay=2)  # disabled
imagecharge = ImageCharge(Mesh=img, Charge=number_slider_6, Decay=number_slider_4)
imagecharge_2 = ImageCharge(Mesh=img_2, Charge=number_slider_6, Decay=number_slider_4)
mergef = MergeFields(Fields=flatten([imagecharge_2, pcharge, imagecharge]))
evf = EvaluateField(Field=mergef, Point=pt)  # -> Tensor, Strength
panel = Panel(evf.Tensor)
panel_2 = Panel(evf.Strength)
voxels = Voxels(Box=box, Number=Slider(60, range=0..100), F=mergef)
mt = MarchingTetrahedra(Voxels=voxels, Isolevel=Slider(3.01, range=0..10), TetrahedraCubes=Toggle(False))
