# Grasshopper definition kdtree.gh (Grasshopper 0.9.76)
# plug-ins: Dodo

brep = Brep(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)
pop3d = Populate3D(Region=brep, Count=100, Seed=1)
wires = BrepWireframe(Brep=brep, Density=-1)
pdecon = Deconstruct(Point=pop3d)  # -> XComponent, YComponent, ZComponent
lng = ListLength(List=pop3d)
entwine = Entwine(Branch00=pdecon.XComponent, Branch01=pdecon.YComponent, Branch02=pdecon.ZComponent, FlattenInputs=True)
flip = FlipMatrix(Data=entwine)  # -> simplify(Data)
series = Series(Start=0, Step=1, Count=lng)
lng_2 = ListLength(List=flip)
item = ListItem(List=flatten(lng_2), Index=0, Wrap=True)
graft = GraftTree(Tree=series, IncludeEmptyLists=True, IncludeNullItems=True)
conkdnode = ConstructKDNode(Coordinates=flip, Object=graft)  # -> flatten(HPointVal)
conkdtree = ConstructKDTree(HPointVal=conkdnode)
number_slider = Slider(20, range=0..100)
branch = TreeBranch(Tree=flip, Path=Slider(0, range=0..100), MaintainPaths=True)
neg = Negative(Value=number_slider)
repeat = RepeatData(Data=number_slider, Length=item)
repeat_2 = RepeatData(Data=neg, Length=item)
conkdnode_2 = ConstructKDNode(Coordinates=branch)  # -> flatten(HPointVal)
conkdnode_3 = ConstructKDNode(Coordinates=repeat_2)  # -> flatten(HPointVal)
conkdnode_4 = ConstructKDNode(Coordinates=repeat)  # -> flatten(HPointVal)
pt = Point(conkdnode_2)
num = Number(number_slider)
box = Box2Pt(PointA=conkdnode_3, PointB=conkdnode_4, Plane=PlaneXY(0, 0, 0))
box_2 = CenterBox(Base=pt, X=num, Y=num, Z=num)
nearkdnnum = NearestNeighoboursNumber(KDTree=conkdtree, HPointVal=conkdnode_2, Neighbours=Slider(8, range=0..10))
nearkdnnum_2 = NearestNeighboursDistance(KDTree=conkdtree, HiperPoint=pt, Distance=conkdnode_4)
nearkdncube = NearestNeighoboursHypercube(KDTree=conkdtree, LowerCorner=conkdnode_3, UpperCorner=conkdnode_4)
number_slider_2 = Slider(2.2, range=0..10)
deconkdnode = DeconstructKDNode(HPointVal=nearkdnnum)  # -> Coordinates, Object
item_2 = ListItem(Index=0, Wrap=True)
item_3 = ListItem(List=deconkdnode.Coordinates, Index=0, Wrap=True)  # -> Item, Item1, Item2
deconkdnode_2 = DeconstructKDNode(HPointVal=nearkdnnum_2)  # -> Coordinates, Object
deconkdnode_3 = DeconstructKDNode(HPointVal=nearkdncube)  # -> Coordinates, Object
pt_2 = ConstructPoint(XCoordinate=item_3.Item, YCoordinate=item_3.Item1, ZCoordinate=item_3.Item2)
item_4 = ListItem(List=deconkdnode_2.Coordinates, Index=0, Wrap=True)  # -> Item, Item1, Item2
item_5 = ListItem(List=deconkdnode_3.Coordinates, Index=0, Wrap=True)  # -> Item, Item1, Item2
item_6 = ListItem(List=branch, Index=0, Wrap=True)  # -> Item, Item1, Item2
sph = Sphere(Base=pt_2, Radius=number_slider_2)
pt_3 = ConstructPoint(XCoordinate=item_4.Item, YCoordinate=item_4.Item1, ZCoordinate=item_4.Item2)
pt_4 = ConstructPoint(XCoordinate=item_5.Item, YCoordinate=item_5.Item1, ZCoordinate=item_5.Item2)
pt_5 = ConstructPoint(XCoordinate=item_6.Item, YCoordinate=item_6.Item1, ZCoordinate=item_6.Item2)
panel = Panel(pt_2)
cull_i = CullIndex(List=flatten(sph), Indices=0, Wrap=True)
sph_2 = Sphere(Base=pt_3, Radius=number_slider_2)
sph_3 = Sphere(Base=pt_4, Radius=number_slider_2)
sph_4 = Sphere(Base=pt_5, Radius=Slider(3.6, range=0..10))
cull_i_2 = CullIndex(List=flatten(sph_2), Indices=0, Wrap=True)
cull_i_3 = CullIndex(List=flatten(sph_3), Indices=0, Wrap=True)

pt_6 = Point(pop3d)
preview = CustomPreview(Geometry=sph_4, Shader=ColourSwatch(SwatchColor=RGB(168, 168, 168)))
preview_2 = CustomPreview(Geometry=cull_i, Shader=ColourSwatch(SwatchColor=RGB(255, 0, 0)))
preview_3 = CustomPreview(Geometry=cull_i_2, Shader=ColourSwatch(SwatchColor=RGB(77, 255, 0)))
preview_4 = CustomPreview(Geometry=cull_i_3, Shader=ColourSwatch(SwatchColor=RGB(47, 0, 255)))
