# Grasshopper definition nn SOM learning.gh (Grasshopper 0.9.76)
# plug-ins: Dodo

number_slider = Slider(20, range=0..100)
number_slider_2 = Slider(20, range=0..100)
number_slider_3 = Slider(0, range=0..100)
number_slider_4 = Slider(1, range=0..1)
dom = Domain(DomainStart=number_slider_3, DomainEnd=number_slider_4)
dom_2 = Domain(DomainStart=number_slider_3, DomainEnd=number_slider_4)
range = Range(Domain=dom, Steps=number_slider)
range_2 = Range(Domain=dom_2, Steps=number_slider_2)
pt = ConstructPoint(XCoordinate=range, YCoordinate=graft(range_2), ZCoordinate=0)  # -> flatten(Point)
image = ImageSampler(
    pt,
    FilePath="C:\Users\Lorenzo\Pictures\vlcsnap-2014-05-10-11h34m44s149.png",
    Filter="Colour",
    Interpolate=False,
    Umax=1,
    Umin=0,
    Vmax=1,
    Vmin=0,
    Wrap=0)
image_2 = ImageSampler(
    pt,
    FilePath="C:\Users\Lorenzo\Pictures\lore.png",
    Filter="Colour",
    Interpolate=False,
    Umax=1,
    Umin=0,
    Vmax=1,
    Vmin=0,
    Wrap=0)
split = TextSplit(Text=image_2, Separators=",")  # -> simplify(Result)
split_2 = TextSplit(Text=image, Separators=",")  # -> simplify(Result)
flip = FlipMatrix(Data=split)
flip_2 = FlipMatrix(Data=split_2)
unsuptrainnn = UnsupervisedTrainNeuralNetwork(Data=split)
unsuptrainnn_2 = UnsupervisedTrainNeuralNetwork(Data=split_2)
int = Integer(295)
int_2 = Integer(5)
int_3 = Integer(395)
int_4 = Integer(5)
panel = Panel(unsuptrainnn_2)
panel_2 = Panel(unsuptrainnn)
subtraction = Subtraction(A=int, B=int_2)
subtraction_2 = Subtraction(A=int_3, B=int_4)
runnn = RunNN(NeuralNetwork=unsuptrainnn_2, Data=split)  # -> Data, Weights, Threshold
runnn_2 = RunNN(NeuralNetwork=unsuptrainnn, Data=flip_2)  # -> Data, Weights, Threshold
multiplication = Multiplication(A=subtraction, B=range)
multiplication_2 = Multiplication(A=subtraction_2, B=range_2)
panel_3 = Panel(runnn.Weights)
pt_2 = ConstructPoint(XCoordinate=multiplication, YCoordinate=graft(multiplication_2), ZCoordinate=0)  # -> flatten(Point)
lng = ListLength(List=runnn.Weights)  # -> flatten(Length)
lng_2 = ListLength(List=lng)  # -> flatten(Length)
sqrt = SquareRoot(Value=lng_2)
series = Series(Start=0, Step=1, Count=sqrt)
pt_3 = ConstructPoint(XCoordinate=series, YCoordinate=graft(series), ZCoordinate=0)  # -> flatten(Point)
cluster = Cluster(P=pt_3, U=sqrt, V=sqrt, L=runnn.Weights)
cluster_2 = Cluster(P=pt_2, U=expr("x+1", number_slider), V=expr("x+1", number_slider_2), L=runnn.Data)
cluster_3 = Cluster(P=pt_2, U=expr("x+1", number_slider), V=expr("x+1", number_slider_2), L=runnn_2.Data)

# ==== cluster Cluster
L = ClusterInput()
item = ListItem(List=L, Index=0, Wrap=True)  # -> Item, Item1, Item2
rgb = ColourRGB(Alpha=255, Red=item.Item, Green=item.Item1, Blue=item.Item2)
P = ClusterInput()
U = ClusterInput()
V = ClusterInput()
frompoints = MeshFromPoints(Points=P, UDirection=U, VDirection=V, Colour=flatten(rgb))
