# Grasshopper definition nn approximation.gh (Grasshopper 0.9.76)
# plug-ins: Dodo

panel = Panel("""0
4
7
9
10
9
7
4
0""")
panel_2 = Panel("""1
2
3
4
5
6
7
8
9""")
panel_3 = Panel("""1
1.5
2.5
4
6
8.5
11.5
15""")
panel_4 = Panel("""1
2
3
4
5
6
7
8""")
graft = GraftTree(Tree=panel_2, IncludeEmptyLists=True, IncludeNullItems=True)
graft_2 = GraftTree(Tree=panel, IncludeEmptyLists=True, IncludeNullItems=True)
number_slider = Slider(1000, range=0..1000)
number_slider_2 = Slider(1000, range=0..1000)
graft_3 = GraftTree(Tree=panel_3, IncludeEmptyLists=True, IncludeNullItems=True)
graft_4 = GraftTree(Tree=panel_4, IncludeEmptyLists=True, IncludeNullItems=True)
trainnn = TrainNeuralNetwork(D=graft, O=graft_2)
trainnn_2 = TrainNeuralNetwork(D=graft_4, O=graft_3)
one_over_x = OneOverX(Value=number_slider)
one_over_x_2 = OneOverX(Value=number_slider_2)
# Neurons per Layer: 20
# Layers: 1
# Approximation
panel_5 = Panel(trainnn_2)
panel_6 = Panel(trainnn)
series = Series(Start=0, Step=one_over_x, Count=number_slider)
series_2 = Series(Start=0, Step=one_over_x_2, Count=number_slider_2)
number_slider_3 = Slider(7, range=0..10)
number_slider_4 = Slider(7, range=0..10)
multiplication = Multiplication(A=series, B=9)
multiplication_2 = Multiplication(A=series_2, B=9)
fsim = FindSimilarMember(Data=number_slider_3, Set=panel_4)  # -> Hit, Index
nickname = GH_RunNN(NeuralNetwork=trainnn_2, Data=graft(multiplication_2))  # -> flatten(Data), Weights, Threshold
nickname_2 = GH_RunNN(NeuralNetwork=trainnn, Data=graft(multiplication))  # -> flatten(Data), Weights, Threshold
fsim_2 = FindSimilarMember(Data=number_slider_4, Set=panel_2)  # -> Hit, Index
nickname_3 = GH_RunNN(NeuralNetwork=trainnn_2, Data=graft(number_slider_3))  # -> flatten(Data), Weights, Threshold
item = ListItem(List=panel_3, Index=fsim.Index, Wrap=True)
nickname_4 = GH_RunNN(NeuralNetwork=trainnn, Data=graft(number_slider_4))  # -> flatten(Data), Weights, Threshold
item_2 = ListItem(List=panel, Index=fsim_2.Index, Wrap=True)
panel_7 = Panel(item)
panel_8 = Panel(nickname_3.Data)
panel_9 = Panel(item_2)
panel_10 = Panel(nickname_4.Data)
entwine = Entwine(Branch00=nickname.Data, Branch01=panel_3, FlattenInputs=True)
entwine_2 = Entwine(Branch00=nickname_2.Data, Branch01=panel, FlattenInputs=True)
graph = QuickGraph(entwine)
graph_2 = QuickGraph(entwine_2)
