# Grasshopper definition threshold.gh (Grasshopper 0.9.76)
# plug-ins: Dodo

pt = ConstructPoint(XCoordinate=0, YCoordinate=0, ZCoordinate=0)
pt_2 = ConstructPoint(XCoordinate="10", YCoordinate="10", ZCoordinate="10")
box = Box2Pt(PointA=pt, PointB=pt_2, Plane=PlaneXY(0, 0, 0))
swatch = ColourSwatch(SwatchColor=RGB(255, 255, 255))
swatch_2 = ColourSwatch(SwatchColor=RGB(0, 0, 0))
box_corners = BoxCorners(Box=box)  # -> CornerA, CornerB, CornerC, CornerD, CornerE, CornerF, CornerG, CornerH
entwine = Entwine(Branch00="1", Branch01="0", FlattenInputs=True)
merge = Merge(
    Data1=box_corners.CornerA,
    Data2=box_corners.CornerB,
    Data3=box_corners.CornerC,
    Data4=box_corners.CornerD,
    Data5=box_corners.CornerE,
    Data6=box_corners.CornerF,
    Data7=box_corners.CornerG,
    Data8=box_corners.CornerH)
entwine_2 = Entwine(Branch00=swatch, Branch01=swatch_2, FlattenInputs=True)
pdecon = Deconstruct(Point=merge)  # -> XComponent, YComponent, ZComponent
repeat = RepeatData(Data=entwine, Length="4")  # -> flatten(Data)
repeat_2 = RepeatData(Data=entwine_2, Length="4")  # -> flatten(Data)
entwine_3 = Entwine(Branch00=pdecon.XComponent, Branch01=pdecon.YComponent, Branch02=pdecon.ZComponent, FlattenInputs=True)
flip = FlipMatrix(Data=entwine_3)
graft = GraftTree(Tree=repeat, IncludeEmptyLists=True, IncludeNullItems=True)
tag = TextTag(Location=merge, Text=repeat, Colour=repeat_2)
trainnn = TrainNeuralNetwork(D=flip, O=graft)
panel = Panel(trainnn)
pt_3 = Point(Point(6.476749888, 4.860811038, 3.052404374))
pdecon_2 = Deconstruct(Point=pt_3)  # -> XComponent, YComponent, ZComponent
series = Series(Start=0, Step=1, Count="10")
entwine_4 = Entwine(Branch00=pdecon_2.XComponent, Branch01=pdecon_2.YComponent, Branch02=pdecon_2.ZComponent, FlattenInputs=True)
division = Division(A=series, B="10")
crossref = CrossReference(ListA=division, ListB=division, ListC=division, CrossMode=1)  # -> ListA, ListB, ListC
flip_2 = FlipMatrix(Data=entwine_4)
box_2 = EvaluateBox(Box=box, UParameter=crossref.ListA, VParameter=crossref.ListB, WParameter=crossref.ListC)  # -> Plane, Point, Include
pdecon_3 = Deconstruct(Point=box_2.Point)  # -> XComponent, YComponent, ZComponent
entwine_5 = Entwine(Branch00=pdecon_3.XComponent, Branch01=pdecon_3.YComponent, Branch02=pdecon_3.ZComponent, FlattenInputs=True)
flip_3 = FlipMatrix(Data=entwine_5)
runnn = RunNN(NeuralNetwork=trainnn, Data=flip_3)  # -> flatten(Data), Weights, Threshold
runnn_2 = RunNN(NeuralNetwork=trainnn, Data=flip_2)  # -> Data, Weights, Threshold
filter = StreamFilter(Gate=runnn_2.Data, Stream0=swatch_2, Stream1=swatch)
cull = CullPattern(List=box_2.Point, CullPattern=runnn.Data)
sph = Sphere(Base=pt_3, Radius=1)
item = ListItem(List=runnn_2.Weights, Index=0, Wrap=True)  # -> Item, Item1, Item2
preview = CustomPreview(Geometry=sph, Shader=filter)
c_script = CSharpScript(x=item.Item, y=item.Item1, z=item.Item2, u=runnn_2.Threshold)  # -> out, A; inputs x: Double, y: Double, z: Double, u: Double
# ---------- c_script: C# ----------
    Plane pl = new Plane(x, y, z, u);
    A = pl;
# ---------- end c_script ----------
planesrf = PlaneSurface(Plane=c_script.A, XSize="-12 to 0", YSize="0 to 12")
