# Grasshopper definition Diagrams.ghx (Grasshopper 0.9.76)
# plug-ins: Python Interpreter, treesloth01, Human UI, Human, LunchBox, MetaHopper, TT Toolbox, Telepathy, Owl.GH

# ----
# NUMBER OF INDIVIDUAL PRIMITIVES
number_slider = Slider(100, range=0..100)

geometry = GeometryPipeline(
    GroupByLayer=False,
    GroupByType=False,
    IncludeHidden=True,
    IncludeLocked=True,
    LayerFilter="Geometry",
    NameFilter="*",
    TypeFilter=1073741880)

panel = Panel("BASE PLANE")
pln = Plane(PlaneXY(0.08767023439, 0.0884122404, 0))

num = Number(50)
geoattrib = GetGeometryAttributes(Geometry=geometry)  # -> GeometryNames, GUID, Layer
range = Range(Domain=num, Steps=number_slider)
num_2 = Number(0)
geometry_meshes = RemoteSender(geometry)
geometry_bins = RemoteSender(geoattrib.GeometryNames)
cull_i = CullIndex(List=range, Indices=num_2, Wrap=True)
geometry_meshes_2 = RemoteReceiver(geometry_meshes)
geometry_bins_2 = RemoteReceiver(geometry_bins)
panel_2 = Panel(cull_i)
geo = Geometry(geometry_meshes_2)

# ---- group: create dodecahedron points
relpath = RelativePath(Path="dodecahedron.csv")
file = ReadFile(File=relpath, PerLineParse=True)
csv = ReadCSV(CSVString=file, Delimiter=",")  # -> Headers, Values
flip = FlipMatrix(Data=csv.Values)
item = ListItem(List=flip, Index="0", Wrap=True)
item_2 = ListItem(List=flip, Index="1", Wrap=True)
item_3 = ListItem(List=flip, Index="2", Wrap=True)
pt = ConstructPoint(XCoordinate=item, YCoordinate=item_2, ZCoordinate=item_3)

# ----
python = PythonScript()  # -> out, random_int
# ---------- python: Python ----------
import Rhino.Geometry as rg
import rhinoscriptsyntax as rs
import math

from random import randint
random_int = (randint(0, 100))
# ---------- end python ----------
python_2 = PythonScript()  # -> out, random_int; same code as python
python_3 = PythonScript()  # -> out, random_int; same code as python
python_4 = PythonScript()  # -> out, random_int; same code as python
python_5 = PythonScript()  # -> out, random_int; same code as python
python_6 = PythonScript()  # -> out, random_int; same code as python
python_7 = PythonScript()  # -> out, random_int; same code as python
python_8 = PythonScript()  # -> out, random_int; same code as python
# Generate Test Geo
panel_3 = Panel("RANDOMIZE SHIT")
jitter = Jitter(List=panel_2, Jitter=1, Seed=python.random_int)  # -> Values, Indices
jitter_2 = Jitter(List=panel_2, Jitter=1, Seed=python_3.random_int)  # -> Values, Indices
jitter_3 = Jitter(List=panel_2, Jitter=1, Seed=python_4.random_int)  # -> Values, Indices
jitter_4 = Jitter(List=panel_2, Jitter=1, Seed=python_5.random_int)  # -> Values, Indices
jitter_5 = Jitter(List=panel_2, Jitter=1, Seed=python_2.random_int)  # -> Values, Indices
jitter_6 = Jitter(List=panel_2, Jitter=1, Seed=python_6.random_int)  # -> Values, Indices
jitter_7 = Jitter(List=panel_2, Jitter=1, Seed=python_7.random_int)  # -> Values, Indices
jitter_8 = Jitter(List=panel_2, Jitter=1, Seed=python_8.random_int)  # -> Values, Indices

color_groups_clusters = Button(ExpressionNormal="True")
number_slider_2 = Slider(50, range=0..100)

balance = Slider(0, range=-5..5)
objfromgroup = GetObjectsInGroup()

panel_4 = Panel("PRIMITIVE CREATION")
box = CenterBox(Base=pln, X=jitter_2.Values, Y=jitter_3.Values, Z=jitter_4.Values)
cone = Cone(Base=pln, Radius=jitter_7.Values, Length=jitter_8.Values)  # -> Cone, Tip
sph = Sphere(Base=pln, Radius=jitter_6.Values)
cyl = Cylinder(Base=pln, Radius=jitter.Values, Length=jitter_5.Values)

demesh = DeconstructMesh(Mesh=geo)  # -> Vertices, Faces, Colours, Normals
volume = Volume(Geometry=geo)  # -> Volume, Centroid
textbox = CreateTextBox(UpdateButton=invert(True), showLabel=True)
col = Colour([RGBA(4, 0, 255, 135), RGBA(0, 128, 255, 133), RGBA(210, 255, 148, 141), RGBA(255, 0, 0, 122), RGBA(224, 224, 224, 211)])
pulldown = CreatePulldownMenu(Label=" ", ListItems=" ", showLabel=True)
capex = CapHolesEx(Brep=sph)  # -> Brep, Caps, Solid
capex_2 = CapHolesEx(Brep=box)  # -> Brep, Caps, Solid
capex_3 = CapHolesEx(Brep=cyl)  # -> Brep, Caps, Solid
capex_4 = CapHolesEx(Brep=cone.Cone)  # -> Brep, Caps, Solid
dup = DuplicateData(Data=objfromgroup, Number=number_slider_2, Order=True)
geo_2 = Geometry(demesh.Vertices)
dup_2 = DuplicateData(Data="Normalize", Number=number_slider_2, Order=True)
dup_3 = DuplicateData(Data=" ", Number=number_slider_2, Order=True)
move = Move(Geometry=pt, Motion=volume.Centroid)  # -> Geometry, Transform
panel_5 = Panel(capex.Brep)
merge = Merge(Data1=textbox, Data2=pulldown)
bbox = BoundingBox(Content=geo, Plane=PlaneXY(0, 0, 0))  # -> Box, Box_2
panel_6 = Panel(capex_4.Brep)
panel_7 = Panel(capex_3.Brep)
ln = Line(StartPoint=volume.Centroid, EndPoint=demesh.Vertices)
cullpt = CullDuplicates(Points=move.Geometry, Tolerance=0.1, CullMode=3)  # -> Points, Indices, Valence
dist = Distance(PointA=volume.Centroid, PointB=geo_2)
panel_8 = Panel(capex_2.Brep)
number_slider_3 = Slider(9, range=0..100)
button = CreateButton(ButtonName="save", ButtonStyle=0)
button_2 = CreateButton(ButtonName="restore", ButtonStyle=0)
values = ValueListener(Elements=textbox, SomeProperty=True)  # -> Values, Indices
checkbox = CreateCheckbox(Label=dup_2, StartingValue=False)  # -> simplify(graft(Checkbox))
values_2 = ValueListener(Elements=pulldown, SomeProperty=True)  # -> Values, Indices
vec2pt = Vector2Pt(PointA=move.Geometry, PointB=volume.Centroid, Unitize=False)  # -> Vector, Length
width_start = Slider(0.04, range=0..1)
width_end = Slider(0.31, range=0..1)
height_start = Slider(0.2, range=0..1)
height_end = Slider(0.96, range=0..1)
checkbox_2 = CreateCheckbox(Label=dup_3, StartingValue=invert(False))  # -> simplify(graft(Checkbox))
flip_2 = FlipMatrix(Data=cullpt.Points)
debrep = DeconstructBrep(Brep=bbox.Box)  # -> Faces, Edges, Vertices
slider = CreateSlider(Slider=dup, ShowBounds=False, showLabel=False, ShowTicks=False, ShowTooltip=False, ShowValLabel=True)  # -> simplify(graft(Sliders))

# ---- group: cpt
geo_3 = Geometry(volume.Centroid)

# ----
number_slider_4 = Slider(13, range=0..100)
window_name = Panel("Metashape")
merge_2 = Merge(Data1=button, Data2=button_2)
taskbar_hidden = BooleanToggle(False)
multiplication = Multiplication(A=vec2pt.Vector, B=Slider(127, range=0..1000))
python_9 = PythonScript(sphere_tree_in=flip_2, cpt_lst_in=geo_3, bound_srf_lst_in=debrep.Faces)  # -> ray_tree, header_lst; inputs sphere_tree_in: tree, cpt_lst_in: list, bound_srf_lst_in: tree
# ---------- python_9: Python ----------
import rhinoscriptsyntax as rs
import Rhino as rc
import scriptcontext as sc
#import ghpythonlib as gh
import Grasshopper as gh

""" Calculate View Factor

"""
class ViewFactor(object):
    def __init__(self):
        self.sphere_nested = []
        self.cpt = []
        self.bound_nested = []
        self.bld_num = None
        self.ray_num = None
        # Outputs
        self.raycast_distance = None
        self.raycast_pt_x = None
        self.raycast_pt_y = None
        self.raycast_pt_z = None

    def process_raw_inputs(self,sphere_tree_in,bound_srf_lst_in,cpt_lst_in):
        self.cpt = map(lambda c: rs.coerce3dpoint(c), cpt_lst_in)
        # convert tree to nested list of sphere pts
        for i in range(sphere_tree_in.BranchCount):
            branchList = sphere_tree_in.Branch(i)
            self.sphere_nested.append(branchList)

        # convert tree to nested list of bound srfs
        for i in range(bound_srf_lst_in.BranchCount):
            branchList = bound_srf_lst_in.Branch(i)
            branchList = map(lambda s: rs.coercebrep(s), branchList)
            self.bound_nested.append(branchList)

        # convert guids to rc points
        for i in xrange(len(self.sphere_nested)):
            sphere_per_bld = list(self.sphere_nested[i])
            for j in xrange(len(sphere_per_bld)):
                sphere_per_bld[j] = rs.coerce3dpoint(sphere_per_bld[j])
            self.sphere_nested[i] = sphere_per_bld

        self.bld_num = len(self.sphere_nested)
        self.ray_num = len(self.sphere_nested[0])

    def ray_cast(self):
        """
        base_vector
        direction_vector
        srf2int
        """
        self.ray_int_nested = []
        self.ray_dist_nested = []

        for i in xrange(self.bld_num):
            raypts = []
            raydist = []
            for j in xrange(self.ray_num):
                srf2int_lst = self.bound_nested[i]
                r0 = self.cpt[i] #base_vector
                r1 = self.sphere_nested[i][j] #direction_vector
                #convert pts to vectors
                r1 = rc.Geometry.Vector3d(r1) - rc.Geometry.Vector3d(r0)

                ray = rc.Geometry.Ray3d(r0,r1)
                point_intersect_lst = rc.Geometry.Intersect.Intersection.RayShoot(ray,srf2int_lst,1)
                if point_intersect_lst:
                    point_intersect_lst = list(point_intersect_lst)
                    rpt = point_intersect_lst[0]
                    raypts.append(rpt)
                    raydist.append(rs.Distance(rpt,r0))
                    #rc.Geometry.Vector3d.Multiply(
            self.ray_dist_nested.append(raydist)
            self.ray_int_nested.append(raypts)
        #print len(self.ray_int_nested)
    def generate_viewfactor_matrix(self):
        # flip the matrix
        self.raycast_distance = map(lambda r: [None] * self.ray_num, [None] * self.bld_num)

        self.raycast_x = map(lambda r: [None] * self.ray_num, [None] * self.bld_num)
        self.raycast_y = map(lambda r: [None] * self.ray_num, [None] * self.bld_num)
        self.raycast_z = map(lambda r: [None] * self.ray_num, [None] * self.bld_num)
        self.ray_mtx = []

        self.header_lst = []
        for ri in xrange(self.ray_num):
            hstr = "RAY_{b}_".format(b=ri)
            self.header_lst.extend([hstr+"dist",hstr+"x",hstr+"y",hstr+"z"])
        print len(self.header_lst)
        print self.header_lst
        for i in xrange(self.bld_num):
            self.bld_lst = []
            for j in xrange(self.ray_num):
                d = self.ray_dist_nested[i][j]
                x = self.ray_int_nested[i][j][0]
                y = self.ray_int_nested[i][j][1]
                z = self.ray_int_nested[i][j][2]

                self.bld_lst.extend([d,x,y,z])

                #self.ray_dist_nested[i][j]
                #self.raycast_distance[i][j]
            self.ray_mtx.append(self.bld_lst)
    def pythonListTGhDataTree(self,pythonList):
        """ Converts a  nested Python list to a GH datatree """
        # Create GH datatree
        dataTree = gh.DataTree[object]()

        # Add pythonlist sub lists to dataTree
        for i,l in enumerate(pythonList):
            for v in l:
                dataTree.Add(v,gh.Kernel.Data.GH_Path(i))

        return dataTree
vf = ViewFactor()
vf.process_raw_inputs(sphere_tree_in, bound_srf_lst_in, cpt_lst_in)
vf.ray_cast()
vf.generate_viewfactor_matrix()

header_lst = vf.header_lst
ray_tree = vf.pythonListTGhDataTree(vf.ray_mtx)
#header_tree
print len(vf.ray_mtx)
print len(vf.bld_lst)

#sphere_out = vf.sphere_nested
#cpt_out = vf.cpt




ray_out = reduce(lambda x,y: x+y, vf.ray_int_nested)
# ---------- end python_9 ----------
values_3 = ValueListener(Elements=button, SomeProperty=True)  # -> Values, Indices

# ---- group: find farthest vertex
sort = SortList(Keys=dist)  # -> Keys, ValuesA
rev = ReverseList(List=sort.Keys)
item_4 = ListItem(List=rev, Index=0, Wrap=True)

# ----
values_4 = ValueListener(Elements=button_2, SomeProperty=True)  # -> Values, Indices
move_2 = Move(Geometry=volume.Centroid, Motion=multiplication)  # -> Geometry, Transform
entwine = Entwine(Branch00=merge, Branch01=merge_2, FlattenInputs=True)
# HUI
snap = ValueList({"Off": 0, "On": 1}, selected="On")
ln_2 = Line(StartPoint=volume.Centroid, EndPoint=move_2.Geometry)

# ---- group: vertexDistanceMean
avr = Average(Input=dist)

# ----
swatch = ColourSwatch(SwatchColor=RGB(255, 102, 0))
geometry_meshes_3 = RemoteReceiver(geometry_meshes)
series = Series(Start=0, Step=1, Count=number_slider_2)
merge_3 = Merge(Data1=checkbox_2, Data2=checkbox, Data3=slider)  # -> graft(Result)
css_stretchhorizontal = RemoteSender(entwine)
entwine_2 = Entwine(Branch00=capex_4.Brep, Branch01=capex_3.Brep, Branch02=capex_2.Brep, FlattenInputs=True)  # -> flatten(Result)
savestates = SaveElementStates(Elements=flatten(merge_3), SaveState=values_3.Values, StateName=values.Values, ClearSavedStates=Button())  # -> SavedStates, SavedStateNames
panel_9 = Panel(multiplication)
material = CreateMaterial(Diffuse=swatch, Specular=RGB(255, 255, 255), Emission=RGB(0, 0, 0), Transparency=Slider(0.88, range=0..1), Shine=0)
field_titles = Panel("""10
11
11
11
11""")
path_mapper = PathMapper(python_9.ray_tree, source="{A}", target="{0;A}")
panel_10 = Panel("""4*
1*""")
medges = MeshEdges(Mesh=geometry_meshes_3)  # -> NakedEdges, InteriorEdges, NonManifoldEdges
data = Data(capex_2.Brep)

mindex = MemberIndex(Set=dist, Member=item_4)  # -> Index, Count
item_5 = ListItem(List=mindex.Index, Index=0, Wrap=True)
item_6 = ListItem(List=geo_2, Index=item_5, Wrap=True)
pdecon = Deconstruct(Point=item_6)  # -> simplify(XComponent), simplify(YComponent), simplify(ZComponent)

data_2 = Data(capex_3.Brep)
merge_4 = Merge(Data1=graft(series), Data2=graft(series), Data3=graft(series))  # -> flatten(Result)
data_3 = Data(capex_4.Brep)
restore = RestoreElementStates(Restore=values_4.Values, SavedStates=savestates.SavedStates, StateNameToRestore=values_2.Values)
lng = ListLength(List=data)
panel_11 = Panel("""3.4*
2*
6*""")
setlist = SetListContents(ListToModify=pulldown, NewListContents=savestates.SavedStateNames)
lng_2 = ListLength(List=data_2)
lng_3 = ListLength(List=data_3)
previewlw = CustomPreviewLineweights(Geometry=geometry_meshes_3, Shader=material, Absolute=False)
ln_3 = Line(StartPoint=volume.Centroid, EndPoint=item_6)
previewlw_2 = CustomPreviewLineweights(Geometry=geometry_meshes_3, Shader=swatch, Absolute=False)
dup_4 = DuplicateData(Data="Box", Number=lng, Order=True)  # -> flatten(Data)
simplegrid = CreateSimpleGrid(UIElements=entwine, RowDefinitions="Auto", ColumnDefinitions=panel_10)
filter = StreamFilter(Gate=values_3.Values)
dup_5 = DuplicateData(Data="Cylinder", Number=lng_2, Order=True)  # -> flatten(Data)
dup_6 = DuplicateData(Data="Cone", Number=lng_3, Order=True)  # -> flatten(Data)
simplegrid_2 = CreateSimpleGrid(UIElements=merge_3, GridMembership=merge_4, RowDefinitions="Auto", ColumnDefinitions=panel_11)  # -> simplify(graft(SimpleGrid))
css_stretchhorizontal_2 = RemoteSender(simplegrid)
settextbox = SetTextBoxContents(TextBoxToModify=textbox, NewTextBoxContents=filter)
number_slider_5 = Slider(0.5, range=0..1)
merge_5 = Merge(Data1=dup_6, Data2=dup_5, Data3=dup_4)
css_stretchhorizontal_3 = RemoteSender(simplegrid_2)
button_3 = CreateButton(ButtonName="update", ButtonStyle=0)
css_margintop = RemoteSender(simplegrid_2)
path_mapper_2 = PathMapper(pdecon.XComponent, source="{A}", target="{0;A}")
path_mapper_3 = PathMapper(pdecon.YComponent, source="{a}", target="{0;a}")
path_mapper_4 = PathMapper(pdecon.ZComponent, source="{a}", target="{0;a}")
jitter_9 = Jitter(List=merge_5, Jitter=number_slider_5, Seed=2)  # -> Values, Indices
jitter_10 = Jitter(List=entwine_2, Jitter=number_slider_5, Seed=2)  # -> Values, Indices
merge_6 = Merge(
    Data1="vertexDistanceMean",
    Data2="vertexFarthestDistance",
    Data3="vertexFarthestX",
    Data4="vertexFarthestY",
    Data5="vertexFarthestZ")
css_stretchhorizontal_4 = RemoteSender(button_3)
path_mapper_5 = PathMapper(merge_6, source="{A}", target="{0;A}")
merge_7 = Merge(Data1=avr, Data2=item_4, Data3=path_mapper_2, Data4=path_mapper_3, Data5=path_mapper_4)
data_4 = Data(simplify(graft(jitter_9.Values)))
graft = GraftTree(Tree=jitter_10.Values, IncludeEmptyLists=True, IncludeNullItems=True)
values_5 = ValueListener(Elements=button_3, SomeProperty=True)  # -> Values, Indices
merge_8 = Merge(Data1=merge_7, Data2=path_mapper)  # -> simplify(Result)
merge_9 = Merge(Data1=path_mapper_5, Data2=python_9.header_lst)  # -> simplify(Result)
hui_values_update = RemoteSender(values_5.Values)
hui_values_update_2 = RemoteReceiver(hui_values_update)
values_6 = ValueListener(Elements=checkbox_2, Trigger=hui_values_update_2, SomeProperty=False)  # -> Values, Indices
long = LongestList(ListA=Slider(111, range=70..130), ListB=graft, PaddingMode=2)  # -> ListA, ListB
lng_4 = ListLength(List=python_9.header_lst)  # -> flatten(Length)
series_2 = Series(Start=0, Step=1, Count=10)
shift = ShiftPaths(Data=merge_9, Offset=-1)
css_stretchhorizontal_5 = RemoteReceiver([css_stretchhorizontal_4, css_stretchhorizontal_3, css_stretchhorizontal, css_stretchhorizontal_2])
ma = MassAddition(Input=flatten(long.ListA))  # -> Result, PartialResults
dup_7 = DuplicateData(Data="Viewfactor", Number=lng_4, Order=True)
dup_8 = DuplicateData(Data="13", Number=lng_4, Order=True)
volume_2 = Volume(Geometry=long.ListB)  # -> Volume, Centroid
features_names_viewfactor = RemoteSender(shift)
features_values_viewfactor = RemoteSender(merge_8)
number_slider_6 = Slider(0, range=0..10)
number_slider_7 = Slider(0, range=0..10)
pt_2 = ConstructPoint(XCoordinate=0, YCoordinate=ma.PartialResults, ZCoordinate=0)  # -> graft(Point)
field_titles_2 = Panel("""VertexMeanDist
VertextFart
VertextFart
VertextFart
VertextFart""")
adjustpos = AdjustElementPositioning(ElementsToAdjust=css_stretchhorizontal_5, AbsolutePositioning=False, HorizontalAlignment=3)
int = Integer(dup_8)
merge_10 = Merge(Data1=flatten(field_titles), Data2=flatten(int))
features_groups_viewfactor = RemoteSender(merge_10)
orient = Orient(Geometry=long.ListB, Source=volume_2.Centroid, Target=pt_2)  # -> Geometry, Transform
css_margintop_2 = RemoteReceiver(css_margintop)

# ---- group: Create Margin String
set_margin = SetMargin(int=Slider(0, range=0..10), int_3=number_slider_6, int_4=number_slider_6, int_2=Slider(-13, range=-20..10))

# ----
geometry_shapenames = RemoteSender("Building")
geometry_primitives = RemoteSender(orient.Geometry)
merge_11 = Merge(Data1=flatten(field_titles_2), Data2=flatten(dup_7))
adjustpos_2 = AdjustElementPositioning(ElementsToAdjust=css_margintop_2, Margin=set_margin, AbsolutePositioning=False)
merge_12 = Merge(Data2=flatten(simplegrid), Data3=flatten(simplegrid_2), Data4=flatten(button_3))
merge_13 = Merge()
features_groupnames_viewfactor = RemoteSender(merge_11)
panel_12 = Panel("""Features
Visualization""")
tabs = TabbedView(TabNames=panel_12, Tab0=flatten(merge_12), Tab1=flatten(merge_13))
merge_14 = Merge(Data2=tabs)
geometry_meshes_4 = RemoteReceiver(graft(geometry_meshes))
geo_4 = Geometry(graft([<mesh referenced from the Rhino model> x2]))
geo_5 = Geometry(simplify(geo_4))
geometry_meshes_5 = RemoteReceiver(graft(geometry_meshes))
geometry_primitives_2 = RemoteReceiver(geometry_primitives)
geo_6 = Geometry(geo_5)
data_5 = Data("5")
G = Geometry(geo_5)

# ---- group: input geometry
geo_7 = Geometry(geometry_meshes_5)

# ----
geo_8 = Geometry(geo_5)
# MARK'S FEATURES
geo_9 = Geometry(geo_5)
# NATE'S FEATURES
volume_3 = Volume(Geometry=geo_7)  # -> simplify(Volume), Centroid

geo_10 = Geometry(geo_6)
data_6 = Data(data_5)
contour = Contour(Shape=geo_10, Point=Point(0, 0, 0), Direction=Vector(0, 0, 1), Distance=data_6)  # -> simplify(Contours)
crv = Curve(contour)

area = Area(Geometry=geo_8)  # -> Area, Centroid

data_7 = Data(Slider(45, range=0..100))
range_2 = Range(Domain="0 to 90", Steps=data_7)
cull_i_2 = CullIndex(List=range_2, Indices=data_7, Wrap=True)
data_8 = Data(cull_i_2)
rad = Radians(Degrees=data_8)
data_9 = Data(rad)

crv_2 = Curve(crv)
lng_5 = ListLength(List=crv_2)
data_10 = Data(lng_5)

pt_3 = Point(area.Centroid)
bbox_2 = BoundingBox(Content=volume_3.Centroid, Plane=PlaneXY(0, 0, 0))  # -> Box, Box_2
pt_4 = Point(pt_3)
pt_5 = Point(pt_4)
pt_6 = Point(pt_4)
pdecon_2 = Deconstruct(Point=pt_6)  # -> XComponent, YComponent, ZComponent
bbox_3 = BoundingBox(Content=geo_7, Plane=PlaneXY(0, 0, 0))  # -> Box, Box_2
box_2 = EvaluateBox(Box=bbox_2.Box, UParameter=0.5, VParameter=0.5, WParameter=0.5)  # -> Plane, Point, Include
area_2 = Area(Geometry=geo_7)  # -> simplify(Area), Centroid

crv_3 = Curve(simplify(crv))
cluster = Cluster_4(C=crv_3)
trim = TrimTree(Tree=cluster, Depth=1)
G_2 = Geometry(trim)

debox = DeconstructBox(Box=bbox_3.Box)  # -> Plane, simplify(X), simplify(Y), simplify(Z)
relative = RelativeCoordinates(Plane=box_2.Plane, Point=box_2.Point)  # -> RelativePoint, RelativeX, RelativeY, RelativeZ

geo_11 = Geometry(geo_9)
volume_4 = Volume(Geometry=geo_11)  # -> Volume, Centroid
pt_7 = Point(volume_4.Centroid)
xy = XYPlane(Origin=pt_7)
prot = RotatePlane(Plane=xy, Angle=data_9)

dlength = DLength(I=debox.Y)
dlength_2 = DLength(I=debox.Z)
pdecon_3 = Deconstruct(Point=relative.RelativePoint)  # -> simplify(XComponent), simplify(YComponent), simplify(ZComponent)
dlength_3 = DLength(I=debox.X)
panel_13 = Panel(dlength_3)
panel_14 = Panel(dlength)
panel_15 = Panel(dlength_2)
panel_16 = Panel(volume_3.Volume)
panel_17 = Panel(area_2.Area)
panel_18 = Panel(pdecon_3.XComponent)
panel_19 = Panel(pdecon_3.YComponent)
panel_20 = Panel(pdecon_3.ZComponent)

G_3 = Geometry(G_2)
area_3 = Area(Geometry=G_3)  # -> Area, Centroid
data_11 = Data(area_3.Area)

data_12 = Data(data_11)

L = List(data_12)
lng_6 = ListLength(List=L)
multiplication_2 = Multiplication(A=lng_6, B=Slider(0.95, range=0..1))
B = DomainEnd(multiplication_2)
dom = ConstructDomain(DomainStart=0, DomainEnd=B)
subset = SubList(List=L, Domain=dom, Wrap=True)  # -> List, Index
data_13 = Data(simplify(subset.List))

pt_8 = Point(pt_5)

data_14 = Data(data_11)
data_15 = Data(data_5)
multiplication_3 = Multiplication(A=data_14, B=data_15)  # -> simplify(Result)
data_16 = Data(multiplication_3)

data_17 = Data(data_16)
avr_2 = Average(Input=data_17)
data_18 = Data(avr_2)

geo_12 = Geometry(geo_9)
P = Plane(prot)
bbox_4 = BoundingBox(Content=geo_12, Plane=P)  # -> Box, Box_2
trim_2 = TrimTree(Tree=bbox_4.Box, Depth=1)
geo_13 = Geometry(simplify(trim_2))

subset_2 = SubList(List=G_2, Domain=dom, Wrap=True)  # -> List, Index
data_19 = Data(simplify(subset_2.List))

K = Keys(data_13)
sort_2 = SortList(Keys=K, ValuesA=data_19)  # -> Keys, ValuesA
item_7 = ListItem(List=sort_2.Keys, Index=0, Wrap=True)  # -> Item1, Item
item_8 = ListItem(List=sort_2.Keys, Index=0, Wrap=True)
data_20 = Data(item_8)
data_21 = Data(item_7.Item1)
division = Division(A=data_20, B=data_21)
data_22 = Data(division)

data_23 = Data(data_22)
data_24 = Data(Slider(0.2, range=0..1))
multiplication_4 = Multiplication(A=data_23, B=data_24)
data_25 = Data(multiplication_4)

data_26 = Data(simplify(data_13))
data_27 = Data(data_25)
pt_9 = ConstructPoint(XCoordinate=data_26, YCoordinate=0, ZCoordinate=0)
cullduppoints = RemoveDuplicatePoints(InputPoints=pt_9, Tolerance=data_27)  # -> OutputPoints, FirstPointIndexes
null = NullItem(Item=cullduppoints.OutputPoints)  # -> NullFlags, InvalidFlags, Description
dispatch = Dispatch(List=cullduppoints.OutputPoints, DispatchPattern=null.InvalidFlags)  # -> ListA, ListB
data_28 = Data(simplify(dispatch.ListB))

lng_7 = ListLength(List=data_26)
series_3 = Series(Start=0, Step=1, Count=lng_7)  # -> simplify(Series)
null_2 = NullItem(Item=cullduppoints.OutputPoints)  # -> NullFlags, InvalidFlags, Description
dispatch_2 = Dispatch(List=series_3, DispatchPattern=null_2.InvalidFlags)  # -> ListA, ListB
data_29 = Data(dispatch_2.ListB)
item_9 = ListItem(List=sort_2.ValuesA, Index=0, Wrap=True)  # -> Item1, Item
item_10 = ListItem(List=data_19, Index=data_29, Wrap=True)
data_30 = Data(sort_2.ValuesA)
data_31 = Data(item_9.Item)
data_32 = Data(item_9.Item1)

lng_8 = ListLength(List=data_28)
larger = LargerThan(FirstNumber=lng_8, SecondNumber="3")  # -> LargerThan, OrEqualTo
data_33 = Data(larger.LargerThan)

dispatch_3 = Dispatch(List=geo_6, DispatchPattern=data_33)  # -> ListA, ListB
mesh = Mesh(dispatch_3.ListA)
mesh_2 = Mesh(dispatch_3.ListB)
preview = CustomPreview(Geometry=mesh, Shader=ColourSwatch(SwatchColor=RGB(255, 69, 69)))
preview_2 = CustomPreview(Geometry=mesh_2, Shader=ColourSwatch(SwatchColor=RGB(132, 0, 255)))

string_name = Panel("Shape")
field_titles_3 = Panel("""Area
centroid x
centroid y 
centroid z
low_slice_length
mid_slice_length
upper_slice_length
slice_ratio""")
data_34 = Data(data_20)

data_35 = Data(data_16)
ma_2 = MassAddition(Input=data_35)  # -> Result, PartialResults
data_36 = Data(ma_2.Result)

geo_14 = Geometry(simplify(geo_13))
volume_5 = Volume(Geometry=geo_14)  # -> Volume, Centroid
sort_3 = SortList(Keys=volume_5.Volume, ValuesA=geo_14, ValuesC=data_8)  # -> Keys, ValuesA, ValuesB, ValuesC, ValuesD
item_11 = ListItem(List=sort_3.ValuesC, Index=0, Wrap=True)
item_12 = ListItem(List=sort_3.ValuesA, Index=0, Wrap=True)
data_37 = Data(item_11)
data_38 = Data(item_12)

panel_21 = Panel(lng_8)
G_4 = Geometry(G_2)
item_13 = ListItem(List=G_4, Index=0, Wrap=True)
G_5 = Geometry(item_13)
G_6 = Geometry(G_5)
G_7 = Geometry(G_6)
area_4 = Area(Geometry=G_7)  # -> Area, Centroid
pt_10 = Point(area_4.Centroid)
vec2pt_2 = Vector2Pt(PointA=pt_10, PointB=pt_8, Unitize=False)  # -> Vector, Length
data_39 = Data(vec2pt_2.Vector)
data_40 = Data(data_39)
cluster_2 = Cluster_3(data=data_40)
data_41 = Data(simplify(cluster_2))
features_names_nate = RemoteSender(field_titles_3)
data_42 = Data(data_37)
data_43 = Data(simplify(data_38))
data_44 = Data(simplify(data_43))
debox_2 = DeconstructBox(Box=data_44)  # -> Plane, simplify(X), simplify(Y), simplify(Z)
pdecon_4 = Deconstruct(Point=debox_2.Plane)  # -> XComponent, YComponent, ZComponent
dlength_4 = DLength_2(data=pdecon_4.ZComponent, I=debox_2.Z)  # -> data_6, data_5, y
dlength_5 = DLength_2(data=pdecon_4.YComponent, I=debox_2.Y)  # -> data_6, data_5, y
dlength_6 = DLength_2(data=pdecon_4.XComponent, I=debox_2.X)  # -> data_6, data_5, y
data_45 = Data(dlength_4.data_6)
data_46 = Data(data_45)
addition = Addition(A=data_46, B="0.001")
pt_11 = ConstructPoint(XCoordinate=pdecon_2.XComponent, YCoordinate=pdecon_2.YComponent, ZCoordinate=addition)
O = Origin(pt_11)
O_2 = Origin(O)
xy_2 = XYPlane(Origin=O_2)
pln_2 = Plane(xy_2)
data_47 = Data(dlength_4.y)
data_48 = Data(data_47)
data_49 = Data(dlength_5.y)
data_50 = Data(dlength_6.y)

data_51 = Data(simplify(data_43))
volume_6 = Volume(Geometry=data_51)  # -> Volume, Centroid
data_52 = Data(volume_6.Volume)

d1 = Data1(data_50)
d2 = Data2(data_49)
d1_2 = Data1(data_50)
d2_2 = Data2(data_49)
d1_3 = Data1(data_47)
d2_3 = Data2(data_50)
d1_4 = Data1(data_47)
d2_4 = Data2(data_49)
integer_division = IntegerDivision(A=d1_4, B=d2_4)
integer_division_2 = IntegerDivision(A=d1_3, B=d2_3)
integer_division_3 = IntegerDivision(A=d2_2, B=d1_2)
integer_division_4 = IntegerDivision(A=d1, B=d2)
max = Maximum(A=integer_division_4, B=integer_division_3)
data_53 = Data(integer_division_2)
data_54 = Data(integer_division)
data_55 = Data(max)
# Bounding box volume
data_56 = Data(data_52)
data_57 = Data(data_56)
data_58 = Data(data_57)
# Orientation
data_59 = Data(data_42)
field_titles_4 = Panel("""-2
-1
-1
-1
3
3
3
3""")
# Volume
data_60 = Data(data_36)
data_61 = Data(data_60)
data_62 = Data(data_60)

data_63 = Data(data_61)
G_8 = Geometry(G)
area_5 = Area(Geometry=G_8)  # -> Area, Centroid
data_64 = Data(area_5.Area)
data_65 = Data(data_64)
division_2 = Division(A=data_63, B=data_65)
data_66 = Data(division_2)

data_67 = Data(data_62)
division_3 = Division(A=data_67, B=data_58)
data_68 = Data(division_3)
# Average Slice Area
data_69 = Data(data_18)
# Min / Max  Slice Area
data_70 = Data(data_22)
# Height Aspect Ratio 2
data_71 = Data(data_54)
# Height Aspect Ratio 1
data_72 = Data(data_53)
# Aspect Ratio XY
data_73 = Data(data_55)
# Number of Terraces
data_74 = Data(lng_8)
# Eccentricity
# X, Y, Z
data_75 = Data(data_41)
# Volume / Bounding Box Volume
data_76 = Data(data_68)
# Surface Area to Volume Ratio
data_77 = Data(data_66)
panel_22 = Panel(data_70)
features_groups_nate = RemoteSender(field_titles_4)
panel_23 = Panel("""Bounding Box Volume
Orientation
Height Aspect Ratio X
Height Aspect Ratio Y
Aspect Ratio XY
Volume
Average Slice Area
Min / Max  Slice Area
Eccentricity X
Eccentricity Y
Eccentricity Z
Volume / Bounding Box Volume
Surface Area to Volume Ratio
Number of Terraces""")
panel_24 = Panel("""2
0
1
1
1
2
3
3
4
4
4
5
6
8""")
merge_15 = Merge(
    Data1=simplify(data_56),
    Data2=simplify(data_59),
    Data3=simplify(data_72),
    Data4=simplify(data_71),
    Data5=simplify(data_73),
    Data6=simplify(data_60),
    Data7=simplify(data_69),
    Data8=simplify(data_70),
    Data9=simplify(data_75),
    Data10=simplify(data_76),
    Data11=simplify(data_77),
    Data12=simplify(data_74))
field_titles_5 = Panel("""Area
Centroid
Centroid
Centroid
Slice Area
Slice Area
Slice Area
Slice Area""")
data_78 = Data(merge_15)
features_names_mark = RemoteSender(panel_23)
features_groups_mark = RemoteSender(panel_24)
features_values_mark = RemoteSender(data_78)
features_groupnames_nate = RemoteSender(field_titles_5)
geo_15 = Geometry(bbox_3.Box)
panel_25 = Panel("""Vol/Box
Orientation
Aspect Ratio
Aspect Ratio
Aspect Ratio
Volume
Slice Area
Slice Area
Eccentricity
Eccentricity
Eccentricity
Vol/Box
Srf to Volume
Terraces""")
debrep_2 = DeconstructBrep(Brep=geo_15)  # -> Faces, Edges, Vertices
geo_16 = Geometry(contour)
geo_17 = Geometry(cluster)
geo_18 = Geometry(move_2.Geometry)
geo_19 = Geometry(ln_2)
geo_20 = Geometry(demesh.Vertices)
geo_21 = Geometry(ln)
geo_22 = Geometry(item_6)
geo_23 = Geometry(ln_3)
geo_24 = Geometry(G_8)
geo_25 = Geometry(item_10)
geo_26 = Geometry(debrep_2.Edges)
geo_27 = Geometry(contour)
previewlw_3 = CustomPreviewLineweights(Geometry=geo_26, Shader=ColourSwatch(SwatchColor=RGB(0, 195, 255)), Thickness=Slider(3, range=0..10), Absolute=False)
features_groupnames_mark = RemoteSender(panel_25)
features_groupnames_viewfactor_2 = RemoteReceiver(features_groupnames_viewfactor)
features_groups_viewfactor_2 = RemoteReceiver(features_groups_viewfactor)
features_groupnames_mark_2 = RemoteReceiver(features_groupnames_mark)
features_groupnames_nate_2 = RemoteReceiver(features_groupnames_nate)
features_groups_mark_2 = RemoteReceiver(features_groups_mark)
features_names_viewfactor_2 = RemoteReceiver(features_names_viewfactor)
features_groups_nate_2 = RemoteReceiver(features_groups_nate)
features_values_viewfactor_2 = RemoteReceiver(features_values_viewfactor)
features_names_mark_2 = RemoteReceiver(features_names_mark)
# MERGE DATA
features_names_nate_2 = RemoteReceiver(features_names_nate)
features_values_mark_2 = RemoteReceiver(features_values_mark)
merge_16 = Merge(Data1=features_names_nate_2, Data2=features_names_mark_2, Data3=features_names_viewfactor_2)
merge_17 = Merge(Data1=features_groups_nate_2, Data2=features_groups_mark_2, Data3=features_groups_viewfactor_2)
merge_18 = Merge(Data1=features_groupnames_nate_2, Data2=features_groupnames_mark_2, Data3=features_groupnames_viewfactor_2)
features_names = RemoteSender(merge_16)
cset = CreateSet(List=merge_18)  # -> Set, Map
tsort = SortText(Keys=cset.Set, Culture=127)  # -> Keys, Values
features_groups = RemoteSender(merge_17)
panel_26 = Panel(merge_16)
geometry_meshes_6 = RemoteReceiver(graft(geometry_meshes))
toggle = BooleanToggle(True)
mindex_2 = MemberIndex(Set=merge_18, Member=graft(tsort.Keys))  # -> Index, Count
features_groupnames = RemoteSender(tsort.Keys)
features_groupnames_2 = RemoteReceiver(features_groupnames)
setcheckbox = SetCheckBox(CheckBoxToModify=flatten(checkbox_2), NewCheckBoxLabel=features_groupnames_2)
lng_9 = ListLength(List=features_groupnames_2)
subtraction = Subtraction(A=lng_9, B=1)
subset_3 = SubList(List=values_6.Values, Domain=subtraction, Wrap=True)  # -> List, Index
dup_9 = DuplicateData(Data="True", Number=lng_9, Order=True)
panel_27 = Panel(subset_3.List)
hui_values_featureactive = RemoteSender(subset_3.List)
merge_19 = Merge(Data1=flatten(dup_9), Data2=flatten("False"))
hideshow = HideShowElement(ElementToHideShow=flatten(simplegrid_2), Show=merge_19, Collapse=True, Disable=False)
hui_values_featureactive_2 = RemoteReceiver(hui_values_featureactive)
geometry_shapenames_2 = RemoteReceiver(geometry_shapenames)
long_2 = LongestList(ListA=graft(hui_values_featureactive_2), ListB=mindex_2.Index, PaddingMode=2)  # -> flatten(ListA), flatten(ListB)
sort_4 = SortList(Keys=long_2.ListB, ValuesA=long_2.ListA)  # -> Keys, ValuesA
values_feedtomodel = RemoteSender(sort_4.ValuesA)
values_feedtomodel_2 = RemoteReceiver(values_feedtomodel)
cull = CullPattern(List=features_names, CullPattern=values_feedtomodel_2)
panel_28 = Panel(mindex_2.Index)
merge_20 = Merge(
    Data1=ColourSwatch(SwatchColor=RGB(10, 255, 71)),
    Data2=ColourSwatch(SwatchColor=RGB(255, 215, 54)),
    Data3=ColourSwatch(SwatchColor=RGB(213, 61, 255)),
    Data4=ColourSwatch(SwatchColor=RGB(61, 213, 255)),
    Data5=ColourSwatch(SwatchColor=RGB(68, 61, 255)))  # -> graft(Result)
features_names_2 = RemoteReceiver(features_names)
geometry_shapenames_3 = RemoteReceiver(geometry_shapenames)
number_slider_8 = Slider(0.64, range=0..1)
eval = Evaluate(F="1-x", x=number_slider_8)
wires = BrepWireframe(Density=-1)

# ----
# ToolDescription: Enter a description of this definition's functionality and use
update_file_info = Button()
group_prefixes = Panel("""out_
in_
action_
warning_
cluster""")
c_script = CSharpScript(update=color_groups_clusters, name=group_prefixes, col=col)  # -> out, A; inputs update: Boolean, name: list of String, col: list of Color
# ---------- c_script: C# ----------
    Color clusterColor = Color.Transparent;
    for(int i = 0;i < name.Count;i++){
      if(name[i].Contains("cluster")){
        clusterColor = col[i];
        break;
      }
    }



    if(update){
      List<Guid> guids = new List<Guid>();
      List<Grasshopper.Kernel.Special.GH_Group> grps = new List<Grasshopper.Kernel.Special.GH_Group>();
      List<Grasshopper.Kernel.Special.GH_Group> alreadygrps = new List<Grasshopper.Kernel.Special.GH_Group>();


      foreach(IGH_DocumentObject o in GrasshopperDocument.Objects){
        Grasshopper.Kernel.Special.GH_Group g = o as Grasshopper.Kernel.Special.GH_Group;
        if(g != null){
          for(int j = 0;j < name.Count;j++){
            if(g.NickName.ToUpper().Contains(name[j].ToUpper())){
              g.Colour = col[j % col.Count];
            }

          }
        }


        if(o is Grasshopper.Kernel.Special.GH_Cluster){
          Grasshopper.Kernel.Special.GH_Cluster cluster = o as  Grasshopper.Kernel.Special.GH_Cluster;
          string filepath = cluster.FilePath;
          if(!String.IsNullOrEmpty(filepath)){
            cluster.Name = System.IO.Path.GetFileNameWithoutExtension(filepath);
            cluster.NickName = System.IO.Path.GetFileNameWithoutExtension(filepath);
            cluster.Attributes.ExpireLayout();
          }
          guids.Add(cluster.InstanceGuid);
          Grasshopper.Kernel.Special.GH_Group grp = new Grasshopper.Kernel.Special.GH_Group();
          grps.Add(grp);

        } else if (o is Grasshopper.Kernel.Special.GH_Group){
          Grasshopper.Kernel.Special.GH_Group alreadygrp = o as Grasshopper.Kernel.Special.GH_Group;
          alreadygrps.Add(alreadygrp);
        }





      }

      List<bool> isAlreadyInGroup = IsAlreadyInGroup(guids, alreadygrps);

      for(int i = 0;i < grps.Count;i++){
        Grasshopper.Kernel.Special.GH_Group grp = grps[i];
        grp.Colour = clusterColor;
        grp.NickName = "";
        grp.AddObject(guids[i]);
        if(!isAlreadyInGroup[i]){
          grp.ExpireCaches();
          GrasshopperDocument.AddObject(grp, false, 1000);
        }
      }



    }
# ---------- c_script: C# additional code ----------
  List<bool> IsAlreadyInGroup(List<Guid> guids, List<Grasshopper.Kernel.Special.GH_Group> grps){
    List<bool> results = new List<bool>();
    foreach(Guid g in guids){
      results.Add(false);
    }
    foreach(Grasshopper.Kernel.Special.GH_Group grp in grps){ //for every group in the pre-existing groups
      if(grp.Objects().Count == 1){ //if that group only has one object in it
        for (int j = 0;j < guids.Count;j++){
          Guid g = guids[j];
          if(grp.ObjectIDs.Contains(g)){
            results[j] = true;
            break;
          }
        }
      }
    }
    return results;
  }
# ---------- end c_script ----------

data_79 = Data(update_file_info)

c_script_2 = CSharpScript(x=data_79)  # -> out, A, B, C, D, E
# ---------- c_script_2: C# ----------
    List < IGH_DocumentObject> objectsRecursive = new List<IGH_DocumentObject>();
    objectsRecursive.AddRange(clusterObjectsRecursive(GrasshopperDocument));


    B = GrasshopperDocument.Author.Name + " " + GrasshopperDocument.Author.Email;
    D = GrasshopperDocument.Properties.DateTag;
    if(GrasshopperDocument.IsFilePathDefined){
      C = GrasshopperDocument.FilePath;
      System.IO.FileInfo info = new System.IO.FileInfo(GrasshopperDocument.FilePath);
      if(info.LastWriteTime != null){
        E = info.LastWriteTime;
      } else {
        E = "";
      }
    } else {
      C = "Unsaved Document";
      E = "";
    }
    A = objectsRecursive;
# ---------- c_script_2: C# additional code ----------
  List<IGH_DocumentObject> clusterObjectsRecursive(GH_Document doc){
    List<IGH_DocumentObject> objList = new List<IGH_DocumentObject>();
    objList.AddRange(doc.Objects);
    foreach(IGH_DocumentObject obj in doc.Objects){
      Grasshopper.Kernel.Special.GH_Cluster cluster = obj as Grasshopper.Kernel.Special.GH_Cluster;
      try{
        objList.AddRange(clusterObjectsRecursive(cluster.Document("")));
      } catch {

      }
    }
    return objList;
  }
# ---------- end c_script_2 ----------
cluster_3 = Cluster_2(T=c_script_2.A, N=c_script_2.B, fn=c_script_2.C, dc=c_script_2.D, dm=c_script_2.E)
file_info = Panel(cluster_3)

cluster_4 = Cluster_5(G_2=snap, G=taskbar_hidden, d1=width_start, d2=width_end, d1_2=height_start, d2_2=height_end)  # -> s_1, R, R_2

# ---- group: Width (plug in to Launch Window)
data_80 = Data(cluster_4.R)

# ---- group: Height (plug in to Launch Window)
data_81 = Data(cluster_4.R_2)

# ---- group: Window Position (plug in to Window Appearance)
# DOMAIN WINDOW
pt_12 = Point(cluster_4.s_1)

# ----
launchwin = LaunchWindow(Show=Toggle(True), Name=window_name, Width=data_80, Height=data_81, ChildStatus=1, EnableHorizScroll=False)
winprops = SetWindowProperties(Window=launchwin, StartingLocation=pt_12, ShowTitleBar=True, ScaleFactor=1)
data_82 = Data(launchwin)

hui_windows = RemoteSender(data_82)
addelems = AddElements(Window=launchwin, Elements=flatten(merge_14), DoVLChecking=True)  # -> AddedElements, ElementNames

# ---- group: length of slice at low mid and high
panel_29 = Panel("""0.1
0.5
0.9""")
box_3 = EvaluateBox(Box=bbox_3.Box, UParameter="0", VParameter="0", WParameter=panel_29)  # -> Plane, Point, Include

# ----
sec = MeshPlane(Mesh=geo_7, Plane=box_3.Plane)

# ---- group: length of slice at low mid and high (continued)
trim_3 = TrimTree(Tree=sec, Depth=1)
len = Length(Curve=trim_3)
item_14 = ListItem(List=simplify(len), Index=0, Wrap=True)  # -> Item, Item1, Item2

# ----
eval_2 = Evaluate(F="z/y + z/x + y/z + y/x + x/z + x/y", x=item_14.Item, y=item_14.Item1, z=item_14.Item2)
merge_21 = Merge(
    Data2=panel_17,
    Data4=panel_18,
    Data5=panel_19,
    Data6=panel_20,
    Data10=item_14.Item,
    Data11=item_14.Item1,
    Data12=item_14.Item2,
    Data13=eval_2)
features_values_nate = RemoteSender(merge_21)
geo_28 = Geometry(sec)
features_values_nate_2 = RemoteReceiver(features_values_nate)
merge_22 = Merge(Data1=features_values_nate_2, Data2=features_values_mark_2, Data3=features_values_viewfactor_2)
cull_2 = CullPattern(List=merge_22, CullPattern=values_feedtomodel_2)
features_values = RemoteSender(cull_2)
# ADD METADATA
bakeud = BakeWithUserData(geometry=geometry_meshes_6, field_names=cull, field_values=features_values, clear=True)
bakeud_2 = BakeWithUserData(geometry=bakeud, field_names="Shape", field_values=geometry_shapenames_2, clear=False)
geometry_withdata = RemoteSender(bakeud_2)

# ----
# ML Stuffs
features_values_2 = RemoteReceiver(features_values)
flip_3 = FlipMatrix(Data=features_values_2)
bnd = Bounds(Numbers=flip_3)  # -> flatten(Domain)
remap = RemapNumbers(Value=features_values_2, Source=bnd, Target=Domain(0, 1))  # -> Mapped, Clipped
datatree_to_tensorset = DataTreeToTensorSet(DataTree=features_values_2)  # "DT->TS"
kmeans = KMeansClustering(Data=datatree_to_tensorset, Clusters=Slider(4, range=0..20), Iterations=Slider(509, range=0..7300), Seed=66)  # -> Clusters, Indices
mll_stuff = RemoteSender(kmeans.Indices)

mll_stuff_2 = RemoteReceiver(mll_stuff)
geometry_withdata_2 = RemoteReceiver(geometry_withdata)
item_15 = ListItem(List=flatten(geometry_withdata_2), Index=mll_stuff_2, Wrap=True)
lng_10 = ListLength(List=item_15)
lng_11 = ListLength(List=flatten(lng_10))
readud = ReadUserData(geometry=item_15)  # -> field_names_2, field_values_2
range_3 = Range(Domain=Domain(0, 1), Steps=expr("x-1", lng_11))
# Visualization Stuffs
gradient = Gradient(
    LowerLimit=0,
    UpperLimit=1,
    Parameter=range_3,
    stops=[0: RGB(243, 57, 0), 0.1: RGB(236, 27, 60), 0.2: RGB(210, 0, 118), 0.3: RGB(103, 0, 120), 0.4: RGB(39, 72, 161), 0.5: RGB(1, 192, 229), 0.6: RGB(18, 178, 90), 0.7: RGB(79, 186, 8), 0.8: RGB(220, 237, 32), 0.9: RGB(247, 159, 20), 1: RGB(243, 57, 0)])
keysearch = KeyValueSearch(Keys=readud.field_names_2, Values=readud.field_values_2, Search="Shape")
panel_30 = Panel(readud.field_names_2)
data_83 = Data(graft(gradient))
mll_stuff_3 = RemoteReceiver(mll_stuff)
pshift = ShiftPaths(Data=keysearch, Offset=-1)
long_3 = LongestList(ListA=data_83, ListB=ColourSwatch(SwatchColor=RGB(255, 255, 255)), PaddingMode=2)  # -> ListA, ListB
merge_23 = Merge(Data1=long_3.ListA, Data2=long_3.ListB)
cset_2 = CreateSet(List=pshift)  # -> Set, Map
item_16 = ListItem(List=flatten(geometry_shapenames_3), Index=mll_stuff_2, Wrap=True)
mindex_3 = MemberIndex(Set=pshift, Member=cset_2.Set)  # -> Index, Count
sort_5 = SortList(Keys=mindex_3.Count, ValuesA=cset_2.Set)  # -> Keys, reverse(ValuesA)
item_17 = ListItem(List=sort_5.ValuesA, Index=0, Wrap=True)
panel_31 = Panel(item_16)
tmatch = MatchText(Text=pshift, Pattern=item_17, Case=True)  # -> graft(Match)
wav = WeightedAverage(Input=merge_23, Weights=[number_slider_8, eval])
cull_3 = CullPattern(List=wires, CullPattern=invert(tmatch))
material_2 = CreateMaterial(Diffuse=wav, Specular=wav, Emission=ColourSwatch(SwatchColor=RGB(48, 48, 48)), Transparency=0, Shine=0)
previewlw_4 = CustomPreviewLineweights(Geometry=cull_3, Shader=ColourSwatch(SwatchColor=RGB(255, 0, 0)), Thickness=Slider(8, range=0..10), Absolute=False)
long_4 = LongestList(ListA=item_15, ListB=material_2, PaddingMode=2)  # -> ListA, ListB
panel_32 = Panel(material_2)
preview_3 = CustomPreview(Geometry=long_4.ListA, Shader=long_4.ListB)

# ==== cluster Cluster_2
T = ClusterInput()
N = ClusterInput()
fn = ClusterInput()
dc = ClusterInput()
dm = ClusterInput()
cluster = Cluster(T=T, N=N, fn=fn, dc=dc, dm=dm)  # -> T_2, author_2, objcount_2, fn_3, dc_4, dm_4
merge = Merge(
    Data1=cluster.author_2,
    Data2=cluster.T_2,
    Data3=cluster.objcount_2,
    Data4=cluster.fn_3,
    Data5=cluster.dc_4,
    Data6=cluster.dm_4)
R = ClusterOutput(merge)

# ==== cluster DLength: computes length of a domain
I = ClusterInput()
dedomain = DeconstructDomain(Domain=I)  # -> Start, End
subtraction = Subtraction(A=dedomain.Start, B=dedomain.End)
abs = Absolute(Value=subtraction)
y = ClusterOutput(abs)

# ==== cluster BakeWithUserData: Bake geometry with associated user data. You can embed Rhino geometry with an arbitrary amount of additional data which can be retrieved at a later time. Options to clear the dictionary with each refresh.
clear = ClusterInput()  # Clear user dictionaries on each refresh (prevents build-up of unwanted KV pairs over multiple iterations). Defaults to true.
field_names = ClusterInput()  # The field names - or keys - associated with the data you're embedding. You can use this to later retrieve data from your geometry. For example, a field name might be "Color" while a field value is "Red".
bake = ClusterInput()  # Set to true to bake geometry with user data.
geometry = ClusterInput()  # Geometry to bake
field_values = ClusterInput()  # The values of the data you're embedding. This data can be retrieved later from your geometry. For example, a field name might be "Color" while a field value is "Red".
object_attributes = ClusterInput()  # The optional object attributes to use when baking. Use an "Object Attributes" component from Human to construct these, including layer name, color, and other properties.
bake_2 = Boolean(bake)
geo = Geometry(geometry)
fn = Text(field_names)
att = Data(object_attributes)
bool = Boolean(clear)
fv = Text(field_values)
bakeuserdict = BakeWithUserDictionary(bake=bake_2, G=geo, FN=fn, FV=fv, att=att, clear=bool)  # -> out, A; inputs bake: Boolean, G: GeometryBase, FN: list of String, FV: list of String, clear: Boolean
# ---------- bakeuserdict: C# ----------
    ObjectAttributes oAtt = att as ObjectAttributes;
    if(oAtt == null) oAtt = RhinoDocument.CreateDefaultAttributes();
    if(clear){
      G.UserDictionary.Clear();
    }
    for(int i = 0;i < FN.Count;i++){
      G.UserDictionary.Set(FN[i], FV[i]);
    }
    if(bake){
      RhinoDocument.Objects.Add(G, oAtt);
    }
    A = G;
# ---------- end bakeuserdict ----------
G = Geometry(bakeuserdict.A)
geometry_2 = ClusterOutput(G)  # Geometry with embedded data.

# ==== cluster ReadUserData: Reads embedded user data from a piece of geometry. Data can be embedded in geometry with the Bake User Data component.
geometry = ClusterInput()  # Geometry that has been embedded with User Data. The Bake User Data component can create this kind of geometry.
field_filter = ClusterInput()  # Optional Filter, if you want to retrieve a particular field from the geometry's data.
geo = Geometry(geometry)
filter = Text(field_filter)
readuser_data = CSharpScript(G=geo)  # -> out, A, B; inputs G: GeometryBase
# ---------- readuser_data: C# ----------
    A = G.UserDictionary.Keys;
    B = G.UserDictionary.Values;
# ---------- end readuser_data ----------
fsim = FindSimilarMember(Data=filter, Set=readuser_data.A)  # -> Hit, Index
item = ListItem(List=readuser_data.B, Index=fsim.Index, Wrap=True)
backup = BackupData(priority_data=fsim.Hit, secondary_data=readuser_data.A)
backup_2 = BackupData(priority_data=item, secondary_data=readuser_data.B)
field_names = Text(backup)
field_values = Text(backup_2)
field_names_2 = ClusterOutput(field_names)  # The names of the fields embedded in the geometry.
field_values_2 = ClusterOutput(field_values)  # The data values embedded in the geometry.

# ==== cluster DLength_2: computes length of a domain
data = ClusterInput()
I = ClusterInput()
data_2 = Data(data)
dedomain = DeconstructDomain(Domain=I)  # -> Start, End
addition = Addition(A=data_2, B=dedomain.Start)
addition_2 = Addition(A=data_2, B=dedomain.End)
subtraction = Subtraction(A=dedomain.Start, B=dedomain.End)
data_3 = Data(addition)
abs = Absolute(Value=subtraction)
data_4 = Data(addition_2)
data_5 = ClusterOutput(data_4)
data_6 = ClusterOutput(data_3)
y = ClusterOutput(abs)

# ==== cluster Cluster_3
data = ClusterInput()
data_2 = Data(data)
pdecon = Deconstruct(Point=data_2)  # -> XComponent, YComponent, ZComponent
merge = Merge(Data1=pdecon.XComponent, Data2=pdecon.YComponent, Data3=pdecon.ZComponent)
data_3 = Data(merge)
data_4 = ClusterOutput(data_3)

# ==== cluster Cluster_4
C = ClusterInput()
explode = Explode(Curve=C, Recursive=True)  # -> Segments, Vertices
trim = TrimTree(Tree=explode.Vertices, Depth=1)
hull = ConvexHull(Points=trim, Plane=PlaneXY(0, 0, 0))  # -> Hull, HullZ, Indices
hz = ClusterOutput(hull.HullZ)

# ==== cluster Cluster_5
getscreen = GetScreenDimensions()  # -> Width, Height
toolbarheight = Slider(40, range=0..100)
d1 = ClusterInput()
d2 = ClusterInput()
d1_2 = ClusterInput()
d2_2 = ClusterInput()
G = ClusterInput()
merge = Merge(Data1=flatten(d1), Data2=flatten(d2))
includes_dpi_scaling = Panel([getscreen.Width, getscreen.Height])
merge_2 = Merge(Data1=flatten(d1_2), Data2=flatten(d2_2))
subtraction = Subtraction(A=getscreen.Height, B=toolbarheight)
sort = SortList(Keys=merge)  # -> Keys, ValuesA
sort_2 = SortList(Keys=merge_2)  # -> Keys, ValuesA
filter = StreamFilter(Gate=G, Stream0=subtraction, Stream1=getscreen.Height)
item = ListItem(List=sort.Keys, Index=0, Wrap=True)  # -> Item, Item1
item_2 = ListItem(List=sort_2.Keys, Index=0, Wrap=True)  # -> Item, Item1
multiplication = Multiplication(A=filter, B=item_2.Item)
subtraction_2 = Subtraction(A=item.Item1, B=item.Item)
multiplication_2 = Multiplication(A=getscreen.Width, B=item.Item)
subtraction_3 = Subtraction(A=item_2.Item1, B=item_2.Item)
G_2 = ClusterInput()
multiplication_3 = Multiplication(A=getscreen.Width, B=subtraction_2)
multiplication_4 = Multiplication(A=getscreen.Height, B=subtraction_3)
pt = ConstructPoint(XCoordinate=multiplication_2, YCoordinate=multiplication, ZCoordinate=0)
R = ClusterOutput(multiplication_3)
R_2 = ClusterOutput(multiplication_4)
filter_2 = StreamFilter(Gate=G_2, Stream1=pt)
s_1 = ClusterOutput(filter_2)

# ==== cluster SetMargin
int = ClusterInput()
int_2 = ClusterInput()
int_3 = ClusterInput()
int_4 = ClusterInput()
int_5 = Integer(int)
int_6 = Integer(int_2)
int_7 = Integer(int_3)
int_8 = Integer(int_4)
merge = Merge(Data1=int_5, Data2=int_7, Data3=int_8, Data5=int_6)
join = TextJoin(Text=merge, Join=",")
R = ClusterOutput(join)

# ==== cluster Cluster
N = ClusterInput()
T = ClusterInput()
N_2 = Text(N)
split = TextSplit(Text=T, Separators=".")
fn = ClusterInput()
dm = ClusterInput()
item = ListItem(List=split, Index=0, Wrap=True)
dc = ClusterInput()
pan = Panel("""HDT_Reference
HDTReference""")
pan_2 = Panel("""Human
Human""")
lng = ListLength(List=T)
len = TextLength(Text=N_2)
contains = ContainsAB(B=N_2)
dm_2 = Text(dm)
dc_2 = Text(dc)
fn_2 = Text(fn)
replace = ReplaceMembers(Set=item, Find=pan, Replace=pan_2)
cset = CreateSet(List=flatten(replace))  # -> Set, Map
txt = Text(["ScriptComponents", "Grasshopper", "MathComponents", "GalapagosComponents", "FieldComponents", "VectorComponents", "AnalysisComponents", "CurveComponents", "LegacyScriptComponents", "SurfaceComponents", "TriangulationComponents", "MassXForms", "LinearXForms"])
format = Format(Format="Definition by {0}", Culture=127, Data0=N_2)
difference = SetDifference(SetA=cset.Set, SetB=txt)
lng_2 = ListLength(List=flatten(difference))
dispatch = Dispatch(List=format, DispatchPattern=contains)  # -> ListA, ListB
format_2 = Format(Format="Object Count: {0:0}", Culture=127, Data0=lng)
format_3 = Format(Format="Date Modified: {0}", Culture=127, Data0=dm_2)
format_4 = Format(Format="Date Created: {0}", Culture=127, Data0=dc_2)
dependencies = Text(flatten(difference))
author = Text(flatten(dispatch.ListB))
larger = LargerThan(FirstNumber=lng_2, SecondNumber="1")  # -> LargerThan, OrEqualTo
objcount = Text(flatten(format_2))
author_2 = ClusterOutput(author)
dm_3 = Text(flatten(format_3))
fn_3 = ClusterOutput(fn_2)
dc_3 = Text(flatten(format_4))
objcount_2 = ClusterOutput(objcount)
dc_4 = ClusterOutput(dc_3)
filter = StreamFilter(
    Gate=larger.LargerThan,
    Stream0="This definition requires the following plug-in:",
    Stream1="This definition requires the following plug-ins:")
dm_4 = ClusterOutput(dm_3)
pan_3 = Panel("""{0}
{1}""")
join = TextJoin(Text=dependencies)
format_5 = Format(Format=pan_3, Culture=127, Data0=filter, Data1=join)
clean = CleanTree(Tree=format_5, CleanInvalid=True, CleanEmpty=False)
T_2 = ClusterOutput(clean)

# ==== cluster BackupData: Passes the list without nulls
secondary_data = ClusterInput()
priority_data = ClusterInput()
null = NullItem(
    A=null.ResultA,
    InternalDocument_plugin_version=(0, 9, 76),
    InternalDocument_DocumentHeader_PreviewMeshType=1,
    InternalDocument_DocumentHeader_PreviewNormal=RGBA(150, 0, 0, 100),
    InternalDocument_DocumentHeader_PreviewSelected=RGBA(0, 120, 0, 100),
    InternalDocument_DefinitionProperties_Projection_Zoom=1.25)  # -> A, A_2
secondary_data_2 = Data(secondary_data)
priority_data_2 = Data([priority_data, null.A_2])
clean = CleanTree(Tree=priority_data_2, CleanInvalid=True, CleanEmpty=False)
lng = ListLength(List=clean)
null_2 = NullItem(Items=clean)  # -> NullFlags, InvalidFlags
equals = Equality(FirstNumber="0", SecondNumber=lng)  # -> Equality, Inequality
clean_2 = CleanTree(Data=clean, CleanInvalid=True, CleanEmpty=False)
not = GateNot(A=null_2.NullFlags)
ma = MassAddition(Input=flatten(not))  # -> Result, PartialResult
bool = Boolean(ma.Result)
filter = StreamFilter(Gate=bool, Stream0=secondary_data_2, Stream1=clean_2)
data = Data(filter)
data_2 = ClusterOutput(data)

# ==== cluster ContainsAB: Tests if a string contains another string.
B = ClusterInput()
A = ClusterInput()
A_2 = String(A)
B_2 = String(B)
eval = Evaluate(F="Contains(x,y)", x=A_2, y=B_2)
c = Boolean(eval)
c_2 = ClusterOutput(c)
