# Grasshopper definition Viewfactor.ghx (Grasshopper 0.9.76)
# plug-ins: Python Interpreter, LunchBox, MetaHopper, Telepathy

geometry = GeometryPipeline(
    GroupByLayer=False,
    GroupByType=False,
    IncludeHidden=True,
    IncludeLocked=True,
    LayerFilter="Geometry",
    NameFilter="*",
    TypeFilter=1073741848)

# ---- group: create dodecahedron points
relpath = RelativePath(Path="dodecahedron.csv")
file = ReadFile(File=relpath, PerLineParse=True)
csv = ReadCSV(CSVString=file, Delimiter=",")  # -> Headers, Values
flip = FlipMatrix(Data=csv.Values)
item = ListItem(List=flip, Index="0", Wrap=True)
item_2 = ListItem(List=flip, Index="2", Wrap=True)
item_3 = ListItem(List=flip, Index="1", Wrap=True)
pt = ConstructPoint(XCoordinate=item, YCoordinate=item_3, ZCoordinate=item_2)

# ----
volume = Volume(Geometry=geometry)  # -> Volume, Centroid
bbox = BoundingBox(Content=geometry, Plane=PlaneXY(0, 0, 0))  # -> Box, Box_2
move = Move(Geometry=pt, Motion=volume.Centroid)  # -> Geometry, Transform
debrep = DeconstructBrep(Brep=geometry)  # -> Faces, Edges, Vertices
cullpt = CullDuplicates(Points=move.Geometry, Tolerance=0.1, CullMode=3)  # -> Points, Indices, Valence
debrep_2 = DeconstructBrep(Brep=bbox.Box)  # -> Faces, Edges, Vertices

# ---- group: cpt
geo = Geometry(volume.Centroid)

# ----
dist = Distance(PointA=volume.Centroid, PointB=debrep.Vertices)
python = PythonScript(sphere_tree_in=cullpt.Points, cpt_lst_in=geo, bound_srf_lst_in=debrep_2.Faces)  # -> sphere_out, cpt_out; inputs sphere_tree_in: tree, cpt_lst_in: list, bound_srf_lst_in: tree
# ---------- python: Python ----------
import rhinoscriptsyntax as rs
import Rhino as rc
import pprint
import scriptcontext as sc


""" Calculate View Factor 

"""
class ViewFactor(object):
    def __init__(self):
        self.sphere_nested = []
        self.cpt = []
        self.bound_nested = []
        
    def process_raw_inputs(self,sphere_tree_in,bound_srf_lst_in,cpt_lst_in):
        self.cpt = cpt_lst_in
        # convert tree to nested list of sphere pts
        for i in range(sphere_tree_in.BranchCount):
            branchList = sphere_tree_in.Branch(i)
            self.sphere_nested.append(branchList)
        
        # convert tree to nested list of bound srfs
        for i in range(bound_srf_lst_in.BranchCount):
            branchList = bound_srf_lst_in.Branch(i)
            self.bound_nested.append(branchList)
        
        # convert guids to brep 
        for i in xrange(len(self.sphere_nested)):
            sphere_per_bld = list(self.sphere_nested[i])
            for j in xrange(len(sphere_per_bld)):
                sphere_per_bld[j] = rs.coerce3dpoint(sphere_per_bld[j])
            self.sphere_nested[i] = sphere_per_bld
    
    def ray_cast(self,srf2int):
        """
        base_vector
        direction_vector
        srf2int
        """
        for i in xrange(self.sphere_nested):
            sphere_pt = self.sphere_nested[i]
            r0 = self.cpt#base_vector
            r1 = self.sphere#direction_vector
            
            ray = rc.Geometry.Ray3d(r0,r1)
            point_intersect_lst = rc.Geometry.Intersect.Intersection.RayShoot(ray,[srf2int],1)
            if point_intersect_lst:
                point_intersect_lst = list(point_intersect_lst)
                #debug.extend(point_intersect_lst)
                #debug.append(self.cpt)
        return point_intersect_lst

vf = ViewFactor()
vf.process_raw_inputs(sphere_tree_in, bound_srf_lst_in, cpt_lst_in)
vf.ray_cast()

sphere_out = vf.sphere_nested
cpt_out = vf.cpt
# ---------- end python ----------
panel = Panel(dist)
panel_2 = Panel(python.sphere_out)
panel_3 = Panel(python.cpt_out)
panel_4 = Panel(cullpt.Points)
viewfactor_vertices = RemoteSender(debrep.Vertices)
viewfactor_distancetovertices = RemoteSender(panel)
