# Grasshopper definition basic geo analysis + owl-MSyp conduit.ghx (Grasshopper 0.9.76)
# plug-ins: ProvingGround.Conduit, Python Interpreter, treesloth01, Human, LunchBox, MetaHopper, TT Toolbox, Telepathy, Owl.GH

# ----
# NUMBER OF INDIVIDUAL PRIMITIVES
number_slider = Slider(100, range=0..100)

panel = Panel("BASE PLANE")
pln = Plane(PlaneXY(0.08767023439, 0.0884122404, 0))

num = Number(50)
range = Range(Domain=num, Steps=number_slider)
num_2 = Number(0)
geometry = GeometryPipeline(
    GroupByLayer=False,
    GroupByType=False,
    IncludeHidden=True,
    IncludeLocked=True,
    LayerFilter="Geometry",
    NameFilter="*",
    TypeFilter=1073741880)
cull_i = CullIndex(List=range, Indices=num_2, Wrap=True)
geoattrib = GetGeometryAttributes(Geometry=geometry)  # -> GeometryNames, GUID, Layer
geometry_meshes = RemoteSender(geometry)
panel_2 = Panel(cull_i)
geometry_bins = RemoteSender(geoattrib.GeometryNames)

python = PythonScript()  # -> out, random_int
# ---------- python: Python ----------
import Rhino.Geometry as rg
import rhinoscriptsyntax as rs
import math

from random import randint
random_int = (randint(0, 100))
# ---------- end python ----------
python_2 = PythonScript()  # -> out, random_int; same code as python
python_3 = PythonScript()  # -> out, random_int; same code as python
python_4 = PythonScript()  # -> out, random_int; same code as python
python_5 = PythonScript()  # -> out, random_int; same code as python
python_6 = PythonScript()  # -> out, random_int; same code as python
python_7 = PythonScript()  # -> out, random_int; same code as python
python_8 = PythonScript()  # -> out, random_int; same code as python
# Generate Test Geo
panel_3 = Panel("RANDOMIZE SHIT")
jitter = Jitter(List=panel_2, Jitter=1, Seed=python.random_int)  # -> Values, Indices
jitter_2 = Jitter(List=panel_2, Jitter=1, Seed=python_3.random_int)  # -> Values, Indices
jitter_3 = Jitter(List=panel_2, Jitter=1, Seed=python_4.random_int)  # -> Values, Indices
jitter_4 = Jitter(List=panel_2, Jitter=1, Seed=python_5.random_int)  # -> Values, Indices
jitter_5 = Jitter(List=panel_2, Jitter=1, Seed=python_2.random_int)  # -> Values, Indices
jitter_6 = Jitter(List=panel_2, Jitter=1, Seed=python_6.random_int)  # -> Values, Indices
jitter_7 = Jitter(List=panel_2, Jitter=1, Seed=python_7.random_int)  # -> Values, Indices
jitter_8 = Jitter(List=panel_2, Jitter=1, Seed=python_8.random_int)  # -> Values, Indices

geometry_meshes_2 = RemoteReceiver(geometry_meshes)
geometry_bins_2 = RemoteReceiver(geometry_bins)
color_groups_clusters = Button(ExpressionNormal="True")
geo = Geometry(geometry_meshes_2)

# ---- group: create dodecahedron points
relpath = RelativePath(Path="dodecahedron.csv")
file = ReadFile(File=relpath, PerLineParse=True)
csv = ReadCSV(CSVString=file, Delimiter=",")  # -> Headers, Values
flip = FlipMatrix(Data=csv.Values)
item = ListItem(List=flip, Index="0", Wrap=True)
item_2 = ListItem(List=flip, Index="1", Wrap=True)
item_3 = ListItem(List=flip, Index="2", Wrap=True)
pt = ConstructPoint(XCoordinate=item, YCoordinate=item_2, ZCoordinate=item_3)

# ----
panel_4 = Panel("PRIMITIVE CREATION")
box = CenterBox(Base=pln, X=jitter_2.Values, Y=jitter_3.Values, Z=jitter_4.Values)
cone = Cone(Base=pln, Radius=jitter_7.Values, Length=jitter_8.Values)  # -> Cone, Tip
sph = Sphere(Base=pln, Radius=jitter_6.Values)
cyl = Cylinder(Base=pln, Radius=jitter.Values, Length=jitter_5.Values)

col = Colour([RGBA(4, 0, 255, 135), RGBA(0, 128, 255, 133), RGBA(210, 255, 148, 141), RGBA(255, 0, 0, 122), RGBA(224, 224, 224, 211)])
capex = CapHolesEx(Brep=sph)  # -> Brep, Caps, Solid
capex_2 = CapHolesEx(Brep=box)  # -> Brep, Caps, Solid
capex_3 = CapHolesEx(Brep=cyl)  # -> Brep, Caps, Solid
capex_4 = CapHolesEx(Brep=cone.Cone)  # -> Brep, Caps, Solid
panel_5 = Panel(capex.Brep)
panel_6 = Panel(capex_4.Brep)
panel_7 = Panel(capex_3.Brep)
panel_8 = Panel(capex_2.Brep)
demesh = DeconstructMesh(Mesh=geo)  # -> Vertices, Faces, Colours, Normals
volume = Volume(Geometry=geo)  # -> Volume, Centroid
geo_2 = Geometry(demesh.Vertices)
move = Move(Geometry=pt, Motion=volume.Centroid)  # -> Geometry, Transform
cullpt = CullDuplicates(Points=move.Geometry, Tolerance=0.1, CullMode=3)  # -> Points, Indices, Valence
entwine = Entwine(Branch00=capex_4.Brep, Branch01=capex_3.Brep, Branch02=capex_2.Brep, FlattenInputs=True)  # -> flatten(Result)
bbox = BoundingBox(Content=geo, Plane=PlaneXY(0, 0, 0))  # -> Box, Box_2
dist = Distance(PointA=volume.Centroid, PointB=geo_2)
flip_2 = FlipMatrix(Data=cullpt.Points)
debrep = DeconstructBrep(Brep=bbox.Box)  # -> Faces, Edges, Vertices

# ---- group: cpt
geo_3 = Geometry(volume.Centroid)

# ----
data = Data(capex_2.Brep)
data_2 = Data(capex_3.Brep)
data_3 = Data(capex_4.Brep)
python_9 = PythonScript(sphere_tree_in=flip_2, cpt_lst_in=geo_3, bound_srf_lst_in=debrep.Faces)  # -> ray_tree, header_lst; inputs sphere_tree_in: tree, cpt_lst_in: list, bound_srf_lst_in: tree
# ---------- python_9: Python ----------
import rhinoscriptsyntax as rs
import Rhino as rc
import scriptcontext as sc
#import ghpythonlib as gh
import Grasshopper as gh

""" Calculate View Factor

"""
class ViewFactor(object):
    def __init__(self):
        self.sphere_nested = []
        self.cpt = []
        self.bound_nested = []
        self.bld_num = None
        self.ray_num = None
        # Outputs
        self.raycast_distance = None
        self.raycast_pt_x = None
        self.raycast_pt_y = None
        self.raycast_pt_z = None

    def process_raw_inputs(self,sphere_tree_in,bound_srf_lst_in,cpt_lst_in):
        self.cpt = map(lambda c: rs.coerce3dpoint(c), cpt_lst_in)
        # convert tree to nested list of sphere pts
        for i in range(sphere_tree_in.BranchCount):
            branchList = sphere_tree_in.Branch(i)
            self.sphere_nested.append(branchList)

        # convert tree to nested list of bound srfs
        for i in range(bound_srf_lst_in.BranchCount):
            branchList = bound_srf_lst_in.Branch(i)
            branchList = map(lambda s: rs.coercebrep(s), branchList)
            self.bound_nested.append(branchList)

        # convert guids to rc points
        for i in xrange(len(self.sphere_nested)):
            sphere_per_bld = list(self.sphere_nested[i])
            for j in xrange(len(sphere_per_bld)):
                sphere_per_bld[j] = rs.coerce3dpoint(sphere_per_bld[j])
            self.sphere_nested[i] = sphere_per_bld

        self.bld_num = len(self.sphere_nested)
        self.ray_num = len(self.sphere_nested[0])

    def ray_cast(self):
        """
        base_vector
        direction_vector
        srf2int
        """
        self.ray_int_nested = []
        self.ray_dist_nested = []

        for i in xrange(self.bld_num):
            raypts = []
            raydist = []
            for j in xrange(self.ray_num):
                srf2int_lst = self.bound_nested[i]
                r0 = self.cpt[i] #base_vector
                r1 = self.sphere_nested[i][j] #direction_vector
                #convert pts to vectors
                r1 = rc.Geometry.Vector3d(r1) - rc.Geometry.Vector3d(r0)

                ray = rc.Geometry.Ray3d(r0,r1)
                point_intersect_lst = rc.Geometry.Intersect.Intersection.RayShoot(ray,srf2int_lst,1)
                if point_intersect_lst:
                    point_intersect_lst = list(point_intersect_lst)
                    rpt = point_intersect_lst[0]
                    raypts.append(rpt)
                    raydist.append(rs.Distance(rpt,r0))
                    #rc.Geometry.Vector3d.Multiply(
            self.ray_dist_nested.append(raydist)
            self.ray_int_nested.append(raypts)
        #print len(self.ray_int_nested)
    def generate_viewfactor_matrix(self):
        # flip the matrix
        self.raycast_distance = map(lambda r: [None] * self.ray_num, [None] * self.bld_num)

        self.raycast_x = map(lambda r: [None] * self.ray_num, [None] * self.bld_num)
        self.raycast_y = map(lambda r: [None] * self.ray_num, [None] * self.bld_num)
        self.raycast_z = map(lambda r: [None] * self.ray_num, [None] * self.bld_num)
        self.ray_mtx = []

        self.header_lst = []
        for ri in xrange(self.ray_num):
            hstr = "RAY_{b}_".format(b=ri)
            self.header_lst.extend([hstr+"dist",hstr+"x",hstr+"y",hstr+"z"])
        print len(self.header_lst)
        print self.header_lst
        for i in xrange(self.bld_num):
            self.bld_lst = []
            for j in xrange(self.ray_num):
                d = self.ray_dist_nested[i][j]
                x = self.ray_int_nested[i][j][0]
                y = self.ray_int_nested[i][j][1]
                z = self.ray_int_nested[i][j][2]

                self.bld_lst.extend([d,x,y,z])

                #self.ray_dist_nested[i][j]
                #self.raycast_distance[i][j]
            self.ray_mtx.append(self.bld_lst)
    def pythonListTGhDataTree(self,pythonList):
        """ Converts a  nested Python list to a GH datatree """
        # Create GH datatree
        dataTree = gh.DataTree[object]()

        # Add pythonlist sub lists to dataTree
        for i,l in enumerate(pythonList):
            for v in l:
                dataTree.Add(v,gh.Kernel.Data.GH_Path(i))

        return dataTree
vf = ViewFactor()
vf.process_raw_inputs(sphere_tree_in, bound_srf_lst_in, cpt_lst_in)
vf.ray_cast()
vf.generate_viewfactor_matrix()

header_lst = vf.header_lst
ray_tree = vf.pythonListTGhDataTree(vf.ray_mtx)
#header_tree
print len(vf.ray_mtx)
print len(vf.bld_lst)

#sphere_out = vf.sphere_nested
#cpt_out = vf.cpt




ray_out = reduce(lambda x,y: x+y, vf.ray_int_nested)
# ---------- end python_9 ----------
lng = ListLength(List=data)

# ---- group: find farthest vertex
sort = SortList(Keys=dist)  # -> Keys, ValuesA
rev = ReverseList(List=sort.Keys)
item_4 = ListItem(List=rev, Index=0, Wrap=True)

# ----
lng_2 = ListLength(List=data_2)
lng_3 = ListLength(List=data_3)

# ---- group: vertexDistanceMean
avr = Average(Input=dist)

# ----
dup = DuplicateData(Data="Box", Number=lng, Order=True)  # -> flatten(Data)
dup_2 = DuplicateData(Data="Cylinder", Number=lng_2, Order=True)  # -> flatten(Data)
dup_3 = DuplicateData(Data="Cone", Number=lng_3, Order=True)  # -> flatten(Data)
path_mapper = PathMapper(python_9.ray_tree, source="{A}", target="{0;A}")
number_slider_2 = Slider(0.5, range=0..1)
merge = Merge(Data1=dup_3, Data2=dup_2, Data3=dup)

mindex = MemberIndex(Set=dist, Member=item_4)  # -> Index, Count
item_5 = ListItem(List=mindex.Index, Index=0, Wrap=True)
item_6 = ListItem(List=geo_2, Index=item_5, Wrap=True)
pdecon = Deconstruct(Point=item_6)  # -> simplify(XComponent), simplify(YComponent), simplify(ZComponent)

jitter_9 = Jitter(List=merge, Jitter=number_slider_2, Seed=2)  # -> Values, Indices
jitter_10 = Jitter(List=entwine, Jitter=number_slider_2, Seed=2)  # -> Values, Indices
data_4 = Data(simplify(graft(jitter_9.Values)))
graft = GraftTree(Tree=jitter_10.Values, IncludeEmptyLists=True, IncludeNullItems=True)
path_mapper_2 = PathMapper(pdecon.XComponent, source="{A}", target="{0;A}")
path_mapper_3 = PathMapper(pdecon.YComponent, source="{a}", target="{0;a}")
path_mapper_4 = PathMapper(pdecon.ZComponent, source="{a}", target="{0;a}")
merge_2 = Merge(
    Data1="vertexDistanceMean",
    Data2="vertexFarthestDistance",
    Data3="vertexFarthestX",
    Data4="vertexFarthestY",
    Data5="vertexFarthestZ")
long = LongestList(ListA=Slider(111, range=70..130), ListB=graft, PaddingMode=2)  # -> ListA, ListB
merge_3 = Merge(Data1=avr, Data2=item_4, Data3=path_mapper_2, Data4=path_mapper_3, Data5=path_mapper_4)
path_mapper_5 = PathMapper(merge_2, source="{A}", target="{0;A}")
ma = MassAddition(Input=flatten(long.ListA))  # -> Result, PartialResults
volume_2 = Volume(Geometry=long.ListB)  # -> Volume, Centroid
merge_4 = Merge(Data1=path_mapper_5, Data2=python_9.header_lst)  # -> simplify(Result)
merge_5 = Merge(Data1=merge_3, Data2=path_mapper)  # -> simplify(Result)
pt_2 = ConstructPoint(XCoordinate=0, YCoordinate=ma.PartialResults, ZCoordinate=0)  # -> graft(Point)
shift = ShiftPaths(Data=merge_4, Offset=-1)
orient = Orient(Geometry=long.ListB, Source=volume_2.Centroid, Target=pt_2)  # -> Geometry, Transform
geometry_shapenames = RemoteSender("Building")
features_values_viewfactor = RemoteSender(merge_5)
geometry_primitives = RemoteSender(orient.Geometry)
features_names_viewfactor = RemoteSender(shift)
geometry_meshes_3 = RemoteReceiver(graft(geometry_meshes))  # disabled
geometry_primitives_2 = RemoteReceiver(geometry_primitives)  # disabled
data_5 = Data(geometry_meshes_3)  # disabled
geometry_meshes_4 = RemoteReceiver(graft(geometry_meshes))
geometry_primitives_3 = RemoteReceiver(geometry_primitives)
brep = Brep(data_5)  # disabled
brep_2 = Brep(data_5)  # disabled
brep_3 = Brep(data_5)  # disabled
brep_4 = Brep(data_5)  # disabled

# ---- group: input geometry
geo_4 = Geometry(geometry_meshes_4)

# ----
vmoments = VolumeMoments(Geometry=brep_3)  # -> simplify(Volume), simplify(Centroid), simplify(Inertia), simplify(InertiaError), simplify(Secondary), simplify(SecondaryError), simplify(Gyration); disabled
debrep_2 = DeconstructBrep(Brep=brep_2)  # -> simplify(Faces), simplify(Edges), simplify(Vertices); disabled
bbox_2 = BoundingBox(Content=brep_4, Plane=PlaneXY(0, 0, 0))  # -> Box, Box_2; disabled
debrep_3 = DeconstructBrep(Brep=brep)  # -> Faces, Edges, Vertices; disabled
brep_5 = Brep(bbox_2.Box_2)  # disabled
brep_6 = Brep(debrep_3.Faces)  # disabled
data_6 = Data(vmoments.Secondary)  # disabled
lng_4 = ListLength(List=debrep_2.Vertices)  # disabled
lng_5 = ListLength(List=debrep_2.Faces)  # disabled
lng_6 = ListLength(List=debrep_2.Edges)  # disabled
volume_3 = Volume(Geometry=geo_4)  # -> simplify(Volume), Centroid
area = Area(Geometry=brep_6)  # -> Area, Centroid; disabled
volume_4 = Volume(Geometry=brep_4)  # -> Volume, Centroid; disabled
volume_5 = Volume(Geometry=brep_5)  # -> Volume, Centroid; disabled
data_7 = Data(lng_4)  # disabled
data_8 = Data(lng_5)  # disabled
data_9 = Data(lng_6)  # disabled
pdecon_2 = Deconstruct(Point=area.Centroid)  # -> XComponent, YComponent, ZComponent; disabled
data_10 = Data(volume_4.Volume)  # disabled
data_11 = Data(volume_5.Volume)  # disabled
data_12 = Data(pdecon_2.ZComponent)  # disabled
bbox_3 = BoundingBox(Content=volume_3.Centroid, Plane=PlaneXY(0, 0, 0))  # -> Box, Box_2
# MARK'S FEATURES
volume_6 = Volume(Geometry=brep)  # -> Volume, Centroid; disabled
division = Division(A=data_11, B=data_10)  # disabled
sort_2 = SortList(Keys=data_12, ValuesA=data_12, ValuesB=brep_6, ValuesC=area.Centroid)  # -> Keys, ValuesA, ValuesB, ValuesC; disabled
bbox_4 = BoundingBox(Content=geo_4, Plane=PlaneXY(0, 0, 0))  # -> Box, Box_2
box_2 = EvaluateBox(Box=bbox_3.Box, UParameter=0.5, VParameter=0.5, WParameter=0.5)  # -> Plane, Point, Include
# NATE'S FEATURES
area_2 = Area(Geometry=geo_4)  # -> simplify(Area), Centroid
data_13 = Data(division)  # disabled
item_7 = ListItem(List=sort_2.ValuesC, Index=0, Wrap=True)  # disabled
debox = DeconstructBox(Box=bbox_4.Box)  # -> Plane, simplify(X), simplify(Y), simplify(Z)
relative = RelativeCoordinates(Plane=box_2.Plane, Point=box_2.Point)  # -> RelativePoint, RelativeX, RelativeY, RelativeZ
pt_3 = Point(volume_6.Centroid)  # disabled
pt_4 = Point(item_7)  # disabled
dlength = DLength(I=debox.Y)
dlength_2 = DLength(I=debox.Z)
pdecon_3 = Deconstruct(Point=relative.RelativePoint)  # -> simplify(XComponent), simplify(YComponent), simplify(ZComponent)
dlength_3 = DLength(I=debox.X)
vec2pt = Vector2Pt(PointA=pt_4, PointB=pt_3, Unitize=False)  # -> Vector, Length; disabled
panel_9 = Panel(dlength_3)
panel_10 = Panel(dlength)
panel_11 = Panel(dlength_2)
panel_12 = Panel(volume_3.Volume)
panel_13 = Panel(area_2.Area)
panel_14 = Panel(pdecon_3.XComponent)
panel_15 = Panel(pdecon_3.YComponent)
panel_16 = Panel(pdecon_3.ZComponent)
data_14 = Data(vec2pt.Vector)  # disabled
data_15 = Data(data_6)  # disabled
data_16 = Data(data_14)  # disabled
cluster = Cluster_3(data=data_15)  # disabled
cluster_2 = Cluster_3(data=data_16)  # disabled
data_17 = Data(simplify(cluster))  # disabled
data_18 = Data(simplify(data_8))  # disabled
data_19 = Data(simplify(data_9))  # disabled
data_20 = Data(simplify(data_7))  # disabled
data_21 = Data(simplify(data_13))  # disabled
data_22 = Data(simplify(cluster_2))  # disabled
field_titles = Panel("""Area
Volume
centroid x
centroid y 
centroid z
BB_Height
BB_Width
BB_Depth
low_slice_length
mid_slice_length
upper_slice_length
slice_ratio""")
string_name = Panel("Shape")
merge_6 = Merge(Data1=data_22, Data2=data_17, Data3=data_18, Data4=data_19, Data5=data_20, Data6=data_21)  # disabled
data_23 = Data(merge_6)  # disabled
features_values_mark = RemoteSender(data_23)  # disabled
panel_17 = Panel(data_22)  # disabled
features_names_nate = RemoteSender(field_titles)
panel_18 = Panel("""x
y
z
lxx
lyy
lzy
num_faces
num_edges
num_vertices
vol-bb_ratio""")  # disabled
# [brep topology]
# number of faces
# number of edges
# number of vertexs
panel_19 = Panel(data_19)  # disabled
panel_20 = Panel(data_20)  # disabled
# volume/ bb volume ratio
panel_21 = Panel(data_21)  # disabled
# [second moment of inertia]
# Ixx
# Iyy
# Izy
panel_22 = Panel(data_17)  # disabled
panel_23 = Panel(data_18)  # disabled
# [eccentricity]
# x
# y
# z
features_names_mark = RemoteSender(panel_18)  # disabled
features_names_viewfactor_2 = RemoteReceiver(features_names_viewfactor)
features_values_viewfactor_2 = RemoteReceiver(features_values_viewfactor)
features_names_mark_2 = RemoteReceiver(features_names_mark)
# MERGE DATA
features_names_nate_2 = RemoteReceiver(features_names_nate)
features_values_mark_2 = RemoteReceiver(features_values_mark)
merge_7 = Merge(Data1=features_names_nate_2, Data2=features_names_mark_2, Data3=features_names_viewfactor_2)
geometry_primitives_4 = RemoteReceiver(geometry_primitives)  # disabled
geometry_meshes_5 = RemoteReceiver(graft(geometry_meshes))
features_names = RemoteSender(merge_7)
geometry_shapenames_2 = RemoteReceiver(geometry_shapenames)
merge_8 = Merge(
    Data1=ColourSwatch(SwatchColor=RGB(10, 255, 71)),
    Data2=ColourSwatch(SwatchColor=RGB(255, 215, 54)),
    Data3=ColourSwatch(SwatchColor=RGB(213, 61, 255)),
    Data4=ColourSwatch(SwatchColor=RGB(61, 213, 255)),
    Data5=ColourSwatch(SwatchColor=RGB(68, 61, 255)))  # -> graft(Result)
geometry_colors = RemoteSender(merge_8)
features_names_2 = RemoteReceiver(features_names)
features_names_3 = RemoteReceiver(features_names)
features_names_4 = RemoteReceiver(features_names)
number_slider_3 = Slider(15, range=0..100)
number_slider_4 = Slider(15, range=0..100)
number_slider_5 = Slider(0, range=0..100)
# Visualization Stuffs
features_names_5 = RemoteReceiver(features_names)
geometry_shapenames_3 = RemoteReceiver(geometry_shapenames)
bounds = GetViewportBoundaryDimensions(Refresh=True, Origin=Point(0, 0, 0), Scale=0.25, xDim=956, yDim=404)
irreg_tiles = IrregularGridTiles(
    Boundary=bounds,
    RelativeColumnSizes=[1, 2, 1],
    RelativeRowSizes=[1, 2, 1],
    InteriorPadding=0.02,
    ExteriorPadding=0.02,
    PaddingAxis=0)
item_8 = ListItem(List=irreg_tiles, Index=0, Wrap=True)  # -> Item, Item1, Item2, Item3, Item4
item_9 = ListItem(List=features_names_2, Index=number_slider_3, Wrap=True)
item_10 = ListItem(List=features_names_3, Index=number_slider_4, Wrap=True)
item_11 = ListItem(List=features_names_4, Index=number_slider_5, Wrap=True)
panel_24 = Panel(item_9)
panel_25 = Panel(item_10)
panel_26 = Panel(item_11)
wires = BrepWireframe(Density=-1)
geometry_colors_2 = RemoteReceiver(geometry_colors)
lng_7 = ListLength(List=flatten(geometry_colors_2))
geometry_colors_3 = RemoteReceiver(geometry_colors)
lng_8 = ListLength(List=flatten(geometry_colors_3))
geometry_colors_4 = RemoteReceiver(geometry_colors)
lng_9 = ListLength(List=flatten(geometry_colors_4))
series = Series(Start=1, Step=1, Count=lng_7)
series_2 = Series(Start=1, Step=1, Count=lng_8)
series_3 = Series(Start=1, Step=1, Count=lng_9)
number_slider_6 = Slider(18, range=0..1000)
int = Integer(graft(series))
int_2 = Integer(graft(series_2))
int_3 = Integer(graft(series_3))
palette = ConduitColorPalette(
    Seed=3,
    HueRange=Domain(-0.05, 0.05),
    SaturationRange=Domain(-0.15, 0.15),
    LuminanceRange=Domain(-0.1, 0.1),
    BaseColors=flatten(geometry_colors_3))
palette_2 = ConduitColorPalette(
    Seed=3,
    HueRange=Domain(-0.05, 0.05),
    SaturationRange=Domain(-0.15, 0.15),
    LuminanceRange=Domain(-0.1, 0.1),
    BaseColors=flatten(geometry_colors_2))
palette_3 = ConduitColorPalette(
    Seed=3,
    HueRange=Domain(-0.05, 0.05),
    SaturationRange=Domain(-0.15, 0.15),
    LuminanceRange=Domain(-0.1, 0.1),
    BaseColors=flatten(geometry_colors_4))
split = SplitList()  # -> ListA, ListB
pie_style = ConduitPieStyle(
    StyleName=panel_24,
    InnerRadius=0,
    OuterRadius=1,
    LabelRadius=1,
    LabelFontFace="Arial",
    RelativeLabelHeight=0.1,
    LabelColor=RGB(0, 0, 0))

# ----
# ToolDescription: Enter a description of this definition's functionality and use
update_file_info = Button()
group_prefixes = Panel("""out_
in_
action_
warning_
cluster""")
c_script = CSharpScript(update=color_groups_clusters, name=group_prefixes, col=col)  # -> out, A; inputs update: Boolean, name: list of String, col: list of Color
# ---------- c_script: C# ----------
    Color clusterColor = Color.Transparent;
    for(int i = 0;i < name.Count;i++){
      if(name[i].Contains("cluster")){
        clusterColor = col[i];
        break;
      }
    }



    if(update){
      List<Guid> guids = new List<Guid>();
      List<Grasshopper.Kernel.Special.GH_Group> grps = new List<Grasshopper.Kernel.Special.GH_Group>();
      List<Grasshopper.Kernel.Special.GH_Group> alreadygrps = new List<Grasshopper.Kernel.Special.GH_Group>();


      foreach(IGH_DocumentObject o in GrasshopperDocument.Objects){
        Grasshopper.Kernel.Special.GH_Group g = o as Grasshopper.Kernel.Special.GH_Group;
        if(g != null){
          for(int j = 0;j < name.Count;j++){
            if(g.NickName.ToUpper().Contains(name[j].ToUpper())){
              g.Colour = col[j % col.Count];
            }

          }
        }


        if(o is Grasshopper.Kernel.Special.GH_Cluster){
          Grasshopper.Kernel.Special.GH_Cluster cluster = o as  Grasshopper.Kernel.Special.GH_Cluster;
          string filepath = cluster.FilePath;
          if(!String.IsNullOrEmpty(filepath)){
            cluster.Name = System.IO.Path.GetFileNameWithoutExtension(filepath);
            cluster.NickName = System.IO.Path.GetFileNameWithoutExtension(filepath);
            cluster.Attributes.ExpireLayout();
          }
          guids.Add(cluster.InstanceGuid);
          Grasshopper.Kernel.Special.GH_Group grp = new Grasshopper.Kernel.Special.GH_Group();
          grps.Add(grp);

        } else if (o is Grasshopper.Kernel.Special.GH_Group){
          Grasshopper.Kernel.Special.GH_Group alreadygrp = o as Grasshopper.Kernel.Special.GH_Group;
          alreadygrps.Add(alreadygrp);
        }





      }

      List<bool> isAlreadyInGroup = IsAlreadyInGroup(guids, alreadygrps);

      for(int i = 0;i < grps.Count;i++){
        Grasshopper.Kernel.Special.GH_Group grp = grps[i];
        grp.Colour = clusterColor;
        grp.NickName = "";
        grp.AddObject(guids[i]);
        if(!isAlreadyInGroup[i]){
          grp.ExpireCaches();
          GrasshopperDocument.AddObject(grp, false, 1000);
        }
      }



    }
# ---------- c_script: C# additional code ----------
  List<bool> IsAlreadyInGroup(List<Guid> guids, List<Grasshopper.Kernel.Special.GH_Group> grps){
    List<bool> results = new List<bool>();
    foreach(Guid g in guids){
      results.Add(false);
    }
    foreach(Grasshopper.Kernel.Special.GH_Group grp in grps){ //for every group in the pre-existing groups
      if(grp.Objects().Count == 1){ //if that group only has one object in it
        for (int j = 0;j < guids.Count;j++){
          Guid g = guids[j];
          if(grp.ObjectIDs.Contains(g)){
            results[j] = true;
            break;
          }
        }
      }
    }
    return results;
  }
# ---------- end c_script ----------

data_24 = Data(update_file_info)

c_script_2 = CSharpScript(x=data_24)  # -> out, A, B, C, D, E
# ---------- c_script_2: C# ----------
    List < IGH_DocumentObject> objectsRecursive = new List<IGH_DocumentObject>();
    objectsRecursive.AddRange(clusterObjectsRecursive(GrasshopperDocument));


    B = GrasshopperDocument.Author.Name + " " + GrasshopperDocument.Author.Email;
    D = GrasshopperDocument.Properties.DateTag;
    if(GrasshopperDocument.IsFilePathDefined){
      C = GrasshopperDocument.FilePath;
      System.IO.FileInfo info = new System.IO.FileInfo(GrasshopperDocument.FilePath);
      if(info.LastWriteTime != null){
        E = info.LastWriteTime;
      } else {
        E = "";
      }
    } else {
      C = "Unsaved Document";
      E = "";
    }
    A = objectsRecursive;
# ---------- c_script_2: C# additional code ----------
  List<IGH_DocumentObject> clusterObjectsRecursive(GH_Document doc){
    List<IGH_DocumentObject> objList = new List<IGH_DocumentObject>();
    objList.AddRange(doc.Objects);
    foreach(IGH_DocumentObject obj in doc.Objects){
      Grasshopper.Kernel.Special.GH_Cluster cluster = obj as Grasshopper.Kernel.Special.GH_Cluster;
      try{
        objList.AddRange(clusterObjectsRecursive(cluster.Document("")));
      } catch {

      }
    }
    return objList;
  }
# ---------- end c_script_2 ----------
cluster_3 = Cluster_2(T=c_script_2.A, N=c_script_2.B, fn=c_script_2.C, dc=c_script_2.D, dm=c_script_2.E)
file_info = Panel(cluster_3)

# ---- group: length of slice at low mid and high
panel_27 = Panel("""0.1
0.5
0.9""")
box_3 = EvaluateBox(Box=bbox_4.Box, UParameter="0", VParameter="0", WParameter=panel_27)  # -> Plane, Point, Include

# ----
sec = MeshPlane(Mesh=geo_4, Plane=box_3.Plane)

# ---- group: length of slice at low mid and high (continued)
trim = TrimTree(Tree=sec, Depth=1)
len = Length(Curve=trim)
item_12 = ListItem(List=simplify(len), Index=0, Wrap=True)  # -> Item, Item1, Item2

# ----
eval = Evaluate(F="z/y + z/x + y/z + y/x + x/z + x/y", x=item_12.Item, y=item_12.Item1, z=item_12.Item2)
merge_9 = Merge(
    Data2=panel_13,
    Data3=panel_12,
    Data4=panel_14,
    Data5=panel_15,
    Data6=panel_16,
    Data7=panel_9,
    Data8=panel_10,
    Data9=panel_11,
    Data10=item_12.Item,
    Data11=item_12.Item1,
    Data12=item_12.Item2,
    Data13=eval)
features_values_nate = RemoteSender(merge_9)
features_values_nate_2 = RemoteReceiver(features_values_nate)
merge_10 = Merge(Data1=features_values_nate_2, Data2=features_values_mark_2, Data3=features_values_viewfactor_2)
features_values = RemoteSender(merge_10)
# ADD METADATA
bakeud = BakeWithUserData(geometry=geometry_meshes_5, field_names=features_names, field_values=features_values, clear=True)
bakeud_2 = BakeWithUserData(geometry=bakeud, field_names="Shape", field_values=geometry_shapenames_2, clear=False)
geometry_withdata = RemoteSender(bakeud_2)
# ML Stuffs
features_values_2 = RemoteReceiver(features_values)
flip_3 = FlipMatrix(Data=features_values_2)
bnd = Bounds(Numbers=flip_3)  # -> flatten(Domain)
remap = RemapNumbers(Value=features_values_2, Source=bnd, Target=Domain(0, 1))  # -> Mapped, Clipped
datatree_to_tensorset = DataTreeToTensorSet(DataTree=remap.Mapped)  # "DT->TS"
kmeans = KMeansClustering(Data=datatree_to_tensorset, Clusters=Slider(5, range=0..10), Iterations=Slider(100, range=0..7300), Seed=66)  # -> Clusters, Indices
mll_stuff = RemoteSender(kmeans.Indices)
mll_stuff_2 = RemoteReceiver(mll_stuff)
geometry_withdata_2 = RemoteReceiver(geometry_withdata)
item_13 = ListItem(List=flatten(geometry_withdata_2), Index=mll_stuff_2, Wrap=True)
readud = ReadUserData(geometry=item_13)  # -> field_names_2, field_values_2
features_values_3 = RemoteReceiver(features_values)
features_values_4 = RemoteReceiver(features_values)
features_values_5 = RemoteReceiver(features_values)
keysearch = KeyValueSearch(Keys=readud.field_names_2, Values=readud.field_values_2, Search="Shape")
long_2 = LongestList(ListA=item_13, ListB=merge_8, PaddingMode=2)  # -> flatten(ListA), flatten(ListB)
mll_stuff_3 = RemoteReceiver(mll_stuff)
pshift = ShiftPaths(Data=keysearch, Offset=-1)
mcol = MeshColours(Mesh=long_2.ListA, Colours=long_2.ListB)
preview = CustomPreview(Geometry=flatten(long_2.ListA), Shader=long_2.ListB)
cset = CreateSet(List=pshift)  # -> Set, Map
item_14 = ListItem(List=flatten(geometry_shapenames_3), Index=mll_stuff_2, Wrap=True)
mindex_2 = MemberIndex(Set=pshift, Member=cset.Set)  # -> Index, Count
sort_3 = SortList(Keys=mindex_2.Count, ValuesA=cset.Set)  # -> Keys, reverse(ValuesA)
item_15 = ListItem(List=features_values_3, Index=number_slider_3, Wrap=True)  # -> flatten(Item)
item_16 = ListItem(List=features_values_4, Index=number_slider_4, Wrap=True)  # -> flatten(Item)
item_17 = ListItem(List=features_values_5, Index=number_slider_5, Wrap=True)  # -> flatten(Item)
panel_28 = Panel(features_values_3)
panel_29 = Panel(features_values_4)
item_18 = ListItem(List=sort_3.ValuesA, Index=0, Wrap=True)
panel_30 = Panel(features_values_5)
panel_31 = Panel(item_15)
panel_32 = Panel(item_16)
panel_33 = Panel(item_14)
panel_34 = Panel(item_17)
tmatch = MatchText(Text=pshift, Pattern=item_18, Case=True)  # -> graft(Match)
cull = CullPattern(List=wires, CullPattern=invert(tmatch))
mll_stuff_4 = RemoteReceiver(mll_stuff)
mll_stuff_5 = RemoteReceiver(mll_stuff)
mll_stuff_6 = RemoteReceiver(mll_stuff)
item_19 = ListItem(List=panel_31, Index=mll_stuff_4, Wrap=True)  # -> flatten(Item)
item_20 = ListItem(List=panel_32, Index=mll_stuff_5, Wrap=True)  # -> flatten(Item)
previewlw = CustomPreviewLineweights(Geometry=cull, Shader=ColourSwatch(SwatchColor=RGB(255, 0, 0)), Thickness=Slider(8, range=0..10), Absolute=False)
item_21 = ListItem(List=panel_34, Index=mll_stuff_6, Wrap=True)  # -> flatten(Item)
long_3 = LongestList(ListA=int, ListB=mll_stuff_4, PaddingMode=2)  # -> flatten(ListA), ListB
long_4 = LongestList(ListA=int_2, ListB=mll_stuff_5, PaddingMode=2)  # -> flatten(ListA), ListB
long_5 = LongestList(ListA=int_3, ListB=mll_stuff_6, PaddingMode=2)  # -> flatten(ListA), ListB
sort_4 = SortList(Keys=item_19, ValuesA=long_3.ListA)  # -> Keys, ValuesA
sort_5 = SortList(Keys=item_20, ValuesA=long_4.ListA)  # -> Keys, ValuesA
sort_6 = SortList(Keys=item_21, ValuesA=long_5.ListA)  # -> Keys, ValuesA
chart = ConduitChart(Bounds=item_8.Item1, Values=sort_5.Keys, Title=panel_25, ColorPalette=palette)  # -> HUDDrawingObjects, ChartSettings
chart_2 = ConduitChart(Bounds=item_8.Item, Values=sort_6.Keys, Title=panel_26, ColorPalette=palette_3)  # -> HUDDrawingObjects, ChartSettings
hud_pie = DrawPieChart(BoundaryRectangle=item_8.Item2, Labels=sort_4.ValuesA, DataValues=item_19, PieStyle=pie_style, ColorPalette=palette_2)
merge_11 = Merge(Data1=chart_2.HUDDrawingObjects, Data2=chart.HUDDrawingObjects, Data3=hud_pie)
hud = HeadsUpDisplayHUD(
    ShowHUD=Toggle(True),
    DrawingObjects=merge_11,
    DrawingBoundary=bounds,
    ConduitStyleSheet="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")

# ==== cluster Cluster_2
T = ClusterInput()
N = ClusterInput()
fn = ClusterInput()
dc = ClusterInput()
dm = ClusterInput()
cluster = Cluster(T=T, N=N, fn=fn, dc=dc, dm=dm)  # -> T_2, author_2, objcount_2, fn_3, dc_4, dm_4
merge = Merge(
    Data1=cluster.author_2,
    Data2=cluster.T_2,
    Data3=cluster.objcount_2,
    Data4=cluster.fn_3,
    Data5=cluster.dc_4,
    Data6=cluster.dm_4)
R = ClusterOutput(merge)

# ==== cluster DLength: computes length of a domain
I = ClusterInput()
dedomain = DeconstructDomain(Domain=I)  # -> Start, End
subtraction = Subtraction(A=dedomain.Start, B=dedomain.End)
abs = Absolute(Value=subtraction)
y = ClusterOutput(abs)

# ==== cluster Cluster_3
data = ClusterInput()
data_2 = Data(data)
pdecon = Deconstruct(Point=data_2)  # -> XComponent, YComponent, ZComponent
smaller = SmallerThan(FirstNumber=pdecon.YComponent, SecondNumber=0.1)  # -> SmallerThan, OrEqualTo
num = Number("0")
p_n_c = PickNChoose(Pattern=smaller.SmallerThan, Stream0=pdecon.YComponent, Stream1=num)
merge = Merge(Data1=pdecon.XComponent, Data2=p_n_c, Data3=pdecon.ZComponent)
data_3 = Data(merge)
data_4 = ClusterOutput(data_3)

# ==== cluster BakeWithUserData: Bake geometry with associated user data. You can embed Rhino geometry with an arbitrary amount of additional data which can be retrieved at a later time. Options to clear the dictionary with each refresh.
clear = ClusterInput()  # Clear user dictionaries on each refresh (prevents build-up of unwanted KV pairs over multiple iterations). Defaults to true.
field_names = ClusterInput()  # The field names - or keys - associated with the data you're embedding. You can use this to later retrieve data from your geometry. For example, a field name might be "Color" while a field value is "Red".
bake = ClusterInput()  # Set to true to bake geometry with user data.
geometry = ClusterInput()  # Geometry to bake
field_values = ClusterInput()  # The values of the data you're embedding. This data can be retrieved later from your geometry. For example, a field name might be "Color" while a field value is "Red".
object_attributes = ClusterInput()  # The optional object attributes to use when baking. Use an "Object Attributes" component from Human to construct these, including layer name, color, and other properties.
bake_2 = Boolean(bake)
geo = Geometry(geometry)
fn = Text(field_names)
att = Data(object_attributes)
bool = Boolean(clear)
fv = Text(field_values)
bakeuserdict = BakeWithUserDictionary(bake=bake_2, G=geo, FN=fn, FV=fv, att=att, clear=bool)  # -> out, A; inputs bake: Boolean, G: GeometryBase, FN: list of String, FV: list of String, clear: Boolean
# ---------- bakeuserdict: C# ----------
    ObjectAttributes oAtt = att as ObjectAttributes;
    if(oAtt == null) oAtt = RhinoDocument.CreateDefaultAttributes();
    if(clear){
      G.UserDictionary.Clear();
    }
    for(int i = 0;i < FN.Count;i++){
      G.UserDictionary.Set(FN[i], FV[i]);
    }
    if(bake){
      RhinoDocument.Objects.Add(G, oAtt);
    }
    A = G;
# ---------- end bakeuserdict ----------
G = Geometry(bakeuserdict.A)
geometry_2 = ClusterOutput(G)  # Geometry with embedded data.

# ==== cluster ReadUserData: Reads embedded user data from a piece of geometry. Data can be embedded in geometry with the Bake User Data component.
geometry = ClusterInput()  # Geometry that has been embedded with User Data. The Bake User Data component can create this kind of geometry.
field_filter = ClusterInput()  # Optional Filter, if you want to retrieve a particular field from the geometry's data.
geo = Geometry(geometry)
filter = Text(field_filter)
readuser_data = CSharpScript(G=geo)  # -> out, A, B; inputs G: GeometryBase
# ---------- readuser_data: C# ----------
    A = G.UserDictionary.Keys;
    B = G.UserDictionary.Values;
# ---------- end readuser_data ----------
fsim = FindSimilarMember(Data=filter, Set=readuser_data.A)  # -> Hit, Index
item = ListItem(List=readuser_data.B, Index=fsim.Index, Wrap=True)
backup = BackupData(priority_data=fsim.Hit, secondary_data=readuser_data.A)
backup_2 = BackupData(priority_data=item, secondary_data=readuser_data.B)
field_names = Text(backup)
field_values = Text(backup_2)
field_names_2 = ClusterOutput(field_names)  # The names of the fields embedded in the geometry.
field_values_2 = ClusterOutput(field_values)  # The data values embedded in the geometry.

# ==== cluster Cluster
N = ClusterInput()
T = ClusterInput()
N_2 = Text(N)
split = TextSplit(Text=T, Separators=".")
fn = ClusterInput()
dm = ClusterInput()
item = ListItem(List=split, Index=0, Wrap=True)
dc = ClusterInput()
pan = Panel("""HDT_Reference
HDTReference""")
pan_2 = Panel("""Human
Human""")
lng = ListLength(List=T)
len = TextLength(Text=N_2)
contains = ContainsAB(B=N_2)
dm_2 = Text(dm)
dc_2 = Text(dc)
fn_2 = Text(fn)
replace = ReplaceMembers(Set=item, Find=pan, Replace=pan_2)
cset = CreateSet(List=flatten(replace))  # -> Set, Map
txt = Text(["ScriptComponents", "Grasshopper", "MathComponents", "GalapagosComponents", "FieldComponents", "VectorComponents", "AnalysisComponents", "CurveComponents", "LegacyScriptComponents", "SurfaceComponents", "TriangulationComponents", "MassXForms", "LinearXForms"])
format = Format(Format="Definition by {0}", Culture=127, Data0=N_2)
difference = SetDifference(SetA=cset.Set, SetB=txt)
lng_2 = ListLength(List=flatten(difference))
dispatch = Dispatch(List=format, DispatchPattern=contains)  # -> ListA, ListB
format_2 = Format(Format="Object Count: {0:0}", Culture=127, Data0=lng)
format_3 = Format(Format="Date Modified: {0}", Culture=127, Data0=dm_2)
format_4 = Format(Format="Date Created: {0}", Culture=127, Data0=dc_2)
dependencies = Text(flatten(difference))
author = Text(flatten(dispatch.ListB))
larger = LargerThan(FirstNumber=lng_2, SecondNumber="1")  # -> LargerThan, OrEqualTo
objcount = Text(flatten(format_2))
author_2 = ClusterOutput(author)
dm_3 = Text(flatten(format_3))
fn_3 = ClusterOutput(fn_2)
dc_3 = Text(flatten(format_4))
objcount_2 = ClusterOutput(objcount)
dc_4 = ClusterOutput(dc_3)
filter = StreamFilter(
    Gate=larger.LargerThan,
    Stream0="This definition requires the following plug-in:",
    Stream1="This definition requires the following plug-ins:")
dm_4 = ClusterOutput(dm_3)
pan_3 = Panel("""{0}
{1}""")
join = TextJoin(Text=dependencies)
format_5 = Format(Format=pan_3, Culture=127, Data0=filter, Data1=join)
clean = CleanTree(Tree=format_5, CleanInvalid=True, CleanEmpty=False)
T_2 = ClusterOutput(clean)

# ==== cluster BackupData: Passes the list without nulls
secondary_data = ClusterInput()
priority_data = ClusterInput()
null = NullItem(
    A=null.ResultA,
    InternalDocument_plugin_version=(0, 9, 76),
    InternalDocument_DocumentHeader_PreviewMeshType=1,
    InternalDocument_DocumentHeader_PreviewNormal=RGBA(150, 0, 0, 100),
    InternalDocument_DocumentHeader_PreviewSelected=RGBA(0, 120, 0, 100),
    InternalDocument_DefinitionProperties_Projection_Zoom=1.25)  # -> A, A_2
secondary_data_2 = Data(secondary_data)
priority_data_2 = Data([priority_data, null.A_2])
clean = CleanTree(Tree=priority_data_2, CleanInvalid=True, CleanEmpty=False)
lng = ListLength(List=clean)
null_2 = NullItem(Items=clean)  # -> NullFlags, InvalidFlags
equals = Equality(FirstNumber="0", SecondNumber=lng)  # -> Equality, Inequality
clean_2 = CleanTree(Data=clean, CleanInvalid=True, CleanEmpty=False)
not = GateNot(A=null_2.NullFlags)
ma = MassAddition(Input=flatten(not))  # -> Result, PartialResult
bool = Boolean(ma.Result)
filter = StreamFilter(Gate=bool, Stream0=secondary_data_2, Stream1=clean_2)
data = Data(filter)
data_2 = ClusterOutput(data)

# ==== cluster ContainsAB: Tests if a string contains another string.
B = ClusterInput()
A = ClusterInput()
A_2 = String(A)
B_2 = String(B)
eval = Evaluate(F="Contains(x,y)", x=A_2, y=B_2)
c = Boolean(eval)
c_2 = ClusterOutput(c)
