# Grasshopper definition gh_script.gh (Grasshopper 0.9.76)
# plug-ins: Python Interpreter

geometry = GeometryPipeline(
    GroupByLayer=False,
    GroupByType=False,
    IncludeHidden=True,
    IncludeLocked=True,
    LayerFilter="Geometry",
    NameFilter="*",
    TypeFilter=1073741848)
panel = Panel("0")
dom = ConstructDomain(DomainStart=expr("-x", "pi/4"), DomainEnd="pi/4")
dom_2 = ConstructDomain(DomainStart=expr("-x", "0"), DomainEnd="2*pi")
range = Range(Domain=dom, Steps=Slider(2, range=0..10))
range_2 = Range(Domain=dom_2, Steps=Slider(8, range=0..10))
crossref = CrossReference(ListA=range_2, ListB=range, CrossMode=1)  # -> ListA, ListB
volume = Volume(Geometry=geometry)  # -> Volume, Centroid
pt = PointPolar(BasePlane=graft(volume.Centroid), XYAngle=crossref.ListA, ZAngle=crossref.ListB, Offset=Slider(5, range=0..10))
bbox = BoundingBox(Content=geometry, Plane=PlaneXY(0, 0, 0))  # -> Box, Box_2
debrep = DeconstructBrep(Brep=geometry)  # -> Faces, Edges, Vertices
cullpt = CullDuplicates(Points=pt, Tolerance=0.1, CullMode=3)  # -> Points, Indices, Valence
debrep_2 = DeconstructBrep(Brep=bbox.Box)  # -> Faces, Edges, Vertices

# ---- group: cpt
geo = Geometry(volume.Centroid)

# ----
geo_2 = Geometry(cullpt.Points)
wires = BrepWireframe(Brep=debrep.Faces, Density=-1)
python = PythonScript(sphere_tree_in=cullpt.Points, cpt_lst_in=geo, bound_srf_lst_in=debrep.Faces)  # -> sphere_out, cpt_out; inputs sphere_tree_in: tree, cpt_lst_in: list, bound_srf_lst_in: tree
# ---------- python: Python ----------
import rhinoscriptsyntax as rs
import Rhino as rc
import pprint
import scriptcontext as sc


""" Calculate View Factor 

"""
class ViewFactor(object):
    def __init__(self):
        self.sphere_nested = []
        self.cpt = []
        self.bound_nested = []
        self.bld_num = None
        self.ray_num = None
        # Outputs
        self.raycast_distance = None
        self.raycast_pt_x = None
        self.raycast_pt_y = None
        self.raycast_pt_z = None
        
    def process_raw_inputs(self,sphere_tree_in,bound_srf_lst_in,cpt_lst_in):
        self.cpt = map(lambda c: rs.coerce3dpoint(c), cpt_lst_in)
        # convert tree to nested list of sphere pts
        for i in range(sphere_tree_in.BranchCount):
            branchList = sphere_tree_in.Branch(i)
            self.sphere_nested.append(branchList)
        
        
        
        # convert tree to nested list of bound srfs
        for i in range(bound_srf_lst_in.BranchCount):
            branchList = bound_srf_lst_in.Branch(i)
            branchList = map(lambda s: rs.coercebrep(s), branchList)
            self.bound_nested.append(branchList)
            
        # convert guids to rc points 
        for i in xrange(len(self.sphere_nested)):
            sphere_per_bld = list(self.sphere_nested[i])
            for j in xrange(len(sphere_per_bld)):
                sphere_per_bld[j] = rs.coerce3dpoint(sphere_per_bld[j])
            self.sphere_nested[i] = sphere_per_bld
        
        self.bld_num = len(self.sphere_nested)
        self.ray_num = len(self.sphere_nested[0])
        
    def ray_cast(self):
        """
        base_vector
        direction_vector
        srf2int
        """
        self.ray_int_nested = []
        self.ray_dist_nested = []
        
        for i in xrange(self.bld_num):
            raypts = []
            raydist = []
            for j in xrange(self.ray_num):
                srf2int_lst = self.bound_nested[i]
                r0 = self.cpt[i] #base_vector
                r1 = self.sphere_nested[i][j] #direction_vector
                #convert pts to vectors
                r1 = rc.Geometry.Vector3d(r1) - rc.Geometry.Vector3d(r0) 
                
                ray = rc.Geometry.Ray3d(r0,r1)
                point_intersect_lst = rc.Geometry.Intersect.Intersection.RayShoot(ray,srf2int_lst,1)
                if point_intersect_lst:
                    point_intersect_lst = list(point_intersect_lst)
                    rpt = point_intersect_lst[0]
                    raypts.append(rpt)
                    raydist.append(rs.Distance(rpt,r0))
                    
            self.ray_dist_nested.append(raydist)
            self.ray_int_nested.append(raypts)
        #print len(self.ray_int_nested)
    def generate_viewfactor_matrix(self):
        self.raycast_distance = map(lambda r: [None] * self.ray_num, [None] * self.bld_num)
        
        self.raycast_x = map(lambda r: [None] * self.ray_num, [None] * self.bld_num)
        self.raycast_y = map(lambda r: [None] * self.ray_num, [None] * self.bld_num)
        self.raycast_z = map(lambda r: [None] * self.ray_num, [None] * self.bld_num)
        for i in xrange(self.bld_num):
            for j in xrange(self.ray_num):
                self.raycast_distance[i][j] = self.ray_dist_nested[i][j]
                self.raycast_pt_x = self.ray_int_nested[i][j][0]
                self.raycast_pt_y = self.ray_int_nested[i][j][1]
                self.raycast_pt_z = self.ray_int_nested[i][j][2]
        
                print self.ray_dist_nested[i][j]
            
vf = ViewFactor()
vf.process_raw_inputs(sphere_tree_in, bound_srf_lst_in, cpt_lst_in)
vf.ray_cast()

#sphere_out = vf.sphere_nested
#cpt_out = vf.cpt
cpt_out = reduce(lambda x,y: x+y, vf.ray_int_nested)
# ---------- end python ----------
panel_2 = Panel(python.sphere_out)
panel_3 = Panel(python.cpt_out)
panel_4 = Panel(cullpt.Points)
